# Grasshopper definition LatticeDensityVariation.gh (Grasshopper 1.0.8)
# plug-ins: Karamba3D

# ----
# METHOD: CONTOUR DENSITY VARIATION
# Remap curve
# control point
# adjustment strength
number_slider = Slider(20, range=0..50)
data = Data(number_slider)

# ----
# Adjust remapping curve
number_slider_2 = Slider(0.05, range=0..1)
number_slider_3 = Slider(0.09, range=0..1)
number_slider_4 = Slider(0.13, range=0..1)
merge = Merge(Data1=number_slider_3, Data2=number_slider_4, Data3=number_slider_2, Data4=number_slider_4, Data5=number_slider_3)
multiplication = Multiplication(A=merge, B=data)
Y = UnitY(Factor=multiplication)
vec = Vector(Y)

# ----
# Adjust remapping curve
number_slider_5 = Slider(0.67, range=0..1)
number_slider_6 = Slider(0, range=0..1)
number_slider_7 = Slider(0.65, range=0..1)
merge_2 = Merge(Data1=number_slider_6, Data2=number_slider_7, Data3=number_slider_5, Data4=number_slider_7, Data5=number_slider_6)
multiplication_2 = Multiplication(A=merge_2, B=data)
# W/Z-axis
Y_2 = UnitY(Factor=multiplication_2)
vec_2 = Vector(Y_2)

# ----
# Adjust remapping curve
number_slider_8 = Slider(0.214, range=0..1)
number_slider_9 = Slider(0, range=0..1)
merge_3 = Merge(
    Data1=number_slider_8,
    Data2=number_slider_9,
    Data3=Slider(0.832, range=0..1),
    Data4=number_slider_9,
    Data5=number_slider_8)
multiplication_3 = Multiplication(A=merge_3, B=data)
# V/Y-axis
Y_3 = UnitY(Factor=multiplication_3)
vec_3 = Vector(Y_3)

# ----
# Segment division
number_slider_10 = Slider(5, range=0..20)
data_2 = Data(number_slider_10)
ln = Line(StartPoint="{0,0,0}", EndPoint="{1,0,0}")
crv = Curve(reparameterize(ln))
division = Division(A="1", B=data_2)
divlength = DivideLength(Curve=crv, Length=division)  # -> Points, Tangents, Parameters
shatter = Shatter(Curve=crv, Parameters=divlength.Parameters)
curvepoint = PointOnCurve(shatter, parameter=0.5)

# ----
# Segment division
number_slider_11 = Slider(5, range=0..20)
data_3 = Data(number_slider_11)
ln_2 = Line(StartPoint="{0,0,0}", EndPoint="{1,0,0}")
crv_2 = Curve(reparameterize(ln_2))
division_2 = Division(A="1", B=data_3)
divlength_2 = DivideLength(Curve=crv_2, Length=division_2)  # -> Points, Tangents, Parameters
shatter_2 = Shatter(Curve=crv_2, Parameters=divlength_2.Parameters)
curvepoint_2 = PointOnCurve(shatter_2, parameter=0.5)

# ----
# ADJUST SPACING ALONG AXES
# U/X-axis
# Segment division
number_slider_12 = Slider(12, range=0..25)
data_4 = Data(number_slider_12)
ln_3 = Line(StartPoint="{0,0,0}", EndPoint="{1,0,0}")
crv_3 = Curve(reparameterize(ln_3))
division_3 = Division(A="1", B=data_4)
divlength_3 = DivideLength(Curve=crv_3, Length=division_3)  # -> Points, Tangents, Parameters
shatter_3 = Shatter(Curve=crv_3, Parameters=divlength_3.Parameters)
curvepoint_3 = PointOnCurve(shatter_3, parameter=0.5)

# ----
# Make remap curve
panel = Panel("{1,1,0}")
ln_4 = Line(StartPoint="{0,1,0}", EndPoint=panel)
crv_4 = Curve(reparameterize(ln_4))

# ----
# Create control points in remapping curve
number_slider_13 = Slider(5, range=0..10)
subtraction = Subtraction(A=number_slider_13, B="1")
data_5 = Data(number_slider_13)
data_6 = Data(subtraction)
division_4 = Division(A="1", B=data_6)
series = Series(Start=0, Step=division_4, Count=data_5)
eval = EvaluateCurve(Curve=crv_4, Parameter=series)  # -> Point, Tangent, Angle
pt = Point(eval.Point)

# ----
# Make remap curve
panel_2 = Panel("{1,1,0}")
ln_5 = Line(StartPoint="{0,1,0}", EndPoint=panel_2)
crv_5 = Curve(reparameterize(ln_5))

# ----
# Create control points in remapping curve
number_slider_14 = Slider(5, range=0..10)
subtraction_2 = Subtraction(A=number_slider_14, B="1")
data_7 = Data(number_slider_14)
data_8 = Data(subtraction_2)
division_5 = Division(A="1", B=data_8)
series_2 = Series(Start=0, Step=division_5, Count=data_7)
eval_2 = EvaluateCurve(Curve=crv_5, Parameter=series_2)  # -> Point, Tangent, Angle
pt_2 = Point(eval_2.Point)

# ----
# Make remap curve
panel_3 = Panel("{0,1,0}")
ln_6 = Line(StartPoint=panel_3, EndPoint="{1,1,0}")
crv_6 = Curve(reparameterize(ln_6))

# ----
# Create control points in remapping curve
number_slider_15 = Slider(5, range=0..10)
subtraction_3 = Subtraction(A=number_slider_15, B="1")
data_9 = Data(number_slider_15)
data_10 = Data(subtraction_3)
division_6 = Division(A="1", B=data_10)
series_3 = Series(Start=0, Step=division_6, Count=data_9)
eval_3 = EvaluateCurve(Curve=crv_6, Parameter=series_3)  # -> Point, Tangent, Angle
pt_3 = Point(eval_3.Point)

# ----
# Adjusted curve
move = Move(Geometry=pt, Motion=vec)  # -> Geometry, Transform
pt_4 = Point(move.Geometry)
nurbs = NurbsCurve(Vertices=pt_4, Degree=3, Periodic=False)  # -> Curve, Length, Domain
crv_7 = Curve(nurbs.Curve)

# ----
# Adjusted curve
move_2 = Move(Geometry=pt_2, Motion=vec_2)  # -> Geometry, Transform
pt_5 = Point(move_2.Geometry)
nurbs_2 = NurbsCurve(Vertices=pt_5, Degree=3, Periodic=False)  # -> Curve, Length, Domain
crv_8 = Curve(nurbs_2.Curve)

# ----
# Adjusted curve
move_3 = Move(Geometry=pt_3, Motion=vec_3)  # -> Geometry, Transform
pt_6 = Point(move_3.Geometry)
nurbs_3 = NurbsCurve(Vertices=pt_6, Degree=3, Periodic=False)  # -> Curve, Length, Domain
crv_9 = Curve(nurbs_3.Curve)

# ----
# Graphically solve remapping curve
pt_7 = Point(curvepoint)
Y_4 = UnitY(Factor=1)
neg = Negative(Value=Y_4)
crv_10 = Curve(crv_7)
project = ProjectPoint(Point=pt_7, Direction=neg, Geometry=crv_10)  # -> Point, Index
project_2 = ProjectPoint(Point=pt_7, Direction=Y_4, Geometry=crv_10)  # -> Point, Index
merge_4 = Merge(Data1=graft(project_2.Point), Data2=graft(project.Point))  # -> simplify(Result)
null = NullItem(Item=project_2.Point)  # -> simplify(graft(NullFlags)), InvalidFlags, Description
item = ListItem(List=merge_4, Index=null.NullFlags, Wrap=True)
pt_8 = Point(flatten(item))

# ----
# Graphically solve remapping curve
pt_9 = Point(curvepoint_2)
Y_5 = UnitY(Factor=1)
crv_11 = Curve(crv_8)
neg_2 = Negative(Value=Y_5)
project_3 = ProjectPoint(Point=pt_9, Direction=neg_2, Geometry=crv_11)  # -> Point, Index
project_4 = ProjectPoint(Point=pt_9, Direction=Y_5, Geometry=crv_11)  # -> Point, Index
null_2 = NullItem(Item=project_4.Point)  # -> simplify(graft(NullFlags)), InvalidFlags, Description
merge_5 = Merge(Data1=graft(project_4.Point), Data2=graft(project_3.Point))  # -> simplify(Result)
item_2 = ListItem(List=merge_5, Index=null_2.NullFlags, Wrap=True)
pt_10 = Point(flatten(item_2))

# ----
# Determine relative spacing
pdecon = Deconstruct(Point=pt_10)  # -> XComponent, YComponent, ZComponent
data_11 = Data(pdecon.YComponent)
ma = MassAddition(Input=data_11)  # -> Result, PartialResults
division_7 = Division(A=data_11, B=ma.Result)
data_12 = Data(division_7)

# ----
# Determine subdivision parameter along edge
panel_4 = Panel("0")
series_4 = Series(Start=panel_4, Step=1, Count=data_3)  # -> simplify(graft(Series))
dom = ConstructDomain(DomainStart=panel_4, DomainEnd=series_4)
subset = SubList(List=data_12, Domain=dom, Wrap=True)  # -> simplify(List), Index
ma_2 = MassAddition(Input=subset.List)  # -> flatten(Result), PartialResults
panel_5 = Panel(ma_2.Result)
ins = InsertItems(List=ma_2.Result, Item="0", Indices="0", Wrap=True)
data_13 = Data(ins)

# ----
# Determine relative spacing
pdecon_2 = Deconstruct(Point=pt_8)  # -> XComponent, YComponent, ZComponent
data_14 = Data(pdecon_2.YComponent)
ma_3 = MassAddition(Input=data_14)  # -> Result, PartialResults
division_8 = Division(A=data_14, B=ma_3.Result)
data_15 = Data(division_8)

# ----
# Determine subdivision parameter along edge
panel_6 = Panel("0")
series_5 = Series(Start=panel_6, Step=1, Count=data_2)  # -> simplify(graft(Series))
dom_2 = ConstructDomain(DomainStart=panel_6, DomainEnd=series_5)
subset_2 = SubList(List=data_15, Domain=dom_2, Wrap=True)  # -> simplify(List), Index
ma_4 = MassAddition(Input=subset_2.List)  # -> flatten(Result), PartialResults
panel_7 = Panel(ma_4.Result)
ins_2 = InsertItems(List=ma_4.Result, Item="0", Indices="0", Wrap=True)
data_16 = Data(ins_2)

# ----
# Graphically solve remapping curve
pt_11 = Point(curvepoint_3)
Y_6 = UnitY(Factor=1)
crv_12 = Curve(crv_9)
neg_3 = Negative(Value=Y_6)
project_5 = ProjectPoint(Point=pt_11, Direction=neg_3, Geometry=crv_12)  # -> Point, Index
project_6 = ProjectPoint(Point=pt_11, Direction=Y_6, Geometry=crv_12)  # -> Point, Index
null_3 = NullItem(Item=project_6.Point)  # -> simplify(graft(NullFlags)), InvalidFlags, Description
merge_6 = Merge(Data1=graft(project_6.Point), Data2=graft(project_5.Point))  # -> simplify(Result)
item_3 = ListItem(List=merge_6, Index=null_3.NullFlags, Wrap=True)
pt_12 = Point(flatten(item_3))

# ----
# Determine relative spacing
pdecon_3 = Deconstruct(Point=pt_12)  # -> XComponent, YComponent, ZComponent
data_17 = Data(pdecon_3.YComponent)
ma_5 = MassAddition(Input=data_17)  # -> Result, PartialResults
division_9 = Division(A=data_17, B=ma_5.Result)
data_18 = Data(division_9)

# ----
# Determine subdivision parameter along edge
panel_8 = Panel("0")
series_6 = Series(Start=panel_8, Step=1, Count=data_4)  # -> simplify(graft(Series))
dom_3 = ConstructDomain(DomainStart=panel_8, DomainEnd=series_6)
subset_3 = SubList(List=data_18, Domain=dom_3, Wrap=True)  # -> simplify(List), Index
ma_6 = MassAddition(Input=subset_3.List)  # -> flatten(Result), PartialResults
panel_9 = Panel(ma_6.Result)
ins_3 = InsertItems(List=ma_6.Result, Item="0", Indices="0", Wrap=True)
data_19 = Data(ins_3)

panel_10 = Panel(data_18)
panel_11 = Panel(data_15)
panel_12 = Panel(data_12)
crossref = CrossReference(ListA=data_19, ListB=data_13, ListC=data_16, CrossMode=1)  # -> ListA, ListB, ListC

# ----
# MAKE BEAM
panel_13 = Panel("0.5")
dom_4 = ConstructDomain(DomainStart="0", DomainEnd="5")
dom_5 = ConstructDomain(DomainStart="0", DomainEnd=panel_13)
dom_6 = ConstructDomain(DomainStart="0", DomainEnd=panel_13)
box = DomainBox(Base=PlaneXY(0, 0, 0), X=dom_4, Y=dom_6, Z=dom_5)

# ----
# 3D GRID
brep = Brep(box)
box_2 = EvaluateBox(Box=brep, UParameter=crossref.ListA, VParameter=crossref.ListB, WParameter=crossref.ListC)  # -> Plane, Point, Include
pt_13 = Point(box_2.Plane)

# ----
# MAKE CELLS
data_20 = Data(data_2)
data_21 = Data(data_3)
data_22 = Data(data_4)
python = PythonScript(x=data_22, y=data_21, z=data_20, pointlist=pt_13)  # -> out, cube; inputs pointlist: list
# ---------- python: Python ----------
x = int (x) + 1
y = int (y) + 1
z = int (z) + 1

cube = []
points = []

count = 0
for k in range (0, z):
    points.append([])
    for j in range (0, y): 
        points[k].append([])
        for i in range (0, x):
            points[k][j].append(pointlist[count])
            count = count + 1

count = 0
for k in range (0, z-1):
    for j in range (0, y-1): 
        for i in range (0, x-1):
            cube.append([])
            cube[count].append(points[k][j][i])
            cube[count].append(points[k][j][i+1])
            cube[count].append(points[k][j+1][i+1])
            cube[count].append(points[k][j+1][i])
            cube[count].append(points[k+1][j][i])
            cube[count].append(points[k+1][j][i+1])
            cube[count].append(points[k+1][j+1][i+1])
            cube[count].append(points[k+1][j+1][i])
            count = count + 1
# ---------- end python ----------
python_2 = PythonScript(x=python.cube)  # -> simplify(a)
# ---------- python_2: Python ----------
a=x
# ---------- end python_2 ----------
pt_14 = Point(python_2)
item_4 = ListItem(List=pt_14, Index=0, Wrap=True)  # -> Item, Item1, Item2, Item3, Item4, Item5, Item6, Item7
tbox = TwistedBox(
    CornerA=item_4.Item,
    CornerB=item_4.Item1,
    CornerC=item_4.Item2,
    CornerD=item_4.Item3,
    CornerE=item_4.Item4,
    CornerF=item_4.Item5,
    CornerG=item_4.Item6,
    CornerH=item_4.Item7)
geo = Geometry(tbox)

# ----
# primitive module
crv_13 = Curve([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])

# ----
# MAP PRIMITIVE TO CELLS
# intersect and clean module
crv_14 = Curve(crv_13)
llinter = LineLineIntersectionKaramba3D(Line=crv_14, LimitDistance_m=0.01)  # -> IntersectionPoints, LineSubSegements
crv_15 = Curve(flatten(llinter.LineSubSegements))
rdlines = RemoveDuplicateLinesKaramba3D(Line=crv_15, LimitDistance=0.005)  # -> OutLine, Info, Indexes
crv_16 = Curve(rdlines.OutLine)

# ----
# box morph
group = Group(Objects=crv_16)
bbox = BoundingBox(Content=group, Plane=PlaneXY(0, 0, 0))  # -> Box, Box_2
morph = BoxMorph(Geometry=group, Reference=bbox.Box, Target=simplify(geo))
ungroup = Ungroup(Group=morph)
crv_17 = Curve(simplify(ungroup))

# ----
# remove duplicates
crv_18 = Curve(flatten(crv_17))
rdlines_2 = RemoveDuplicateLinesKaramba3D(Line=crv_18, LimitDistance=0.005)  # -> OutLine, Info, Indexes
crv_19 = Curve(rdlines_2.OutLine)

crv_20 = Curve(crv_19)
