# Grasshopper definition basic_truss_design.gh (Grasshopper 1.0.8)
# plug-ins: Karamba3D

# dy_4
# dx_0
number_slider = Slider(1.5, range=-2..2)
# dy_0
number_slider_2 = Slider(0, range=-1..1)
# SET INITIAL VALUES
# Truss Span
# y_0 (Initial)
number_slider_3 = Slider(8, range=0..10)
# dy_4
# dx_0
number_slider_4 = Slider(0.5, range=-1..1)
# dy_0
number_slider_5 = Slider(0, range=-1..1)
num = Number(number_slider_2)
num_2 = Number(Slider(0, range=-2..3))
num_3 = Number(number_slider)
num_4 = Number(Slider(1, range=-2..2))
num_5 = Number(number_slider_4)
num_6 = Number(number_slider_5)
num_7 = Number(Slider(0, range=-2..2))
num_8 = Number(number_slider_3)
neg = Negative(Value=num_4)
num_9 = Number(num)
num_10 = Number(num_6)
num_11 = Number(num_3)
num_12 = Number(num_5)
num_13 = Number(num_2)
num_14 = Number(num_7)
addition = Addition(A=num_9, B=num_10)
addition_2 = Addition(A=num_13, B=num_14)
addition_3 = Addition(A=num_11, B=num_12)
_0 = Stream0(addition)
_0_2 = Stream0(addition_3)
_0_3 = Stream0(addition_2)
_0_4 = Stream0(neg)
num_15 = Number(num_8)
num_16 = Number(_0_4)
num_17 = Number(_0_2)
num_18 = Number(_0)
num_19 = Number(_0_3)
num_20 = Number(num_15)
num_21 = Number(num_15)
division = Division(A=num_21, B="2")
division_2 = Division(A=num_20, B="4")
num_22 = Number(division)
num_23 = Number(division_2)

num_24 = Number(num_15)
num_25 = Number(num_23)
num_26 = Number(num_18)
subtraction = Subtraction(A=num_24, B=num_25)
num_27 = Number(num_19)
num_28 = Number(num_16)
num_29 = Number(num_18)
# BUILD TRUSS
num_30 = Number(num_23)
num_31 = Number(num_16)
num_32 = Number(num_19)
num_33 = Number(subtraction)
addition_4 = Addition(A=num_30, B=num_29)
addition_5 = Addition(A=num_31, B=num_32)
addition_6 = Addition(A=num_28, B=num_27)
num_34 = Number(num_17)
num_35 = Number(num_15)
num_36 = Number(num_22)
subtraction_2 = Subtraction(A=num_33, B=num_26)
num_37 = Number(addition_6)
num_38 = Number(addition_5)
num_39 = Number(addition_4)
panel = Panel(num_34)
pt = ConstructPoint(XCoordinate="0", YCoordinate="0", ZCoordinate="0")
pt_2 = ConstructPoint(XCoordinate=subtraction_2, YCoordinate="0", ZCoordinate=num_37)
pt_3 = ConstructPoint(XCoordinate=num_35, YCoordinate="0", ZCoordinate="0")
pt_4 = ConstructPoint(XCoordinate=num_39, YCoordinate="0", ZCoordinate=num_38)
pt_5 = ConstructPoint(XCoordinate=num_36, YCoordinate="0", ZCoordinate=panel)
pt_6 = Point(pt_4)
pt_7 = Point(pt_2)
pt_8 = Point(pt_3)
pt_9 = Point(pt)
pt_10 = Point(pt_5)

panel_2 = Panel("point 3")
panel_3 = Panel("point 4")
panel_4 = Panel("point 2")
panel_5 = Panel("point 0")
pt_11 = Point(pt_8)
panel_6 = Panel("point 1")
pt_12 = Point(pt_10)
pt_13 = Point(pt_9)
pt_14 = Point(pt_6)
pt_15 = Point(pt_7)

merge = Merge(Data1=pt_14, Data2=pt_15, Data3=pt_13, Data4=pt_11, Data5=pt_12)
pt_16 = Point(merge)
points = PointList(Points=pt_16, Size=Slider(0.5, range=0..10))

ln = Line(StartPoint=pt_14, EndPoint=pt_15)
ln_2 = Line(StartPoint=pt_15, EndPoint=pt_12)
ln_3 = Line(StartPoint=pt_11, EndPoint=pt_15)
ln_4 = Line(StartPoint=pt_13, EndPoint=pt_12)
ln_5 = Line(StartPoint=pt_13, EndPoint=pt_14)
ln_6 = Line(StartPoint=pt_14, EndPoint=pt_12)
ln_7 = Line(StartPoint=pt_12, EndPoint=pt_11)
crv = Curve(ln)
crv_2 = Curve(ln_2)
crv_3 = Curve(ln_5)
crv_4 = Curve(ln_3)
crv_5 = Curve(ln_6)
crv_6 = Curve(ln_4)
crv_7 = Curve(ln_7)

num_40 = Number(Slider(200, range=0..250))
neg_2 = Negative(Value=num_40)
merge_2 = Merge(Data1=crv_3, Data2=crv_4, Data3=crv, Data4=crv_6, Data5=crv_7, Data6=crv_5, Data7=crv_2)
merge_3 = Merge(Data1=pt_13, Data2=pt_11)
merge_4 = Merge(Data1=pt_13, Data2=pt_11, Data3=pt_14, Data4=pt_15, Data5=pt_12)
unit_z = UnitZ(Factor=neg_2)
crv_8 = Curve(merge_2)
pt_17 = Point(merge_3)
pt_18 = Point(merge_4)
crv_9 = Curve(crv_8)
pt_19 = Point(pt_17)
pt_20 = Point(pt_12)
pt_21 = Point(pt_18)
line_to_beam_karamba3d = LineToBeam(
    Line=crv_9,
    New=True,
    Remove=True,
    LimitDistance_m=0.005,
    Bending=True,
    SetBucklingLength=True,
    ToPolylineMaxAngle=0.03,
    ToPolylineTolerance=0.01,
    ToPolylineMaxEdgeLength=0.25)  # -> Element, Points, Info
force = ForceVector(unit_z)
support_karamba3d = Supp(PosInd=pt_21, menu=[buttons(off, on, off, off, off, off)])
support_karamba3d_2 = Supp(PosInd=pt_19, menu=[buttons(on, off, on, off, off, off)])
loads_karamba3d = Loads(ForceVector=force, Local=False, PosInd=pt_20, LCase="LC0", mode="Point")
support = Support(support_karamba3d_2)
support_2 = Support(support_karamba3d)
# STRUCTURAL ANALYSIS
elem = Elem(line_to_beam_karamba3d.Element)
load = LoadKaramba3D(loads_karamba3d)
merge_5 = Merge(Data1=support, Data2=support_2)
support_3 = Support(merge_5)
elem_2 = Elem(elem)
support_4 = Support(support_3)
load_2 = LoadKaramba3D(load)
cross_section_karamba3d = CrossSectionKaramba3D(
    FamilyNameOfCrossSection="DefaultCroSec",
    Diameter_cm=Slider(50, range=0..100),
    WallThickness_cm=Slider(5, range=0..10),
    mode="Circular Hollow")
assemble_model_karamba3d = Assemble(Elem=elem_2, Support=support_4, Load=load_2, CrossSection=cross_section_karamba3d, LimitDistance_m=0.005)  # -> Model, Info, Mass_kg, CentreOfGravity, LoadCaseNames
model = Model(assemble_model_karamba3d.Model)
num_41 = Number(assemble_model_karamba3d.Mass_kg)
analyze_karamba3d = Analyze(Model=model)  # -> CalculatedModel, MaximumDisplacement_cm, ResultingForceOfGravity_kN, ElasticEnergyChange_kNm
num_42 = Number(analyze_karamba3d.MaximumDisplacement_cm)
model_2 = Model(analyze_karamba3d.CalculatedModel)
beam_forces_karamba3d = BForces(AnalysedModel=model_2, Ts=[0, 1])  # -> Model, NormalForce_kN, ShearForceVz_kN, ShearForceVy_kN, TorsionalMomentMt_kNm, flatten(BendingMomentMy_kNm), flatten(BendingMomentMz_kNm), LoadCaseIndex
model_3 = Model(model_2)
panel_7 = Panel(beam_forces_karamba3d.BendingMomentMy_kNm)
model_view_karamba3d = ModelView(Model=model_3, ResultFactors=1, ResultCase=-1)  # -> Model, DeformedMesh, DeformedAxes, DeformedModel
beam_view_karamba3d = BeamView(Model=model_view_karamba3d.Model)  # -> Model, MeshesOfRenderedBeams, DeformedBeamAxes, LegendColours, LegendTags
