# Grasshopper definition basic_truss_design_python.gh (Grasshopper 1.0.7)
# plug-ins: RhinoCodePluginGH

number_slider = Slider(8, range=0..10)
ghpython_script = GhPythonScript(x=Slider(8, range=0..10), u=number_slider, v=number_slider)  # -> a, point1, line, point2
# ---------- ghpython_script: Python ----------
__author__ = "Hadidi"
__version__ = "2025.10.02"

import rhinoscriptsyntax as rs



y= 2
z= 1
point1=rs.AddPoint(x, y, z)

point2=rs.AddPoint((x+2), v, (z+1))

line=rs.AddLine(point1, point2)
# ---------- end ghpython_script ----------
int = Integer(Slider(5, range=0..10))
num = Number(Slider(2, range=0..10))
num_2 = Number(Slider(2, range=0..10))
int_2 = Integer(Slider(5, range=0..10))
num_3 = Number(Slider(5, range=0..10))
py3 = Python3Script(n=int, r=num)  # -> out, Lines, Pts
# ---------- py3: Python ----------
import rhinoscriptsyntax as rs
"""Starburst pattern
Inputs:
  n   : number of rays
  r   : radius
Outputs:
  center : the central point
  pts    : list of end points
  lines  : list of lines
"""
import rhinoscriptsyntax as rs
import math

center = rs.AddPoint(0,0,0)
Pts = []
Lines = []

for i in range(n):
    angle = (2*math.pi/n) * i
    x = math.cos(angle) * r
    y = math.sin(angle) * r
    pt = rs.AddPoint(x,y,0)
    Pts.append(pt)
    Lines.append(rs.AddLine(center, pt))
# ---------- end py3 ----------
py3_2 = Python3Script(n=int_2, h=num_2, span=num_3)  # -> out, Bottom, Top, Webs
# ---------- py3_2: Python ----------
"""Grasshopper Script"""
"""Simple triangular truss
Inputs:
  n    : number of panels (int)
  span : total length (float)
  h    : truss height (float)
Outputs:
  pts   : list of points
  lines : list of lines
"""
import rhinoscriptsyntax as rs

"""Mini Warren truss (with top chord)
Inputs:
  n    : number of panels (int >= 1)
  span : total length
  h    : height
Outputs:
  Bottom : list of line ids (bottom chord)
  Top    : list of line ids (top chord)
  Webs   : list of line ids (zig-zag)
"""
import rhinoscriptsyntax as rs

dx = float(span) / n

# bottom and top nodes
B = [rs.AddPoint(i*dx, 0, 0) for i in range(n+1)]
T = [rs.AddPoint((i+0.5)*dx, h, 0) for i in range(n)]

# chords
Bottom = [rs.AddLine(B[i], B[i+1]) for i in range(n)]
Top    = [rs.AddLine(T[i], T[i+1]) for i in range(n-1)] if n > 1 else []

# zig-zag webs
Webs = []
for i in range(n):
    Webs.append(rs.AddLine(B[i],   T[i]))
    Webs.append(rs.AddLine(T[i],   B[i+1]))
# ---------- end py3_2 ----------
pt = Point()
# import rhinoscriptsyntax as rs
# """Starburst pattern
# Inputs:
#   n   : number of rays
#   r   : radius
# Outputs:
#   center : the central point
#   pts    : list of end points
#   lines  : list of lines
# """
# import rhinoscriptsyntax as rs
# import math
# 
# center = rs.AddPoint(0,0,0)
# Pts = []
# Lines = []
# 
# for i in range(n):
#     angle = (2*math.pi/n) * i
#     x = math.cos(angle) * r
#     y = math.sin(angle) * r
#     pt = rs.AddPoint(x,y,0)
#     Pts.append(pt)
#     Lines.append(rs.AddLine(center, pt))
crv = Curve()
crv_2 = Curve()
# """Grasshopper Script"""
# """Simple triangular truss
# Inputs:
#   n    : number of panels (int)
#   span : total length (float)
#   h    : truss height (float)
# Outputs:
#   pts   : list of points
#   lines : list of lines
# """
# import rhinoscriptsyntax as rs
# 
# """Mini Warren truss (with top chord)
# Inputs:
#   n    : number of panels (int >= 1)
#   span : total length
#   h    : height
# Outputs:
#   Bottom : list of line ids (bottom chord)
#   Top    : list of line ids (top chord)
#   Webs   : list of line ids (zig-zag)
# """
# import rhinoscriptsyntax as rs
# 
# dx = float(span) / n
# 
# # bottom and top nodes
# B = [rs.AddPoint(i*dx, 0, 0) for i in range(n+1)]
# T = [rs.AddPoint((i+0.5)*dx, h, 0) for i in range(n)]
# 
# # chords
# Bottom = [rs.AddLine(B[i], B[i+1]) for i in range(n)]
# Top    = [rs.AddLine(T[i], T[i+1]) for i in range(n-1)] if n > 1 else []
# 
# # zig-zag webs
# Webs = []
# for i in range(n):
#     Webs.append(rs.AddLine(B[i],   T[i]))
#     Webs.append(rs.AddLine(T[i],   B[i+1]))
crv_3 = Curve()
crv_4 = Curve()
