# Grasshopper definition gen_truss_log_data_screenshots.gh (Grasshopper 1.0.8)
# plug-ins: Karamba3D

# ----
# make sure slider max value set to number of data points N_data - 1
# ANIMATE THIS!
number_slider = Slider(0, range=0..124)
int = Integer(number_slider)

# ----
# OPTION 1 (False) OR 2 (True)
# INPUT VARIABLES
toggle = BooleanToggle(True)
# SET INITIAL VALUES
# Truss Span
# y_0 (Initial)
number_slider_2 = Slider(4, range=0..10)
# Start Screenshot Recorder
toggle_2 = BooleanToggle(True)
# Start Data Recorder
toggle_3 = BooleanToggle(True)
number_slider_3 = Slider(-1.71, range=-2..3)
# dy_4
number_slider_4 = Slider(0, range=-1..1)
# OPTION 1.
# dy_4
# dx_0
number_slider_5 = Slider(1.67, range=-2..2)
# dy_0
number_slider_6 = Slider(-0.31, range=-1..1)
# dx_0
number_slider_7 = Slider(0, range=-1..1)
# dy_0
number_slider_8 = Slider(0, range=-2..2)
# OPTION 2. PARAMETER AUTO-GENERATION & ANIMATION
int_2 = Integer(Slider(4, range=0..10))
data = Data(toggle)
data_2 = Data(toggle_2)
data_3 = Data(toggle_3)
num = Number("-2")
num_2 = Number("2")
int_3 = Integer(int_2)
num_3 = Number("-2")
num_4 = Number("-1")
num_5 = Number("3")
int_4 = Integer(int_2)
num_6 = Number("1")
int_5 = Integer(int_2)
num_7 = Number(number_slider_8)
num_8 = Number(number_slider_4)
num_9 = Number(number_slider_7)
dom = ConstructDomain(DomainStart=num, DomainEnd=num_2)
dom_2 = ConstructDomain(DomainStart=num_3, DomainEnd=num_5)
dom_3 = ConstructDomain(DomainStart=num_4, DomainEnd=num_6)
num_10 = Number(Slider(1, range=-2..2))
num_11 = Number(number_slider_2)
neg = Negative(Value=num_10)
range = Range(Domain=dom_2, Steps=int_4)
range_2 = Range(Domain=dom, Steps=int_3)
range_3 = Range(Domain=dom_3, Steps=int_5)
# Reset Recording
reset = Button()
num_12 = Number(number_slider_6)
num_13 = Number(number_slider_3)
# MANUAL EXPLORATION
# OPTIMISATION-DRIVEN EXPLORATION
num_14 = Number(number_slider_5)
dy_4 = Panel(range_2)
dy_0 = Panel(range)
dx_0 = Panel(range_3)
data_4 = Data(reset)
crossref = CrossReference(ListA=dy_4, ListB=dx_0, ListC=dy_0, CrossMode=1)  # -> ListA, ListB, ListC
galapagos = Galapagos(fitness=num_65, gene=[number_slider_5, number_slider_6, number_slider_3])
int_6 = Integer(int)
int_7 = Integer(int_6)
int_8 = Integer(int_6)
L = List(crossref.ListB)
L_2 = List(crossref.ListC)
int_9 = Integer(int_6)
L_3 = List(crossref.ListA)
lng = ListLength(List=L_3)
num_15 = Number(lng)
n_data = Panel(num_15)
panel = Panel(crossref.ListA)
item = ListItem(List=L, Index=int_7, Wrap=True)
item_2 = ListItem(List=L_2, Index=int_8, Wrap=True)
item_3 = ListItem(List=L_3, Index=int_9, Wrap=True)
num_16 = Number(item_2)
num_17 = Number(item)
num_18 = Number(item_3)
dx_0_2 = Panel(num_17)
dy_1 = Panel(num_16)
dy_4_2 = Panel(num_18)
num_19 = Number(num_12)
num_20 = Number(num_9)
G = Gate(data)
G_2 = Gate(data)
num_21 = Number(num_7)
num_22 = Number(num_13)
num_23 = Number(num_14)
num_24 = Number(num_8)
# ROUTE DATA BY OPTION
G_3 = Gate(data)
num_25 = Number(flatten(dx_0_2))
num_26 = Number(num_25)
filter = StreamFilter(Gate=G_2, Stream0=num_19, Stream1=num_26)
num_27 = Number(flatten(dy_1))
num_28 = Number(num_27)
filter_2 = StreamFilter(Gate=G, Stream0=num_22, Stream1=num_28)
num_29 = Number(flatten(dy_4_2))
num_30 = Number(num_29)
filter_3 = StreamFilter(Gate=G_3, Stream0=num_23, Stream1=num_30)
num_31 = Number(filter_2)
num_32 = Number(filter)
num_33 = Number(filter_3)
addition = Addition(A=num_32, B=num_20)
addition_2 = Addition(A=num_31, B=num_21)
addition_3 = Addition(A=num_33, B=num_24)
_0 = Stream0(addition)
_0_2 = Stream0(addition_3)
_0_3 = Stream0(addition_2)
_0_4 = Stream0(neg)
num_34 = Number(num_31)
num_35 = Number(num_32)
num_36 = Number(num_33)
num_37 = Number(_0)
num_38 = Number(_0_3)
num_39 = Number(_0_2)
num_40 = Number(num_11)
num_41 = Number(_0_4)
merge = Merge(Data1=num_36, Data2=num_35, Data3=num_34)
num_42 = Number(merge)
num_43 = Number(num_40)
num_44 = Number(num_40)
division = Division(A=num_43, B="2")
division_2 = Division(A=num_44, B="4")
num_45 = Number(division)
num_46 = Number(division_2)
num_47 = Number(num_37)
num_48 = Number(num_46)
num_49 = Number(num_40)
subtraction = Subtraction(A=num_49, B=num_48)
num_50 = Number(subtraction)
num_51 = Number(num_38)
num_52 = Number(num_38)
num_53 = Number(num_41)
num_54 = Number(num_41)
num_55 = Number(num_37)
# PIPELINE
# BUILD TRUSS
num_56 = Number(num_46)
addition_4 = Addition(A=num_53, B=num_51)
addition_5 = Addition(A=num_54, B=num_52)
subtraction_2 = Subtraction(A=num_50, B=num_47)
addition_6 = Addition(A=num_56, B=num_55)
num_57 = Number(num_39)
num_58 = Number(num_45)
num_59 = Number(addition_4)
num_60 = Number(addition_5)
num_61 = Number(addition_6)
panel_2 = Panel(num_57)
num_62 = Number(num_40)
pt = ConstructPoint(XCoordinate="0", YCoordinate="0", ZCoordinate="0")
pt_2 = ConstructPoint(XCoordinate=num_62, YCoordinate="0", ZCoordinate="0")
pt_3 = ConstructPoint(XCoordinate=num_58, YCoordinate=panel_2, ZCoordinate="0")
pt_4 = ConstructPoint(XCoordinate=subtraction_2, YCoordinate=num_60, ZCoordinate="0")
pt_5 = ConstructPoint(XCoordinate=num_61, YCoordinate=num_59, ZCoordinate="0")
pt_6 = Point(pt)
pt_7 = Point(pt_2)
pt_8 = Point(pt_3)
pt_9 = Point(pt_5)
pt_10 = Point(pt_4)
pt_11 = Point(pt_6)
pt_12 = Point(pt_9)
pt_13 = Point(pt_7)
pt_14 = Point(pt_8)
pt_15 = Point(pt_10)
merge_2 = Merge(Data1=pt_12, Data2=pt_15, Data3=pt_11, Data4=pt_13, Data5=pt_14)
ln = Line(StartPoint=pt_11, EndPoint=pt_12)
pt_16 = Point(merge_2)
crv = Curve(ln)
ln_2 = Line(StartPoint=pt_11, EndPoint=pt_14)
points = PointList(Points=pt_16, Size=Slider(0.5, range=0..10))
ln_3 = Line(StartPoint=pt_12, EndPoint=pt_14)
crv_2 = Curve(ln_2)
ln_4 = Line(StartPoint=pt_12, EndPoint=pt_15)
crv_3 = Curve(ln_3)
ln_5 = Line(StartPoint=pt_15, EndPoint=pt_14)
ln_6 = Line(StartPoint=pt_14, EndPoint=pt_13)
crv_4 = Curve(ln_5)
ln_7 = Line(StartPoint=pt_13, EndPoint=pt_15)
crv_5 = Curve(ln_4)
crv_6 = Curve(ln_6)
crv_7 = Curve(ln_7)
merge_3 = Merge(Data1=pt_11, Data2=pt_13, Data3=pt_12, Data4=pt_15, Data5=pt_14)
merge_4 = Merge(Data1=crv, Data2=crv_7, Data3=crv_5, Data4=crv_2, Data5=crv_6, Data6=crv_3, Data7=crv_4)
merge_5 = Merge(Data1=pt_11, Data2=pt_13)
num_63 = Number(Slider(100, range=0..100))
pt_17 = Point(merge_3)
pt_18 = Point(merge_5)
crv_8 = Curve(merge_4)
neg_2 = Negative(Value=num_63)
Y = UnitY(Factor=neg_2)
force = ForceVector(Y)
pt_19 = Point(pt_14)
pt_20 = Point(pt_18)
pt_21 = Point(pt_17)
crv_9 = Curve(crv_8)
loads = LoadsKaramba3D(ForceVector=force, Local=False, PosInd=pt_19, LCase="LC0", mode="Point")
supp = SupportKaramba3D(PosInd=pt_21, menu=[buttons(off, off, on, off, off, off)])
lineelem = CreateLinearElementKaramba3D(
    Line=crv_9,
    LimitDistance_m=0.005,
    BucklingLengthY_m=-1,
    BucklingLengthZ_m=-1,
    BucklingLengthLT_m=-1,
    Bending=True,
    ToPolylineMaxAngle=0.03,
    ToPolylineTolerance=0.01,
    ToPolylineMaxEdgeLength=0.25,
    New=True,
    Remove=True,
    mode="LineToBeam")  # -> Element, Points, Info
supp_2 = SupportKaramba3D(PosInd=pt_20, menu=[buttons(on, on, off, off, off, off)])
elem = Elem(lineelem.Element)
load = LoadKaramba3D(loads)
support = Support(supp)
support_2 = Support(supp_2)
merge_6 = Merge(Data1=support_2, Data2=support)
support_3 = Support(merge_6)
elem_2 = Elem(elem)
load_2 = LoadKaramba3D(load)
support_4 = Support(support_3)
# EVALUATION
# STRUCTURAL ANALYSIS
assemble = AssembleModelKaramba3D(Elem=elem_2, Support=support_4, Load=load_2, LimitDistance_m=0.005)  # -> Model, Info, Mass_kg, CentreOfGravity, LoadCaseNames
model = Model(assemble.Model)
analyse = AnalyseKaramba3D(Model=model)  # -> AnalysedModel, MaximumDisplacement_cm, ResultingForce_kN, ChangeOfElasticEnergy_kNm
model_2 = Model(analyse.AnalysedModel)
b_forces = BeamForcesKaramba3D(AnalysedModel=model_2, Ts=[0, 1])  # -> Model, NormalForce_kN, ShearForceVz_kN, ShearForceVy_kN, TorsionalMomentMt_kNm, flatten(BendingMomentMy_kNm), flatten(BendingMomentMz_kNm), LoadCaseIndex
num_64 = Number(analyse.MaximumDisplacement_cm)
panel_3 = Panel(b_forces.BendingMomentMz_kNm)
model_3 = Model(model_2)
num_65 = Number(num_64)
modelview = ModelViewKaramba3D(Model=model_3)  # -> Model, DeformedMesh, DeformedAxes, DeformedModel, MaximumDeformation
objectives = Panel(num_65)
beamview = BeamViewKaramba3D(Model=modelview.Model)  # -> Model, MeshesOfRenderedBeams, DeformedBeamAxes, LegendColours, LegendTags
model_4 = ModelKaramba3D(beamview.Model)
image_file_name_prefix = Panel("test_save")
csv_file_name = Panel("data_log.csv")
# SAVE DATA
# Path
folder_path = Panel("C:/GHAutoScreenshotTest")
bool = Boolean(data_2)
num_66 = Number(num_42)
num_67 = Number(num_65)
data_5 = Data(flatten(model_4))
data_6 = Data(num_66)
data_7 = Data(num_67)
item_4 = ListItem(List=data_5, Index=0, Wrap=True)
panel_4 = Panel("""y_4
x_0
y_0""")
# Create header row of csv spreadsheet,
# containing names of the columns
panel_5 = Panel("image_path")
bool_2 = Boolean(bool)
data_8 = Data(data_4)
merge_7 = Merge(Data1=panel_4, Data2="max_disp", Data3=panel_5)
txt = Text(csv_file_name)
txt_2 = Text(image_file_name_prefix)
txt_3 = Text(folder_path)
txt_4 = Text(txt_3)
txt_5 = Text(txt_3)
concat = Concatenate(FragmentA=txt_4, FragmentB="/", FragmentC=txt)
concat_2 = Concatenate(FragmentA=txt_5, FragmentB="/", FragmentC=txt_2)
txt_6 = Text(concat)
txt_7 = Text(concat_2)
# Screenshot Saver
txt_8 = Text(txt_7)
c_name_iterator = CSharpScript(port=item_4, T=bool_2, R=data_8, P=txt_8)  # -> out, A; inputs T: Boolean, R: Boolean
# ---------- c_name_iterator: C# ----------
    if(T)
    {
      n++;
    }
    if(R)
    {
      n = 0;
    }
    A = P + "_" + n + ".jpg";
# ---------- c_name_iterator: C# additional code ----------
  public int n;
# ---------- end c_name_iterator ----------
txt_9 = Text(c_name_iterator.A)
# Merge data
# CSV File Streamer
data_9 = Data(txt_9)
merge_8 = Merge(Data1=flatten(data_6), Data2=flatten(data_7), Data3=flatten(data_9))
data_10 = Data(flatten(merge_8))
panel_6 = Panel(data_10)
c_vp_to_img = CSharpScript(T=bool_2, P=txt_9)  # inputs T: Boolean, P: String
# ---------- c_vp_to_img: C# ----------
    if(T)
    {
      var file_name = "";
      if (P != "")
      {
        file_name = P;
        var bitmap = RhinoDoc.ActiveDoc.Views.ActiveView.CaptureToBitmap(false, false, false);
        //Clipboard.SetImage(bitmap);
        bitmap.Save(file_name);
      }
    }
# ---------- end c_vp_to_img ----------
full_saved_image_path = Panel(txt_9)
panel_7 = Panel(txt_6)
txt_10 = Text(txt_6)
bool_3 = Boolean(data_3)
data_11 = Data(data_4)
txt_11 = Text(merge_7)
data_12 = Data(data_10)
ghpython_script = GhPythonScript(filepath=txt_10, head=txt_11, data=data_12, write=bool_3, reset=data_11)  # -> out, a; inputs head: list, data: list
# ---------- ghpython_script: Python ----------
__author__ = "tamk"
__version__ = "2024.04.04"

import rhinoscriptsyntax as rs
from scriptcontext import sticky
import os
import sys


if reset:
    _ = sticky.pop('filestream', {})
    
fs = sticky.setdefault('filestream', None)

if not fs and filepath and write:
    fs = sticky['filestream'] = open(filepath, 'w')
    if head:
        fs.write(','.join(str(_h) for _h in head) + '\n')
    
if fs and write:
    fs.write(','.join(str(_x) for _x in data) + '\n')
    fs.flush()

if fs and not write:
    fs.close()
    fs = sticky['filestream'] = None
# ---------- end ghpython_script ----------
