# Grasshopper definition basic_truss_galapogas.gh (Grasshopper 1.0.8)
# plug-ins: Karamba3D, CORE.Grasshopper.Colibri

int = Integer(Slider(5, range=0..10))
# Use Data Generator (True) or Sliders (False)
# INPUTS VARIABLES
# OPTION 1. PARAMETER AUTO-GENERATION
toggle = BooleanToggle(False)
# Start Data Recorder
toggle_2 = BooleanToggle(False)
number_slider = Slider(-1.71, range=-2..3)
# OPTION 2. PLAY WITH SLIDERS
# dy_4
number_slider_2 = Slider(-1.52, range=-2..2)
# dx_0
# dy_0
number_slider_3 = Slider(-0.31, range=-1..1)
# dy_4
number_slider_4 = Slider(0, range=-1..1)
# SET INITIAL VALUES
# Truss Span
# y_0 (Initial)
number_slider_5 = Slider(4, range=0..10)
# dx_0
# dy_0
number_slider_6 = Slider(0, range=-1..1)
G = Gate(toggle)
data = Data(toggle_2)
num = Number("-2")
num_2 = Number("-2")
num_3 = Number("2")
int_2 = Integer(int)
num_4 = Number("-1")
int_3 = Integer(int)
num_5 = Number("1")
int_4 = Integer(int)
num_6 = Number("3")
dom = ConstructDomain(DomainStart=num, DomainEnd=num_3)
dom_2 = ConstructDomain(DomainStart=num_2, DomainEnd=num_6)
dom_3 = ConstructDomain(DomainStart=num_4, DomainEnd=num_5)
num_7 = Number(number_slider_4)
num_8 = Number(number_slider_6)
num_9 = Number(Slider(0, range=-2..2))
num_10 = Number(Slider(1, range=-2..2))
num_11 = Number(number_slider_5)
range = Range(Domain=dom, Steps=int_2)
range_2 = Range(Domain=dom_2, Steps=int_3)
range_3 = Range(Domain=dom_3, Steps=int_4)
neg = Negative(Value=num_10)
num_12 = Number(number_slider_3)
num_13 = Number(number_slider)
num_14 = Number(number_slider_2)
dx_0 = Panel(range_3)
dy_0 = Panel(range_2)
dy_4 = Panel(range)
G_2 = Gate(G)
num_15 = Number(num_12)
num_16 = Number(num_8)
G_3 = Gate(G)
G_4 = Gate(G)
num_17 = Number(num_13)
num_18 = Number(num_14)
num_19 = Number(num_9)
num_20 = Number(num_7)
colibri_in = ColibriInputsIterator(dy_4=dy_4, dx_0=dx_0, dy_0=dy_0, ignoreAllWarningMsg=True)  # -> U, IP, dy_4, dx_0, dy_0, V_N
num_21 = Number(colibri_in.dx_0)
num_22 = Number(colibri_in.dy_4)
num_23 = Number(colibri_in.dy_0)
panel = Panel(num_21)
panel_2 = Panel(num_22)
panel_3 = Panel(num_23)
_0 = Stream0(neg)
galapagos = Galapagos(fitness=num_57, gene=[number_slider_2, number_slider_3, number_slider])
num_24 = Number(num_11)
num_25 = Number(_0)
num_26 = Number(flatten(panel_3))
num_27 = Number(num_26)
filter = StreamFilter(Gate=G_3, Stream0=num_17, Stream1=num_27)
addition = Addition(A=filter, B=num_19)
_0_2 = Stream0(addition)
num_28 = Number(_0_2)
num_29 = Number(flatten(panel))
num_30 = Number(num_29)
filter_2 = StreamFilter(Gate=G_2, Stream0=num_15, Stream1=num_30)
addition_2 = Addition(A=filter_2, B=num_16)
_0_3 = Stream0(addition_2)
num_31 = Number(_0_3)
num_32 = Number(flatten(panel_2))
num_33 = Number(num_32)
filter_3 = StreamFilter(Gate=G_4, Stream0=num_18, Stream1=num_33)
addition_3 = Addition(A=filter_3, B=num_20)
_0_4 = Stream0(addition_3)
num_34 = Number(_0_4)
num_35 = Number(num_24)
panel_4 = Panel("4")
num_36 = Number(num_24)
division = Division(A=num_36, B="2")
division_2 = Division(A=num_35, B=num_35)
num_37 = Number(division)
num_38 = Number(division_2)
num_39 = Number(num_38)
num_40 = Number(num_24)
num_41 = Number(num_31)
subtraction = Subtraction(A=num_40, B=num_39)
# BUILD TRUSS
num_42 = Number(num_38)
num_43 = Number(num_31)
num_44 = Number(num_28)
num_45 = Number(num_25)
num_46 = Number(num_25)
num_47 = Number(num_28)
num_48 = Number(subtraction)
addition_4 = Addition(A=num_42, B=num_43)
addition_5 = Addition(A=num_45, B=num_44)
addition_6 = Addition(A=num_46, B=num_47)
subtraction_2 = Subtraction(A=num_48, B=num_41)
num_49 = Number(addition_4)
num_50 = Number(addition_6)
num_51 = Number(num_34)
num_52 = Number(num_37)
num_53 = Number(addition_5)
panel_5 = Panel(num_51)
num_54 = Number(num_24)
pt = ConstructPoint(XCoordinate=subtraction_2, YCoordinate=num_50, ZCoordinate="0")
pt_2 = ConstructPoint(XCoordinate=num_49, YCoordinate=num_53, ZCoordinate="0")
pt_3 = ConstructPoint(XCoordinate="0", YCoordinate="0", ZCoordinate="0")
pt_4 = ConstructPoint(XCoordinate=num_54, YCoordinate="0", ZCoordinate="0")
pt_5 = ConstructPoint(XCoordinate=num_52, YCoordinate=panel_5, ZCoordinate="0")
pt_6 = Point(pt_2)
pt_7 = Point(pt)
pt_8 = Point(pt_3)
pt_9 = Point(pt_4)
pt_10 = Point(pt_5)
pt_11 = Point(pt_8)
pt_12 = Point(pt_9)
pt_13 = Point(pt_6)
pt_14 = Point(pt_10)
pt_15 = Point(pt_7)
merge = Merge(Data1=pt_13, Data2=pt_15, Data3=pt_11, Data4=pt_12, Data5=pt_14)
pt_16 = Point(merge)
ln = Line(StartPoint=pt_11, EndPoint=pt_13)
crv = Curve(ln)
ln_2 = Line(StartPoint=pt_11, EndPoint=pt_14)
points = PointList(Points=pt_16, Size=Slider(0.5, range=0..10))
ln_3 = Line(StartPoint=pt_13, EndPoint=pt_14)
crv_2 = Curve(ln_2)
ln_4 = Line(StartPoint=pt_13, EndPoint=pt_15)
crv_3 = Curve(ln_3)
crv_4 = Curve(ln_4)
ln_5 = Line(StartPoint=pt_15, EndPoint=pt_14)
ln_6 = Line(StartPoint=pt_14, EndPoint=pt_12)
crv_5 = Curve(ln_5)
crv_6 = Curve(ln_6)
ln_7 = Line(StartPoint=pt_12, EndPoint=pt_15)
crv_7 = Curve(ln_7)
merge_2 = Merge(Data1=pt_11, Data2=pt_12, Data3=pt_13, Data4=pt_15, Data5=pt_14)
merge_3 = Merge(Data1=crv, Data2=crv_7, Data3=crv_4, Data4=crv_2, Data5=crv_6, Data6=crv_3, Data7=crv_5)
merge_4 = Merge(Data1=pt_11, Data2=pt_12)
num_55 = Number(Slider(100, range=0..100))
pt_17 = Point(merge_2)
pt_18 = Point(merge_4)
crv_8 = Curve(merge_3)
neg_2 = Negative(Value=num_55)
Y = UnitY(Factor=neg_2)
force = ForceVector(Y)
pt_19 = Point(pt_14)
pt_20 = Point(pt_18)
pt_21 = Point(pt_17)
crv_9 = Curve(crv_8)
line_to_beam_karamba3d = LineToBeam(
    Line=crv_9,
    New=True,
    Remove=True,
    LimitDistance_m=0.005,
    Bending=True,
    SetBucklingLength=True,
    ToPolylineMaxAngle=0.03,
    ToPolylineTolerance=0.01,
    ToPolylineMaxEdgeLength=0.25)  # -> Element, Points, Info
support_karamba3d = Supp(PosInd=pt_21, menu=[buttons(off, off, on, off, off, off)])
loads_karamba3d = Loads(ForceVector=force, Local=False, PosInd=pt_19, LCase="LC0", mode="Point")
support_karamba3d_2 = Supp(PosInd=pt_20, menu=[buttons(on, on, off, off, off, off)])
# STRUCTURAL ANALYSIS
elem = Elem(line_to_beam_karamba3d.Element)
load = LoadKaramba3D(loads_karamba3d)
support = Support(support_karamba3d_2)
support_2 = Support(support_karamba3d)
merge_5 = Merge(Data1=support, Data2=support_2)
support_3 = Support(merge_5)
elem_2 = Elem(elem)
load_2 = LoadKaramba3D(load)
support_4 = Support(support_3)
assemble_model_karamba3d = Assemble(Elem=elem_2, Support=support_4, Load=load_2, LimitDistance_m=0.005)  # -> Model, Info, Mass_kg, CentreOfGravity, LoadCaseNames
model = Model(assemble_model_karamba3d.Model)
analyze_karamba3d = Analyze(Model=model)  # -> CalculatedModel, MaximumDisplacement_cm, ResultingForceOfGravity_kN, ElasticEnergyChange_kNm
model_2 = Model(analyze_karamba3d.CalculatedModel)
beam_forces_karamba3d = BForces(AnalysedModel=model_2, Ts=[0, 1])  # -> Model, NormalForce_kN, ShearForceVz_kN, ShearForceVy_kN, TorsionalMomentMt_kNm, flatten(BendingMomentMy_kNm), flatten(BendingMomentMz_kNm), LoadCaseIndex
num_56 = Number(analyze_karamba3d.MaximumDisplacement_cm)
num_57 = Number(num_56)
panel_6 = Panel(num_57)
num_58 = Number(assemble_model_karamba3d.Mass_kg)
num_59 = Number(num_58)
panel_7 = Panel(num_59)
panel_8 = Panel(beam_forces_karamba3d.BendingMomentMz_kNm)
panel_9 = Panel(num_59)
galapagos_2 = Galapagos(fitness=num_57, gene=[number_slider_2, number_slider_3, number_slider])
model_3 = Model(model_2)
model_view_karamba3d = ModelView(Model=model_3, ResultFactors=1, ResultCase=-1)  # -> Model, DeformedMesh, DeformedAxes, DeformedModel

# ---- group: Collect Outputs
colibri_out = ColibriOutputs(Deflection=flatten(panel_6), Mass=flatten(panel_7))

# ----
beam_view_karamba3d = BeamView(Model=model_view_karamba3d.Model)  # -> Model, MeshesOfRenderedBeams, DeformedBeamAxes, LegendColours, LegendTags
data_2 = Data(data)
ca = ColibriAggregator(Folder="C:\Colibri", Inputs=colibri_in.IP, Outputs=colibri_out, Write=data_2, recordingMode=0)
