# Grasshopper definition 02_BesoTower_with_opt.gh (Grasshopper 1.0.8)
# plug-ins: Karamba3D

r = Slider(90, range=-120..120)
number_slider = Slider(1, range=0.25..2)
number_slider_2 = Slider(1, range=0.25..2)
galapagos = Galapagos(fitness=opticrosec, gene=[number_slider, number_slider_2, r])
dom = ConstructDomain(DomainStart=number_slider_2, DomainEnd=number_slider)

# ---- group: Define Material
ids = Panel("S")
matprops = MaterialPropertiesKaramba3D(
    FamilyOfMaterial="Steel",
    Name="S235",
    ElementIdentifier=ids,
    YoungsModulus_kN_cm²=21000,
    InPlaneShearModulus_kN_cm²=8076,
    TransverseShearModulus_kN_cm²=8076,
    SpecificWeight_kN_m³="25",
    CoefficientOfThermalExpansion_1=1.2e-05,
    TensileStrength_kN_cm²=23.5,
    CompressiveStrength_kN_cm²=-23.5,
    StrengthHypothesis="MISES",
    mode="Isotrop")

# ----
number_slider_3 = Slider(25, range=0..100)

# ---- group: Define Cross Section
range = Range(Domain="25 to 500", Steps=number_slider_3)
range_2 = Range(Domain="1 to 5", Steps=number_slider_3)
concat = Concatenate(FragmentA="R", FragmentB=range)
crosec = CrossSectionKaramba3D(
    FamilyNameOfCrossSection="R",
    NameOfCrossSection=concat,
    Material=matprops,
    Diameter_cm=range,
    WallThickness_cm=range_2,
    mode="Circular Hollow")
item = ListItem(List=crosec, Index=0, Wrap=True)

# ----
swatch = ColourSwatch(SwatchColor=RGBA(166, 166, 166, 84))  # disabled

# ---- group: Generate Geometry
f = Slider(4.5, range=0..10)
c = Slider(12, range=0..20)
pt = Point([Point(-3.657535989, -5.253774633, 0), Point(-0.3512743697, -9.067863605, 0), Point(16.64971476, -2.166487217, 0), Point(18.36270625, 2.353830528, 0), Point(0.9740227883, 14.90998805, 0), Point(-6.59886065, 10.00155037, 0)])
series = Series(Start=0, Step=f, Count=c)
pt_2 = ConstructPoint(XCoordinate=0, YCoordinate=0, ZCoordinate=series)
toggle = BooleanToggle(False)
panel = Panel("""-1
1""")
filter = StreamFilter(Gate=toggle, Stream0="-1", Stream1="1")
item_2 = ListItem(List=panel, Index=toggle, Wrap=True)
series_2 = Series(Start=0, Step=item_2, Count=c)  # -> graft(Series)
panel_2 = Panel([item_2, filter])

# ----
range_3 = Range(Domain=r, Steps=expr("x-1", c))
range_4 = Range(Domain=dom, Steps=expr("x-1", c))
num = Number(range_4)

# ---- group: Generate Geometry (continued)
prot = RotatePlane(Plane=pt_2, Angle=degrees(range_3))
# 03 - BESO Tower
# Difficulty: Moderate | Version 3.1.4
# A tube structure for a highrise is generated parametrically. The BESO component removes a proportion of the "D" elements in the structure.
orient = Orient(Geometry=pt, Source=PlaneXY(0, 0, 0), Target=graft(prot))  # -> Geometry, Transform

# ----
scale_nu = ScaleNU(Geometry=orient.Geometry, Plane=PlaneXY(0, 0, 0), ScaleX=num, ScaleY=num, ScaleZ=Slider(1, range=0..1))  # -> Geometry, Transform

# ---- group: Generate Geometry (continued)
nurbs = NurbsCurve(Vertices=scale_nu.Geometry, Degree=3, Periodic=True)  # -> Curve, Length, Domain
offset_l = OffsetLoose(Curve=nurbs.Curve, Distance="-1")
divide = DivideCurve(Curve=nurbs.Curve, Count=Slider(16, range=10..40), Kinks=False)  # -> Points, Tangents, Parameters
loft = Loft(
    Curves=flatten(offset_l),
    Options={Adjust=False, Closed=False, LoftEnds=0, LoftSimp=0, LoftType=1, Rebuild=10, Refit=0.01})
shift = ShiftList(List=divide.Points, Shift=series_2, Wrap=True)
flip = FlipMatrix(Data=divide.Points)
flip_2 = FlipMatrix(Data=shift)
preview = CustomPreview(Geometry=loft, Shader=ColourSwatch(SwatchColor=RGB(166, 166, 166)))
item_3 = ListItem(List=flip, Index=0, Wrap=True)  # -> flatten(Item)
branch = TreeBranch(Tree=simplify(divide.Points), Path="0", MaintainPaths=True)
pline = PolyLine(Vertices=divide.Points, Closed=True)
pline_2 = PolyLine(Vertices=flip, Closed=False)
pline_3 = PolyLine(Vertices=flip_2, Closed=False)
entwine = Entwine(Branch00=pline, Branch01=pline_2, Branch02=pline_3, FlattenInputs=True)
boundary = BoundarySurfaces(Edges=pline)

# ---- group: Define Supports
panel_3 = Panel("""0
0
0
1""")
cull = CullPattern(List=branch, CullPattern=panel_3)
supp = SupportKaramba3D(PosInd=cull, menu=[buttons(on, on, on, off, off, off)])

# ---- group: Define Element - Mesh
mesh = MeshBrep(
    Brep=boundary,
    Settings={GridMaxCount=0, GridMinCount=16, JaggedSeams=False, MaxEdgeLength=0, MinEdgeLength=0.0001, MinTolerance=0, Refine=True, RefineAngle=0, RelativeTolerance=0.65, SimplePlanes=True, Tolerance=0})
ids_2 = Panel("S")
surfelem = CreateSurfaceElementKaramba3D(Mesh=flatten(mesh), Identifier=ids_2, LimitDistance_m=0.005, Bending=True, mode="MeshToShell")  # -> Element, Points, Info

# ---- group: Define Element - Beams
explode = Explode(Curve=entwine, Recursive=True)  # -> Segments, Vertices
trim = TrimTree(Tree=explode.Segments, Depth=1)
ids_3 = Panel("""H
V
D""")
lineelem = CreateLinearElementKaramba3D(
    Line=trim,
    Identifier=graft(ids_3),
    CrossSection=item,
    LimitDistance_m=0.005,
    BucklingLengthY_m=-1,
    BucklingLengthZ_m=-1,
    BucklingLengthLT_m=-1,
    Bending=True,
    ToPolylineMaxAngle=0.03,
    ToPolylineTolerance=0.01,
    ToPolylineMaxEdgeLength=0.25,
    New=True,
    Remove=True,
    mode="LineToBeam")  # -> Element, Points, Info

# ----
preview_2 = CustomPreview(Geometry=mesh, Shader=swatch)  # disabled
element = ElementKaramba3D([lineelem.Element, surfelem.Element])

# ---- group: Define Loads
offset_l_2 = OffsetLoose(Curve=nurbs.Curve, Distance="0.5")
loft_2 = Loft(
    Curves=flatten(offset_l_2),
    Options={Adjust=False, Closed=False, LoftEnds=0, LoftSimp=0, LoftType=1, Rebuild=10, Refit=0.01})
boundary_2 = BoundarySurfaces(Edges=nurbs.Curve)
mesh_2 = MeshBrep(
    Brep=loft_2,
    Settings={GridMaxCount=0, GridMinCount=0, JaggedSeams=False, MaxEdgeLength=1, MinEdgeLength=1, MinTolerance=0, Refine=True, RefineAngle=0, RelativeTolerance=0, SimplePlanes=False, Tolerance=0})
mesh_3 = MeshBrep(
    Brep=boundary_2,
    Settings={GridMaxCount=0, GridMinCount=0, JaggedSeams=False, MaxEdgeLength=1.5, MinEdgeLength=1.5, MinTolerance=0, Refine=True, RefineAngle=0, RelativeTolerance=0, SimplePlanes=False, Tolerance=0})
mjoin = MeshJoin(Meshes=flatten(mesh_3))
panel_4 = Panel("""Wind1
Wind2""")
ids_4 = Panel("H")
ids_5 = Panel("H")
X = UnitX(Factor="4")
Z = UnitZ(Factor="-20")
Y = UnitY(Factor="4")
loads = LoadsKaramba3D(Vector=Vector(0, 0, -1), LCase="Gravity", mode="Gravity")
loads_2 = LoadsKaramba3D(
    Vector=Z,
    Mesh=mjoin,
    ElementIdentifiers=ids_4,
    LCase="Floor",
    mode="MeshLoad -Const.",
    menu=[buttons(off, on, off), buttons(on, on)])
loads_3 = LoadsKaramba3D(
    Vector=[X, Y],
    Mesh=mesh_2,
    ElementIdentifiers=ids_5,
    LCase=panel_4,
    mode="MeshLoad -Const.",
    menu=[buttons(off, off, on), buttons(on, on)])
lccombinator = LoadCaseCombinatorKaramba3D(LoadCaseCombinationRulesKaramba3D="LCC= Gravity + Floor + (Wind1|Wind2)")  # -> LoadCaseCombinations, NamesOfLoadCases, NumberOfLoadCases

# ----
merge = Merge(Data1=flatten(loads), Data2=flatten(loads_2), Data3=flatten(loads_3), Data4=flatten(lccombinator.LoadCaseCombinations))

# ---- group: Define Loads (continued)
load = LoadKaramba3D(flatten(merge))

# ---- group: Assemble Model
assemble = AssembleModelKaramba3D(Elem=flatten(element), Support=flatten(supp), Load=flatten(load), LimitDistance_m=0.005)  # -> Model, Info, Mass_kg, CentreOfGravity, LoadCaseNames

# ---- group: BESOBeams
t = Slider(0.17, range=0..1)
ids_6 = Panel("D")
besobeam = BESOForBeamsKaramba3D(
    Model=assemble.Model,
    ElemIdentifiers=ids_6,
    LoadCases="LCC",
    TargetVolumeRatio=t,
    NumberOfChangeIterations=10,
    NumberOfConvergenceIterations=20,
    WeightingFactorForTension=1,
    WeightingFactorForCompression=1,
    WeightingFactorForShear=0,
    WeightingFactorForMoments=0,
    BESOFactor=0,
    MinimumDistanceBetweenChangingElements=0,
    RelativeWeightLimit=0)  # -> MaximumDisplacement_cm, OptimizedModel, HistoryOfTheBESO, ElementIsActive, DistributionOfWeights

# ----
bnd = Bounds(Numbers=besobeam.DistributionOfWeights)
panel_5 = Panel(bnd)
modelview = ModelViewKaramba3D(Model=besobeam.OptimizedModel)  # -> Model, DeformedMesh, DeformedAxes, DeformedModel, MaximumDeformation

# ---- group: Optimize Cross Section
opticrosec = OptimizeCrossSectionKaramba3D(
    Model=besobeam.OptimizedModel,
    CrossSections=crosec,
    MaximumUtilization=1,
    MaximumVirtualWork_kNcm=0.01,
    NumberOfUtilizationIterations=5,
    NumberOfDisplacementIterations=5,
    NumberOfDisplacementIncrementsPerIteration=2,
    DisplacementTolerance=0.01,
    NumberOfSamplePoints=3,
    ElasticDesign=True,
    GammaM0=1,
    GammaM1=1.1,
    SwayFrame=True)  # -> OptimizedModel, Info, Mass_kg, MaximumDisplacement_cm, ElasticEnergyChange_kNm, MaximumUtilizationViewInsufficientCrossSections, MaximumDisplacementViewLimitCrossSections
displacement = Panel(opticrosec.MaximumDisplacement_cm)

# ---- group: Analyse Model
analyse = AnalyseKaramba3D(Model=opticrosec.OptimizedModel)  # -> AnalysedModel, MaximumDisplacement_cm, ResultingForce_kN, ChangeOfElasticEnergy_kNm

# ---- group: View Results
resultselect = ResultSelectorKaramba3D(
    Model=analyse.AnalysedModel,
    menu=[buttons(on, on), dropdown(2), dropdown(0), buttons(off, off, off, off, off, off, off), buttons(off, off, off, off, off, off), buttons(off, off, off, off, off, off, off, off), buttons(off, off, off, off, off, off, off, off)])  # -> Model, LoadCaseSelection
modelview_2 = ModelViewKaramba3D(Model=resultselect.Model)  # -> Model, DeformedMesh, DeformedAxes, DeformedModel, MaximumDeformation
beamview = BeamViewKaramba3D(Model=modelview_2.Model)  # -> Model, MeshesOfRenderedBeams, DeformedBeamAxes, LegendColours, LegendTags
legend = Legend(Colour=beamview.LegendColours, Tags=beamview.LegendTags, LegendType=1)
