# Grasshopper definition 02_ShellThicknessFromImage_with_imageBlending.gh (Grasshopper 1.0.8)
# plug-ins: Karamba3D, RhinoCodePluginGH

panel = Panel("""0
0
0
0""")
int = Integer(Slider(0, range=0..3))

# ---- group: Define Loads
loads = LoadsKaramba3D(Vector=Vector(0, 0, -1), LCase="LC0", mode="Gravity")

# ---- group: Generate Geometry
number_slider = Slider(60, range=1..100)
number_slider_2 = Slider(60, range=1..100)
pt = Point([Point(0.6195443211, 0.6731465889, 0), Point(1.180868586, 3.142313202, 0), Point(2.50871305, 0.8228635272, 0), Point(4.061493053, 3.806671036, 0)])
srfgrid = SurfaceFromPoints(Points=pt, UCount="2", Interpolate=False)

# ----
num = Number(number_slider)

# ---- group: Generate Geometry (continued)
# 02 - Shell Thickness from Image
# Difficulty: Moderate | Version 3.1.4
# Use the image sampler to define the cross section thickness of a shell.
mesh_uv = MeshSurface(Surface=srfgrid, UCount=num, VCount=num, Overhang=True, Equalize=False)

# ----
mesh = Mesh(mesh_uv)

# ---- group: Define Cross Section with Image Sampler
facen = FaceNormals(Mesh=mesh)  # -> Centers, Normals
srf_cp = SurfaceClosestPoint(Point=facen.Centers, Surface=reparameterize(srfgrid))  # -> Point, UVPoint, Distance
image = ImageSampler(srf_cp.UVPoint, Filter="Value", Interpolate=False, Umax=1, Umin=0, Vmax=1, Vmin=0, Wrap=1)

# ----
num_2 = Number(image)
num_3 = Number(image)
multiplication = Multiplication(A=num_2, B=num_2)
py3 = Python3Script(A=num_3, B=panel, order=int)  # -> out, C, A_up, B_up; inputs A: list of Double, B: list of Double
# ---------- py3: Python ----------
import numpy as np
from scipy.ndimage import zoom

def match_and_add(A, B, order=1):
    """
    Adds two matrices of different sizes by upsampling
    the smaller one to match the larger one.

    Parameters:
        A, B : numpy arrays
        order : interpolation order (1 = bilinear)

    Returns:
        C : numpy array, sum of resized A and B
        A_resized, B_resized : resized matrices
    """

    # Shapes
    a_h, a_w = A.shape
    b_h, b_w = B.shape

    # Determine target size (largest of each dimension)
    target_h = max(a_h, b_h)
    target_w = max(a_w, b_w)

    # Compute scale factors
    scale_A = (target_h / a_h, target_w / a_w)
    scale_B = (target_h / b_h, target_w / b_w)
    print(scale_A, scale_B)

    # Resize both matrices to target size
    A_resized = zoom(A, scale_A, order=order)
    B_resized = zoom(B, scale_B, order=order)

    # Add matrices
    C = A_resized + B_resized
    return C, A_resized, B_resized


# ------------------------------
# Example usage:
# ------------------------------

if A is not None and B is not None:
    order = 0 if order is None else order
    s_A = int(len(A) ** 0.5)
    s_B = int(len(B) ** 0.5)

    A_ = np.array(A).reshape(s_A, s_A)
    B_ = np.array(B).reshape(s_B, s_B)
    C, A_up, B_up = match_and_add(A_, B_, order=order)

    C = C.flatten().tolist()
    A_up = A_up.flatten().tolist()
    B_up = B_up.flatten().tolist()


# A = np.array([[1, 2],
#               [3, 4]])

# B = np.array([[10, 20, 30],
#               [40, 50, 60],
#               [70, 80, 90]])

# C, A_up, B_up = match_and_add(A, B)

# print("Upsampled A:\n", A_up)
# print("\nUpsampled B:\n", B_up)
# print("\nSum:\n", C)
# ---------- end py3 ----------
graph = GraphMapper(graft(multiplication), x0=0, x1=1, y0=0, y1=1, container_name="Bezier", cpx=[0, 0.25, 0.75, 1], cpy=[0, 0.25, 0.75, 1])
num_4 = Number(py3.C)
data = Data(flatten(num_4))

# ---- group: Define Cross Section with Image Sampler (continued)
bnd = Bounds(Numbers=data)
remap = RemapNumbers(Value=data, Source=bnd, Target="0.5 to 10")  # -> Mapped, Clipped
crosec = CrossSectionKaramba3D(
    FamilyNameOfCrossSection="DefaultCroSec",
    NameOfCrossSection="Shell",
    ElementIdentifier="s",
    Heights_cm=remap.Mapped,
    mode="Shell - Var")

# ---- group: Define Elements
tri = Triangulate(Mesh=mesh)  # -> Mesh, Count
surfelem = CreateSurfaceElementKaramba3D(Mesh=tri.Mesh, Identifier="s", CrossSection=crosec, LimitDistance_m=0.005, Bending=True, mode="MeshToShell")  # -> Element, Points, Info

# ---- group: Define Supports
genes = GenePool(Decimals=2, Maximum=1, Minimum=0, Value=[0, 0.27])
dispatch = Dispatch(List=genes, DispatchPattern=[True, False])  # -> ListA, ListB
vec = VectorXYZ(XComponent=dispatch.ListA, YComponent=dispatch.ListB, ZComponent=0)  # -> Vector, Length
evalsrf = EvaluateSurface(Surface=reparameterize(srfgrid), Point=vec.Vector)  # -> Point, Normal, UDirection, VDirection, Frame
cps = ClosestPoints(Point=evalsrf.Point, Cloud=surfelem.Points, Count=Slider(6, range=0..10))  # -> ClosestPoint, CPIndex, Distance
supp = SupportKaramba3D(PosInd=cps.ClosestPoint, menu=[buttons(on, on, on, on, on, on)])

# ---- group: Assemble Model
assemble = AssembleModelKaramba3D(Elem=surfelem.Element, Support=flatten(supp), Load=flatten(loads), LimitDistance_m=0.005)  # -> Model, Info, Mass_kg, CentreOfGravity, LoadCaseNames

# ---- group: Analyze Model
analyse = AnalyseKaramba3D(Model=assemble.Model)  # -> AnalysedModel, MaximumDisplacement_cm, ResultingForce_kN, ChangeOfElasticEnergy_kNm
panel_2 = Panel(analyse.MaximumDisplacement_cm)

# ---- group: View Results
modelview = ModelViewKaramba3D(Model=analyse.AnalysedModel)  # -> Model, DeformedMesh, DeformedAxes, DeformedModel, MaximumDeformation
shellview = ShellViewKaramba3D(Model=modelview.Model, IndexOfLayer=0)  # -> Model, MeshesOfRenderedShells, LegendColours, LegendTags
legend = Legend(Colour=shellview.LegendColours, Tags=shellview.LegendTags, LegendType=1)
