# Grasshopper definition 05_ProjectedVoronoiPatternGridshell_with_opt.gh (Grasshopper 1.0.8)
# Copyright: B+G Engineers
# Copyright: Karamba3D
# plug-ins: Karamba3D

genes = GenePool(
    Decimals=3,
    Maximum=1,
    Minimum=-1,
    Value=[0, 0, 0, 0, 0, 0, 0, 0, 0, 0, 0, 0, 0, 0, 0, 0, 0, 0, 0, 0, 0, 0, 0, 0, 0, 0, 0, 0])
genes_2 = GenePool(Decimals=3, Maximum=1, Minimum=-1, Value=[0, 0, 0, 0, 0, 0, 0, 0])
genes_3 = GenePool(Decimals=3, Maximum=1, Minimum=-1, Value=[0, 0, 0, 0, 0, 0, 0, 0])
genes_4 = GenePool(Decimals=3, Maximum=1, Minimum=-1, Value=[0, 0, 0, 0, 0.023, 0, 0, 0])
genes_5 = GenePool(
    Decimals=3,
    Maximum=1,
    Minimum=-1,
    Value=[0, 0, 0, 0, 0, 0, 0, 0, 0, 0, 0, 0, 0, 0, 0, 0, 0, 0, 0, 0, 0, 0, 0, 0, 0, 0, 0, 0])
genes_6 = GenePool(
    Decimals=3,
    Maximum=1,
    Minimum=-1,
    Value=[0, 0, 0, 0, 0, 0, 0, 0, 0, 0, 0, 0, 0, 0, 0, 0, 0, 0, 0, 0, 0, 0, 0, 0, 0, 0, 0, 0])
Z = UnitZ(Factor=genes_4)
X = UnitX(Factor=genes_2)
Y = UnitY(Factor=genes_3)
X_2 = UnitX(Factor=genes_5)
Y_2 = UnitY(Factor=genes_6)
addition = Addition(A=X, B=Y, C=Z)
addition_2 = Addition(A=X_2, B=Y_2)
vec = Vector(addition)
vec_2 = Vector(addition_2)
multiplication = Multiplication(A=vec, B=Slider(2, range=0..10))
multiplication_2 = Multiplication(A=vec_2, B=Slider(4, range=0..10))
galapagos = Galapagos(fitness=opticrosec, gene=[genes_5, genes_6, genes_3, genes_2, genes_4])

# ---- group: Define Materials
matselect = MaterialSelectionKaramba3D(menu=[dropdown(1), dropdown(2)])

# ---- group: Define Cross Sections
range = Range(Domain="20 to 80", Steps="10")  # -> graft(Range)
range_2 = Range(Domain="1 to 2", Steps="10")  # -> graft(Range)
eval = Evaluate(F="family &\" \"& height &\"/\"& thickH", family="FRQ", height="45", width=range, thickH=range_2)
crosec = CrossSectionKaramba3D(
    FamilyNameOfCrossSection="FRQ",
    NameOfCrossSection=eval,
    Material=matselect,
    Height_cm="45",
    UpperFlangeWidth_cm=range,
    LowerFlangeWidth_cm=range,
    UpperFlangeThickness_cm=range_2,
    LowerFlangeThickness_cm=range_2,
    SidewallsThickness_cm=range_2,
    FilletRadius_cm=0.6,
    mode="Box")  # -> flatten(CrossSection)
beam_ids = Panel("""A
B""")
crosecselect = CrossSectionSelectorKaramba3D(CrossSections=crosec, ElementsIdentifiers=beam_ids)  # -> CrossSection, Info

# ---- group: Define Joints
joint_agent = BeamJointAgentKaramba3D(
    BeamIdentifier="A",
    ToElementIdentifiers="B",
    Ct_kN_m=Vector(0, 0, 0),
    Cr_kNm_rad=Vector(0, 0, 0),
    menu=[buttons(off, off, off, on, on, on)])

# ---- group: Create Geometry
pt = Point([Point(3.327000821, 4.650775012, 0), Point(9.219793822, 0.9540431692, 0), Point(26.46719328, 1.757260388, 7.389493176), Point(27.47623261, 3.906008056, 7.437447087), Point(21.37015162, 15.37001021, 0), Point(15.80988716, 18.31487448, 0), Point(2.254486923, 18.65425393, 7.879748359), Point(1.099614045, 14.76551155, 8.807656018)])
panel = Panel("""10
18""")

# ----
move = Move(Geometry=pt, Motion=multiplication)  # -> Geometry, Transform
pt_2 = Point(move.Geometry)

# ---- group: Create Geometry (continued)
nurbs = NurbsCurve(Vertices=pt_2, Degree=3, Periodic=True)  # -> reparameterize(Curve), Length, Domain
cluster = Cluster_2(C=nurbs.Curve)  # -> crv_2, P, P_2
patch = Patch(Curves=nurbs.Curve, Spans="12", Flexibility=1, Trim=True)
project = Project(Geometry=cluster.crv_2, Plane=PlaneXY(0, 0, 0))  # -> Geometry, Transform
aligndim = AlignedDimension(Plane=PlaneXY(0, 0, 0), PointA=cluster.P, PointB=cluster.P_2, Offset=graft(panel), Text="{0:0.00}", Size=1)
popgeo = PopulateGeometry(Geometry=patch, Count=Slider(28, range=0..100), Seed=1)
# 05 - Projected Voronoi Pattern Gridshell
# Difficulty: Hard | Version 3.1.4
# A Voronoi pattern is projected onto a surface. The cross section optimizer is used to specify the thickness of each member.
# By using the Beam Orient component, each element can be orientated individually to align with the input surface.
divide = DivideCurve(Curve=nurbs.Curve, Count=Slider(50, range=0..100), Kinks=False)  # -> Points, Tangents, Parameters
edges = BrepEdges(Brep=patch)  # -> Naked, Interior, NonManifold
preview = CustomPreview(
    Geometry=project.Geometry,
    Shader={diffuse=RGB(255, 105, 180), emission=RGB(76, 32, 54), shine=0.5, specular=RGB(255, 255, 255), transparency=0})
project_2 = Project(Geometry=patch, Plane=PlaneXY(0, 0, 0))  # -> Geometry, Transform

# ----
popgeo_2 = PopulateGeometry(Geometry=patch, Count=Slider(28, range=0..100), Seed=1)
move_2 = Move(Geometry=popgeo_2, Motion=multiplication_2)  # -> Geometry, Transform
pt_3 = Point(move_2.Geometry)
merge = Merge(Data1=divide.Points, Data2=pt_3)

# ---- group: Create Geometry (continued)
voronoi = Voronoi(Points=flatten(merge), BruteForceOverride=False)
explode = Explode(Curve=voronoi, Recursive=True)  # -> Segments, Vertices
rdlines = RemoveDuplicateLinesKaramba3D(Line=flatten(explode.Segments), LimitDistance=0.005)  # -> OutLine, Info, Indexes
project_3 = Project(Curve=rdlines.OutLine, Brep=project_2.Geometry, Direction=Vector(0, 0, 1))
project_4 = Project(Curve=project_3, Brep=patch, Direction=Vector(0, 0, 1))
end = EndPoints(Curve=project_4)  # -> Start, End
crv_cp = CurveClosestPoint(Point=flatten([end.Start, end.End]), Curve=edges.Naked)  # -> Point, Parameter, Distance
smaller = SmallerThan(FirstNumber=crv_cp.Distance, SecondNumber="0.01")  # -> SmallerThan, OrEqualTo
cull = CullPattern(List=crv_cp.Parameter, CullPattern=smaller.SmallerThan)
shatter = Shatter(Curve=edges.Naked, Parameters=cull)
topoly = CurveToPolyline(Curve=shatter, ToleranceDistance="0.01", ToleranceAngle="pi/16")  # -> Polyline, Segments
explode_2 = Explode(Curve=topoly.Polyline, Recursive=True)  # -> flatten(Segments), Vertices
ln = Line(StartPoint=end.Start, EndPoint=end.End)  # -> flatten(Line)
entwine = Entwine(Branch00=ln, Branch01=explode_2.Segments, FlattenInputs=True)

# ---- group: Define Supports
genes_7 = GenePool(Decimals=3, Maximum=1, Minimum=0, Value=[0.048, 0.089, 0.541, 0.554])
eval_2 = EvaluateCurve(Curve=reparameterize(edges.Naked), Parameter=genes_7)  # -> Point, Tangent, Angle
pull = PullPoint(Point=eval_2.Point, Geometry=flatten([end.Start, end.End]), ClosestOnly=True)  # -> ClosestPoint, Distance
supp = SupportKaramba3D(PosInd=pull.ClosestPoint, menu=[buttons(on, on, on, off, off, off)])

# ---- group: Define Elements
beam_ids_2 = Panel("""A
B""")
lineelem = CreateLinearElementKaramba3D(
    Line=entwine,
    Identifier=graft(beam_ids_2),
    CrossSection=crosecselect.CrossSection,
    LimitDistance_m=0.005,
    BucklingLengthY_m=-1,
    BucklingLengthZ_m=-1,
    BucklingLengthLT_m=-1,
    Bending=True,
    ToPolylineMaxAngle=0.03,
    ToPolylineTolerance=0.01,
    ToPolylineMaxEdgeLength=0.25,
    New=True,
    Remove=True,
    mode="LineToBeam")  # -> Element, Points, Info

# ---- group: Define Loads
Z_2 = UnitZ(Factor="-1")
mesh = MeshBrep(
    Brep=patch,
    Settings={GridMaxCount=0, GridMinCount=0, JaggedSeams=False, MaxEdgeLength=0.7, MinEdgeLength=0.7, MinTolerance=0, Refine=False, RefineAngle=0, RelativeTolerance=0, SimplePlanes=False, Tolerance=0})
loads = LoadsKaramba3D(Vector=Vector(0, 0, -1), LCase="LC0", mode="Gravity")
loads_2 = LoadsKaramba3D(Vector=Z_2, Mesh=mesh, LCase="LC0", mode="MeshLoad -Const.", menu=[buttons(off, on, off), buttons(off, on)])
load = LoadKaramba3D(flatten([loads, loads_2]))

# ---- group: Orientate Elements
cluster_2 = Cluster(S=patch, curvepoint=entwine)
orientate = OrientateElemKaramba3D(Beam=lineelem.Element, ZOrientation=cluster_2, mode="Beam")

# ---- group: Assemble Model
assemble = AssembleModelKaramba3D(Elem=flatten(orientate), Support=supp, Load=load, Joint=joint_agent, LimitDistance_m=0.005)  # -> Model, Info, Mass_kg, CentreOfGravity, LoadCaseNames

# ---- group: Optimize Cross Sections
opticrosec = OptimizeCrossSectionKaramba3D(
    Model=assemble.Model,
    ElemIdentifiers="A",
    CrossSections=crosec,
    MaximumUtilization=1,
    MaximumVirtualWork_kNcm=0.01,
    NumberOfUtilizationIterations=5,
    NumberOfDisplacementIterations=5,
    NumberOfDisplacementIncrementsPerIteration=2,
    DisplacementTolerance=0.01,
    NumberOfSamplePoints=3,
    ElasticDesign=True,
    GammaM0=1,
    GammaM1=1.1,
    SwayFrame=True)  # -> OptimizedModel, Info, Mass_kg, MaximumDisplacement_cm, ElasticEnergyChange_kNm, MaximumUtilizationViewInsufficientCrossSections, MaximumDisplacementViewLimitCrossSections
panel_2 = Panel(opticrosec.Mass_kg)
panel_3 = Panel(opticrosec.MaximumDisplacement_cm)

# ---- group: Analyse Model
analyse = AnalyseKaramba3D(Model=assemble.Model)  # -> AnalysedModel, MaximumDisplacement_cm, ResultingForce_kN, ChangeOfElasticEnergy_kNm
panel_4 = Panel(analyse.MaximumDisplacement_cm)

# ---- group: View Results
modelview = ModelViewKaramba3D(Model=opticrosec.OptimizedModel)  # -> Model, DeformedMesh, DeformedAxes, DeformedModel, MaximumDeformation
beamview = BeamViewKaramba3D(Model=modelview.Model)  # -> Model, MeshesOfRenderedBeams, DeformedBeamAxes, LegendColours, LegendTags
legend = Legend(Colour=beamview.LegendColours, Tags=beamview.LegendTags, LegendType=1)

# ==== cluster Cluster
S = ClusterInput()
curvepoint = ClusterInput()
curvepoint_2 = PointOnCurve(curvepoint, parameter=0.5)
srf_cp = SurfaceClosestPoint(Point=curvepoint_2, Surface=reparameterize(S))  # -> Point, UVPoint, Distance
evalsrf = EvaluateSurface(Surface=reparameterize(S), Point=srf_cp.UVPoint)  # -> Point, Normal, UDirection, VDirection, Frame
N = ClusterOutput(evalsrf.Normal)

# ==== cluster Cluster_2
xy = XYPlane(Origin=Point(0, 0, 0))
C = ClusterInput()
x_tremez = Extremes(Curve=reparameterize(C), Plane=xy)  # -> Highest, Lowest
crv_cp = CurveClosestPoint(Point=[x_tremez.Highest, x_tremez.Lowest], Curve=reparameterize(C))  # -> graft(Point), Parameter, Distance
crv = Curve(C)
eval = EvaluateCurve(Curve=reparameterize(C), Parameter=expr("(x+0.5)%1", crv_cp.Parameter))  # -> graft(Point), Tangent, Angle
P = ClusterOutput(crv_cp.Point)
P_2 = ClusterOutput(eval.Point)
crv_2 = ClusterOutput(crv)
