# Grasshopper definition BSL_GH_183_WallaceiKarambaTable1.gh (Grasshopper 1.0.8)
# plug-ins: Karamba3D, Wallacei

# RESEARCH PROJECT
# Development of Plug-and-Play E-Learning
# Tutorials for Incorporation into Flipped-Classroom
# Teaching of Artificial Intelligence and Machine
# Learning Applications in Advanced Architecture
# Design and Production
# SUPPORTED BY
# Teach Devlopment Grant (Project No.: 928)
# REQUIRED PLUGINS
# - Karamba3D
# - Wallacei
# LEGEND
# Train Data
data = Data(0)
# Test Input Data
data_2 = Data(0)
# Algorithm
data_3 = Data(0)
# © ALL RIGHTS RESERVED, 2024
# Output
data_4 = Data(0)
galapagos = Galapagos(fitness=displacement, gene=[genes_2, genes])

crv = Curve(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)
offset = OffsetCurve(Curve=crv, Distance=Slider(0.03, range=0..0.1), Plane=PlaneXY(0, 0, 0), Corners=1)

# ----
# RESEARCH TEAM
# Principal Investigator: Dr. Kristof Crolla
# 
# Team Members: Dr. Garvin Goepel, Abdullah
# Tahir Sheikh, Jingwen Song, Adeline Chan
panel = Panel("0,0,0.75")
rectangle = Rectangle(Plane=panel, XSize="1.25", YSize="2.44", Radius=0)  # -> Rectangle, Length
boundary = BoundarySurfaces(Edges=offset)
Z = UnitZ(Factor="-0.75")
popgeo = PopulateGeometry(Geometry=boundary, Count="500", Seed=1)
move = Move(Geometry=popgeo, Motion=Z)  # -> Geometry, Transform
genes = GenePool(Decimals=0, Maximum=500, Minimum=0, Value=[178, 380, 170, 226, 113, 372, 370, 121, 246, 430])
genes_2 = GenePool(Decimals=0, Maximum=500, Minimum=0, Value=[30, 132, 93, 465, 125, 139, 407, 87, 332, 95])
item = ListItem(List=move.Geometry, Index=genes, Wrap=True)
item_2 = ListItem(List=popgeo, Index=genes_2, Wrap=True)
ln = Line(StartPoint=item_2, EndPoint=item)

boundary_2 = BoundarySurfaces(Edges=[crv, rectangle.Rectangle])
extr = Extrude(Base=boundary_2, Direction=Z)
bcx = BrepCurve(Brep=extr, Curve=ln)  # -> Curves, Points
lng = ListLength(List=flatten(bcx.Points))
project = Project(Geometry=boundary_2, Plane=PlaneXY(0, 0, 0))  # -> Geometry, Transform

boundary_3 = BoundarySurfaces(Edges=rectangle.Rectangle)
mesh_breps = MeshBrepsKaramba3D(
    Brep=boundary_3,
    InclusionPoints=flatten([item_2, item]),
    MeshResolution=Slider(0.1, range=0.1..0.5),
    EdgeRefinementFactor=0.67,
    PointReduction=False,
    SmoothingStepSize=0,
    SmoothingIterations=5)  # -> Mesh, Info
matselect = MaterialSelectionKaramba3D(menu=[dropdown(2), dropdown(1)])
crosec = CrossSectionKaramba3D(FamilyNameOfCrossSection="DefaultCroSec", Material=matselect, Height_cm=Slider(3, range=0..10), mode="Shell - Const")
mtoshell = MeshToShellKaramba3D(Mesh=mesh_breps.Mesh, CrossSection=crosec, LimitDistance_m=0.005)  # -> Element, Points, Info

dom = ConstructDomain(DomainStart=Slider(1, range=0..1), DomainEnd=Slider(6, range=0..10))
range = Range(Domain=dom, Steps=Slider(9, range=0..10))
crosec_2 = CrossSectionKaramba3D(
    FamilyNameOfCrossSection="DefaultCroSec",
    Material=matselect,
    Diameter_cm=range,
    WallThickness_cm=0.4,
    mode="Circular Hollow")
linetobeam = LineToBeamKaramba3D(
    Line=flatten(ln),
    Identifier=graft("beam"),
    CrossSection=crosec_2,
    New=True,
    Remove=True,
    LimitDistance_m=0.005,
    Bending=True,
    SetBucklingLength=True,
    ToPolylineMaxAngle=0.03,
    ToPolylineTolerance=0.01,
    ToPolylineMaxEdgeLength=0.25)  # -> Element, Points, Info

pt = Point(flatten(linetobeam.Points))
pdecon = Deconstruct(Point=pt)  # -> XComponent, YComponent, ZComponent
# 4
# 5
# 3
# 0
# 2
# 1
number_slider = Slider(0.1, range=0..10)
sort = SortList(Keys=pdecon.ZComponent)  # -> Keys, ValuesA
item_3 = ListItem(List=sort.Keys, Index=0, Wrap=True)
expression = Expression(x=item_3, y=number_slider, Expression="x+y")
smaller = SmallerThan(FirstNumber=pdecon.ZComponent, SecondNumber=expression)  # -> SmallerThan, OrEqualTo
cull = CullPattern(List=pt, CullPattern=smaller.OrEqualTo)
supp = SupportKaramba3D(PosInd=cull, menu=[buttons(on, on, on, off, off, off)])

end = EndPoints(Curve=ln)  # -> Start, End
pt_2 = Point(end.Start)

lng_2 = ListLength(List=mtoshell.Points)
multiplication = Multiplication(A=lng_2, B=Slider(-0.00619, range=-0.1..0))
multiplication_2 = Multiplication(A=multiplication, B=100)
panel_2 = Panel(multiplication_2)
Z_2 = UnitZ(Factor=Slider(0.3, range=0..1))
loads = LoadsKaramba3D(Vector=Vector(0, 0, -1), LCase="LC", mode="Gravity")
loads_2 = LoadsKaramba3D(ForceVector=Z_2, Local=False, PosInd=pt_2, LCase="LC", mode="Point")
load = LoadKaramba3D([loads_2, loads])

assemble = AssembleModelKaramba3D(Elem=flatten([linetobeam.Element, mtoshell.Element]), Support=supp, Load=flatten(load), LimitDistance_m=0.005)  # -> Model, Info, Mass_kg, CentreOfGravity, LoadCaseNames
opticrosec = OptimizeCrossSectionKaramba3D(
    Model=assemble.Model,
    ElemIdentifiers="beam",
    CrossSections=crosec_2,
    MaximumUtilization=1,
    UltimateLimitStateIterations=5,
    DisplacementIterations=5,
    NumberOfSamplePoints=3,
    ElasticDesign=True,
    GammaM0=1,
    GammaM1=1.1,
    SwayFrame=True)  # -> ModelWithOptimizedCrossSections, Info, Mass_kg, MaximumDisplacement_cm, ElasticEnergyChange_kNm

intersection = Number(lng)

modelview = ModelViewKaramba3D(Model=opticrosec.ModelWithOptimizedCrossSections, ResultFactors=1, ResultCase=-1)  # -> Model, DeformedMesh, DeformedAxes, DeformedModel
shellview = ShellViewKaramba3D(Model=modelview.Model, IndexOfLayer=0)  # -> Model, MeshesOfRenderedShells, LegendColours, LegendTags
beamview = BeamViewKaramba3D(Model=modelview.Model)  # -> Model, MeshesOfRenderedBeams, DeformedBeamAxes, LegendColours, LegendTags

utilization = UtilizationOfElementsKaramba3D(
    AnalysedModel=shellview.Model,
    NumberOfSamplePoints=3,
    ElasticDesign=True,
    GammaM0=1,
    GammaM1=1.1,
    SwayFrame=True,
    WithDetails=False,
    mode="Beams")  # -> Model, Utilization, SigMax_kN_cm², SigMin_kN_cm², TauMax_kN_cm², UtilN, UtilVy, UtilVz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
disassemble = DisassembleModelKaramba3D(Model=beamview.Model)  # -> Model, Point, Beam, Shell, Support, Load, Line, Mesh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
len = Length(Curve=disassemble.Line)  # -> expr("ROUND(X,2)", Length)
bnd = Bounds(Numbers=utilization.Utilization)
ma = MassAddition(Input=len)  # -> Result, PartialResults

displacement = Number(opticrosec.MaximumDisplacement_cm)
utilization_2 = Number(bnd)
mass = Number(assemble.Mass_kg)
lenght = Number(ma.Result)
entwine = Entwine(Branch00=displacement, Branch01=mass, Branch02=utilization_2, Branch03=lenght, Branch04=intersection, FlattenInputs=True)

geo = Geometry(flatten([shellview.MeshesOfRenderedShells, beamview.MeshesOfRenderedBeams, project.Geometry]))
wallacei_x = WallaceiX(Genes=[genes, genes_2], Objectives=entwine, Phenotype=geo, popGen="10,20", total="0", wlcDone=False)  # -> WallaceiGenomes, FitnessValues, Data, WPhenotypes
distribute_to_grid = DistributeToGrid(
    FitnessValues=wallacei_x.FitnessValues,
    WallaceiPhenotypes=wallacei_x.WPhenotypes,
    SizeOfTheGridInTheXDirection=Slider(3, range=0..100),
    SizeOfTheGridInTheYDirection=Slider(5, range=0..100),
    SizeOfTheTexts=Slider(0.236, range=0..1),
    OutputOptions=0)  # -> DistributedFitnessValues, DistributedData, DistributedGeometries, DistributedMeshes, DistributedNumbers, GridLocations; disabled
