# Grasshopper definition Karamba_CrossSectionOpter_Beam.gh (Grasshopper 1.0.8)
# plug-ins: Karamba3D, Human, LunchBox

y2 = Slider(1, range=1..15)
# GENERATE GEOMETRY
x3 = Slider(0, range=-5..5)
x2 = Slider(10, range=5..15)
v = Slider(9, range=0..12)
u = Slider(2, range=0..12)
xz = XZPlane(Origin=Point(0, 0, 0))
pt = PointOriented(BasePlane=xz, UComponent=x3, VComponent=y2, WComponent=0)
pt_2 = PointOriented(BasePlane=xz, UComponent=x2, VComponent=y2, WComponent=0)
integer = Integer(u)
integer_2 = Integer(v)
srf4pt = _4PointSurface(CornerA="0,0,0", CornerB=pt, CornerC=pt_2, CornerD="10,0,0")
integer_3 = Integer(integer)
braced_grid_2_d_structure = BracedGrid2DStructure(Surface=srf4pt, UDivisions=expr("x-1", integer), VDivisions=expr("x-1", integer_2))  # -> PrimaryLines, BraceLines, StructureNodes
sdivide = DivideSurface(Surface=srf4pt, UCount=expr("x-1", integer), VCount=expr("x-1", integer_2))  # -> Points, Normals, Parameters
subtraction = Subtraction(A=integer_3, B="1")
pt_3 = Point(flatten(sdivide.Points))
curve = Curve(braced_grid_2_d_structure.BraceLines)
pt_4 = Point(sdivide.Points)
point = Point(simplify(pt_4))
tree_branch = TreeBranch(Tree=point, Path="0", MaintainPaths=True)
curve_2 = Curve(braced_grid_2_d_structure.PrimaryLines)
integer_4 = Integer(subtraction)
# feed your own point if you like,
# and press True
panel = Panel("2")
tree_branch_2 = TreeBranch(Tree=point, Path=integer_4, MaintainPaths=True)
list_length = ListLength(List=pt_3)
integer_5 = Integer(integer_2)
curve_3 = Curve(flatten([curve_2, curve]))
pt_5 = Point()
integer_division = IntegerDivision(A=integer_5, B=panel)
series = Series(Start=0, Step=1, Count=list_length)
point_2 = Point(tree_branch_2)
point_3 = Point(point_2)
list_item = ListItem(List=tree_branch, Index=0, Wrap=True)  # -> Item1, Item
point_4 = Point(point_2)
list_item_2 = ListItem(List=point_3, Index=integer_division, Wrap=True)
integer_6 = Integer(series)
list_item_3 = ListItem(List=point_4, Index=0, Wrap=True)
point_5 = Point(flatten([list_item.Item, list_item.Item1]))
point_6 = Point(list_item_2)
number = Number(Slider(5, range=0..10))
# DEFINE DESIGN
crosec = CrossSectionKaramba3D(
    FamilyNameOfCrossSection="DefaultCroSec",
    Diameter_cm=number,
    WallThickness_cm=expr("x/2", number),
    mode="Circular Hollow")
txt = Text("LC0")
supp = SupportKaramba3D(PosInd=integer_6, menu=[buttons(off, on, off, off, off, off)])
supp_2 = SupportKaramba3D(PosInd=list_item_3, menu=[buttons(on, off, on, off, off, off)])
supp_3 = SupportKaramba3D(PosInd=point_5, menu=[buttons(on, off, on, off, off, off)])
linetobeam = LineToBeamKaramba3D(
    Line=curve_3,
    CrossSection=crosec,
    New=True,
    Remove=True,
    LimitDistance_m=0.005,
    Bending=True,
    SetBucklingLength=True,
    ToPolylineMaxAngle=0.03,
    ToPolylineTolerance=0.01,
    ToPolylineMaxEdgeLength=0.25)  # -> Element, Points, Info
pt_6 = Point(linetobeam.Points)
point_7 = Point(pt_6)
cp = ClosestPoint(Point=pt_5, Cloud=point_7)  # -> ClosestPoint, CPIndex, Distance
filter = StreamFilter(Gate=Toggle(False), Stream0=point_6, Stream1=cp.ClosestPoint)
point_8 = Point(filter)
loads = LoadsKaramba3D(ForceVector="{0,0,-20}", Local=False, PosInd=point_8, LCase=txt, mode="Point")
load = Load(loads)
support = SupportKaramba(flatten([supp_3, supp_2, supp]))
assemble = AssembleModelKaramba3D(Point=pt_3, Elem=linetobeam.Element, Support=support, Load=load, LimitDistance_m=0.005)  # -> Model, Info, Mass_kg, CentreOfGravity, LoadCaseNames
model_karamba3d = ModelKaramba3D(assemble.Model)
number_2 = Number(assemble.Mass_kg)
# Create Cross Sections
number_slider = Slider(1, range=0..10)
number_3 = Number(Slider(10, range=0..10))
integer_7 = Integer(Slider(50, range=0..100))
number_4 = Number(number_slider)
construct_domain = ConstructDomain(DomainStart=number_4, DomainEnd=number_3)
range = Range(Domain=construct_domain, Steps=integer_7)
number_5 = Number(range)
concatenate = Concatenate(FragmentA="circle_solid_", FragmentB=number_5)
number_6 = Number(number_5)
crosec_2 = CrossSectionKaramba3D(
    FamilyNameOfCrossSection="DefaultCroSec",
    NameOfCrossSection=concatenate,
    Diameter_cm=number_6,
    WallThickness_cm=expr("x/2", number_6),
    mode="Circular Hollow")
# DEFINE
number_slider_2 = Slider(0.9, range=0..1)
# OPTIMISE
# Cross Section Optimisation
model_karamba3d_2 = ModelKaramba3D(model_karamba3d)
cross_sections = CrossSections(crosec_2)
txt_2 = Text(txt)
num = Number(number_slider_2)
opticrosec = OptimizeCrossSectionKaramba3D(
    Model=model_karamba3d_2,
    CrossSections=cross_sections,
    MaximumUtilization=num,
    LoadCasesUtil=txt_2,
    MaximumDisplacement_cm=-1,
    MaximumVirtualWork_kNcm=0.01,
    NumberOfUtilizationIterations=5,
    NumberOfDisplacementIterations=5,
    NumberOfDisplacementIncrementsPerIteration=2,
    DisplacementTolerance=0.01,
    NumberOfSamplePoints=3,
    ElasticDesign=True,
    GammaM0=1,
    GammaM1=1.1,
    SwayFrame=True)  # -> OptimizedModel, Info, Mass_kg, MaximumDisplacement_cm, ElasticEnergyChange_kNm, MaximumUtilizationViewInsufficientCrossSections, MaximumDisplacementViewLimitCrossSections
model_karamba3d_3 = ModelKaramba3D(opticrosec.OptimizedModel)
# Visualise Opitimised Cross Sections
disassemble = DisassembleModelKaramba3D(Model=model_karamba3d_3)  # -> Model, Point, Beam, Shell, Support, Load, Line, Mesh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
# VISUALISE
disassemble_2 = DisassembleElementKaramba3D(Element=disassemble.Beam)  # -> Element, ElementIdentifier, AxisOfElement, CrossSection, Joint, Material, LocalCoordinateSystem, ElementIsActive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
disassemble_3 = DisassembleCrossSectionKaramba3D(CroSec=disassemble_2.CrossSection)  # -> CrossSection, FamilyNameOfCrossSection, TypeNameOfCrossSection, ElemIdentifiers, Colour, Material, LocalEccentricity_cm, Heights_cm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
number_7 = Number(disassemble_3.Area_cm²)
curve_4 = Curve(disassemble_2.AxisOfElement)
multiplication = Multiplication(A=number_7, B=Slider(2, range=0..10))
model_karamba3d_4 = ModelKaramba3D(model_karamba3d_3)
custom_preview_lineweights = CustomPreviewLineweights(Geometry=curve_4, Shader=ColourSwatch(SwatchColor=RGB(0, 0, 0)), Thickness=multiplication, Absolute=False)
utilization = UtilizationOfElementsKaramba3D(
    AnalysedModel=model_karamba3d_4,
    NumberOfSamplePoints=3,
    ElasticDesign=True,
    GammaM0=1,
    GammaM1=1.1,
    SwayFrame=True,
    WithDetails=False,
    mode="Beams")  # -> Model, Utilization, SigMax_kN_cm², SigMin_kN_cm², TauMax_kN_cm², UtilN, UtilVy, UtilVz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
model = ModelKaramba3D(model_karamba3d_3)
modelview = ModelViewKaramba3D(Model=model)  # -> Model, DeformedMesh, DeformedAxes, DeformedModel, MaximumDeformation
num_2 = Number(flatten(utilization.Utilization))
modelview_2 = ModelViewKaramba3D(Model=model, ResultFactors=1, ResultCase=-1)  # -> Model, DeformedMesh, DeformedAxes, DeformedModel
sort_list = SortList(Keys=num_2)  # -> Keys, ValuesValuesA
beamview = BeamViewKaramba3D(Model=modelview_2.Model)  # -> Model, MeshesOfRenderedBeams, DeformedBeamAxes, LegendColours, LegendTags
list_item_4 = ListItem(List=sort_list.Keys, Index=0, Wrap=True)  # -> Item1, Item
# Final Performance
number_8 = Number(opticrosec.Mass_kg)
number_9 = Number(number_2)
# Always Make Sure No Elements Are Failing!!
panel_2 = Panel(sort_list.ValuesValuesA)
mass_before = Panel(number_9)
optimised_mass = Panel(number_8)
number_10 = Number(list_item_4.Item)
number_11 = Number(list_item_4.Item1)
larger_than = LargerThan(FirstNumber=number_11, SecondNumber="1")  # -> LargerThan, OrEqualTo
panel_3 = Panel(sort_list.Keys)
failing = Panel(larger_than.LargerThan)
max_utilisation = Panel(number_11)
min_utilisation = Panel(number_10)
