# Grasshopper definition Karamba_CrossSectionOpter_Shell.gh (Grasshopper 1.0.7)
# plug-ins: Karamba3D

# ---- group: Define Materials
matselect = MaterialSelectionKaramba3D(menu=[dropdown(9), dropdown(19)])

# ---- group: define cross sections
range = Range(Domain="2 to 50", Steps=20)
expression = Expression(x="Shell", y=range, Expression="x&\" \"&y")
cross_section = CrossSectionKaramba3D(
    FamilyNameOfCrossSection="Shell",
    NameOfCrossSection=simplify(graft(expression)),
    Material=matselect,
    Height_cm=simplify(graft(range)),
    mode="Shell - Const")  # -> flatten(CrossSection)
crosecselect = CrossSectionSelectorKaramba3D(CrossSections=cross_section, ElementsIdentifiers="S")  # -> CrossSection, Info

# ---- group: Create Geometry
# Note: With Modifications to Original Karamba's Example File
pt = Point([Point(-30.29866546, -3.508493978, 0), Point(-30.29866546, -1.169497993, 0), Point(-30.29866546, 1.169497993, 0), Point(-30.29866546, 3.508493978, 0), Point(-19.80304532, -5.223412372, 3.46494229), Point(-19.80304532, -3.301380148, 0.2402272391)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])
res = Slider(1.5, range=0.5..6)
panel = Panel("""{0,0,0}
{0.125,0.25,0}
{0.25,0.5,0}
{0.375,0.75,0}
{0.5,1,0}
{0.625,1,0}
{0.75,1,0}
{0.875,1,0}
{1,1,0}""")
srfgrid = SurfaceFromPoints(Points=pt, UCount="6", Interpolate=False)
# 02 - Shell Cross Section Optimization
# Difficulty: Simple (TRIAL/PRO versions only)
# The cross sections of a concrete shell bridge with an arc form are optimized. A mesh load runs along the center of the bridge. Custom colours can be plugged into the ModelViewer for the mesh preview.
# To view in the TRIAL version, set the Mesh Resolution to 6 and the Edge Refinement Factor to 1.
mesh_breps = MeshBreps(
    Brep=srfgrid,
    MeshResolution=res,
    EdgeRefinementFactor=0.67,
    PointReduction=True,
    SmoothingStepSize=0.8,
    SmoothingIterations=5)  # -> Mesh, Info
iso = IsoCurve(Surface=reparameterize(srfgrid), UVPoint=panel)  # -> UIsocurve, VIsocurve

# ---- group: Define Loads
dom²num = ConstructDomain²(UMin="0", UMax="1", VMin="0.25", VMax="0.75")
subsrf = Isotrim(Surface=reparameterize(srfgrid), Domain=dom²num)
Z = UnitZ(Factor="-5")
mesh_breps_2 = MeshBreps(
    Brep=subsrf,
    MeshResolution=0.5,
    EdgeRefinementFactor=0.67,
    PointReduction=False,
    SmoothingStepSize=0,
    SmoothingIterations=5)  # -> Mesh, Info
loads = LoadsKaramba3D(Vector=Vector(0, 0, -1), LCase="0", mode="Gravity")
loads_2 = LoadsKaramba3D(Vector=Z, Mesh=mesh_breps_2.Mesh, LCase="0", mode="MeshLoad -Const.", menu=[buttons(on, off, off), buttons(on, on)])
load = LoadKaramba3D(flatten([loads, loads_2]))

# ---- group: Define Elements
meshtoshell = MeshToShellKaramba3D(Mesh=mesh_breps.Mesh, Identifier="S", CrossSection=crosecselect.CrossSection, LimitDistance_m=0.005)  # -> Element, Points, Info

# ---- group: Define Supports
panel_2 = Panel("""{1,0,0}
{1,1,0}""")
panel_3 = Panel("""{0,0,0}
{0,1,0}""")
evalsrf = EvaluateSurface(Surface=reparameterize(srfgrid), Point=panel_2)  # -> Point, Normal, UDirection, VDirection, Frame
evalsrf_2 = EvaluateSurface(Surface=reparameterize(srfgrid), Point=panel_3)  # -> Point, Normal, UDirection, VDirection, Frame
pline = PolyLine(Vertices=evalsrf.Point, Closed=False)
pline_2 = PolyLine(Vertices=evalsrf_2.Point, Closed=False)
pt_2 = Point(meshtoshell.Points)
pt_3 = Point(meshtoshell.Points)
pull = PullPoint(Point=pt_2, Geometry=pline, ClosestOnly=True)  # -> ClosestPoint, Distance
pull_2 = PullPoint(Point=pt_3, Geometry=pline_2, ClosestOnly=True)  # -> ClosestPoint, Distance
smaller = SmallerThan(FirstNumber=pull.Distance, SecondNumber=0.01)  # -> SmallerThan, OrEqualTo
smaller_2 = SmallerThan(FirstNumber=pull_2.Distance, SecondNumber=0.01)  # -> SmallerThan, OrEqualTo
cull = CullPattern(List=pt_2, CullPattern=smaller.SmallerThan)
cull_2 = CullPattern(List=pt_3, CullPattern=smaller_2.SmallerThan)
supp = SupportKaramba3D(PosInd=cull, menu=[buttons(on, on, on, off, off, off)])
supp_2 = SupportKaramba3D(PosInd=cull_2, menu=[buttons(on, on, on, off, off, off)])

# ---- group: Create Geometry (continued)
item = ListItem(List=[evalsrf.Point, evalsrf_2.Point], Index=0, Wrap=True)  # -> Item, Item1, Item2, Item3
aligndim = AlignedDimension(
    Plane=PlaneXY(0, 0, 0),
    PointA=[item.Item, item.Item2],
    PointB=[item.Item2, item.Item3],
    Offset=Slider(4.2, range=0..10),
    Text="{0:0.00}",
    Size=Slider(0.7, range=0..1))

# ---- group: Assemble Model
assemble = AssembleModelKaramba3D(Elem=flatten(meshtoshell.Element), Support=flatten([supp, supp_2]), Load=flatten(load), LimitDistance_m=0.005)  # -> Model, Info, Mass_kg, CenterOfGravity, LoadCaseNames

# ---- group: Optimize Cross Sections
opticrosec = OptimizeCrossSectionKaramba3D(
    Model=assemble.Model,
    CrossSections=cross_section,
    MaximumUtilization=1,
    MaximumDisplacement_cm="1",
    UltimateLimitStateIterations=5,
    DisplacementIterations=5,
    NumberOfSamplePoints=3,
    ElasticDesign=True,
    GammaM0=1,
    GammaM1=1.1,
    SwayFrame=True)  # -> ModelWithOptimizedCrossSections, Info, Mass_kg, MaximumDisplacement_cm, ElasticEnergy_kNm
panel_4 = Panel(opticrosec.MaximumDisplacement_cm)

# ---- group: Analyze Model - FREE VERSION
analyzethii = AnalyzeThIIKaramba3D(Model=opticrosec.ModelWithOptimizedCrossSections, RTolerance=1e-07, MaxIterations=50, NoTensionalNII=False)  # -> CalculatedModel, MaximumDisplacement_cm, ResultingForceOfGravity_kN, ElasticEnergy_kNm; disabled
panel_5 = Panel(analyzethii.MaximumDisplacement_cm)  # disabled

# ---- group: View Results
modelview = ModelViewKaramba3D(Model=opticrosec.ModelWithOptimizedCrossSections, ResultFactors=1, ResultCase=-1)  # -> Model, DeformedMesh, DeformedAxes, DeformedModel
shellview = ShellViewKaramba3D(Model=modelview.Model, IndexOfLayer=0)  # -> Model, MeshesOfRenderedShells, LegendColors, LegendTags
legend = Legend(Colour=shellview.LegendColors, Tags=shellview.LegendTags, LegendType=1)
