# Grasshopper definition 20241029_Funicular FormFinding.gh (Grasshopper 1.0.7)
# plug-ins: Kangaroo2 Components, LunchBox, Karamba3D

# ---- group: surface
srf = Surface(<surface referenced from the Rhino model>)

srf_2 = Surface(<surface referenced from the Rhino model>)

# ----
# Funicular Net
# shear stiff (triangulated)
# with point supports
number_slider = Slider(20, range=0..100)
# Funicular Net
# shear stiff (triangulated)
# with point supports
number_slider_2 = Slider(20, range=0..100)
multiplication = Multiplication(A=number_slider, B=Slider(1, range=1..10))
multiplication_2 = Multiplication(A=number_slider_2, B=Slider(2, range=1..10))
diagrid = DiagridStructure(Surface=srf, UDivisions=number_slider, VDivisions=multiplication, Type=True)  # -> StructureLines, StructureNodes
diagrid_2 = DiagridStructure(Surface=srf, UDivisions=multiplication, VDivisions=number_slider, Type=False)  # -> StructureLines, StructureNodes
edges = BrepEdges(Brep=srf)  # -> Naked, Interior, NonManifold
diagrid_3 = DiagridStructure(Surface=srf_2, UDivisions=multiplication_2, VDivisions=number_slider_2, Type=True)  # -> StructureLines, StructureNodes
diagrid_4 = DiagridStructure(Surface=srf_2, UDivisions=multiplication_2, VDivisions=number_slider_2, Type=False)  # -> StructureLines, StructureNodes
sdivide = DivideSurface(Surface=srf, UCount=multiplication, VCount=number_slider)  # -> Points, Normals, Parameters
edges_2 = BrepEdges(Brep=srf_2)  # -> Naked, Interior, NonManifold
sdivide_2 = DivideSurface(Surface=srf_2, UCount=multiplication_2, VCount=number_slider_2)  # -> Points, Normals, Parameters
join = JoinCurves(Curves=edges_2.Naked, Preserve=False)
join_2 = JoinCurves(Curves=edges.Naked, Preserve=False)
flip = FlipMatrix(Data=sdivide.Points)
flip_2 = FlipMatrix(Data=sdivide_2.Points)
# Funicular Net
# with point supports
crv = Curve([<curve referenced from the Rhino model> x42])
pt = Point([<point referenced from the Rhino model> x4])
# Funicular Net
# diagonal with point supports
crv_2 = Curve([<curve referenced from the Rhino model> x38])
# Funicular Net
# diagonal with edge supports
crv_3 = Curve([<curve referenced from the Rhino model> x38])
# Funicular Net
# with edge supports
crv_4 = Curve([<curve referenced from the Rhino model> x38])
pt_2 = Point([<point referenced from the Rhino model> x4])
crv_5 = Curve([<curve referenced from the Rhino model> x4])

# ---- group: single load
crv_6 = Curve(<curve referenced from the Rhino model>)

# ----
crv_7 = Curve([<curve referenced from the Rhino model> x4])

pline = PolyLine(Vertices=sdivide.Points, Closed=False)  # -> flatten(Polyline)
pline_2 = PolyLine(Vertices=flip, Closed=False)  # -> flatten(Polyline)
cp = ControlPoints(Curve=join_2)  # -> Points, Weights, Knots
crv_8 = Curve([diagrid.StructureLines, diagrid_2.StructureLines])

pline_3 = PolyLine(Vertices=sdivide_2.Points, Closed=False)  # -> flatten(Polyline)
pline_4 = PolyLine(Vertices=flip_2, Closed=False)  # -> flatten(Polyline)
cp_2 = ControlPoints(Curve=join)  # -> Points, Weights, Knots
crv_9 = Curve([diagrid_3.StructureLines, diagrid_4.StructureLines])

# ----
# Catenaries
crv_10 = Curve([<curve referenced from the Rhino model> x2])
crv_11 = Curve([<curve referenced from the Rhino model> x19])
pt_3 = Point([<point referenced from the Rhino model> x4])
crv_12 = Curve(<curve referenced from the Rhino model>)
# Input Geometry
# Catenary
crv_13 = Curve(<curve referenced from the Rhino model>)
cp_3 = ControlPoints(Curve=crv_5)  # -> Points, Weights, Knots
cp_4 = ControlPoints(Curve=crv_7)  # -> Points, Weights, Knots
pt_4 = Point(flatten(cp_3.Points))
pt_5 = Point(flatten(cp_4.Points))
explode = Explode(Curve=pline, Recursive=True)  # -> Segments, Vertices
explode_2 = Explode(Curve=pline_2, Recursive=True)  # -> Segments, Vertices
explode_3 = Explode(Curve=pline_3, Recursive=True)  # -> Segments, Vertices
explode_4 = Explode(Curve=pline_4, Recursive=True)  # -> Segments, Vertices
cluster = Cluster(pt=explode_2.Vertices)  # -> flatten(pt_7), flatten(pt_8), flatten(pt_6)
cluster_2 = Cluster(pt=explode_4.Vertices)  # -> flatten(pt_7), flatten(pt_8), flatten(pt_6)
explode_5 = Explode(Curve=crv, Recursive=True)  # -> flatten(Segments), Vertices
explode_6 = Explode(Curve=crv_2, Recursive=True)  # -> flatten(Segments), Vertices
explode_7 = Explode(Curve=crv_3, Recursive=True)  # -> flatten(Segments), Vertices
explode_8 = Explode(Curve=crv_4, Recursive=True)  # -> flatten(Segments), Vertices
pt_6 = Point([<point referenced from the Rhino model> x5])
pt_7 = Point(cp.Points)
pt_8 = Point(cluster.pt_8)
pt_9 = Point(cluster.pt_6)
pt_10 = Point(cluster.pt_7)
pt_11 = Point(cluster_2.pt_8)
pt_12 = Point(cluster_2.pt_6)
pt_13 = Point(cluster_2.pt_7)
crv_14 = Curve(flatten([explode.Segments, explode_2.Segments]))
crv_15 = Curve(flatten([explode_3.Segments, explode_4.Segments]))
explode_9 = Explode(Curve=crv_11, Recursive=True)  # -> Segments, Vertices
explode_10 = Explode(Curve=crv_10, Recursive=True)  # -> Segments, Vertices
# GRAVITY
# Define Goals
explode_11 = Explode(Curve=crv_13, Recursive=True)  # -> Segments, Vertices
end = EndPoints(Curve=crv_13)  # -> Start, End
end_2 = EndPoints(Curve=crv_12)  # -> Start, End
pt_14 = Point(explode_5.Vertices)
end_3 = EndPoints(Curve=crv_6)  # -> Start, End
vec2pt = Vector2Pt(PointA=end_2.Start, PointB=end_2.End, Unitize=False)  # -> Vector, Length
vec2pt_2 = Vector2Pt(PointA=end_3.Start, PointB=end_3.End, Unitize=False)  # -> Vector, Length
number_slider_3 = Slider(1, range=0..1)
number_slider_4 = Slider(1, range=0..1)
number_slider_5 = Slider(0.9, range=0..10)
number_slider_6 = Slider(1.7, range=0..10)

Z = UnitZ(Factor=Slider(0.1, range=0..1))
length_line = LengthLine(Line=explode_5.Segments, Length=Slider(0.5, range=0..1), Strength=Slider(100, range=0..100))
anchor = Anchor(Point=pt, Strength=10000)
load = Load(Point=pt_14, ForceVector=Z)
show = Show(G=crv)

number_slider_7 = Slider(0.5, range=0..1)

# ---- group: Goals
Z_2 = UnitZ(Factor=Slider(0.5, range=0..1))
anchor_2 = Anchor(Point=pt_3, Strength=10000)
length_line_2 = LengthLine(Line=explode_9.Segments, Length=number_slider_7, Strength=Slider(100, range=0..100))
load_2 = Load(Point=explode_9.Vertices, ForceVector=Z_2)
show_2 = Show(G=crv_10)

Z_3 = UnitZ(Factor=Slider(1, range=0..1))
anchor_3 = Anchor(Point=[end.Start, end.End], Strength=10000)
length_line_3 = LengthLine(Line=explode_11.Segments, Length=Slider(0.5, range=0..1), Strength=Slider(100, range=0..100))
load_3 = Load(Point=explode_11.Vertices, ForceVector=Z_3)
show_3 = Show(G=crv_13)

# ----
len = Length(Curve=crv_14)
len_2 = Length(Curve=crv_15)
len_3 = Length(Curve=crv_8)
len_4 = Length(Curve=crv_9)
multiplication_3 = Multiplication(A=vec2pt.Vector, B=Slider(0, range=0..1))
Z_4 = UnitZ(Factor=Slider(0.3, range=0..1))
Z_5 = UnitZ(Factor=Slider(0.3, range=0..1))
Z_6 = UnitZ(Factor=Slider(0.3, range=0..1))
multiplication_4 = Multiplication(A=vec2pt_2.Vector, B=Slider(0, range=0..100))
multiplication_5 = Multiplication(A=len, B=number_slider_3)
multiplication_6 = Multiplication(A=len_3, B=number_slider_3)
multiplication_7 = Multiplication(A=len_2, B=number_slider_4)
multiplication_8 = Multiplication(A=len_4, B=number_slider_4)
multiplication_9 = Multiplication(A=number_slider_5, B=Slider(1, range=0..1))
multiplication_10 = Multiplication(A=number_slider_6, B=Slider(0.5, range=0..1))
anchor_4 = Anchor(Point=pt_2, Strength=10000)
anchor_5 = Anchor(Point=pt_4, Strength=10000)
length_line_4 = LengthLine(Line=explode_10.Segments, Length=number_slider_7, Strength=Slider(100, range=0..100))
anchor_6 = Anchor(Point=pt_5, Strength=10000)
length_line_5 = LengthLine(Line=explode_6.Segments, Length=Slider(0.5, range=0..1), Strength=Slider(83, range=0..100))
length_line_6 = LengthLine(Line=explode_7.Segments, Length=Slider(0.7, range=0..1), Strength=Slider(100, range=0..100))
length_line_7 = LengthLine(Line=explode_8.Segments, Length=Slider(0.5, range=0..1), Strength=Slider(100, range=0..100))
anchor_7 = Anchor(Point=pt_6, Strength=10000)
length_line_8 = LengthLine(Line=crv_14, Length=multiplication_5, Strength=Slider(100, range=0..100))
load_4 = Load(Point=explode_6.Vertices, ForceVector=Z_4)
length_line_9 = LengthLine(Line=crv_8, Length=multiplication_6, Strength=Slider(100, range=0..100))
load_5 = Load(Point=explode_7.Vertices, ForceVector=Z_5)
anchor_8 = Anchor(Point=pt_7, Strength=10000)
load_6 = Load(Point=explode_8.Vertices, ForceVector=Z_6)
load_7 = Load(Point=end_2.Start, ForceVector=multiplication_3)
show_4 = Show(G=crv_2)
show_5 = Show(G=crv_3)
show_6 = Show(G=crv_11)
show_7 = Show(G=crv_8)
length_line_10 = LengthLine(Line=crv_15, Length=multiplication_7, Strength=Slider(100, range=0..100))
length_line_11 = LengthLine(Line=crv_9, Length=multiplication_8, Strength=Slider(100, range=0..100))
show_8 = Show(G=crv_4)
show_9 = Show(G=pline_2)
load_8 = Load(Point=end_3.Start, ForceVector=multiplication_4)
show_10 = Show(G=pline)
load_9 = Load(Point=pt_10, ForceVector=Vector(0, 0, 1), Weighting=number_slider_5)
anchorxyz = AnchorXYZ(Point=[pt_11, pt_12], X=Toggle(True), Y=Toggle(True), Z=Toggle(False), Strength=1000)
show_11 = Show(G=crv_9)
show_12 = Show(G=pline_4)
load_10 = Load(Point=[pt_8, pt_9], ForceVector=Vector(0, 0, 1), Weighting=multiplication_9)
show_13 = Show(G=pline_3)
load_11 = Load(Point=[pt_11, pt_12], ForceVector=Vector(0, 0, 1), Weighting=multiplication_10)
load_12 = Load(Point=pt_13, ForceVector=Vector(0, 0, 1), Weighting=number_slider_6)
entwine = Entwine(Branch00=show, Branch01=length_line, Branch02=anchor, Branch03=load, Branch04=load_8, FlattenInputs=True)
merge = Merge(Data1=show_4, Data2=length_line_5, Data3=load_4, Data4=anchor_4)  # -> flatten(Result)
merge_2 = Merge(Data1=show_5, Data2=length_line_6, Data3=load_5, Data4=anchor_5)  # -> flatten(Result)
entwine_2 = Entwine(
    Branch00=show_2,
    Branch01=show_6,
    Branch02=length_line_4,
    Branch03=length_line_2,
    Branch04=anchor_2,
    Branch05=load_2,
    FlattenInputs=True)
merge_3 = Merge(Data1=show_8, Data2=length_line_7, Data3=load_6, Data4=anchor_6)  # -> flatten(Result)
# Run FormFinding
entwine_3 = Entwine(Branch00=show_3, Branch01=length_line_3, Branch02=anchor_3, Branch03=load_3, Branch04=load_7, FlattenInputs=True)
entwine_4 = Entwine(
    Branch00=show_10,
    Branch01=show_9,
    Branch02=show_7,
    Branch03=length_line_8,
    Branch04=length_line_9,
    Branch05=load_9,
    Branch06=load_10,
    Branch07=anchor_8,
    FlattenInputs=True)
entwine_5 = Entwine(
    Branch00=show_13,
    Branch01=show_12,
    Branch02=show_11,
    Branch03=length_line_10,
    Branch04=length_line_11,
    Branch05=load_12,
    Branch06=load_11,
    Branch07=anchorxyz,
    Branch08=anchor_7,
    FlattenInputs=True)
solver = Solver(GoalObjects=entwine_4, Reset=Button(), Threshold=1e-15, Tolerance=Slider(0.0001, range=0..0.0001), On=Toggle(False))  # -> I, V, O
solver_2 = Solver(GoalObjects=entwine_5, Reset=Button(), Threshold=1e-15, Tolerance=Slider(0.0001, range=0..0.0001), On=Toggle(False))  # -> I, V, O
solver_3 = Solver(GoalObjects=merge, Reset=Button(), Threshold=1e-15, Tolerance=0.01, On=Toggle(False))  # -> I, V, O
solver_4 = Solver(GoalObjects=entwine, Reset=Button(), Threshold=1e-15, Tolerance=0.01, On=Toggle(False))  # -> I, V, O
solver_5 = Solver(GoalObjects=merge_2, Reset=Button(), Threshold=1e-15, Tolerance=0.01, On=Toggle(False))  # -> I, V, O
solver_6 = Solver(GoalObjects=merge_3, Reset=Button(), Threshold=1e-15, Tolerance=0.01, On=Toggle(False))  # -> I, V, O
solver_7 = Solver(GoalObjects=entwine_2, Reset=Button(), Threshold=1e-15, Tolerance=0.01, On=Toggle(False))  # -> I, V, O
solver_8 = Solver(GoalObjects=entwine_3, Reset=Button(), Threshold=1e-15, Tolerance=0.01, On=Toggle(False))  # -> I, V, O
unflatten = UnflattenTree(Tree=solver.O, Guide=entwine_4)
bang = ExplodeTree(Data=solver_2.O)  # -> Branch0, Branch1, Branch2, Branch3, Branch4, Branch5, Branch6, Branch7, Branch8
bang_2 = ExplodeTree(Data=solver_7.O)  # -> Branch0, Branch1, Branch2, Branch3, Branch4, Branch5
bang_3 = ExplodeTree(Data=solver_4.O)  # -> Branch0, Branch1, Branch2, Branch3, Branch4
# Result
bang_4 = ExplodeTree(Data=solver_8.O)  # -> Branch0, Branch1, Branch2, Branch3, Branch4
panel = Panel(solver_3.O)
panel_2 = Panel(solver_5.O)
panel_3 = Panel(solver_6.O)
bang_5 = ExplodeTree(Data=unflatten)  # -> Branch0, Branch1, Branch2, Branch3, Branch4, Branch5, Branch6, Branch7
lng = ListLength(List=show_4)
lng_2 = ListLength(List=show_5)
lng_3 = ListLength(List=show_8)
split = SplitList(List=solver_3.O, Index=lng)  # -> ListA, ListB
split_2 = SplitList(List=solver_5.O, Index=lng_2)  # -> ListA, ListB
split_3 = SplitList(List=solver_6.O, Index=lng_3)  # -> ListA, ListB
crv_16 = Curve(bang.Branch0)
crv_17 = Curve(bang.Branch1)
crv_18 = Curve(bang.Branch2)
crv_19 = Curve(bang.Branch3)
crv_20 = Curve(bang.Branch4)
crv_21 = Curve(bang_3.Branch0)
cp_5 = ControlPoints(Curve=crv_16)  # -> Points, Weights, Knots
crv_22 = Curve([crv_18, crv_17, crv_16])

# ---- group: Create circular beams
pipe = Pipe(Curve=crv_22, Radius=Slider(0.03, range=0..0.1), Caps=2)

# ----
nurbs = NurbsCurve(Vertices=cp_5.Points, Degree=3, Periodic=False)  # -> flatten(Curve), Length, Domain
loft = Loft(Curves=nurbs.Curve, Options={Adjust=False, Closed=False, LoftEnds=0, LoftSimp=0, LoftType=1, Rebuild=10, Refit=0.01})
crv_23 = Curve(bang_2.Branch1)
crv_24 = Curve(bang_2.Branch0)
crv_25 = Curve(split.ListA)
crv_26 = Curve(split_2.ListA)
crv_27 = Curve(split_3.ListA)
crv_28 = Curve(bang_4.Branch0)
crv_29 = Curve()
crv_30 = Curve(bang_5.Branch0)
crv_31 = Curve(bang_5.Branch1)
crv_32 = Curve(bang_5.Branch2)
crv_33 = Curve(bang_5.Branch3)
crv_34 = Curve(bang_5.Branch4)
loft_2 = Loft(Curves=nurbs.Curve, Options={Adjust=False, Closed=False, LoftEnds=0, LoftSimp=0, LoftType=0, Rebuild=10, Refit=0.01})

# ---- group: Create circular beams
pipe_2 = Pipe(Curve=crv_29, Radius=Slider(0.05, range=0..0.1), Caps=2)

# ----
cp_6 = ControlPoints(Curve=crv_30)  # -> Points, Weights, Knots
nurbs_2 = NurbsCurve(Vertices=cp_6.Points, Degree=3, Periodic=False)  # -> flatten(Curve), Length, Domain
loft_3 = Loft(Curves=nurbs_2.Curve, Options={Adjust=False, Closed=False, LoftEnds=0, LoftSimp=0, LoftType=1, Rebuild=10, Refit=0.01})

# ---- group: Polylines to Lines
explode_12 = Explode(Recursive=True)  # -> Segments, Vertices
line = Line(explode_12.Segments)  # disabled

# ----
end_points = EndPoints(Curve=line)  # -> Start, End
point = Point(flatten([end_points.Start, end_points.End]))

# ---- group: Find suport points
deconstruct = Deconstruct(Point=flatten(point))  # -> XComponent, YComponent, ZComponent
smaller_than = SmallerThan(FirstNumber=deconstruct.ZComponent, SecondNumber=Slider(0.1, range=0..0.1))  # -> SmallerThan, OrEqualTo

# ----
removeduplicatepts = RemoveDuplicatePts(Points=point, Tolerance=0.01)
dispatch = Dispatch(List=point, DispatchPattern=smaller_than.SmallerThan)  # -> ListA, ListB

# ---- group: Input surfaces
brep = Brep([<brep referenced from the Rhino model> x3])

# ---- group: SUPPORTS
pt_15 = Point(dispatch.ListA)

# ----
pt_16 = Point(removeduplicatepts)

# ---- group: BEAMS
matselect = MaterialSelectionKaramba3D(menu=[dropdown(1), dropdown(2)])
cross_section = CrossSectionKaramba3D(
    FamilyNameOfCrossSection="DefaultCroSec",
    Material=matselect,
    Diameter_cm=Slider(4, range=0..100),
    WallThickness_cm=Slider(2, range=0..10),
    mode="Circular Hollow")
linetobeam = LineToBeamKaramba3D(
    Line=line,
    CrossSection=cross_section,
    New=True,
    Remove=True,
    LimitDistance_m=0.005,
    Bending=Toggle(True),
    SetBucklingLength=True,
    ToPolylineMaxAngle=0.03,
    ToPolylineTolerance=0.01,
    ToPolylineMaxEdgeLength=0.25)  # -> Element, Points, Info
orientate = OrientateElemKaramba3D(Beam=linetobeam.Element, mode="Beam")
element = ElementKaramba3D(flatten(orientate))

# ---- group: Reference Geometry
# Set the mesh uv count to 7 (49 faces) for the trial version of Karamba3D
# (may result in inaccurate results due to the low mesh resolution)
# 
# To apply to a new model: right-click and set a new surface
brep_2 = Brep(brep)
mesh_uv = MeshSurface(Surface=brep_2, UCount=Slider(50, range=0..100), VCount=Slider(25, range=0..100), Overhang=True, Equalize=False)

# ---- group: LOADS
vec = VectorXYZ(XComponent=0, YComponent=0, ZComponent="-10")  # -> Vector, Length
loads = LoadsKaramba3D(ForceVector=vec.Vector, Local=False, PosInd=pt_16, LCase="0", mode="Point")
loads_2 = LoadsKaramba3D(Vector=Vector(0, 0, -1), LCase="0", mode="Gravity")
load_13 = LoadKaramba3D(flatten(loads_2))

# ---- group: Define Cross Sections
cross_section_2 = CrossSectionKaramba3D(
    FamilyNameOfCrossSection="DefaultCroSec",
    Material=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,
    Height_cm=Slider(4, range=0..10),
    mode="Shell - Const")

# ---- group: SUPPORTS
supp = SupportKaramba3D(PosInd=pt_15, menu=[buttons(on, on, on, on, on, on)])
support = SupportKaramba3D(flatten(supp))

# ---- group: Define Elements
meshtoshell = MeshToShellKaramba3D(Mesh=mesh_uv, Identifier="shell", CrossSection=cross_section_2, LimitDistance_m=0.005)  # -> Element, Points, Info
rdpoints = RemoveDuplicatePointsKaramba(Point=meshtoshell.Points, LDist=0.005)  # -> OutPoint, Info, Indexes
points = PointList(Points=rdpoints.OutPoint, Size=Slider(0.116, range=0..1))

# ----
point_2 = Point(flatten(rdpoints.OutPoint))

# ---- group: Find suport points
number_slider_8 = Slider(0.1, range=0..0.1)
deconstruct_2 = Deconstruct(Point=flatten(point_2))  # -> XComponent, YComponent, ZComponent
smaller_than_2 = SmallerThan(FirstNumber=deconstruct_2.ZComponent, SecondNumber=Slider(0.7, range=0..1))  # -> SmallerThan, OrEqualTo

# ----
dispatch_2 = Dispatch(List=point_2, DispatchPattern=smaller_than_2.SmallerThan)  # -> ListA, ListB
panel_4 = Panel(dispatch_2.ListA)

# ---- group: SUPPORTS
pt_17 = Point(dispatch_2.ListA)

# ---- group: Define Supports / LOWEST Z supports
supp_2 = SupportKaramba3D(PosInd=pt_17, menu=[buttons(on, on, on, off, off, off)])

# ---- group: Define Loads
Z_7 = UnitZ(Factor="-1")
loads_3 = LoadsKaramba3D(Vector=Z_7, LCase="0", mode="Gravity")

# ---- group: Define Supports
# ALTERNATE support input between
# points on the bottom (lowest z value) - FALSE and
# either end (extreme x values) - TRUE of the shell
toggle = BooleanToggle(False)
filter = StreamFilter(Gate=toggle, Stream0=supp_2)

# ----
assemble = AssembleModelKaramba3D(Elem=element, Support=support, Load=load_13, LimitDistance_m=0.005)  # -> Model, Info, Mass_kg, CenterOfGravity, LoadCaseNames

# ---- group: Assemble Model
assemble_2 = AssembleModelKaramba3D(Elem=meshtoshell.Element, Support=filter, Load=loads_3, LimitDistance_m=0.005)  # -> Model, Info, Mass_kg, CenterOfGravity, LoadCaseNames

# ----
analyze = AnalyzeKaramba3D(Model=assemble.Model)  # -> CalculatedModel, MaximumDisplacement_cm, ResultingForceOfGravity_kN, ElasticEnergy_kNm
panel_5 = Panel(analyze.MaximumDisplacement_cm)

# ---- group: Analyze Model
analyze_2 = AnalyzeKaramba3D(Model=assemble_2.Model)  # -> CalculatedModel, MaximumDisplacement_cm, ResultingForceOfGravity_kN, ElasticEnergy_kNm
displacement = Panel(analyze_2.MaximumDisplacement_cm)

# ----
modelview = ModelViewKaramba3D(Model=analyze.CalculatedModel, ResultFactors=1, ResultCase=-1)  # -> Model, DeformedMesh, DeformedAxes, DeformedModel

# ---- group: View Results
modelview_2 = ModelViewKaramba3D(Model=analyze_2.CalculatedModel, ResultFactors=1, ResultCase=-1)  # -> Model, DeformedMesh, DeformedAxes, DeformedModel
shellview = ShellViewKaramba3D(Model=modelview_2.Model, IndexOfLayer=0)  # -> Model, MeshesOfRenderedShells, LegendColors, LegendTags
legend = Legend(Colour=shellview.LegendColors, Tags=shellview.LegendTags, LegendType=1)

# ---- group: Check Beam Displacements
panel_6 = Panel("""0
0
0
0
0
1""")
cull = CullPattern(List=rdpoints.OutPoint, CullPattern=panel_6)
shelllineresults = LineResultsOnShellsKaramba3D(
    AnalyzedModel=modelview_2.Model,
    LayerPosition=0,
    ListOfSourcesOfPrincipalStressLinesLinesPoints=cull,
    SegmentLength_m=0.5,
    DA_deg=5,
    mode="PrincStress")  # -> AnalyzedModel, Lines1, Lines2
rgb = ColourRGB(Alpha=255, Red=0, Green=0, Blue="250")
rgb_2 = ColourRGB(Alpha=255, Red="250", Green=0, Blue=0)
preview = CustomPreview(Geometry=shelllineresults.Lines1, Shader=rgb)
preview_2 = CustomPreview(Geometry=shelllineresults.Lines2, Shader=rgb_2)

# ----
beamview = BeamViewKaramba3D(Model=modelview.Model)  # -> Model, MeshesOfRenderedBeams, DeformedBeamAxes, LegendColors, LegendTags
mesh = Mesh(beamview.MeshesOfRenderedBeams)
panel_7 = Panel(beamview.LegendTags)
legend_2 = Legend(Colour=beamview.LegendColors, Tags=beamview.LegendTags, LegendType=1)

# ==== cluster Cluster
pt = ClusterInput()
pt_2 = Point(pt)
cull_i = CullIndex(List=pt_2, Indices=[0, -1], Wrap=True)
item = ListItem(List=pt_2, Index=[0, -1], Wrap=True)
flip = FlipMatrix(Data=cull_i)
cull_i_2 = CullIndex(List=flip, Indices=[0, -1], Wrap=True)
item_2 = ListItem(List=flip, Index=[0, -1], Wrap=True)
pt_3 = Point(cull_i_2)
pt_4 = Point(item_2)
pt_5 = Point(item)
pt_6 = ClusterOutput(pt_4)
pt_7 = ClusterOutput(pt_3)
pt_8 = ClusterOutput(pt_5)
