# Grasshopper definition Karamba_CrossSectionOpter_Shell_wGeom.gh (Grasshopper 1.0.8)
# plug-ins: Karamba3D

number_slider = Slider(0, range=0..5)
number_slider_2 = Slider(0, range=0..5)
# Note: With Modifications to Original Karamba's Example File
number_slider_3 = Slider(0, range=0..5)
number_slider_4 = Slider(0, range=0..5)
number_slider_5 = Slider(0, range=0..5)
number_slider_6 = Slider(0, range=0..5)
number = Number(number_slider_6)
number_2 = Number(number_slider_4)
number_3 = Number(number_slider_5)
number_4 = Number(number_slider_2)
number_5 = Number(number_slider)
number_6 = Number(number_slider_3)
galapagos = Galapagos(
    fitness=opticrosec,
    gene=[number_slider_3, number_slider, number_slider_2, number_slider_6, number_slider_4, number_slider_5])

# ---- group: Create Geometry
pt = Point([Point(-30.29866546, -3.508493978, 0), Point(-30.29866546, -1.169497993, 0), Point(-30.29866546, 1.169497993, 0), Point(-30.29866546, 3.508493978, 0), Point(-19.80304532, -5.223412372, 3.46494229), Point(-19.80304532, -3.301380148, 0.2402272391)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])
res = Slider(1.5, range=0.5..6)
srfgrid = SurfaceFromPoints(Points=pt, UCount="6", Interpolate=False)
project = Project(Geometry=srfgrid, Plane=PlaneXY(0, 0, 0))  # -> Geometry, Transform
dom²num = ConstructDomain²(UMin="0", UMax="1", VMin="0.25", VMax="0.75")
unit_z = UnitZ(Factor=Slider(3, range=0..10))
surface = Surface(project.Geometry)
subsrf = Isotrim(Surface=reparameterize(surface), Domain=dom²num)
move = Move(Geometry=subsrf, Motion=unit_z)  # -> Geometry, Transform

# ---- group: Define Materials
matselect = MaterialSelectionKaramba3D(menu=[dropdown(9), dropdown(19)])

# ---- group: define cross sections
range = Range(Domain="5 to 200", Steps=20)
expression = Expression(x="Shell", y=range, Expression="x&\" \"&y")
crosec = CrossSectionKaramba3D(
    FamilyNameOfCrossSection="Shell",
    NameOfCrossSection=simplify(graft(expression)),
    Material=matselect,
    Height_cm=simplify(graft(range)),
    mode="Shell - Const")  # -> flatten(CrossSection)
crosecselect = CrossSectionSelectorKaramba3D(CrossSections=crosec, ElementsIdentifiers="S")  # -> CrossSection, Info

# ----
custom_preview = CustomPreview(Geometry=move.Geometry, Material=ColourSwatch(SwatchColor=RGBA(252, 255, 156, 135)))
mesh_breps = MeshBrepsKaramba3D(
    Brep=move.Geometry,
    MeshResolution=0.5,
    EdgeRefinementFactor=0.67,
    PointReduction=False,
    SmoothingStepSize=0,
    SmoothingIterations=5)  # -> Mesh, Info
Z = UnitZ(Factor="-5")
loads = LoadsKaramba3D(Vector=Vector(0, 0, -1), LCase="LC0", mode="Gravity")
loads_2 = LoadsKaramba3D(Vector=Z, Mesh=mesh_breps.Mesh, LCase="LC0", mode="MeshLoad -Const.", menu=[buttons(off, on, off), buttons(on, on)])
load = LoadKaramba3D(flatten([loads, loads_2]))
construct_point = ConstructPoint(XCoordinate="-40", YCoordinate="-11", ZCoordinate=0)
point = Point(construct_point)
range_2 = Range(Domain=Domain(0, 1), Steps=10)
gradient = Gradient(
    LowerLimit=0,
    UpperLimit=1,
    Parameter=range_2,
    stops=[0: RGB(234, 38, 0), 0.25: RGB(234, 126, 0), 0.5: RGB(254, 244, 84), 0.75: RGB(173, 203, 249), 1: RGB(75, 107, 169)])
colour = Colour(reverse(gradient))

# ---- group: Create Geometry
number_7 = Number(Slider(0.25, range=0..1))
pt_2 = Point([Point(-30.29866546, -3.508493978, 0), Point(-30.29866546, -1.169497993, 0), Point(-30.29866546, 1.169497993, 0), Point(-30.29866546, 3.508493978, 0), Point(-19.80304532, -5.223412372, 3.46494229), Point(-19.80304532, -3.301380148, 0.2402272391)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])
scale_nu = ScaleNU(Geometry=pt_2, Plane=PlaneXY(0, 0, 0), ScaleX=1, ScaleY=1, ScaleZ=number_7)  # -> Geometry, Transform
panel = Panel("""{0,0,0}
{0.125,0.25,0}
{0.25,0.5,0}
{0.375,0.75,0}
{0.5,1,0}
{0.625,1,0}
{0.75,1,0}
{0.875,1,0}
{1,1,0}""")
pt_3 = Point(scale_nu.Geometry)
res_2 = Slider(2, range=0.5..6)

# ----
point_list = PointList(Points=pt_3, Size=Slider(1, range=0..1))
# 02 - Shell Cross Section Optimization
# Difficulty: Simple (TRIAL/PRO versions only)
# The cross sections of a concrete shell bridge with an arc form are optimized. A mesh load runs along the center of the bridge. Custom colours can be plugged into the ModelViewer for the mesh preview.
# To view in the TRIAL version, set the Mesh Resolution to 6 and the Edge Refinement Factor to 1.
point_2 = Point(pt_3)
ghpython_script = GhPythonScript(points=point_2, h1=number_6, h2=number_5, d1=number_4, d2=number, w1=number_2, w2=number_3)  # -> out, points; inputs points: list of Point3d
# ---------- ghpython_script: Python ----------
__author__ = "user"
__version__ = "2024.02.21"

import rhinoscriptsyntax as rs
from copy import copy

points_ = [copy(_p) for _p in points]

for _p in points_[4:8] + points_[16:20]:
    _p.Z += h1
    
for _p in points_[8:16]:
    _p.Z += h2

idx = [4,7,16,19]
for _i in idx:
    points_[_i].Z += d1
    
idx = [8,11,12,15]
for _i in idx:
    points_[_i].Z += d2



points_[4].Y -= w1
points_[7].Y += w1
points_[16].Y -= w1
points_[19].Y += w1

points_[8].Y -= w2
points_[11].Y += w2
points_[12].Y -= w2
points_[15].Y += w2
# ---------- end ghpython_script ----------
point_3 = Point(ghpython_script.points)
vector_2pt = Vector2Pt(PointA=pt_3, PointB=point_3, Unitize=False)  # -> Vector, Length
vector_display_ex = VectorDisplayEx(Point=pt_3, Vector=vector_2pt.Vector, Colour=ColourSwatch(SwatchColor=RGB(43, 153, 217)), Width=Slider(2, range=0..10))

# ---- group: Create Geometry (continued)
srfgrid_2 = SurfaceFromPoints(Points=point_3, UCount="6", Interpolate=False)
iso = IsoCurve(Surface=reparameterize(srfgrid_2), UVPoint=panel)  # -> UIsocurve, VIsocurve
mesh_breps_2 = MeshBrepsKaramba3D(
    Brep=srfgrid_2,
    MeshResolution=res_2,
    EdgeRefinementFactor=0.67,
    PointReduction=True,
    SmoothingStepSize=0.8,
    SmoothingIterations=5)  # -> Mesh, Info

# ---- group: Define Elements
mtoshell = MeshToShellKaramba3D(Mesh=mesh_breps_2.Mesh, Identifier="S", CrossSection=crosecselect.CrossSection, LimitDistance_m=0.005)  # -> Element, Points, Info

# ---- group: Define Supports
panel_2 = Panel("""{1,0,0}
{1,1,0}""")
panel_3 = Panel("""{0,0,0}
{0,1,0}""")
evalsrf = EvaluateSurface(Surface=reparameterize(srfgrid_2), Point=panel_2)  # -> Point, Normal, UDirection, VDirection, Frame
evalsrf_2 = EvaluateSurface(Surface=reparameterize(srfgrid_2), Point=panel_3)  # -> Point, Normal, UDirection, VDirection, Frame
pline = PolyLine(Vertices=evalsrf.Point, Closed=False)
pline_2 = PolyLine(Vertices=evalsrf_2.Point, Closed=False)
pt_4 = Point(mtoshell.Points)
pt_5 = Point(mtoshell.Points)
pull = PullPoint(Point=pt_4, Geometry=pline, ClosestOnly=True)  # -> ClosestPoint, Distance
pull_2 = PullPoint(Point=pt_5, Geometry=pline_2, ClosestOnly=True)  # -> ClosestPoint, Distance
smaller = SmallerThan(FirstNumber=pull.Distance, SecondNumber=0.01)  # -> SmallerThan, OrEqualTo
smaller_2 = SmallerThan(FirstNumber=pull_2.Distance, SecondNumber=0.01)  # -> SmallerThan, OrEqualTo
cull = CullPattern(List=pt_4, CullPattern=smaller.SmallerThan)
cull_2 = CullPattern(List=pt_5, CullPattern=smaller_2.SmallerThan)
supp = SupportKaramba3D(PosInd=cull, menu=[buttons(on, on, on, off, off, off)])
supp_2 = SupportKaramba3D(PosInd=cull_2, menu=[buttons(on, on, on, off, off, off)])

# ---- group: Create Geometry (continued)
item = ListItem(List=[evalsrf.Point, evalsrf_2.Point], Index=0, Wrap=True)  # -> Item, Item1, Item2, Item3
aligndim = AlignedDimension(
    Plane=PlaneXY(0, 0, 0),
    PointA=[item.Item, item.Item2],
    PointB=[item.Item2, item.Item3],
    Offset=Slider(4.2, range=0..10),
    Text="{0:0.00}",
    Size=Slider(0.7, range=0..1))

# ---- group: Assemble Model
assemble = AssembleModelKaramba3D(Elem=flatten(mtoshell.Element), Support=flatten([supp, supp_2]), Load=flatten(load), LimitDistance_m=0.005)  # -> Model, Info, Mass_kg, CentreOfGravity, LoadCaseNames

# ---- group: Optimize Cross Sections
opticrosec = OptimizeCrossSectionKaramba3D(
    Model=assemble.Model,
    CrossSections=crosec,
    MaximumUtilization=1,
    MaximumDisplacement_cm="5",
    UltimateLimitStateIterations=5,
    DisplacementIterations=5,
    NumberOfSamplePoints=3,
    ElasticDesign=True,
    GammaM0=1,
    GammaM1=1.1,
    SwayFrame=True)  # -> ModelWithOptimizedCrossSections, Info, Mass_kg, MaximumDisplacement_cm, ElasticEnergyChange_kNm
panel_4 = Panel(opticrosec.MaximumDisplacement_cm)

# ----
integer = Integer(opticrosec.Mass_kg)
text = Text(integer)
concatenate = Concatenate(FragmentA=text, FragmentB=" kg")
mass = Panel(opticrosec.Mass_kg)
text_tag_3d = TextTag3D(Location=point, Text=concatenate, Size=Slider(2, range=0..10), Justification=7)

# ---- group: View Results
modelview = ModelViewKaramba3D(Model=opticrosec.ModelWithOptimizedCrossSections, ResultFactors=1, ResultCase=-1, Colors=colour)  # -> Model, DeformedMesh, DeformedAxes, DeformedModel
shellview = ShellViewKaramba3D(Model=modelview.Model, IndexOfLayer=0)  # -> Model, MeshesOfRenderedShells, LegendColours, LegendTags
legend = Legend(Colour=shellview.LegendColours, Tags=shellview.LegendTags, LegendType=1)
