# Grasshopper definition basic_ml_on_basic_truss.gh (Grasshopper 1.0.8)
# plug-ins: Karamba3D, LunchBoxML, LunchBox

# Load Data
panel = Panel("\\Mac\Home\Documents\GitHub\HKU\HKU_202324S2_DESN3002_ARCH7378\Dataset\3var_7bar_truss_1331\data.csv")
read_file = ReadFile(File=panel, PerLineParse=True)
# Connect 'content' to CSV String
data = Data(read_file)
data_2 = Data(data)
read_csv = ReadCSV(CSVString=data_2, Delimiter=",", DataStruct=False)  # -> Headers, Values
panel_2 = Panel(data_2)
panel_3 = Panel(read_csv.Headers)
threshold = Panel("55")
data_3 = Data(read_csv.Values)
number = Number(threshold)
flip_matrix = FlipMatrix(Data=data_3)
# Design Variables
data_4 = Data(flip_matrix)
# Optimised Mass
panel_4 = Panel("6")
# Is Not Failing
# Make Label
panel_5 = Panel("9")
number_2 = Number(number)
list_item = ListItem(List=data_4, Index="0", Wrap=True)
list_item_2 = ListItem(List=data_4, Index="1", Wrap=True)
list_item_3 = ListItem(List=data_4, Index="2", Wrap=True)
# Objective
list_item_4 = ListItem(List=data_4, Index=panel_4, Wrap=True)
list_item_5 = ListItem(List=data_4, Index=panel_5, Wrap=True)
boolean = Boolean(flatten(list_item_5))
number_3 = Number(flatten(list_item_3))
number_4 = Number(flatten(list_item_2))
number_5 = Number(flatten(list_item))
number_6 = Number(flatten(list_item_4))
# Is design lightweighted?
number_7 = Number(number_6)
smaller_than = SmallerThan(FirstNumber=number_7, SecondNumber=number_2)  # -> SmallerThan, OrEqualTo
gate_not = GateNot(A=boolean)
number_8 = Number(number_6)
# Data in this case is 3D:
# We can treat it as points...
construct_point = ConstructPoint(XCoordinate=number_5, YCoordinate=number_4, ZCoordinate=number_3)
quick_graph = QuickGraph(number_6, SortOrder=1)
sort_list = SortList(Keys=number_8)  # -> Keys, ValuesValuesA
boolean_2 = Boolean(gate_not)
boolean_3 = Boolean(smaller_than.SmallerThan)
list_item_6 = ListItem(List=sort_list.Keys, Index=0, Wrap=True)  # -> Item1, Item
number_9 = Number(list_item_6.Item)
number_10 = Number(list_item_6.Item1)
construct_domain = ConstructDomain(DomainStart=number_9, DomainEnd=number_10)
point = Point(flatten(construct_point))
gate_and = GateAnd(A=boolean_2, B=boolean_3)
domain = Domain(construct_domain)
boolean_4 = Boolean(gate_and)
panel_6 = Panel(boolean_4)

# ----
# Remap Objective
number_11 = Number(number_6)
domain_2 = Domain(domain)
value_list = ValueList({"View Raw Numbers": 0, "View Remapped Numbers": 1}, selected="View Raw Numbers")
remap_numbers = RemapNumbers(Value=number_11, Source=domain_2, Target=Domain(0, 1))  # -> Mapped, Clipped
graph_mapper = GraphMapper(
    remap_numbers.Mapped,
    x0=0,
    x1=1,
    y0=0,
    y1=1,
    A=1,
    B=0,
    container_name="Linear",
    Graph_x0=0.25,
    Graph_x1=0.75,
    Graph_y0=0.25,
    Graph_y1=0.75)
graph_mapper_2 = GraphMapper(
    remap_numbers.Mapped,
    x0=0,
    x1=1,
    y0=0,
    y1=1,
    container_name="Bezier",
    cpx=[0, 0, 0.4629030228, 1],
    cpy=[0, 0.5941653252, 1, 1])
number_12 = Number(graph_mapper)
number_13 = Number(graph_mapper_2)
stream_filter = StreamFilter(Gate=value_list, Stream0=number_12, Stream1=number_13)
number_14 = Number(stream_filter)

# ----
# Visualisation
# Visualise as Circles
number_15 = Number(number_14)
number_16 = Number(Slider(0.01, range=0..1))
number_17 = Number(Slider(0.1, range=0..1))
construct_domain_2 = ConstructDomain(DomainStart=number_16, DomainEnd=number_17)
panel_7 = Panel(graph_mapper_2)  # disabled
remap_numbers_2 = RemapNumbers(Value=number_15, Source=Domain(0, 1), Target=construct_domain_2)  # -> Mapped, Clipped
radius = Radius(remap_numbers_2.Mapped)
radius_2 = Radius(radius)
number_18 = Number(flatten(radius_2))
number_19 = Number(flatten(number_18))
bounds = Bounds(Numbers=number_19)
base = Base(point)
radius_3 = Radius(radius)
deconstruct_domain = DeconstructDomain(Domain=bounds)  # -> Start, End
circle = Circle(Plane=base, Radius=radius_3)
min = Panel(deconstruct_domain.Start)
max = Panel(deconstruct_domain.End)
surface = Surface(circle)
surface_2 = Surface(flatten(surface))
# Colour based on objective
gradient = Gradient(
    LowerLimit=min,
    UpperLimit=max,
    Parameter=number_18,
    stops=[0: RGB(75, 107, 169), 0.249: RGB(173, 203, 249), 0.5: RGB(254, 244, 84), 0.747: RGB(234, 126, 0), 1: RGB(234, 38, 0)])
boolean_5 = Boolean(boolean_4)
material = Material(gradient)

# ----
# Classifier
# Make LunchBox Data
# Build Classifier
# Evaluate Predictions on Training Data
data_5 = Data(boolean_5)
data_6 = Data(number_5)
data_7 = Data(number_4)
data_8 = Data(number_3)
merge = Merge(Data1=graft(data_6), Data2=graft(data_7), Data3=graft(data_8), Data4=graft(data_5))
panel_8 = Panel("""dy4
dx0
dy0
good""")
create = CreateDataSet(Labels=panel_8, Data=merge)
data_9 = Data(create)
data_10 = Data(data_9)
column_label = GetColumnLabel(Data=data_10, columns="dy4,dx0,dy0,good")  # -> Dy4, Dx0, Dy0, Good
fast_forest = FastForestBinaryClassifier(
    NumberOfLeaves=Slider(56, range=0..100),
    NumberOfTrees=Slider(45, range=0..100),
    MinimumExampleCountPerLeaf=Slider(2, range=0..100))
binary_classifier_trainer = BinaryClassifierTrainer(
    TrainingDataSet=data_10,
    FeatureNames=[column_label.Dy4, column_label.Dx0, column_label.Dy0],
    LabelName=column_label.Good,
    TrainerType=fast_forest)
data_11 = Data(data_9)
data_12 = Data(point)
boolean_6 = Boolean(boolean_5)
binary_classifier_tester = BinaryClassifierTester(Model=binary_classifier_trainer, TestingDataSet=data_11)  # -> Predictions, Scores
data_13 = Data(flatten(binary_classifier_tester.Predictions))
boolean_7 = Boolean(data_13)
equality = Equality(FirstNumber=boolean_6, SecondNumber=boolean_7)  # -> Equality, Inequality
boolean_8 = Boolean(equality.Equality)
dispatch = Dispatch(List=data_12, DispatchPattern=boolean_8)  # -> ListA, ListB
data_14 = Data(dispatch.ListB)
list_length = ListLength(List=data_14)
panel_9 = Panel(data_13)
how_many_wrong = Panel(list_length)

custom_preview = CustomPreview(Geometry=surface_2, Material=material)

# ----
# Clustering
# Filter out Design Options
data_15 = Data(data_4)
boolean_9 = Boolean(boolean_4)
data_16 = Data(data_15)
data_17 = Data(data_15)
tree_statistics = TreeStatistics(Tree=data_16)  # -> Paths, Length, Count
dispatch_2 = Dispatch(List=tree_statistics.Paths, DispatchPattern=boolean_9)  # -> ListA, ListB
tree_branch = TreeBranch(Tree=data_17, Path=dispatch_2.ListA, MaintainPaths=True)
data_18 = Data(tree_branch)
data_19 = Data(data_18)
sub_list = SubList(List=data_19, Domain="0 to 3", Wrap=True)  # -> simplify(List), Index
integer = Integer(Slider(6, range=0..10))
data_20 = Data(sub_list.List)
data_21 = Data(data_20)
k_means_clustering = KMeansClustering(TrainingInputs=data_21, OfClusters=integer, RandomSeed=5)  # -> Result, Likelihood, Centroids
data_22 = Data(k_means_clustering.Centroids)
data_23 = Data(data_20)
list_item_7 = ListItem(List=data_22, Index=0, Wrap=True)  # -> Item, Item1, Item2
list_item_8 = ListItem(List=data_23, Index=0, Wrap=True)  # -> Item, Item1, Item2
construct_point_2 = ConstructPoint(XCoordinate=list_item_7.Item, YCoordinate=list_item_7.Item1, ZCoordinate=list_item_7.Item2)
construct_point_3 = ConstructPoint(XCoordinate=list_item_8.Item, YCoordinate=list_item_8.Item1, ZCoordinate=list_item_8.Item2)
point_2 = Point(construct_point_2)
point_3 = Point(construct_point_3)

pt = Point(point)
# Basic Machine Learning
boolean_10 = Boolean(boolean_9)
dispatch_3 = Dispatch(List=pt, DispatchPattern=boolean_10)  # -> ListA, ListB
pt_2 = Point(dispatch_3.ListA)
pt_3 = Point(pt_2)
int = Integer(integer)
int_2 = Integer(k_means_clustering.Result)
series = Series(Start=0, Step=1, Count=int)
pt_4 = Point(pt_2)
gradient_2 = Gradient(
    LowerLimit=0,
    UpperLimit=int,
    Parameter=series,
    stops=[0: RGB(243, 57, 0), 0.1: RGB(236, 27, 60), 0.2: RGB(210, 0, 118), 0.3: RGB(103, 0, 120), 0.4: RGB(39, 72, 161), 0.5: RGB(1, 192, 229), 0.6: RGB(18, 178, 90), 0.7: RGB(79, 186, 8), 0.8: RGB(220, 237, 32), 0.9: RGB(247, 159, 20), 1: RGB(243, 57, 0)])
gradient_3 = Gradient(
    LowerLimit=0,
    UpperLimit=int,
    Parameter=int_2,
    stops=[0: RGB(243, 57, 0), 0.1: RGB(236, 27, 60), 0.2: RGB(210, 0, 118), 0.3: RGB(103, 0, 120), 0.4: RGB(39, 72, 161), 0.5: RGB(1, 192, 229), 0.6: RGB(18, 178, 90), 0.7: RGB(79, 186, 8), 0.8: RGB(220, 237, 32), 0.9: RGB(247, 159, 20), 1: RGB(243, 57, 0)])
point_4 = Point(data_14)
preview = CustomPreview(Geometry=pt_4, Material=gradient_3)
col = Colour(simplify(graft(gradient_2)))
point_5 = Point(point_2)
sphere = Sphere(Base=point_5, Radius=Slider(0.1, range=0..0.1))
value_list_2 = ValueList({"View Unclustered Data": 0, "View Clustered Groups": 1}, selected="View Clustered Groups")
custom_preview_2 = CustomPreview(Geometry=sphere, Material=col)

# ----
# Check Out Cluster
point_6 = Point(point_3)
point_7 = Point(point_2)
stream_filter_2 = StreamFilter(Gate=value_list_2, Stream0=point_6, Stream1=point_7)
point_8 = Point(stream_filter_2)
tree_statistics_2 = TreeStatistics(Tree=point_8)  # -> Paths, Length, Count
integer_2 = Integer(Slider(0, range=0..10))
list_item_9 = ListItem(List=tree_statistics_2.Paths, Index=integer_2, Wrap=True)
tree_branch_2 = TreeBranch(Tree=point_8, Path=list_item_9, MaintainPaths=True)
point_9 = Point(flatten(tree_branch_2))

number_slider = Slider(0.25, range=0..1)  # disabled
deconstruct = Deconstruct(Point=point_9)  # -> XComponent, YComponent, ZComponent
colour_swatch = ColourSwatch(SwatchColor=RGB(103, 89, 255))  # disabled
sphere_2 = Sphere(Base=point_9, Radius=number_slider)  # disabled
number_20 = Number(deconstruct.YComponent)
number_21 = Number(deconstruct.XComponent)
number_22 = Number(deconstruct.ZComponent)
custom_preview_3 = CustomPreview(Geometry=sphere_2, Material=colour_swatch)  # disabled
# SET INITIAL VALUES
number_slider_2 = Slider(0, range=-2..3)  # disabled
# REBUILD SYSTEM
# PLAY WITH SLIDERS
# dy_4
number_slider_3 = Slider(0, range=-2..2)
# dx_0
# dy_0
number_slider_4 = Slider(0, range=-1..1)
# Truss Span
# y_0 (Initial)
number_slider_5 = Slider(4, range=0..10)
num = Number(Slider(1, range=-2..2))
num_2 = Number(number_21)
num_3 = Number(number_20)
num_4 = Number(number_22)
num_5 = Number(number_slider_5)
neg = Negative(Value=num)
num_6 = Number(number_slider_4)
num_7 = Number(number_slider_2)
num_8 = Number(number_slider_3)
num_9 = Number(num_2)
num_10 = Number(num_7)
num_11 = Number(num_4)
num_12 = Number(num_8)
num_13 = Number(num_3)
num_14 = Number(num_6)
_0 = Stream0(neg)
addition = Addition(A=num_14, B=num_13)
addition_2 = Addition(A=num_10, B=num_11)
addition_3 = Addition(A=num_12, B=num_9)
_0_2 = Stream0(addition)
_0_3 = Stream0(addition_3)
_0_4 = Stream0(addition_2)
num_15 = Number(_0_3)
num_16 = Number(_0_4)
num_17 = Number(_0_2)
num_18 = Number(num_5)
num_19 = Number(_0)
num_20 = Number(num_18)
num_21 = Number(num_18)
division = Division(A=num_20, B="2")
division_2 = Division(A=num_21, B="4")
num_22 = Number(division)
num_23 = Number(division_2)
# STRUCTURAL CROSS SECTION OPTIM
# Create Cross Sections
number_slider_6 = Slider(1, range=0..10)
num_24 = Number(num_17)
num_25 = Number(num_23)
num_26 = Number(num_18)
subtraction = Subtraction(A=num_26, B=num_25)
num_27 = Number(num_16)
num_28 = Number(subtraction)
num_29 = Number(num_17)
num_30 = Number(num_16)
num_31 = Number(num_19)
num_32 = Number(num_19)
# BUILD TRUSS
num_33 = Number(num_23)
addition_4 = Addition(A=num_31, B=num_27)
addition_5 = Addition(A=num_32, B=num_30)
subtraction_2 = Subtraction(A=num_28, B=num_24)
addition_6 = Addition(A=num_33, B=num_29)
number_23 = Number(Slider(20, range=0..100))
integer_3 = Integer(Slider(50, range=0..100))
number_24 = Number(number_slider_6)
num_34 = Number(num_15)
num_35 = Number(num_22)
construct_domain_3 = ConstructDomain(DomainStart=number_24, DomainEnd=number_23)
num_36 = Number(addition_4)
num_37 = Number(addition_5)
num_38 = Number(addition_6)
panel_11 = Panel(num_34)
num_39 = Number(num_18)
pt_5 = ConstructPoint(XCoordinate="0", YCoordinate="0", ZCoordinate="0")
pt_6 = ConstructPoint(XCoordinate=num_39, YCoordinate="0", ZCoordinate="0")
pt_7 = ConstructPoint(XCoordinate=num_35, YCoordinate=panel_11, ZCoordinate="0")
pt_8 = ConstructPoint(XCoordinate=subtraction_2, YCoordinate=num_37, ZCoordinate="0")
pt_9 = ConstructPoint(XCoordinate=num_38, YCoordinate=num_36, ZCoordinate="0")
range = Range(Domain=construct_domain_3, Steps=integer_3)
pt_10 = Point(pt_5)
pt_11 = Point(pt_6)
pt_12 = Point(pt_7)
pt_13 = Point(pt_9)
pt_14 = Point(pt_8)
number_25 = Number(range)
list_length_2 = ListLength(List=number_25)
concatenate = Concatenate(FragmentA="circle_solid_", FragmentB=number_25)
integer_division = IntegerDivision(A=list_length_2, B="2")
text = Text(concatenate)
pt_15 = Point(pt_10)
pt_16 = Point(pt_11)
pt_17 = Point(pt_13)
pt_18 = Point(pt_12)
pt_19 = Point(pt_14)
number_26 = Number(number_25)
crosec = CrossSectionKaramba3D(
    FamilyNameOfCrossSection="DefaultCroSec",
    NameOfCrossSection=text,
    Diameter_cm=number_26,
    WallThickness_cm=expr("x/2", number_26),
    mode="Circular Hollow")
ln = Line(StartPoint=pt_15, EndPoint=pt_17)
crv = Curve(ln)
ln_2 = Line(StartPoint=pt_15, EndPoint=pt_18)
cross_sections = CrossSections(crosec)
crosecselect = CrossSectionSelectorKaramba3D(CrossSections=cross_sections, NameOrListIndexOfCrossSection=integer_division)  # -> CrossSection, Info
cross_sections_2 = CrossSections(crosecselect.CrossSection)
ln_3 = Line(StartPoint=pt_17, EndPoint=pt_18)
cross_sections_3 = CrossSections(crosec)
cross_sections_4 = CrossSections(crosec)
crv_2 = Curve(ln_2)
ln_4 = Line(StartPoint=pt_17, EndPoint=pt_19)
crv_3 = Curve(ln_3)
crv_4 = Curve(ln_4)
ln_5 = Line(StartPoint=pt_19, EndPoint=pt_18)
ln_6 = Line(StartPoint=pt_18, EndPoint=pt_16)
cross_sections_5 = CrossSections(cross_sections)
crv_5 = Curve(ln_5)
crv_6 = Curve(ln_6)
ln_7 = Line(StartPoint=pt_16, EndPoint=pt_19)
crv_7 = Curve(ln_7)
merge_2 = Merge(Data1=pt_15, Data2=pt_16, Data3=pt_17, Data4=pt_19, Data5=pt_18)
# STRUCTURAL ANALYSIS
merge_3 = Merge(Data1=crv, Data2=crv_7, Data3=crv_4, Data4=crv_2, Data5=crv_6, Data6=crv_3, Data7=crv_5)
merge_4 = Merge(Data1=pt_15, Data2=pt_16)
num_40 = Number(Slider(100, range=0..100))
pt_20 = Point(merge_2)
pt_21 = Point(merge_4)
crv_8 = Curve(merge_3)
neg_2 = Negative(Value=num_40)
Y = UnitY(Factor=neg_2)
force = ForceVector(Y)
pt_22 = Point(pt_21)
pt_23 = Point(pt_20)
crv_9 = Curve(crv_8)
crosec_2 = CrossSection(cross_sections_2)
pt_24 = Point(pt_18)
supp = SupportKaramba3D(PosInd=pt_23, menu=[buttons(off, off, on, off, off, off)])
supp_2 = SupportKaramba3D(PosInd=pt_22, menu=[buttons(on, on, off, off, off, off)])
linetobeam = LineToBeamKaramba3D(
    Line=crv_9,
    CrossSection=crosec_2,
    New=True,
    Remove=True,
    LimitDistance_m=0.005,
    Bending=True,
    SetBucklingLength=True,
    ToPolylineMaxAngle=0.03,
    ToPolylineTolerance=0.01,
    ToPolylineMaxEdgeLength=0.25)  # -> Element, Points, Info
loads = LoadsKaramba3D(ForceVector=force, Local=False, PosInd=pt_24, LCase="0", mode="Point")
elem = Elem(linetobeam.Element)
load = LoadKaramba3D(loads)
support = Support(supp_2)
support_2 = Support(supp)
merge_5 = Merge(Data1=support, Data2=support_2)
support_3 = Support(merge_5)
elem_2 = Elem(elem)
load_2 = LoadKaramba3D(load)
support_4 = Support(support_3)
assemble = AssembleModelKaramba3D(Elem=elem_2, Support=support_4, Load=load_2, LimitDistance_m=0.005)  # -> Model, Info, Mass_kg, CentreOfGravity, LoadCaseNames
model = Model(assemble.Model)
model_karamba3d = ModelKaramba3D(model)
opticrosec = OptimizeCrossSectionKaramba3D(
    Model=model_karamba3d,
    CrossSections=cross_sections_5,
    MaximumUtilization=1,
    UltimateLimitStateIterations=5,
    DisplacementIterations=5,
    NumberOfSamplePoints=3,
    ElasticDesign=True,
    GammaM0=1,
    GammaM1=1.1,
    SwayFrame=True)  # -> ModelWithOptimizedCrossSections, Info, Mass_kg, MaximumDisplacement_cm, ElasticEnergyChange_kNm
model_karamba3d_2 = ModelKaramba3D(opticrosec.ModelWithOptimizedCrossSections)
number_27 = Number(opticrosec.Mass_kg)
number_28 = Number(opticrosec.MaximumDisplacement_cm)
number_29 = Number(opticrosec.ElasticEnergyChange_kNm)
model_karamba3d_3 = ModelKaramba3D(model_karamba3d_2)
utilization = UtilizationOfElementsKaramba3D(
    AnalysedModel=model_karamba3d_3,
    NumberOfSamplePoints=3,
    ElasticDesign=True,
    GammaM0=1,
    GammaM1=1.1,
    SwayFrame=True,
    WithDetails=False,
    mode="Beams")  # -> Model, Utilization, SigMax_kN_cm², SigMin_kN_cm², TauMax_kN_cm², UtilN, UtilVy, UtilVz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
disassemble = DisassembleModelKaramba3D(Model=model_karamba3d_2)  # -> Model, Point, Beam, Shell, Support, Load, Line, Mesh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
num_41 = Number(flatten(utilization.Utilization))
disassemble_2 = DisassembleElementKaramba3D(Element=disassemble.Beam)  # -> Element, ElementIdentifier, AxisOfElement, CrossSection, Joint, Material, LocalCoordinateSystem, ElementIsActive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
# Always Make Sure No Elements Are Failing!!
sort_list_2 = SortList(Keys=num_41)  # -> Keys, ValuesValuesA
disassemble_3 = DisassembleCrossSectionKaramba3D(CroSec=disassemble_2.CrossSection)  # -> CrossSection, FamilyNameOfCrossSection, TypeNameOfCrossSection, ElemIdentifiers, Colour, Material, LocalEccentricity_cm, Heights_cm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
list_item_10 = ListItem(List=sort_list_2.Keys, Index=0, Wrap=True)  # -> Item1, Item
number_30 = Number(list_item_10.Item)
number_31 = Number(list_item_10.Item1)
larger_than = LargerThan(FirstNumber=number_31, SecondNumber="1")  # -> LargerThan, OrEqualTo
mass = Panel(number_27)
panel_12 = Panel(sort_list_2.Keys)
modelview = ModelViewKaramba3D(Model=disassemble.Model, ResultFactors=1, ResultCase=-1)  # -> Model, DeformedMesh, DeformedAxes, DeformedModel
analyze = AnalyzeKaramba3D(Model=model)  # -> CalculatedModel, MaximumDisplacement_cm, ResultingForceOfGravity_kN, ElasticEnergyChange_kNm
beamview = BeamViewKaramba3D(Model=modelview.Model)  # -> Model, MeshesOfRenderedBeams, DeformedBeamAxes, LegendColours, LegendTags
model_2 = Model(analyze.CalculatedModel)
num_42 = Number(analyze.MaximumDisplacement_cm)
num_43 = Number(analyze.ElasticEnergyChange_kNm)
num_44 = Number(assemble.Mass_kg)
data_24 = Data(larger_than.LargerThan)
unit_x = UnitX(Factor=Slider(3, range=0..10))
max_utilisation = Panel(number_31)
min_utilisation = Panel(number_30)
failing = Panel(data_24)
move = Move(Geometry=beamview.MeshesOfRenderedBeams, Motion=unit_x)  # -> Geometry, Transform
