# Grasshopper definition BSL_GH_195_LunchBoxMLPanelGrouping-Buildings.gh (Grasshopper 1.0.7)
# plug-ins: LunchBoxML, LunchBox, HAL for Grasshopper

# RESEARCH PROJECT
# Development of Plug-and-Play E-Learning
# Tutorials for Incorporation into Flipped-Classroom
# Teaching of Artificial Intelligence and Machine
# Learning Applications in Advanced Architecture
# Design and Production
# SUPPORTED BY
# Teach Devlopment Grant (Project No.: 928)
# REQUIRED PLUGINS
# - LunchboxML
# LEGEND
# Train Data
data = Data(0)
# Test Input Data
data_2 = Data(0)
# Algorithm
data_3 = Data(0)
# Output
data_4 = Data(0)
# RESEARCH TEAM
# Principal Investigator: Dr. Kristof Crolla
# 
# Team Members: Dr. Garvin Goepel, Abdullah
# Tahir Sheikh, Jingwen Song, Adeline Chan
sessionsettings = SessionSettings()  # -> Data, DefaultSettings
srf = Surface(reparameterize(<surface referenced from the Rhino model>))
# © ALL RIGHTS RESERVED, 2024
slider = Slider(40, range=1..50)

hexgrid = Hexagonal(Plane=PlaneXY(0, 0, 0), Size=1, ExtentX=Slider(20, range=1..50), ExtentY=slider)  # -> Cells, Points
bbox = BoundingBox(Content=flatten(hexgrid.Cells), Plane=PlaneXY(0, 0, 0), UnionBox=True)  # -> Box, Box_2
disc = Discontinuity(Curve=hexgrid.Cells, Level=1)  # -> Points, Parameters
explode = BrepComponents(Brep=bbox.Box)  # -> Faces, Edges, Vertices
pcomp = Decompose(Point=explode.Vertices)  # -> XComponent, YComponent, ZComponent
bnd = Bounds(Numbers=pcomp.XComponent)
bnd_2 = Bounds(Numbers=pcomp.YComponent)
pcomp_2 = Decompose(Point=disc.Points)  # -> XComponent, YComponent, ZComponent
remap = RemapNumbers(Value=pcomp_2.XComponent, Source=bnd, Target=Domain(0, 1))  # -> Mapped, Clipped
remap_2 = RemapNumbers(Value=pcomp_2.YComponent, Source=bnd_2, Target=Domain(0, 1))  # -> Mapped, Clipped
pt = PointXYZ(XComponent=remap.Mapped, YComponent=remap_2.Mapped, ZComponent=0)
evalsrf = EvaluateSurface(Surface=srf, Point=pt)  # -> Point, Normal, UDirection, VDirection, Frame
pline = PolyLine(Vertices=evalsrf.Point, Closed=True)
patch = Patch(Curves=pline, Spans=20, Flexibility=1, Trim=True)  # -> flatten(Patch)

flat = FlatnessCheck(PanelList=patch)  # -> FlatPanels, Planes, Deviations
debrep = DeconstructBrep(Brep=patch)  # -> Faces, Edges, Vertices
join = JoinCurves(Curves=debrep.Edges, Preserve=False)
area = Area(Geometry=patch)  # -> Area, Centroid
len = Length(Curve=join)
entwine = Entwine(Branch00=area.Area, Branch01=len, Branch02=flat.Deviations, FlattenInputs=True)
number_slider = Slider(4, range=0..100)
number_slider_2 = Slider(7, range=0..100)
flip = FlipMatrix(Data=entwine)
k_means = KMeansClustering(TrainingInputs=flip, OfClusters=Slider(20, range=0..100), RandomSeed=5)  # -> Result, Likelihood, Centroids

bnd_3 = Bounds(Numbers=k_means.Result)
dedomain = DeconstructDomain(Domain=bnd_3)  # -> Start, End
gradient = Gradient(
    LowerLimit=dedomain.Start,
    UpperLimit=dedomain.End,
    Parameter=k_means.Result,
    stops=[0: RGB(243, 57, 0), 0: RGB(39, 72, 161), 0.0526: RGB(53, 35, 221), 0.1: RGB(236, 27, 60), 0.2: RGB(210, 0, 118), 0.3: RGB(103, 0, 120), 0.5: RGB(1, 192, 229), 0.6: RGB(18, 178, 90), 0.7: RGB(79, 186, 8), 0.8: RGB(220, 237, 32), 0.9: RGB(247, 159, 20), 1: RGB(243, 57, 0)])
preview = CustomPreview(Geometry=patch, Material=gradient)
