# Grasshopper definition BSL_GH_196_LunchBoxMLPanelGrouping-UrbanAnalysis.gh (Grasshopper 1.0.7)
# plug-ins: HAL for Grasshopper, LunchBoxML

# RESEARCH PROJECT
# Development of Plug-and-Play E-Learning
# Tutorials for Incorporation into Flipped-Classroom
# Teaching of Artificial Intelligence and Machine
# Learning Applications in Advanced Architecture
# Design and Production
# SUPPORTED BY
# Teach Devlopment Grant (Project No.: 928)
# REQUIRED PLUGINS
# - LunchboxML
# LEGEND
# Train Data
data = Data(0)
# Test Input Data
data_2 = Data(0)
# Algorithm
data_3 = Data(0)
# © ALL RIGHTS RESERVED, 2024
# Output
data_4 = Data(0)
# RESEARCH TEAM
# Principal Investigator: Dr. Kristof Crolla
# 
# Team Members: Dr. Garvin Goepel, Abdullah
# Tahir Sheikh, Jingwen Song, Adeline Chan
sessionsettings = SessionSettings()  # -> Data, DefaultSettings
brep = Brep([<brep referenced from the Rhino model> x560])

volume = Volume(Geometry=brep)  # -> Volume, Centroid
colmm = CollisionManyMany(Colliders=brep)  # -> Collision, Indices
bbox = BoundingBox(Content=brep, Plane=PlaneXY(0, 0, 0))  # -> Box, Box_2
num = Number(colmm.Collision)
cps = ClosestPoints(Point=volume.Centroid, Cloud=volume.Centroid, Count=Slider(11, range=0..100))  # -> ClosestPoint, CPIndex, Distance
debox = DeconstructBox(Box=bbox.Box)  # -> Plane, X, Y, Z
avr = Average(Input=cps.Distance)  # -> flatten(ArithmeticMean)
dedomain = DeconstructDomain(Domain=debox.Z)  # -> Start, End
dedomain_2 = DeconstructDomain(Domain=debox.Y)  # -> Start, End
dedomain_3 = DeconstructDomain(Domain=debox.X)  # -> Start, End
panel = Panel(avr)
subtraction = Subtraction(A=dedomain_3.End, B=dedomain_3.Start)
subtraction_2 = Subtraction(A=dedomain.End, B=dedomain.Start)
subtraction_3 = Subtraction(A=dedomain_2.End, B=dedomain_2.Start)
entwine = Entwine(Branch00=subtraction, Branch01=subtraction_3, Branch02=subtraction_2, Branch03=num, Branch04=avr, FlattenInputs=True)
flip = FlipMatrix(Data=entwine)

k_means = KMeansClustering(TrainingInputs=flip, OfClusters=Slider(28, range=0..100), RandomSeed=5)  # -> Result, Likelihood, Centroids

bnd = Bounds(Numbers=k_means.Result)
dedomain_4 = DeconstructDomain(Domain=bnd)  # -> Start, End
gradient = Gradient(
    LowerLimit=dedomain_4.Start,
    UpperLimit=dedomain_4.End,
    Parameter=k_means.Result,
    stops=[0: RGB(243, 57, 0), 0.1: RGB(236, 27, 60), 0.2: RGB(210, 0, 118), 0.3: RGB(103, 0, 120), 0.4: RGB(39, 72, 161), 0.5: RGB(1, 192, 229), 0.6: RGB(18, 178, 90), 0.7: RGB(79, 186, 8), 0.8: RGB(220, 237, 32), 0.9: RGB(247, 159, 20), 1: RGB(243, 57, 0)])
preview = CustomPreview(Geometry=brep, Material=gradient)
