# Grasshopper definition lunchbox_test.gh (Grasshopper 1.0.7)
# plug-ins: LunchBox, LunchBoxML

# Connect 'content' to CSV String
data = Data(["in:dy_4,in:dx_0,in:dy_0,out:Deflection,out:Mass,out:SE,out:Mass_CSOptim,out:Deflection_CSOptim,out:SE_CSOptim,out:HasFailed_CSOptim,img", "-2,-1,-2,0.01237,1368.233201,0.006185,45.325864,0.340328,0.170164,False,dy_4-2_dx_0-1_dy_0-2.png", "-1.6,-1,-2,0.012404,1359.81345,0.006202,53.014956,0.366775,0.183387,False,dy_4-1.6_dx_0-1_dy_0-2.png", "-1.2,-1,-2,0.013682,1362.606438,0.006841,79.065153,0.365905,0.182953,False,dy_4-1.2_dx_0-1_dy_0-2.png", "-0.8,-1,-2,0.016802,1376.768546,0.008401,108.374485,0.454716,0.227358,False,dy_4-0.8_dx_0-1_dy_0-2.png", "-0.4,-1,-2,0.021873,1402.948045,0.010936,146.651788,0.447707,0.223854,False,dy_4-0.4_dx_0-1_dy_0-2.png"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])
read_csv = ReadCSV(CSVString=data, Delimiter=",")  # -> Headers, Values
panel = Panel(read_csv.Headers)
threshold = Panel("55")
data_2 = Data(read_csv.Values)
number = Number(threshold)
flip_matrix = FlipMatrix(Data=data_2)
# Design Variables
data_3 = Data(flip_matrix)
# Optimised Mass
panel_2 = Panel("6")
# Is Not Failing
# Make Label
panel_3 = Panel("9")
number_2 = Number(number)
list_item = ListItem(List=data_3, Index="0", Wrap=True)
list_item_2 = ListItem(List=data_3, Index="1", Wrap=True)
list_item_3 = ListItem(List=data_3, Index="2", Wrap=True)
# Objective
list_item_4 = ListItem(List=data_3, Index=panel_2, Wrap=True)
list_item_5 = ListItem(List=data_3, Index=panel_3, Wrap=True)
boolean = Boolean(flatten(list_item_5))
number_3 = Number(flatten(list_item_3))
number_4 = Number(flatten(list_item_2))
number_5 = Number(flatten(list_item))
number_6 = Number(flatten(list_item_4))
# Is design lightweighted?
number_7 = Number(number_6)
smaller_than = SmallerThan(FirstNumber=number_7, SecondNumber=number_2)  # -> SmallerThan, OrEqualTo
gate_not = GateNot(A=boolean)
number_8 = Number(number_6)
# Data in this case is 3D:
# We can treat it as points...
construct_point = ConstructPoint(XCoordinate=number_5, YCoordinate=number_4, ZCoordinate=number_3)
sort_list = SortList(Keys=number_8)  # -> Keys, ValuesValuesA
boolean_2 = Boolean(gate_not)
boolean_3 = Boolean(smaller_than.SmallerThan)
list_item_6 = ListItem(List=sort_list.Keys, Index=0, Wrap=True)  # -> Item1, Item
number_9 = Number(list_item_6.Item)
number_10 = Number(list_item_6.Item1)
construct_domain = ConstructDomain(DomainStart=number_9, DomainEnd=number_10)
point = Point(flatten(construct_point))
gate_and = GateAnd(A=boolean_2, B=boolean_3)
domain = Domain(construct_domain)
boolean_4 = Boolean(gate_and)
boolean_5 = Boolean(boolean_4)

# ----
# Classifier
# Make LunchBox Data
# Build Classifier
# Evaluate Predictions on Training Data
data_4 = Data(boolean_5)
data_5 = Data(number_5)
data_6 = Data(number_4)
data_7 = Data(number_3)
panel_4 = Panel("""dy4
dx0
dy0
good""")
merge = Merge(Data1=graft(data_5), Data2=graft(data_6), Data3=graft(data_7), Data4=graft(data_4))
create = CreateDataSet(Labels=panel_4, Data=merge)
data_8 = Data(create)
data_9 = Data(data_8)
column_label = GetColumnLabel(Data=data_9, columns="dy4,dx0,dy0,good")  # -> Dy4, Dx0, Dy0, Good
fast_forest = FastForestBinaryClassifier(
    NumberOfLeaves=Slider(56, range=0..100),
    NumberOfTrees=Slider(45, range=0..100),
    MinimumExampleCountPerLeaf=Slider(2, range=0..100))
binary_classifier_trainer = BinaryClassifierTrainer(
    TrainingDataSet=data_9,
    FeatureNames=[column_label.Dy4, column_label.Dx0, column_label.Dy0],
    LabelName=column_label.Good,
    TrainerType=fast_forest)
data_10 = Data(data_8)
data_11 = Data(point)
boolean_6 = Boolean(boolean_5)
binary_classifier_tester = BinaryClassifierTester(Model=binary_classifier_trainer, TestingDataSet=data_10)  # -> Predictions, Scores
data_12 = Data(flatten(binary_classifier_tester.Predictions))
boolean_7 = Boolean(data_12)
equality = Equality(FirstNumber=boolean_6, SecondNumber=boolean_7)  # -> Equality, Inequality
boolean_8 = Boolean(equality.Equality)
dispatch = Dispatch(List=data_11, DispatchPattern=boolean_8)  # -> ListA, ListB
data_13 = Data(dispatch.ListB)
list_length = ListLength(List=data_13)
panel_5 = Panel(data_12)
how_many_wrong = Panel(list_length)
panel_6 = Panel(boolean_4)

# ----
# Basic Machine Learning
# Clustering
# Filter out Design Options
data_14 = Data(data_3)
boolean_9 = Boolean(boolean_4)
data_15 = Data(data_14)
data_16 = Data(data_14)
tree_statistics = TreeStatistics(Tree=data_15)  # -> Paths, Length, Count
dispatch_2 = Dispatch(List=tree_statistics.Paths, DispatchPattern=boolean_9)  # -> ListA, ListB
tree_branch = TreeBranch(Tree=data_16, Path=dispatch_2.ListA, MaintainPaths=True)
data_17 = Data(tree_branch)
data_18 = Data(data_17)
sub_list = SubList(List=data_18, Domain="0 to 3", Wrap=True)  # -> simplify(List), Index
integer = Integer(Slider(6, range=0..10))
data_19 = Data(sub_list.List)
data_20 = Data(data_19)
k_means_clustering = KMeansClustering(TrainingInputs=data_20, OfClusters=integer, RandomSeed=5)  # -> Result, Likelihood, Centroids
data_21 = Data(k_means_clustering.Centroids)
data_22 = Data(data_19)
list_item_7 = ListItem(List=data_21, Index=0, Wrap=True)  # -> Item, Item1, Item2
list_item_8 = ListItem(List=data_22, Index=0, Wrap=True)  # -> Item, Item1, Item2
construct_point_2 = ConstructPoint(XCoordinate=list_item_7.Item, YCoordinate=list_item_7.Item1, ZCoordinate=list_item_7.Item2)
construct_point_3 = ConstructPoint(XCoordinate=list_item_8.Item, YCoordinate=list_item_8.Item1, ZCoordinate=list_item_8.Item2)
point_2 = Point(construct_point_2)
point_3 = Point(construct_point_3)
sphere = Sphere(Base=point_2, Radius=Slider(0.1, range=0..1))

point_4 = Point(data_13)
