# Grasshopper definition lunchbox_truss_nn.gh (Grasshopper 1.0.8)
# plug-ins: RhinoCodePluginGH, LunchBoxML

# ----
# Display - Material Consumption Prediction
# Display - Material Consumption Truth
panel = Panel("-2")
# Display on Screen
panel_2 = Panel("-10")
series = Series(Start="2", Step=panel, Count="6")
series_2 = Series(Start=panel_2, Step="10", Count="4")
construct_point = ConstructPoint(XCoordinate=series_2, YCoordinate=graft(series), ZCoordinate=0)
flatten_tree = FlattenTree(Tree=construct_point, Path="{0}")  # -> simplify(flatten(Tree))
list_item = ListItem(List=flatten_tree, Index="10", Wrap=True)
list_item_2 = ListItem(List=flatten_tree, Index="20", Wrap=True)
list_item_3 = ListItem(List=flatten_tree, Index="18", Wrap=True)
list_item_4 = ListItem(List=flatten_tree, Index="11", Wrap=True)
list_item_5 = ListItem(List=flatten_tree, Index="16", Wrap=True)
list_item_6 = ListItem(List=flatten_tree, Index="14", Wrap=True)
list_item_7 = ListItem(List=flatten_tree, Index="19", Wrap=True)
list_item_8 = ListItem(List=flatten_tree, Index="12", Wrap=True)
list_item_9 = ListItem(List=flatten_tree, Index="15", Wrap=True)
list_item_10 = ListItem(List=flatten_tree, Index="22", Wrap=True)
list_item_11 = ListItem(List=flatten_tree, Index="23", Wrap=True)
list_item_12 = ListItem(List=flatten_tree, Index="1", Wrap=True)
list_item_13 = ListItem(List=flatten_tree, Index="8", Wrap=True)
list_item_14 = ListItem(List=flatten_tree, Index="0", Wrap=True)
list_item_15 = ListItem(List=flatten_tree, Index="3", Wrap=True)
list_item_16 = ListItem(List=flatten_tree, Index="6", Wrap=True)
list_item_17 = ListItem(List=flatten_tree, Index="4", Wrap=True)
list_item_18 = ListItem(List=flatten_tree, Index="7", Wrap=True)
list_item_19 = ListItem(List=flatten_tree, Index="2", Wrap=True)

# ----
# LOAD DATA
# File reader
panel_3 = Panel("truss_dataset.csv")
python_3_script = Python3Script(filename=panel_3)  # -> out, filepath
# ---------- python_3_script: Python ----------
import os

_filepath = ghenv.Component.OnPingDocument().FilePath
path = os.path.dirname(_filepath)

filepath = os.path.join(path, filename)
# ---------- end python_3_script ----------
panel_4 = Panel(python_3_script.filepath)
file_path = FilePath(panel_4)
read_file = ReadFile(File=file_path, PerLineParse=True)
cull_index = CullIndex(List=read_file, Indices="0", Wrap=True)
text_split = TextSplit(Text=cull_index, Separators=",")  # -> simplify(Result)
number = Number(text_split)
panel_5 = Panel(number)

point = Point(list_item_13)
point_2 = Point(list_item_8)
point_3 = Point(list_item_5)
point_4 = Point(list_item_2)
point_5 = Point(list_item_14)
point_6 = Point(list_item_17)
text_tag = TextTag(Location=point_3, Text="Truss #4")
text_tag_2 = TextTag(Location=point_4, Text="Truss #5")
text_tag_3 = TextTag(Location=point, Text="Truss #2")
text_tag_4 = TextTag(Location=point_2, Text="Truss #3")
text_tag_5 = TextTag(Location=point_6, Text="Truss #1")
text_tag_6 = TextTag(Location=point_5, Text="Truss ID")
point_7 = Point(list_item_19)
point_8 = Point(list_item_15)
point_9 = Point(list_item_12)
text_tag_7 = TextTag(Location=point_7, Text="Material Consumption Prediction")
text_tag_8 = TextTag(Location=point_8, Text="Material Consumption Truth")
text_tag_9 = TextTag(Location=point_9, Text="Truss Geometry")

# ----
# Training Inputs, Training Outputs, Training Test Data
# Inputs - training data
panel_6 = Panel("10")
split_list = SplitList(List=number, Index=panel_6)  # -> simplify(ListA), simplify(ListB)

python_3_script_2 = Python3Script(T=split_list.ListB)  # -> A_out, B_out; inputs T: tree
# ---------- python_3_script_2: Python ----------
from Grasshopper import DataTree
from Grasshopper.Kernel.Data import GH_Path

split = 595 

A = DataTree[object]()  
B = DataTree[object]()  


if T:
    bc = T.BranchCount  
    for i in range(bc):
        branch = T.Branch(i)
        
       
        if i < split:
            A.AddRange(branch, GH_Path(i))  
    
        else:
            B.AddRange(branch, GH_Path(i))  


    A_out = A
    B_out = B
else:
    A_out = "Error: T is not a valid DataTree"
    B_out = "Error: T is not a valid DataTree"
# ---------- end python_3_script_2 ----------
number_2 = Number(python_3_script_2.B_out)
panel_7 = Panel(number_2)
explode_tree = ExplodeTree(Data=panel_7)  # -> Branch0, Branch1, Branch2, Branch3, Branch4
point_10 = Point(list_item_18)
point_11 = Point(list_item_4)
point_12 = Point(list_item_9)
point_13 = Point(list_item_7)
point_14 = Point(list_item_11)
text_tag_10 = TextTag(Location=point_10, Text=explode_tree.Branch0)
text_tag_11 = TextTag(Location=point_11, Text=explode_tree.Branch1)
text_tag_12 = TextTag(Location=point_12, Text=explode_tree.Branch2)
text_tag_13 = TextTag(Location=point_13, Text=explode_tree.Branch3)
text_tag_14 = TextTag(Location=point_14, Text=explode_tree.Branch4)

number_3 = Number(split_list.ListB)
# Outputs  - truth/labels
panel_8 = Panel(number_3)
# Normalization
average = Average(Input=flatten(split_list.ListB))
construct_domain = ConstructDomain(DomainStart=Slider(0.0001, range=0..0.0001), DomainEnd=Slider(0.9936, range=0..1))
subtraction = Subtraction(A=flatten(split_list.ListB), B=average)
bounds = Bounds(Numbers=subtraction)
remap_numbers = RemapNumbers(Value=flatten(subtraction), Source=flatten(bounds), Target=construct_domain)  # -> graft(Mapped), Clipped
number_4 = Number(remap_numbers.Mapped)

# ----
# Inputs to test
python_3_script_3 = Python3Script(T=split_list.ListA)  # -> A_out, B_out; inputs T: tree; same code as python_3_script_2
number_5 = Number(python_3_script_3.B_out)

panel_9 = Panel(number_5)

# ----
# Construct Truss
# Truss #1
# Truss #2
# Truss #3
# Truss #4
# Truss #5
explode_tree_2 = ExplodeTree(Data=number_5)  # -> Branch0, Branch1, Branch2, Branch3, Branch4

python_3_script_4 = Python3Script(T=split_list.ListA)  # -> A_out; inputs T: tree
# ---------- python_3_script_4: Python ----------
from Grasshopper import DataTree
from Grasshopper.Kernel.Data import GH_Path

split = 595

A = DataTree[object]()  


if T:
    bc = T.BranchCount  
    for i in range(split):  
        branch = T.Branch(i)
        A.AddRange(branch, GH_Path(i))  

    # 输出 A
    A_out = A
else:
    A_out = "Error: T is not a valid DataTree"
# ---------- end python_3_script_4 ----------

number_6 = Number(python_3_script_4)
panel_10 = Panel(number_6)

partition_list = PartitionList(List=explode_tree_2.Branch0, Size="2")  # -> simplify(Chunks)
split_list_2 = SplitList(List=partition_list, Index="1")  # -> simplify(ListA), simplify(ListB)
construct_point_2 = ConstructPoint(XCoordinate=split_list_2.ListA, YCoordinate=split_list_2.ListB, ZCoordinate=0)
python_3_script_5 = Python3Script(P=construct_point_2)  # -> Top, Webs, Bottom; inputs P: tree of Point3d
# ---------- python_3_script_5: Python ----------
import rhinoscriptsyntax as rs
import Rhino.Geometry as rg


# -------- 从 P（Tree Access）收集 5 个点 --------
n=3
pts = []
if hasattr(P, "BranchCount"):
    for bi in range(P.BranchCount):
        br = list(P.Branch(bi))
        if not br: 
            continue
        v = br[0]
        if isinstance(v, rg.Point3d):
            pts.append(v)
        else:
            try:
                x, y, z = v
                pts.append(rg.Point3d(float(x), float(y), float(z)))
            except:
                pass

print("Point count:", len(pts))
for i, p in enumerate(pts):
    print(i, p)

if len(pts)>=5:
    T_pts = [pts[i] for i in (0,1,2)]  
    B_pts = [pts[i] for i in (3,4)]   


T=T_pts
B=B_pts


Bottom=[rs.AddLine(B[0], B[1])]
Top=[]
Top.append(rs.AddLine(T[0], T[1]))
Top.append(rs.AddLine(T[1], T[2]))
print(Top)
Webs   = []
Webs.append(rs.AddLine(B[0], T[0]))
Webs.append(rs.AddLine(B[0], T[1]))
Webs.append(rs.AddLine(B[1], T[1]))
Webs.append(rs.AddLine(B[1], T[2]))
# ---------- end python_3_script_5 ----------
curve = Curve(python_3_script_5.Bottom)
curve_2 = Curve(python_3_script_5.Top)
curve_3 = Curve(python_3_script_5.Webs)

partition_list_2 = PartitionList(List=explode_tree_2.Branch1, Size="2")  # -> simplify(Chunks)
split_list_3 = SplitList(List=partition_list_2, Index="1")  # -> simplify(ListA), simplify(ListB)
construct_point_3 = ConstructPoint(XCoordinate=split_list_3.ListA, YCoordinate=split_list_3.ListB, ZCoordinate=0)
unit_y = UnitY(Factor="-2")
move = Move(Geometry=construct_point_3, Motion=unit_y)  # -> Geometry, Transform
python_3_script_6 = Python3Script(P=move.Geometry)  # -> Top, Webs, Bottom; inputs P: tree of Point3d; same code as python_3_script_5
curve_4 = Curve(python_3_script_6.Top)
curve_5 = Curve(python_3_script_6.Webs)
curve_6 = Curve(python_3_script_6.Bottom)

partition_list_3 = PartitionList(List=explode_tree_2.Branch3, Size="2")  # -> simplify(Chunks)
split_list_4 = SplitList(List=partition_list_3, Index="1")  # -> simplify(ListA), simplify(ListB)
construct_point_4 = ConstructPoint(XCoordinate=split_list_4.ListA, YCoordinate=split_list_4.ListB, ZCoordinate=0)
unit_y_2 = UnitY(Factor="-6")
move_2 = Move(Geometry=construct_point_4, Motion=unit_y_2)  # -> Geometry, Transform
python_3_script_7 = Python3Script(P=move_2.Geometry)  # -> Top, Webs, Bottom; inputs P: tree of Point3d; same code as python_3_script_5
curve_7 = Curve(python_3_script_7.Top)
curve_8 = Curve(python_3_script_7.Webs)
curve_9 = Curve(python_3_script_7.Bottom)

partition_list_4 = PartitionList(List=explode_tree_2.Branch2, Size="2")  # -> simplify(Chunks)
split_list_5 = SplitList(List=partition_list_4, Index="1")  # -> simplify(ListA), simplify(ListB)
construct_point_5 = ConstructPoint(XCoordinate=split_list_5.ListA, YCoordinate=split_list_5.ListB, ZCoordinate=0)
unit_y_3 = UnitY(Factor="-4")
move_3 = Move(Geometry=construct_point_5, Motion=unit_y_3)  # -> Geometry, Transform
python_3_script_8 = Python3Script(P=move_3.Geometry)  # -> Top, Webs, Bottom; inputs P: tree of Point3d; same code as python_3_script_5
curve_10 = Curve(python_3_script_8.Top)
curve_11 = Curve(python_3_script_8.Webs)
curve_12 = Curve(python_3_script_8.Bottom)

partition_list_5 = PartitionList(List=explode_tree_2.Branch4, Size="2")  # -> simplify(Chunks)
split_list_6 = SplitList(List=partition_list_5, Index="1")  # -> simplify(ListA), simplify(ListB)
construct_point_6 = ConstructPoint(XCoordinate=split_list_6.ListA, YCoordinate=split_list_6.ListB, ZCoordinate=0)
unit_y_4 = UnitY(Factor="-8")
move_4 = Move(Geometry=construct_point_6, Motion=unit_y_4)  # -> Geometry, Transform
python_3_script_9 = Python3Script(P=move_4.Geometry)  # -> Top, Webs, Bottom; inputs P: tree of Point3d; same code as python_3_script_5
curve_13 = Curve(python_3_script_9.Top)
curve_14 = Curve(python_3_script_9.Webs)
curve_15 = Curve(python_3_script_9.Bottom)

# ----
# Trained ML Model
panel_11 = Panel("0")
# Neural Network Trainer and Tester
neural_network_trainer = NeuralNetworkTrainer(
    TrainingInputs=number_6,
    TrainingOutputs=number_4,
    HiddenNeurons=6,
    LearningAlgorithm=panel_11,
    ActivationFunction="0",
    Alpha=2,
    Iterations="200")  # -> TrainedNueralNetwork, ErrorsDynamics
quick_graph = QuickGraph(neural_network_trainer.ErrorsDynamics, SortOrder=0)
panel_12 = Panel(neural_network_trainer.ErrorsDynamics)

# ----
# Tester
neural_network_tester = NeuralNetworkTester(TrainedNeuralNetwork=neural_network_trainer.TrainedNueralNetwork, TestInputData=number_5)
panel_13 = Panel(neural_network_tester)

# ----
# Back - Normalization
number_slider = Slider(0.0001, range=0..0.0001)
construct_domain_2 = ConstructDomain(DomainStart=number_slider, DomainEnd=Slider(1, range=0..1))
remap_numbers_2 = RemapNumbers(Value=flatten(panel_13), Source=flatten(construct_domain_2), Target=bounds)  # -> graft(Mapped), Clipped
addition = Addition(A=average, B=remap_numbers_2.Mapped)

# ----
# Prediction
# Prediction
panel_14 = Panel(addition)

explode_tree_3 = ExplodeTree(Data=panel_14)  # -> Branch0, Branch1, Branch2, Branch3, Branch4
point_15 = Point(list_item)
point_16 = Point(list_item_16)
point_17 = Point(list_item_6)
point_18 = Point(list_item_3)
point_19 = Point(list_item_10)
text_tag_15 = TextTag(Location=point_15, Text=explode_tree_3.Branch1)
text_tag_16 = TextTag(Location=point_17, Text=explode_tree_3.Branch2)
text_tag_17 = TextTag(Location=point_18, Text=explode_tree_3.Branch3)
text_tag_18 = TextTag(Location=point_16, Text=explode_tree_3.Branch0)
text_tag_19 = TextTag(Location=point_19, Text=explode_tree_3.Branch4)
