# Grasshopper definition 11bar.gh (Grasshopper 1.0.8)
# plug-ins: Karamba3D

number = Number(Slider(20, range=0..100))
crosec = CrossSectionKaramba3D(
    FamilyNameOfCrossSection="DefaultCroSec",
    Height_cm=number,
    UpperFlangeWidth_cm=number,
    LowerFlangeWidth_cm=number,
    UpperFlangeThickness_cm=expr("x/2-0.001", number),
    LowerFlangeThickness_cm=expr("x/2-0.001", number),
    SidewallsThickness_cm=expr("x/2-0.001", number),
    FilletRadius_cm=0.6,
    mode="Box")
crv = Curve([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])
pt = Point([Point(0, 0, 0), Point(30, 0, 0)])
point = Point(<point referenced from the Rhino model>)
point_2 = Point(<point referenced from the Rhino model>)
matprops = MaterialPropertiesKaramba3D(
    FamilyOfMaterial="Steel",
    Name="S235",
    YoungsModulus_kN_cm²=21000,
    InPlaneShearModulus_kN_cm²=8076,
    TransverseShearModulus_kN_cm²=8076,
    SpecificWeight_kN_m³=Slider(80.9, range=0..200),
    CoefficientOfThermalExpansion_1=1.2e-05,
    TensileStrength_kN_cm²=23.5,
    CompressiveStrength_kN_cm²=-23.5,
    StrengthHypothesis="MISES",
    mode="Isotrop")
merge = Merge(Data1=point_2, Data2=point)
merge_2 = Merge(Data1=crv)
point_3 = Point(merge)
material_karamba3d = MaterialKaramba3D(matprops)
cross_section_karamba3d = CrossSectionKaramba3D(crosec)
line = Line(merge_2)
panel = Panel("""10
10""")
Z = UnitZ(Factor=panel)
neg = Negative(Value=Z)
supp = SupportKaramba3D(PosInd=pt, menu=[buttons(on, off, on, off, on, off)])
loads = LoadsKaramba3D(ForceVector=neg, Local=False, PosInd=point_3, LCase="LC0", mode="Point")
linetobeam = LineToBeamKaramba3D(
    Line=line,
    CrossSection=cross_section_karamba3d,
    New=True,
    Remove=True,
    LimitDistance_m=0.005,
    Bending=True,
    SetBucklingLength=True,
    ToPolylineMaxAngle=0.03,
    ToPolylineTolerance=0.01,
    ToPolylineMaxEdgeLength=0.25)  # -> Element, Points, Info
supp_2 = SupportKaramba3D(PosInd=linetobeam.Points, menu=[buttons(off, on, off, off, off, off)])
support = Support(flatten([supp, supp_2]))
load = Load(loads)
elem = Elem(linetobeam.Element)
assemble = AssembleModelKaramba3D(Elem=elem, Support=support, Load=load, Material=material_karamba3d, LimitDistance_m=0.005)  # -> Model, Info, Mass_kg, CentreOfGravity, LoadCaseNames
model = Model(assemble.Model)
analyze = AnalyzeKaramba3D(Model=model)  # -> CalculatedModel, MaximumDisplacement_cm, ResultingForceOfGravity_kN, ElasticEnergyChange_kNm
strain_energy_stiffness = Panel(analyze.ElasticEnergyChange_kNm)
deflection = Panel(analyze.MaximumDisplacement_cm)
model_2 = Model(analyze.CalculatedModel)
modelview = ModelViewKaramba3D(Model=model_2, ResultFactors=1, ResultCase=-1)  # -> Model, DeformedMesh, DeformedAxes, DeformedModel
beamview = BeamViewKaramba3D(Model=modelview.Model)  # -> Model, MeshesOfRenderedBeams, DeformedBeamAxes, LegendColours, LegendTags
