# Grasshopper definition 2D_2bar.gh (Grasshopper 1.0.8)
# plug-ins: Karamba3D

# Span
number_slider = Slider(3.17, range=0..10)
# Length
number_slider_2 = Slider(6, range=0..10)
construct_point = ConstructPoint(XCoordinate=0, YCoordinate=0, ZCoordinate=0)
construct_point_2 = ConstructPoint(XCoordinate=number_slider_2, YCoordinate=0, ZCoordinate=0)
construct_point_3 = ConstructPoint(XCoordinate=expr("x/2", number_slider_2), YCoordinate=0, ZCoordinate=number_slider)
point = Point(construct_point)
point_2 = Point(construct_point_2)
line = Line(StartPoint=point, EndPoint=point_2)
point_3 = Point(construct_point_3)
line_2 = Line(StartPoint=point_3, EndPoint=point)
line_3 = Line(StartPoint=point_3, EndPoint=point_2)
curve = Curve(line_2)
curve_2 = Curve(line_3)
merge = Merge(Data1=curve, Data2=curve_2)
number = Number(Slider(20, range=0..100))
crosec = CrossSectionKaramba3D(
    FamilyNameOfCrossSection="DefaultCroSec",
    Height_cm=number,
    UpperFlangeWidth_cm=number,
    LowerFlangeWidth_cm=number,
    UpperFlangeThickness_cm=expr("x/2-0.001", number),
    LowerFlangeThickness_cm=expr("x/2-0.001", number),
    SidewallsThickness_cm=expr("x/2-0.001", number),
    FilletRadius_cm=0.6,
    mode="Box")
point_4 = Point(point)
point_5 = Point(point_3)
point_6 = Point(point_2)
matprops = MaterialPropertiesKaramba3D(
    FamilyOfMaterial="Steel",
    Name="S235",
    YoungsModulus_kN_cm²=21000,
    InPlaneShearModulus_kN_cm²=8076,
    TransverseShearModulus_kN_cm²=8076,
    SpecificWeight_kN_m³=Slider(80.9, range=0..200),
    CoefficientOfThermalExpansion_1=1.2e-05,
    TensileStrength_kN_cm²=23.5,
    CompressiveStrength_kN_cm²=-23.5,
    StrengthHypothesis="MISES",
    mode="Isotrop")
material_karamba3d = MaterialKaramba3D(matprops)
cross_section_karamba3d = CrossSectionKaramba3D(crosec)
negative = Negative(Value=Slider(100, range=0..100))
line_4 = Line(merge)
unit_z = UnitZ(Factor=negative)
supp = SupportKaramba3D(PosInd=[point_6, point_4, point_5], menu=[buttons(off, on, off, off, off, off)])
supp_2 = SupportKaramba3D(PosInd=[point_4, point_6], menu=[buttons(on, off, on, off, on, off)])
loads = LoadsKaramba3D(ForceVector=unit_z, Local=False, PosInd=point_5, LCase="LC0", mode="Point")
loads_2 = LoadsKaramba3D(Vector=Vector(0, 0, -1), LCase="LC0", mode="Gravity")
linetobeam = LineToBeamKaramba3D(
    Line=line_4,
    CrossSection=cross_section_karamba3d,
    New=True,
    Remove=True,
    LimitDistance_m=0.005,
    Bending=True,
    SetBucklingLength=True,
    ToPolylineMaxAngle=0.03,
    ToPolylineTolerance=0.01,
    ToPolylineMaxEdgeLength=0.25)  # -> Element, Points, Info
support = Support(flatten([supp_2, supp]))
load = Load([loads, loads_2])
elem = Elem(linetobeam.Element)
assemble = AssembleModelKaramba3D(Elem=elem, Support=support, Load=load, Material=material_karamba3d, LimitDistance_m=0.005)  # -> Model, Info, Mass_kg, CentreOfGravity, LoadCaseNames
model = Model(assemble.Model)
analyze = AnalyzeKaramba3D(Model=model)  # -> CalculatedModel, MaximumDisplacement_cm, ResultingForceOfGravity_kN, ElasticEnergyChange_kNm
strain_energy_stiffness = Panel(analyze.ElasticEnergyChange_kNm)
deflection = Panel(analyze.MaximumDisplacement_cm)
model_2 = Model(analyze.CalculatedModel)
modelview = ModelViewKaramba3D(Model=model_2, ResultFactors=1, ResultCase=-1)  # -> Model, DeformedMesh, DeformedAxes, DeformedModel
beamview = BeamViewKaramba3D(Model=modelview.Model)  # -> Model, MeshesOfRenderedBeams, DeformedBeamAxes, LegendColours, LegendTags
