# Grasshopper definition SizingMembers.gh (Grasshopper 1.0.8)
# plug-ins: Karamba3D, RhinoCodePluginGH, LunchBox

y2 = Slider(1, range=1..15)
# GENERATE GEOMETRY
x3 = Slider(0, range=-5..5)
x2 = Slider(10, range=5..15)
v = Slider(9, range=0..12)
u = Slider(2, range=0..12)
xz = XZPlane(Origin=Point(0, 0, 0))
pt = PointOriented(BasePlane=xz, UComponent=x3, VComponent=y2, WComponent=0)
pt_2 = PointOriented(BasePlane=xz, UComponent=x2, VComponent=y2, WComponent=0)
integer = Integer(u)
integer_2 = Integer(v)
srf4pt = _4PointSurface(CornerA="0,0,0", CornerB=pt, CornerC=pt_2, CornerD="10,0,0")
integer_3 = Integer(integer)
braced_grid_2_d_structure = BracedGrid2DStructure(Surface=srf4pt, UDivisions=expr("x-1", integer), VDivisions=expr("x-1", integer_2))  # -> PrimaryLines, BraceLines, StructureNodes
sdivide = DivideSurface(Surface=srf4pt, UCount=expr("x-1", integer), VCount=expr("x-1", integer_2))  # -> Points, Normals, Parameters
subtraction = Subtraction(A=integer_3, B="1")
pt_3 = Point(flatten(sdivide.Points))
curve = Curve(braced_grid_2_d_structure.BraceLines)
pt_4 = Point(sdivide.Points)
point = Point(simplify(pt_4))
tree_branch = TreeBranch(Tree=point, Path="0", MaintainPaths=True)
curve_2 = Curve(braced_grid_2_d_structure.PrimaryLines)
integer_4 = Integer(subtraction)
tree_branch_2 = TreeBranch(Tree=point, Path=integer_4, MaintainPaths=True)
list_length = ListLength(List=pt_3)
integer_5 = Integer(integer_2)
curve_3 = Curve(flatten([curve_2, curve]))
integer_division = IntegerDivision(A=integer_5, B="2")
series = Series(Start=0, Step=1, Count=list_length)
point_2 = Point(tree_branch_2)
point_3 = Point(point_2)
list_item = ListItem(List=tree_branch, Index=0, Wrap=True)  # -> Item1, Item
point_4 = Point(point_2)
list_item_2 = ListItem(List=point_3, Index=integer_division, Wrap=True)
integer_6 = Integer(series)
list_item_3 = ListItem(List=point_4, Index=0, Wrap=True)
point_5 = Point(flatten([list_item.Item, list_item.Item1]))
point_6 = Point(list_item_2)
py3 = Python3Script()  # -> out, a; unedited script template
len = Length(Curve=curve_3)
# SOLID CROSS SECTION
# Set Volume (m^3)
number_slider = Slider(1, range=0..1)
num = Number(len)
ma = MassAddition(Input=num)  # -> Result, PartialResults
num_2 = Number(ma.Result)
num_3 = Number(num_2)
num_4 = Number(number_slider)
txt = Text("LC0")
division = Division(A=num_4, B=num_3)
num_5 = Number(division)
num_6 = Number(num_5)
expression = Expression(A=num_6, Expression="100*(2*(A/pi)^0.5)")
loads = LoadsKaramba3D(ForceVector="{0,0,-20}", Local=False, PosInd=point_6, LCase=txt, mode="Point")
supp = SupportKaramba3D(PosInd=integer_6, menu=[buttons(off, on, off, off, off, off)])
supp_2 = SupportKaramba3D(PosInd=list_item_3, menu=[buttons(on, off, on, off, off, off)])
supp_3 = SupportKaramba3D(PosInd=point_5, menu=[buttons(on, off, on, off, off, off)])
num_7 = Number(expression)
num_8 = Number(num_7)
# DEFINE DESIGN
crosec = CrossSectionKaramba3D(FamilyNameOfCrossSection="DefaultCroSec", Diameter_cm=num_8, WallThickness_cm=expr("x/2", num_8), mode="Circular Hollow")
lineelem = CreateLinearElementKaramba3D(
    Line=curve_3,
    CrossSection=crosec,
    LimitDistance_m=0.005,
    BucklingLengthY_m=-1,
    BucklingLengthZ_m=-1,
    BucklingLengthLT_m=-1,
    Bending=True,
    ToPolylineMaxAngle=0.03,
    ToPolylineTolerance=0.01,
    ToPolylineMaxEdgeLength=0.25,
    New=True,
    Remove=True,
    mode="LineToBeam")  # -> Element, Points, Info
load = Load(loads)
set_diameter_cm = Panel(num_7)
set_cross_section_area_m_2 = Panel(num_5)
set_cross_section_area_m_2_2 = Panel(num_2)
support = SupportKaramba(flatten([supp_3, supp_2, supp]))
assemble = AssembleModelKaramba3D(Point=pt_3, Elem=lineelem.Element, Support=support, Load=load, LimitDistance_m=0.005)  # -> Model, Info, Mass_kg, CentreOfGravity, LoadCaseNames
analyse = AnalyseKaramba3D(Model=assemble.Model)  # -> AnalysedModel, MaximumDisplacement_cm, ResultingForce_kN, ChangeOfElasticEnergy_kNm
model_karamba3d = ModelKaramba3D(analyse.AnalysedModel)
number = Number(assemble.Mass_kg)
# OPTIMISE
model_karamba3d_2 = ModelKaramba3D(model_karamba3d)
# Create Cross Sections
number_2 = Number(number)
utilization = UtilizationOfElementsKaramba3D(
    AnalysedModel=model_karamba3d_2,
    NumberOfSamplePoints=3,
    ElasticDesign=True,
    GammaM0=1,
    GammaM1=1.1,
    SwayFrame=True,
    WithDetails=False,
    mode="Beams")  # -> Model, Utilization, SigMax_kN_cm², SigMin_kN_cm², TauMax_kN_cm², UtilN, UtilVy, UtilVz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
mass_before = Panel(number_2)
beamview = BeamViewKaramba3D(Model=model_karamba3d_2)  # -> Model, MeshesOfRenderedBeams, DeformedBeamAxes, LegendColours, LegendTags
num_9 = Number(flatten(utilization.Utilization))
sort_list = SortList(Keys=num_9)  # -> Keys, ValuesValuesA
list_item_4 = ListItem(List=sort_list.Keys, Index=0, Wrap=True)  # -> Item1, Item
# Always Make Sure No Elements Are Failing!!
panel = Panel(sort_list.ValuesValuesA)
number_3 = Number(list_item_4.Item)
number_4 = Number(list_item_4.Item1)
larger_than = LargerThan(FirstNumber=number_4, SecondNumber="1")  # -> LargerThan, OrEqualTo
panel_2 = Panel(sort_list.Keys)
failing = Panel(larger_than.LargerThan)
max_utilisation = Panel(number_4)
min_utilisation = Panel(number_3)
