# Grasshopper definition FormfindEarth.gh (Grasshopper 1.0.8)
# plug-ins: Karamba3D

construct_domain = ConstructDomain(DomainStart=Slider(0.6, range=0..1), DomainEnd=1)

number_slider = Slider(10, range=0..10)
number_slider_2 = Slider(4, range=0..10)
series = Series(Start=number_slider_2, Step=number_slider_2, Count=number_slider)

# ----
# Play with Me
seed = Slider(7, range=0..15)

# ---- group: Geometry generation
radius = Slider(35, range=0..100)
number_slider_3 = Slider(12, range=0..100)
xy_plane = XYPlane(Origin=Point(0, 0, 0))
circle = Circle(Plane=xy_plane, Radius=radius)
divide_curve = DivideCurve(Curve=circle, Count=number_slider_3, Kinks=False)  # -> Points, Tangents, Parameters
line = Line(StartPoint=xy_plane, EndPoint=divide_curve.Points)
end_points = EndPoints(Curve=line)  # -> Start, End
rotation = Slider(-20, range=-30..30)
vector_2pt = Vector2Pt(PointA=end_points.Start, PointB=end_points.End, Unitize=False)  # -> Vector, Length
construct_domain_2 = ConstructDomain(DomainStart=rotation, DomainEnd=Slider(20, range=-30..30))
unit_vector = UnitVector(Vector=vector_2pt.Vector)
move = Slider(-15, range=-30..30)
line_sdl = LineSDL(Start=end_points.End, Direction=unit_vector, Length=Slider(1, range=0..1))
random = Random(Range=construct_domain_2, Number=number_slider_3, Seed=seed)
construct_domain_3 = ConstructDomain(DomainStart=move, DomainEnd=Slider(15, range=-30..30))
rotate = Rotate(Geometry=line_sdl, Angle=degrees(random), Plane=end_points.End)  # -> Geometry, Transform
random_2 = Random(Range=construct_domain_3, Number=number_slider_3, Seed=seed)
vector_display = VectorDisplay(Anchor=end_points.End, Vector=rotate.Geometry)
line_sdl_2 = LineSDL(Start=end_points.End, Direction=rotate.Geometry, Length=random_2)
end_points_2 = EndPoints(Curve=line_sdl_2)  # -> Start, End
point = Point(end_points_2.End)
interpolate = Interpolate(Vertices=point, Degree=Slider(5, range=0..10), Periodic=True, KnotStyle=1)  # -> Curve, Length, Domain
divide_curve_2 = DivideCurve(Curve=interpolate.Curve, Count=Slider(50, range=0..100), Kinks=False)  # -> Points, Tangents, Parameters
polyline = PolyLine(Vertices=divide_curve_2.Points, Closed=True)
range = Range(Domain=construct_domain, Steps=number_slider)
bounds = Bounds(Numbers=range)
unit_z = UnitZ(Factor=series)
list_length = ListLength(List=series)
remap_numbers = RemapNumbers(Value=range, Source=bounds, Target=construct_domain)  # -> Mapped, Clipped
repeat_data = RepeatData(Data=unit_z, Length=list_length)
graph_mapper = GraphMapper(
    remap_numbers.Mapped,
    x0=0,
    x1=1,
    y0=0,
    y1=1,
    container_name="Bezier",
    cpx=[0, 0, 0.6171260476, 1],
    cpy=[0, 0.4709937572, 1, 1])
move_2 = Move(Geometry=flatten(polyline), Motion=repeat_data)  # -> Geometry, Transform
bounds_2 = Bounds(Numbers=graph_mapper)
merge = Merge(Data1=polyline, Data2=reverse(flatten(move_2.Geometry)))  # -> flatten(Result)
remap_numbers_2 = RemapNumbers(Value=graph_mapper, Source=bounds_2, Target=construct_domain)  # -> Mapped, Clipped
area = Area(Geometry=merge)  # -> Area, Centroid
scale = Scale(Geometry=merge, Center=area.Centroid, Factor=remap_numbers_2.Mapped)  # -> Geometry, Transform
control_points = ControlPoints(Curve=scale.Geometry)  # -> Points, Weights, Knots
cull_index = CullIndex(List=scale.Geometry, Indices=-1, Wrap=True)
flip_matrix = FlipMatrix(Data=control_points.Points)
polyline_2 = PolyLine(Vertices=flip_matrix, Closed=False)

# ---- group: Force density of rings
number_slider_4 = Slider(3.8, range=0.1..10)
number_slider_5 = Slider(6.3, range=0.1..10)
number_slider_6 = Slider(3.7, range=0.1..10)
number_slider_7 = Slider(7.2, range=0.1..10)
number_slider_8 = Slider(9.7, range=0.1..10)
number_slider_9 = Slider(7.6, range=0.1..10)
number_slider_10 = Slider(4.2, range=0.1..10)
number_slider_11 = Slider(9.7, range=0.1..10)
number_slider_12 = Slider(9.3, range=0.1..10)
number_slider_13 = Slider(9.7, range=0.1..10)
number_slider_14 = Slider(9.6, range=0.1..10)
merge_2 = Merge(
    Data1=number_slider_4,
    Data2=number_slider_5,
    Data3=number_slider_6,
    Data4=number_slider_8,
    Data5=number_slider_7,
    Data6=number_slider_9,
    Data7=number_slider_10,
    Data8=number_slider_12,
    Data9=number_slider_13,
    Data10=number_slider_14,
    Data11=number_slider_11)

# ---- group: Force density of radials
number_slider_15 = Slider(4, range=0.1..10)

# ----
galapagos = Galapagos(
    fitness=ma,
    gene=[number_slider_5, number_slider_4, number_slider_6, number_slider_8, number_slider_7, number_slider_9, number_slider_10, number_slider_12, number_slider_13, number_slider_14, number_slider_11])

# ---- group: FDM form finding
# boundary constrain point
control_points_2 = ControlPoints(Curve=polyline)  # -> Points, Weights, Knots

# ---- group: FDM form finding / support
point_2 = Point(flatten(control_points_2.Points))
removeduplicatepts = RemoveDuplicatePts(Points=flatten(point_2), Tolerance=0.01)

# ----
num = Number(graft(merge_2))
reset = Button()
data = Data(Toggle(True))
data_2 = Data(Toggle(True))
data_3 = Data(reset)
num_2 = Number(seed)
txt = Text("data_table.csv")
txt_2 = Text("screenshot")
# Create header row of csv spreadsheet,
# containing names of the columns
merge_3 = Merge(Data1="boundary_shape", Data2="load_path", Data3="image_path")
data_4 = Data(num_2)
data_5 = Data(data_3)
bool = Boolean(data)
bool_2 = Boolean(bool)
txt_3 = Text(merge_3)
bool_3 = Boolean(data_2)
data_6 = Data(data_3)

# ---- group: FDM form finding
merge_4 = Merge(Data1=flatten(polyline_2), Data2=flatten(scale.Geometry))  # -> flatten(Result)
explode = Explode(Curve=flatten(polyline_2), Recursive=True)  # -> flatten(Segments), Vertices
explode_2 = Explode(Curve=scale.Geometry, Recursive=True)  # -> Segments, Vertices
explode_3 = Explode(Curve=merge_4, Recursive=True)  # -> Segments, Vertices
list_length_2 = ListLength(List=explode_2.Segments)
list_length_3 = ListLength(List=explode.Segments)
repeat_data_2 = RepeatData(Data=number_slider_15, Length=list_length_3)  # -> flatten(Data)
repeat_data_3 = RepeatData(Data=num, Length=list_length_2)  # -> flatten(Data)
number_slider_16 = Slider(1.56, range=-10..10)

curve = Curve(flatten(explode_3.Segments))

# ---- group: FDM form finding / force density
force_density = Merge(Data1=flatten(repeat_data_2), Data2=flatten(repeat_data_3))

# ---- group: FDM form finding (continued)
end_points_3 = EndPoints(Curve=curve)  # -> Start, End
length = Length(Curve=curve)
point_3 = Point(flatten([end_points_3.Start, end_points_3.End]))
removeduplicatepts_2 = RemoveDuplicatePts(Points=point_3, Tolerance=0.01)
point_4 = Point(flatten(removeduplicatepts_2))
end_points_4 = EndPoints(Curve=curve)  # -> Start, End
point_5 = Point(flatten(point_4))
point_6 = Point(flatten(point_4))
cps = ClosestPointsKaramba3D(Point=end_points_4.Start, Cloud=point_5, NumberOfNeighbours=1, LimitDistance=-1)  # -> Points, Index, Distance
cps_2 = ClosestPointsKaramba3D(Point=removeduplicatepts, Cloud=point_5, NumberOfNeighbours=1, LimitDistance=-1)  # -> Points, Index, Distance
cps_3 = ClosestPointsKaramba3D(Point=end_points_4.End, Cloud=point_5, NumberOfNeighbours=1, LimitDistance=-1)  # -> Points, Index, Distance
shift_paths = ShiftPaths(Data=cps_3.Index, Offset=-1)  # -> simplify(Data)
shift_paths_2 = ShiftPaths(Data=cps.Index, Offset=-1)  # -> simplify(Data)
number = Number(flatten(cps_2.Index))
cull_index_2 = CullIndex(List=point_5, Indices=number, Wrap=True)
deconstruct = Deconstruct(Point=cull_index_2)  # -> XComponent, YComponent, ZComponent
cps_4 = ClosestPointsKaramba3D(Point=cull_index_2, Cloud=point_6, NumberOfNeighbours=1, LimitDistance=-1)  # -> Points, flatten(Index), Distance
construct_point = ConstructPoint(XCoordinate=deconstruct.XComponent, YCoordinate=deconstruct.YComponent, ZCoordinate=Slider(10, range=0..10))
replace_items = ReplaceItems(List=point_6, Item=construct_point, Indices=cps_4.Index, Wrap=False)
merge_5 = Merge(Data1=graft(shift_paths_2), Data2=graft(shift_paths))  # -> flatten(Result)
point_7 = Point(replace_items)

# ---- group: FDM form finding / loads
vector_xyz = VectorXYZ(XComponent=0, YComponent=0, ZComponent=number_slider_16)  # -> Vector, Length
list_length_4 = ListLength(List=point_5)
repeat_data_4 = RepeatData(Data=vector_xyz.Vector, Length=list_length_4)  # -> flatten(Data)

# ---- group: FDM form finding / FDM
python_3_script = Python3Script(vertices=point_7, edges=merge_5, fixed=number, q=force_density, loads=repeat_data_4)  # -> out, XYZ, Acond, method, msg; inputs vertices: list of Point3d, edges: list, fixed: list, q: list, loads: list
# ---------- python_3_script: Python ----------
# GhPython – Force Density Method (Python 3, NumPy + SciPy sparse)
# Inputs:
#   vertices : [Point3d, ...]
#   edges    : [(i, j), ...]  # vertex indices (0- or 1-based)
#   fixed    : [k1, k2, ...]  # fixed node indices
#   q        : float OR [q_e1, q_e2, ...]  # scalar broadcasts to all edges
#   loads    : optional [Vector3d or (fx,fy,fz) per node], len = n (None/[] => zeros)
#   zero_based : optional bool or None; if None, auto-detect 1-based vs 0-based
#
# Outputs:
#   XYZ    : [Point3d, ...]
#   Acond  : float or None
#   method : "spsolve" or "lstsq"
#   msg    : str

import Rhino
from Rhino.Geometry import Point3d
import numpy as np

from scipy.sparse import coo_matrix, diags
from scipy.sparse.linalg import spsolve
from numpy.linalg import lstsq

def to_int_pairs(E):
    out = []

    for i in range(int(len(E)/2)):
        out.append([E[2*i], E[2*i+1]])

    return out

def ghpts_to_np(V):
    arr = []
    for v in V:
        if hasattr(v, "X"):
            arr.append([v.X, v.Y, v.Z])
        else:
            arr.append([float(v[0]), float(v[1]), float(v[2])])
    return np.asarray(arr, dtype=float)

def ghvecs_to_np(vecs, n):
    if vecs is None or len(vecs) == 0:
        return np.zeros((n,3), dtype=float)
    if len(vecs) != n:
        raise ValueError("loads length ({}) must equal number of nodes ({}).".format(len(vecs), n))
    arr = []
    for v in vecs:
        if hasattr(v, "X"):
            arr.append([v.X, v.Y, v.Z])
        else:
            arr.append([float(v[0]), float(v[1]), float(v[2])])
    return np.asarray(arr, dtype=float)

def detect_one_based(edges_ij, fixed_idx, n):
    if not edges_ij and not fixed_idx:
        return False
    mins = []
    maxs = []
    if edges_ij:
        mins.append(min(min(i,j) for (i,j) in edges_ij))
        maxs.append(max(max(i,j) for (i,j) in edges_ij))
    if fixed_idx:
        mins.append(min(fixed_idx))
        maxs.append(max(fixed_idx))
    mn = min(mins) if mins else 0
    mx = max(maxs) if maxs else 0
    # If everything is within [1, n] and nothing is 0, likely 1-based.
    if mn >= 1 and mx <= n:
        return True
    return False

def normalize_indices(E, F, n, zero_based_flag):
    """Normalize edges & fixed to 0-based indices."""
    if zero_based_flag is None:
        is_one_based = detect_one_based(E, F, n)
    else:
        is_one_based = not bool(zero_based_flag)
    if is_one_based:
        E = [(i-1, j-1) for (i,j) in E]
        F = [k-1 for k in F]
    return E, F

def validate_ranges(E, F, n):
    for (i,j) in E:
        if i < 0 or i >= n or j < 0 or j >= n:
            raise IndexError("Edge index out of range: ({}, {}) for n={}".format(i, j, n))
    for k in F:
        if k < 0 or k >= n:
            raise IndexError("Fixed node index out of range: {} for n={}".format(k, n))

def build_incidence_sparse(edges_ij, n):
    m = len(edges_ij)
    rows = np.arange(m)
    data = np.concatenate((-np.ones(m), np.ones(m)))
    row_idx = np.concatenate((rows, rows))
    col_idx = np.asarray(edges_ij, dtype=int).reshape(2*m, order="F")
    C = coo_matrix((data, (row_idx, col_idx)), shape=(m, n)).tocsr()
    return C

def cond_estimate_dense(A, max_nf=1500):
    nf = A.shape[0]
    if nf > max_nf:
        return None
    try:
        return float(np.linalg.cond(A.toarray()))
    except:
        return None

# ---------- Guard inputs ----------
if vertices is None or edges is None or fixed is None or q is None:
    XYZ, Acond, method, msg = [], None, "", "Missing one or more inputs."
else:
    # Nodal coords (n x 3)
    V = ghpts_to_np(vertices)
    n = V.shape[0]

    # Edges & fixed lists
    E = to_int_pairs(edges)
    F = [int(k) for k in fixed]

    # Normalize indices to 0-based (auto-detect if zero_based is None)
    # E, F = normalize_indices(E, F, n, zero_based if 'zero_based' in globals() else None)
    validate_ranges(E, F, n)

    # Partition nodes
    fixed_set = set(F)
    all_nodes = set(range(n))
    free_idx = sorted(list(all_nodes - fixed_set))
    F = sorted(list(fixed_set))

    if len(free_idx) == 0:
        XYZ = [Point3d(*row) for row in V]
        Acond, method, msg = None, "none", "All nodes fixed; no solve performed."
    else:
        # q vector (broadcast scalar if needed)
        if isinstance(q, (int, float)):
            qv = np.full(len(E), float(q), dtype=float)
        else:
            qv = np.asarray(q, dtype=float).reshape(-1)
            if len(qv) == 1 and len(E) > 1:
                qv = np.full(len(E), float(qv[0]), dtype=float)
            if len(qv) != len(E):
                XYZ, Acond, method, msg = [], None, "", \
                    "q length mismatch: got {}, expected {}.".format(len(qv), len(E))
                raise Exception(msg)

        # Loads (n x 3), may be zeros
        P = ghvecs_to_np(loads if 'loads' in globals() else None, n)
        P_free = P[free_idx, :]

        # Sparse incidence and Q
        C  = build_incidence_sparse(E, n)   # (m x n)
        Ci = C[:, free_idx]                 # (m x nf)
        Cf = C[:, F] if len(F) > 0 else C[:, []]
        Q  = diags([qv], [0])               # (m x m), sparse

        # System: A X_free = B, shared for x,y,z
        A = (Ci.T).dot(Q.dot(Ci))           # (nf x nf), sparse
        if len(F) > 0:
            V_fixed = V[F, :]
            rhs_fix = (Ci.T).dot(Q.dot(Cf.dot(V_fixed)))  # (nf x 3)
        else:
            rhs_fix = np.zeros((len(free_idx), 3), dtype=float)

        B = P_free - rhs_fix                # (nf x 3)

        # Solve coord-wise with spsolve; fallback to dense lstsq if needed
        try:
            A_csc = A.tocsc()
            X_free = np.zeros_like(B)
            for c in range(3):
                X_free[:, c] = spsolve(A_csc, B[:, c])
            method = "spsolve"
        except Exception:
            X_free, *_ = lstsq(A.toarray(), B, rcond=None)
            method = "lstsq"

        # Assemble
        V_out = V.copy()
        V_out[free_idx, :] = X_free
        XYZ   = [Point3d(float(p[0]), float(p[1]), float(p[2])) for p in V_out]
        Acond = cond_estimate_dense(A)
        msg   = "Solved (nf={}, m={}, method={}).".format(len(free_idx), len(E), method)
# ---------- end python_3_script ----------

# ---- group: FDM form finding (continued)
list_item = ListItem(List=python_3_script.XYZ, Index=shift_paths, Wrap=True)
list_item_2 = ListItem(List=python_3_script.XYZ, Index=shift_paths_2, Wrap=True)
line_2 = Line(StartPoint=list_item, EndPoint=list_item_2)
line_3 = Line(line_2)
length_2 = Length(Curve=line_3)
multiplication = Multiplication(A=length_2, B=force_density)

# ---- group: FDM form finding / Internal force
number_2 = Number(multiplication)

# ---- group: FDM form finding (continued)
bnd = Bounds(Numbers=number_2)
dedomain = DeconstructDomain(Domain=bnd)  # -> Start, End

# ---- group: Illustration
panel = Panel(number_2)
absolute = Absolute(Value=panel)
multiplication_2 = Multiplication(A=absolute, B=Slider(0.02, range=0..1))
larger_than = LargerThan(FirstNumber=number_2, SecondNumber=0)  # -> LargerThan, OrEqualTo
pipe = Pipe(Curve=line_3, Radius=multiplication_2, Caps=0)  # -> flatten(Pipe); disabled
dispatch = Dispatch(List=pipe, DispatchPattern=larger_than.LargerThan)  # -> ListA, ListB
custom_preview = CustomPreview(Geometry=dispatch.ListB, Material="Blue")
custom_preview_2 = CustomPreview(Geometry=dispatch.ListA, Material="Red")
custom_curve_preview = CustomCurvePreview(Curve=line_3, Colour=RGB(0, 0, 0))

# ----
# SAVING
# Path
panel_2 = Panel("save_folder")
python_3_script_2 = Python3Script()  # -> out, path
# ---------- python_3_script_2: Python ----------
import os

_filepath = ghenv.Component.OnPingDocument().FilePath
path = os.path.dirname(_filepath)
# ---------- end python_3_script_2 ----------
folder_path = Panel(python_3_script_2.path)
txt_4 = Text("case")
txt_5 = Text("json")
txt_6 = Text(panel_2)
txt_7 = Text(folder_path)
num_3 = Number(length_2)
num_4 = Number(number_2)
path = Python3Script(path=txt_7, to_append=txt_6)  # -> out, path
# ---------- path: Python ----------
import os
if to_append:
    path_ = os.path.join(path, to_append)
# ---------- end path ----------
abs = Absolute(Value=num_4)
txt_8 = Text(path.path)
multiplication_3 = Multiplication(A=num_3, B=abs)
ma = MassAddition(Input=multiplication_3)  # -> Result, PartialResults
panel_3 = Panel(txt_8)
txt_9 = Text(folder_path)

py3 = Python3Script(x=ma.Result)  # -> out, a
# ---------- py3: Python ----------
"""Grasshopper Script"""
# a = "Hello Python 3 in Grasshopper!"
# print(a)
import datetime
a = datetime.datetime.now().strftime("%Y-%m-%d-%H-%M-%S-%f")
# ---------- end py3 ----------
txt_10 = Text(py3.a)

concat = Concatenate(FragmentA=txt_4, FragmentD=txt_10, FragmentB=".", FragmentC=txt_5)
txt_11 = Text(concat)
panel_4 = Panel(txt_11)

# ---- group: Save files
int = Integer(shift_paths)
num_5 = Number(force_density)
num_6 = Number(flatten(number))
int_2 = Integer(shift_paths_2)
py3_2 = Python3Script(
    path=txt_8,
    filename=txt_11,
    nodes=point_5,
    edges_u=int,
    edges_v=int_2,
    q=num_5,
    l=num_3,
    f=num_4,
    load_path=ma.Result,
    max_f=dedomain.End,
    support=num_6)  # -> out, a; inputs nodes: list of Point3d, edges_u: list, edges_v: list, q: list of Double, l: list of Double, f: list of Double, load_path: list of Double, max_f: list, support: list of Int32
# ---------- py3_2: Python ----------
"""Provides a scripting component.
    Inputs:
        x: The x script variable
        y: The y script variable
    Output:
        a: The a output variable"""
        
__author__ = "Asymptotic"
__version__ = "2025.03.10"
        
import rhinoscriptsyntax as rs
import compas
        
from compas.datastructures import Graph

import os
filepath = os.path.join(path, filename)       
g = Graph()
        
g.default_edge_attributes.update({'f': None})
g.default_edge_attributes.update({'l': None})
g.default_edge_attributes.update({'max_f': None})
_ = [g.add_node(x=_n.X, y=_n.Y, z=_n.Z) for _n in nodes]
g.default_node_attributes.update({'is_fixed': False})
g.nodes_attribute(keys=support, name='is_fixed', value=True)
        
        
uv = [g.add_edge(_u, _v) for _u, _v in zip(edges_u, edges_v)]
        
_ = [g.edge_attribute((_u, _v), name='f', value=_val) \
    for (_u, _v), _val in zip(uv, f)]
        
_ = [g.edge_attribute((_u, _v), name='l', value=_val) \
    for (_u, _v), _val in zip(uv, l)]
        
_ = [g.edge_attribute((_u, _v), name='max_f', value=_val) \
    for (_u, _v), _val in zip(uv, max_f)]
        
_ = [g.edge_attribute((_u, _v), name='q', value=_val) \
    for (_u, _v), _val in zip(uv, q)]
        
        
g.to_json(filepath)
# ---------- end py3_2 ----------

# ---- group: make folder if it does not exists
path_2 = Python3Script(path=txt_8)  # -> out
# ---------- path_2: Python ----------
import os
if not os.path.exists(path):
    os.makedirs(path)
# ---------- end path_2 ----------

# ----
num_7 = Number(ma.Result)
txt_12 = Text(txt_8)
# CSV File Streamer
txt_13 = Text(txt_12)
data_7 = Data(num_7)
path_3 = Python3Script(path=txt_13, to_append=txt)  # -> out, path; same code as path
path_4 = Python3Script(path=txt_12, to_append=txt_2)  # -> out, path; same code as path
# Screenshot Saver
data_8 = Data(flatten(ma.Result))
txt_14 = Text(path_3.path)
txt_15 = Text(path_4.path)
item = ListItem(List=data_8, Index=0, Wrap=True)
c_name_iterator = CSharpScript(port=item, T=bool_2, R=data_5, P=txt_15)  # -> out, A; inputs T: Boolean, R: Boolean
# ---------- c_name_iterator: C# ----------
    if(T)
    {
      n++;
    }
    if(R)
    {
      n = 0;
    }
    A = P + "_" + n + ".jpg";
# ---------- c_name_iterator: C# additional code ----------
  public int n;
# ---------- end c_name_iterator ----------
panel_5 = Panel(txt_14)
txt_16 = Text(c_name_iterator.A)
data_9 = Data(txt_16)
# Merge data
merge_6 = Merge(Data1=flatten(data_4), Data2=flatten(data_7), Data3=flatten(data_9))
data_10 = Data(flatten(merge_6))
panel_6 = Panel(data_10)
txt_17 = Text(txt_14)
data_11 = Data(data_10)
c_script = CSharpScript(T=bool_2, P=txt_16)  # inputs T: Boolean, P: String
# ---------- c_script: C# ----------
using System;
using System.Collections;
using System.Collections.Generic;

using Rhino;
using Rhino.Geometry;

using Grasshopper;
using Grasshopper.Kernel;
using Grasshopper.Kernel.Data;
using Grasshopper.Kernel.Types;

/// <summary>
/// This class will be instantiated on demand by the Script component.
/// </summary>
public class Script_Instance : GH_ScriptInstance
{
  /// <summary>Print a String to the [Out] Parameter of the Script component.</summary>
  /// <param name="text">String to print.</param>
  private void Print(string text) { /* Implementation hidden. */ }
  /// <summary>Print a formatted String to the [Out] Parameter of the Script component.</summary>
  /// <param name="format">String format.</param>
  /// <param name="args">Formatting parameters.</param>
  private void Print(string format, params object[] args) { /* Implementation hidden. */ }
  /// <summary>Print useful information about an object instance to the [Out] Parameter of the Script component. </summary>
  /// <param name="obj">Object instance to parse.</param>
  private void Reflect(object obj) { /* Implementation hidden. */ }
  /// <summary>Print the signatures of all the overloads of a specific method to the [Out] Parameter of the Script component. </summary>
  /// <param name="obj">Object instance to parse.</param>
  private void Reflect(object obj, string method_name) { /* Implementation hidden. */ }

  /// <summary>Gets the current Rhino document.</summary>
  private readonly RhinoDoc RhinoDocument;
  /// <summary>Gets the Grasshopper document that owns this script.</summary>
  private readonly GH_Document GrasshopperDocument;
  /// <summary>Gets the Grasshopper script component that owns this script.</summary>
  private readonly IGH_Component Component;
  /// <summary>
  /// Gets the current iteration count. The first call to RunScript() is associated with Iteration==0.
  /// Any subsequent call within the same solution will increment the Iteration count.
  /// </summary>
  private readonly int Iteration;

  /// <summary>
  /// This procedure contains the user code. Input parameters are provided as regular arguments,
  /// Output parameters as ref arguments. You don't have to assign output parameters,
  /// they will have a default value.
  /// </summary>
  private void RunScript(bool T, string P)
  {
    if(T)
    {
      var file_name = "";
      if (P != "")
      {
        file_name = P;
        var bitmap = RhinoDoc.ActiveDoc.Views.ActiveView.CaptureToBitmap(false, false, false);
        //Clipboard.SetImage(bitmap);
        bitmap.Save(file_name);
      }
    }


  }

  // <Custom additional code> 

  // </Custom additional code> 
}
# ---------- end c_script ----------
ghpython_script = GhPythonScript(filepath=txt_17, head=txt_3, data=data_11, write=bool_3, reset=data_6)  # -> out, a; inputs head: list, data: list
# ---------- ghpython_script: Python ----------
__author__ = "tamk"
__version__ = "2024.04.04"

import rhinoscriptsyntax as rs
from scriptcontext import sticky
import os
import sys


if reset:
    _ = sticky.pop('filestream', {})
    
fs = sticky.setdefault('filestream', None)

if not fs and filepath and write:
    fs = sticky['filestream'] = open(filepath, 'w')
    if head:
        fs.write(','.join(str(_h) for _h in head) + '\n')
    
if fs and write:
    fs.write(','.join(str(_x) for _x in data) + '\n')
    fs.flush()

if fs and not write:
    fs.close()
    fs = sticky['filestream'] = None
# ---------- end ghpython_script ----------
full_saved_image_path = Panel(txt_16)
