# Grasshopper definition install.gh (Grasshopper 1.0.8)
# plug-ins: RhinoCodePluginGH

py3 = Python3Script()  # -> out
# ---------- py3: Python ----------
import numpy as np

print("Imported Numpy...")

import scipy as sp

print("Imported Scipy...")
# ---------- end py3 ----------
py3_2 = Python3Script()  # -> out
# ---------- py3_2: Python ----------
#! python3
# r: compas

print("Installed COMPAS...")
import compas
from compas.datastructures import Mesh

print("Imported COMPAS...")
# ---------- end py3_2 ----------
panel = Panel(py3_2)
panel_2 = Panel(py3)
