# Grasshopper definition GrammarLayout.gh (Grasshopper 1.0.8)
# plug-ins: Karamba3D, Human

# GLOBAL PARAMETERS
number_slider = Slider(1, range=0..10)

# ---- group: Turn on this to start recording; rewrites over file
boolean_toggle = BooleanToggle(False)

# ----
reset = Button()
# Global Tolerance
num = Number("1e-3")
# Total Volume
num_2 = Number(number_slider)
txt = Text("C:/test_data/data_stream_test.csv")
bool = Boolean(boolean_toggle)

# ----
# ITERATION CONTROL
# animate slider
# total number should equal to number of experiments x number of iterations
# iterate here -->
number_slider_2 = Slider(11, range=0..20)

# ----
# Number of Iterations per Experiment
# EXPERIMENT PARAMETERS
number_slider_3 = Slider(100, range=0..100)
# Design Rule
number_slider_4 = Slider(5, range=0..10)
# Cross Section Option
# play here -->
# and then iterate above...
number_slider_5 = Slider(2, range=0..10)
# Selection: Strategy
number_slider_6 = Slider(3, range=0..10)
# selection percentage
number_slider_7 = Slider(0.2, range=0..1)
# Starting Design
number_slider_8 = Slider(6, range=0..10)
# 0) Automation Geneneration
# Selection: Attribute
number_slider_9 = Slider(4, range=0..10)
# selection percentage
number_slider_10 = Slider(0.2, range=0..1)
# Design Rule
# Starting Design
# Cross Section Option
number_slider_11 = Slider(0, range=0..10)
# 1) Manual Experimentation
# Selection: Attribute
# Selection: Strategy
number_slider_12 = Slider(0, range=0..1)
C = Count(number_slider_3)
series = Series(Start=0, Step=1, Count=number_slider_9)
series_2 = Series(Start="1", Step=1, Count=number_slider_6)
series_3 = Series(Start=0, Step=1, Count=number_slider_4)
series_4 = Series(Start=0, Step=1, Count=number_slider_8)
series_5 = Series(Start=0, Step=1, Count=number_slider_5)
merge = Merge(
    Data1=number_slider_12,
    Data2=Slider(1, range=0..10),
    Data3=number_slider_10,
    Data4=number_slider_11,
    Data5=Slider(2, range=0..5),
    Data6=Slider(0, range=0..1))
data = Data(merge)
panel = Panel(series)
panel_2 = Panel(series_5)
panel_3 = Panel(series_2)
panel_4 = Panel(series_3)
panel_5 = Panel(series_4)
cross_reference = CrossReference(ListListA=panel, ListListB=panel_3, ListA=number_slider_7, ListB=panel_4, ListC=panel_5, ListD=panel_2, CrossMode=1)  # -> ListListA, ListListB, ListA, ListB, ListC, ListD
py3 = Python3Script(x=data)  # -> out, list_of_params; inputs x: list
# ---------- py3: Python ----------
list_of_params = [x]
# ---------- end py3 ----------

# ----
# right click on input
# -chose 'list access'
# -set 'type hint' to 'int'
ghpython_script = GhPythonScript(
    a=cross_reference.ListListA,
    b=cross_reference.ListListB,
    c=cross_reference.ListA,
    d=cross_reference.ListB,
    e=cross_reference.ListC,
    f=cross_reference.ListD)  # -> out, list_of_params; inputs a: list, b: list, c: list, d: list, e: list, f: list
# ---------- ghpython_script: Python ----------
__author__ = "User"
__version__ = "2024.05.02"

import rhinoscriptsyntax as rs

list_of_params = list(zip(a,b,c,d,e,f))  # include all options here

list_of_params = [list(_x) for _x in list_of_params]
# ---------- end ghpython_script ----------

# ----
# 0 or 1
boolean_toggle_2 = BooleanToggle(True)
panel_6 = Panel(ghpython_script.list_of_params)
data_2 = Data(ghpython_script.list_of_params)
data_3 = Data(py3.list_of_params)

# ---- group: Automated OR Manual
stream_filter = StreamFilter(Gate=boolean_toggle_2, Stream0=data_2, Stream1=data_3)

# ----
data_4 = Data(stream_filter)
# ITERATION SETUP
data_5 = Data(C)
list_length = ListLength(List=data_4)
integer = Integer(list_length)
curve = Curve([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])
curve_2 = Curve([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])
curve_3 = Curve([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])
C_2 = Count(integer)
C_3 = Count(data_5)
srf = Surface(curve_3)
srf_2 = Surface(curve)
srf_3 = Surface(curve_2)
number = Number(Slider(2.44, range=0..4))
number_2 = Number(Slider(3.23, range=0..4))
series_6 = Series(Start=0, Step=1, Count=C_3)
series_7 = Series(Start=0, Step=1, Count=C_2)
number_3 = Number(number_2)
number_4 = Number(number)
cross_reference_2 = CrossReference(ListListA=series_6, ListListB=series_7, CrossMode=1)  # -> ListListA, ListListB
integer_2 = Integer(number_slider_2)
integer_3 = Integer(cross_reference_2.ListListA)
integer_4 = Integer(cross_reference_2.ListListB)
# Current Experiment
list_length_2 = ListLength(List=integer_4)
point = Point([Point(0, 3.23, 0), Point(0, 0, 0), Point(19.52, 3.23, 0), Point(19.52, 0, 0)])
# Supports
# hand drawn dots to represent joints
point_2 = Point([Point(0, 0, 0), Point(2.44, 0, 0)])
# DESIGN INITIALISATION
# for experiments
# Layout
rectangle = Rectangle(Plane=PlaneXY(0, 0, 0), XSize=number_4, YSize=number_3, Radius=0)  # -> Rectangle, Length
point_3 = Point([Point(0, 0, 0), Point(0, 3.23, 0)])
list_item = ListItem(List=integer_4, Index=integer_2, Wrap=True)
list_item_2 = ListItem(List=integer_3, Index=integer_2, Wrap=True)
num_3 = Number(number)
entwine = Entwine(Branch00=point_2, Branch01=point, Branch02=point_3, Branch03=point, Branch04=point, Branch05=point_2, FlattenInputs=True)  # -> simplify(Result)
integer_5 = Integer(list_length_2)
data_6 = Data(list_item)
# Current Experiment Parameters
list_item_3 = ListItem(List=data_4, Index=data_6, Wrap=True)
ghpython_script_2 = GhPythonScript(x=list_item_3)  # -> out, params
# ---------- ghpython_script_2: Python ----------
__author__ = "user"
__version__ = "2024.03.09"

import rhinoscriptsyntax as rs

params = x
# ---------- end ghpython_script_2 ----------
data_7 = Data(list_item_2)
curve_4 = Curve(rectangle.Rectangle)
data_8 = Data(ghpython_script_2.params)
list_item_4 = ListItem(List=data_8, Index=0, Wrap=True)  # -> Item, Item1, Item2, Item3, Item4, Item5
total_iterations = Panel(integer_5)
series_8 = Series(Start=0, Step=num_3, Count=Slider(8, range=0..10))
iteration = Panel(data_7)
number_of_experiments = Panel(integer)
panel_7 = Panel(integer_4)
id_experiment = Panel(data_6)
# Starting Design
integer_6 = Integer(list_item_4.Item4)
path = Path(integer_6)
# Cross Section
integer_7 = Integer(list_item_4.Item5)
# Selection: Attribute
integer_8 = Integer(list_item_4.Item)
# Selection: Percentage
num_4 = Number(list_item_4.Item2)
# Design Operation
integer_9 = Integer(list_item_4.Item3)
# Selection: Strategy
integer_10 = Integer(list_item_4.Item1)
curve_5 = Curve(curve_4)
tree_branch = TreeBranch(Tree=entwine, Path=path, MaintainPaths=True)
unit_x = UnitX(Factor=series_8)
currrent_experiment_parameters = Panel(data_8)
panel_8 = Panel(integer_3)
point_4 = Point(tree_branch)
move = Move(Geometry=graft(curve_5), Motion=unit_x)  # -> flatten(Geometry), Transform
srf_4 = Surface(move.Geometry)
integer_11 = Integer(integer_6)
srf_5 = Surface(curve_4)
srf_6 = Surface(srf_4)
filter = StreamFilter(Gate=integer_11, Stream0=srf_5, Stream1=srf_6, Stream2=srf_6, Stream3=srf, Stream4=srf_2, Stream5=srf_3)
curve_6 = Curve(filter)
curve_7 = Curve(curve_6)
number_slider_13 = Slider(0, range=0..1)
data_9 = Data(data_7)
srf_7 = Surface(curve_7)
data_10 = Data(data_9)
data_11 = Data(data_5)
py3_2 = Python3Script(data_0=srf_7, n_iter=data_11, iter=data_10, reset=Button())  # -> out, iter, data; inputs data_0: list, n_iter: Int32, iter: Int32
# ---------- py3_2: Python ----------
__author__ = "tamk"
__version__ = "2024.03.21"

import rhinoscriptsyntax as rs
from scriptcontext import sticky
from copy import deepcopy

if reset or 'logger' not in sticky:
    sticky['logger'] = {}

if iter_ == 0:
    data = sticky['logger'][0] = data_0
else:
    data = sticky['logger'][iter_]
# ---------- end py3_2 ----------
data_12 = Data(py3_2.data)
data_13 = Data(py3_2.iter)
panel_9 = Panel(py3_2.out)
# RULE-BASED DESIGN SYSTEM COMPONENTS
# SELECTION ATTRIBUTE
integer_12 = Integer(integer_8)
data_14 = Data(data_12)
stream_gate = StreamGate(Stream=data_14, Gate=integer_12)  # -> Target0, Target1, Target2
data_15 = Data(data_14)
data_16 = Data(stream_gate.Target0)
data_17 = Data(stream_gate.Target1)
# Face Areas
srf_8 = Surface(data_16)
# Sum Force / Face Areas
cluster = Cluster_5(srf=data_17)
area = Area(Geometry=srf_8)  # -> Area, Centroid
data_18 = Data(area.Area)
data_19 = Data(cluster)
data_20 = Data(data_18)
integer_13 = Integer(integer_12)
stream_filter_2 = StreamFilter(Gate=integer_13, Stream0=data_20, Stream1=data_19)
data_21 = Data(stream_filter_2)
entwine_2 = Entwine(Branch00=data_21, Branch01=data_15, FlattenInputs=True)
data_22 = Data(entwine_2)
# SELECTION METHOD
integer_14 = Integer(integer_10)
data_23 = Data(data_22)
integer_15 = Integer(integer_14)
stream_gate_2 = StreamGate(Stream=data_23, Gate=integer_15)  # -> Target0, Target1, Target2, Target3
data_24 = Data(stream_gate_2.Target2)
data_25 = Data(stream_gate_2.Target1)
# Select Top Ranked Faces
explode_tree = ExplodeTree(Data=data_25)  # -> Branch0, Branch1
# Select All Faces
data_26 = Data(stream_gate_2.Target0)
# Select the area with the least "Force/Area Area"
explode_tree_2 = ExplodeTree(Data=data_24)  # -> Branch0, Branch1, Branch2
data_27 = Data(explode_tree_2.Branch0)
data_28 = Data(explode_tree_2.Branch2)
list_length_3 = ListLength(List=data_28)
num_5 = Number(num_4)
data_29 = Data(explode_tree.Branch1)
data_30 = Data(explode_tree.Branch0)
num_6 = Number(num_4)
explode_tree_3 = ExplodeTree(Data=data_26)  # -> Branch0, Branch1
list_length_4 = ListLength(List=data_29)
multiplication = Multiplication(A=list_length_3, B=num_5)
multiplication_2 = Multiplication(A=list_length_4, B=num_6)
sort_list = SortList(Keys=data_27, ValuesValuesA=data_28)  # -> Keys, ValuesValuesA
sort_list_2 = SortList(Keys=data_30, ValuesValuesA=data_29)  # -> Keys, reverse(ValuesValuesA)
data_31 = Data(explode_tree_3.Branch1)
round = Round(Number=multiplication)  # -> Nearest, Floor, Ceiling
round_2 = Round(Number=multiplication_2)  # -> Nearest, Floor, Ceiling
integer_16 = Integer(round.Ceiling)
integer_17 = Integer(round_2.Ceiling)
data_32 = Data(sort_list.ValuesValuesA)
data_33 = Data(sort_list_2.ValuesValuesA)
ghpython_script_3 = GhPythonScript(list=data_33, k=integer_17)  # -> out, list_1, list_2; inputs list: list
# ---------- ghpython_script_3: Python ----------
__author__ = "user"
__version__ = "2024.03.09"

import rhinoscriptsyntax as rs

n = len(list)

list_1=list[k:]
list_2=list[:k]
# ---------- end ghpython_script_3 ----------
ghpython_script_4 = GhPythonScript(list=data_32, k=integer_16)  # -> out, list_1, list_2; inputs list: list; same code as ghpython_script_3
data_34 = Data(data_31)
data_35 = Data(ghpython_script_3.list_1)
data_36 = Data(ghpython_script_3.list_2)
data_37 = Data(ghpython_script_4.list_1)
data_38 = Data(ghpython_script_4.list_2)
entwine_3 = Entwine(Branch00=data_35, Branch01=data_36, FlattenInputs=True)  # -> simplify(Result)
entwine_4 = Entwine(Branch01=data_34, FlattenInputs=True)  # -> simplify(Result)
entwine_5 = Entwine(Branch00=data_37, Branch01=data_38, FlattenInputs=True)  # -> simplify(Result)
integer_18 = Integer(integer_14)
stream_filter_3 = StreamFilter(Gate=integer_18, Stream0=entwine_4, Stream1=entwine_3, Stream2=entwine_5)
explode_tree_4 = ExplodeTree(Data=stream_filter_3)  # -> Branch0, Branch1
data_39 = Data(explode_tree_4.Branch1)
data_40 = Data(data_39)
panel_10 = Panel(data_40)
crv = Curve(data_40)
integer_19 = Integer(integer_9)
previewlw = CustomPreviewLineweights(Geometry=crv, Shader=ColourSwatch(SwatchColor=RGB(204, 0, 0)), Thickness=Slider(20, range=0..100), Absolute=False)
# DESIGN OPERATION
stream_gate_3 = StreamGate(Stream=data_40, Gate=integer_19)  # -> Target0, Target1, Target2, Target3, Target4
data_41 = Data(stream_gate_3.Target1)
data_42 = Data(stream_gate_3.Target0)
data_43 = Data(data_41)
# Ice Ray Lattice
number_5 = Number(num)
data_44 = Data(stream_gate_3.Target2)
data_45 = Data(stream_gate_3.Target3)
data_46 = Data(stream_gate_3.Target4)
data_47 = Data(explode_tree_4.Branch0)

# ---- group: Rule #1
quad_double_split = QuadDoubleSplit(data=data_42, number=number_5)

# ---- group: Rule #2
generic_rule2 = GenericRule2(brep=data_43)

# ---- group: Rule #3
cluster_2 = Cluster_2(data=data_44)

# ---- group: Rule #5
cluster_3 = Cluster_3(data=data_46)

# ---- group: Rule #4
cluster_4 = Cluster_4(data=data_45)

# ----
srf_9 = Surface(quad_double_split)
surface = Surface(generic_rule2)
srf_10 = Surface(cluster_4)
srf_11 = Surface(cluster_2)
srf_12 = Surface(cluster_3)
integer_20 = Integer(integer_19)
srf_13 = Surface(surface)
srf_14 = Surface(srf_11)
srf_15 = Surface(srf_9)
srf_16 = Surface(srf_10)
srf_17 = Surface(srf_12)
stream_filter_4 = StreamFilter(Gate=integer_19, Stream0=srf_15, Stream1=srf_13, Stream2=srf_14, Stream3=srf_16, Stream4=srf_17)
surface_2 = Surface(data_47)
surface_3 = Surface(stream_filter_4)
merge_2 = Merge(Data1=flatten(surface_2), Data2=flatten(surface_3))
data_48 = Data(data_13)
data_49 = Data(merge_2)
py3_3 = Python3Script(data_1=data_49, iter=data_48, log_hist=Toggle(True))  # -> out, data_1, hist; inputs data_1: list of GeometryBase, iter: Int32
# ---------- py3_3: Python ----------
"""Grasshopper Script"""
a = "Hello Python 3 in Grasshopper!"


import rhinoscriptsyntax as rs

from scriptcontext import sticky

_hist = sticky.get('logger', {})

_hist[iter_ + 1] = data_1
if not log_hist and iter_ in _hist:
    _hist.pop(iter_)

hist = [_hist]

print(data_1)
# ---------- end py3_3 ----------
crv_2 = Curve(merge_2)
crv_3 = Curve(surface_3)
previewlw_2 = CustomPreviewLineweights(Geometry=crv_3, Shader=ColourSwatch(SwatchColor=RGB(143, 73, 105)), Thickness=Slider(13, range=0..100), Absolute=False)
previewlw_3 = CustomPreviewLineweights(Geometry=crv_2, Shader=ColourSwatch(SwatchColor=RGB(204, 204, 204)), Thickness=Slider(2, range=0..10), Absolute=False)

# ---- group: record this with colibri / output data for experiment e iteration k
data_50 = Data(py3_3.data_1)

# ---- group: record this with colibri / experiment e
data_51 = Data(data_6)

# ---- group: record this with colibri / experiment e iteration k
iteration_2 = Data(data_13)

# ----
panel_11 = Panel(", out:")
panel_12 = Panel(", in:")
construct_point = ConstructPoint(XCoordinate=0, YCoordinate=Slider(-2, range=-10..10), ZCoordinate=0)
concatenate = Concatenate(FragmentH="exp: ", FragmentA=data_51, FragmentI=", iter:", FragmentC=iteration_2)
text_tag_3d = TextTag3D(Location=construct_point, Text=concatenate, Size=Slider(0.5, range=0..1), Justification=7)
# ANALYSIS
srf_18 = Surface(data_50)
num_7 = Number(num)
integer_21 = Integer(integer_7)
num_8 = Number(num_2)
data_52 = Data(point_4)
cluster_5 = Cluster(data=srf_18, relay=num_8, joint_points=data_52, relay_3=integer_21, relay_2=num_7)  # -> model_karamba3d_8, s_0, displacement_cm, energy_kn_m, curve_2, pts
model_karamba3d = ModelKaramba3D(cluster_5.model_karamba3d_8)
num_9 = Number(cluster_5.s_0)
num_10 = Number(cluster_5.displacement_cm)
number_6 = Number(cluster_5.energy_kn_m)
number_7 = Number(number_6)
number_8 = Number(num_10)
num_11 = Number(num_9)
strain_energy = Panel(number_7)
max_disp = Panel(number_8)
mass = Panel(num_11)
model_karamba3d_2 = ModelKaramba3D(model_karamba3d)
# SAVE DATA
integer_22 = Integer(data_6)
integer_23 = Integer(data_7)
number_9 = Number(integer_8)
number_10 = Number(integer_10)
number_11 = Number(integer_9)
number_12 = Number(num_4)
number_13 = Number(integer_7)
number_14 = Number(integer_6)
model_karamba3d_3 = ModelKaramba3D(model_karamba3d_2)
model_karamba3d_4 = ModelKaramba3D(model_karamba3d_2)
# EXTRACT RESULTS
disassemble = DisassembleModelKaramba3D(Model=model_karamba3d_3)  # -> Model, Point, Beam, Shell, Support, Load, Line, Mesh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
utilization = UtilizationOfElementsKaramba3D(
    AnalysedModel=model_karamba3d_4,
    NumberOfSamplePoints=3,
    ElasticDesign=True,
    GammaM0=1,
    GammaM1=1.1,
    SwayFrame=True,
    WithDetails=False,
    mode="Beams")  # -> Model, Utilization, SigMax_kN_cm², SigMin_kN_cm², TauMax_kN_cm², UtilN, UtilVy, UtilVz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
number_15 = Number(mass)
number_16 = Number(max_disp)
number_17 = Number(strain_energy)
element_karamba3d = ElementKaramba3D(disassemble.Beam)
panel_13 = Panel("""ep
iter
selection_att
selection_str
Select_percent
Design_rule
Starting_case
Crossec_opt""")
panel_14 = Panel("""mass
max_disp
strain_ener
max_util""")
num_12 = Number(utilization.Utilization)
merge_3 = Merge(
    Data1=integer_22,
    Data2=integer_23,
    Data3=number_9,
    Data4=number_10,
    Data5=number_12,
    Data6=number_11,
    Data7=number_14,
    Data8=number_13)  # -> flatten(Result)
disassemble_2 = DisassembleElementKaramba3D(Element=element_karamba3d)  # -> Element, ElementIdentifier, AxisOfElement, CrossSection, Joint, Material, LocalCoordinateSystem, ElementIsActive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
num_13 = Number(flatten(num_12))
cross_section_karamba3d = CrossSectionKaramba3D(disassemble_2.CrossSection)
merge_4 = Merge(Data1=panel_13, Data2=panel_14)
sort = SortList(Keys=num_13)  # -> Keys, ValuesA
disassemble_3 = DisassembleCrossSectionKaramba3D(CroSec=cross_section_karamba3d)  # -> CrossSection, FamilyNameOfCrossSection, TypeNameOfCrossSection, ElemIdentifiers, Colour, Material, LocalEccentricity_cm, simplify(Heights_cm)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
num_14 = Number(flatten(sort.Keys))
num_15 = Number(flatten(num_14))
sort_2 = SortList(Keys=num_15)  # -> reverse(Keys), ValuesA
item = ListItem(List=sort_2.Keys, Index=0, Wrap=True)
number_18 = Number(item)
number_19 = Number(number_18)
max_utilisation = Panel(number_19)
number_20 = Number(max_utilisation)
merge_5 = Merge(Data1=number_15, Data2=number_16, Data3=number_17, Data4=number_20)  # -> flatten(Result)
merge_6 = Merge(Data1=merge_3, Data2=merge_5)
panel_15 = Panel(merge_4)
model_karamba3d_5 = ModelKaramba3D(model_karamba3d_2)
data_53 = Data(reset)
modelview = ModelViewKaramba3D(Model=model_karamba3d_5)  # -> Model, DeformedMesh, DeformedAxes, DeformedModel, MaximumDeformation
beamview = BeamViewKaramba3D(Model=modelview.Model)  # -> Model, MeshesOfRenderedBeams, DeformedBeamAxes, LegendColours, LegendTags
legend = Legend(Colour=beamview.LegendColours, Tags=beamview.LegendTags, LegendType=101)
# Start Screenshot Recorder
# Start Data Recorder
toggle = BooleanToggle(True)
reset_2 = Button()
data_54 = Data(toggle)
data_55 = Data(Toggle(True))
data_56 = Data(reset_2)
panel_16 = Panel("C:/test_data")
bool_2 = Boolean(data_55)
# Path
python_3_script = Python3Script()  # -> out, path
# ---------- python_3_script: Python ----------
import os

_filepath = ghenv.Component.OnPingDocument().FilePath
path = os.path.dirname(_filepath)
# ---------- end python_3_script ----------
txt_2 = Text(python_3_script.path)
txt_3 = Text("save_folder")
txt_4 = Text("screenshot")
path_2 = Python3Script(path=txt_2, to_append=txt_3)  # -> out, path
# ---------- path_2: Python ----------
import os
if to_append:
    path_ = os.path.join(path, to_append)
# ---------- end path_2 ----------
folder_path = Panel(python_3_script.path)
data_57 = Data(flatten(beamview.Model))
data_58 = Data(data_56)
bool_3 = Boolean(data_54)
txt_5 = Text(path_2.path)
# Screenshot Saver
txt_6 = Text(txt_5)
txt_7 = Text(txt_6)
path_3 = Python3Script(path=txt_6, to_append=txt_4)  # -> out, path; same code as path_2
txt_8 = Text(txt_5)
txt_9 = Text(txt_8)
panel_17 = Panel(txt_9)
txt_10 = Text(path_3.path)
bool_4 = Boolean(bool_3)
txt_11 = Text(folder_path)
item_2 = ListItem(List=data_57, Index=0, Wrap=True)

# ---- group: make folder if it does not exists
path_4 = Python3Script(path=txt_5)  # -> out
# ---------- path_4: Python ----------
import os
if not os.path.exists(path):
    os.makedirs(path)
# ---------- end path_4 ----------

# ----
c_name_iterator = CSharpScript(port=item_2, T=bool_4, R=data_58, P=txt_10)  # -> out, A; inputs T: Boolean, R: Boolean
# ---------- c_name_iterator: C# ----------
    if(T)
    {
      n++;
    }
    if(R)
    {
      n = 0;
    }
    A = P + "_" + n + ".jpg";
# ---------- c_name_iterator: C# additional code ----------
  public int n;
# ---------- end c_name_iterator ----------
ghpython_script_5 = GhPythonScript(filepath=txt_7, head=panel_15, data=merge_6, write=bool_2, reset=data_53)  # -> out, a; inputs head: list, data: list; disabled
# ---------- ghpython_script_5: Python ----------
__author__ = "tamk"
__version__ = "2024.04.04"

import rhinoscriptsyntax as rs
from scriptcontext import sticky
import os
import sys


if reset:
    _ = sticky.pop('filestream', {})
    
fs = sticky.setdefault('filestream', None)

if not fs and filepath and write:
    fs = sticky['filestream'] = open(filepath, 'w')
    if head:
        fs.write(','.join(str(_h) for _h in head) + '\n')
    
if fs and write:
    fs.write(','.join(str(_x) for _x in data) + '\n')
    fs.flush()

if fs and not write:
    fs.close()
    fs = sticky['filestream'] = None
# ---------- end ghpython_script_5 ----------
txt_12 = Text(c_name_iterator.A)
py3_4 = Python3Script(filepath=txt_7, head=panel_15, data=merge_6, write=bool_2, reset=data_53)  # -> out, a; inputs head: list, data: list; same code as ghpython_script_5
c_vp_to_img = CSharpScript()  # inputs T: Boolean, P: String
# ---------- c_vp_to_img: C# ----------
    if(T)
    {
      var file_name = "";
      if (P != "")
      {
        file_name = P;
        var bitmap = RhinoDoc.ActiveDoc.Views.ActiveView.CaptureToBitmap(false, false, false);
        //Clipboard.SetImage(bitmap);
        bitmap.Save(file_name);
      }
    }
# ---------- end c_vp_to_img ----------
c_script = CSharpScript(T=bool_4, P=txt_12)  # inputs T: Boolean, P: String
# ---------- c_script: C# ----------
using System;
using System.Collections;
using System.Collections.Generic;

using Rhino;
using Rhino.Geometry;

using Grasshopper;
using Grasshopper.Kernel;
using Grasshopper.Kernel.Data;
using Grasshopper.Kernel.Types;

/// <summary>
/// This class will be instantiated on demand by the Script component.
/// </summary>
public class Script_Instance : GH_ScriptInstance
{
  /// <summary>Print a String to the [Out] Parameter of the Script component.</summary>
  /// <param name="text">String to print.</param>
  private void Print(string text) { /* Implementation hidden. */ }
  /// <summary>Print a formatted String to the [Out] Parameter of the Script component.</summary>
  /// <param name="format">String format.</param>
  /// <param name="args">Formatting parameters.</param>
  private void Print(string format, params object[] args) { /* Implementation hidden. */ }
  /// <summary>Print useful information about an object instance to the [Out] Parameter of the Script component. </summary>
  /// <param name="obj">Object instance to parse.</param>
  private void Reflect(object obj) { /* Implementation hidden. */ }
  /// <summary>Print the signatures of all the overloads of a specific method to the [Out] Parameter of the Script component. </summary>
  /// <param name="obj">Object instance to parse.</param>
  private void Reflect(object obj, string method_name) { /* Implementation hidden. */ }

  /// <summary>Gets the current Rhino document.</summary>
  private readonly RhinoDoc RhinoDocument;
  /// <summary>Gets the Grasshopper document that owns this script.</summary>
  private readonly GH_Document GrasshopperDocument;
  /// <summary>Gets the Grasshopper script component that owns this script.</summary>
  private readonly IGH_Component Component;
  /// <summary>
  /// Gets the current iteration count. The first call to RunScript() is associated with Iteration==0.
  /// Any subsequent call within the same solution will increment the Iteration count.
  /// </summary>
  private readonly int Iteration;

  /// <summary>
  /// This procedure contains the user code. Input parameters are provided as regular arguments,
  /// Output parameters as ref arguments. You don't have to assign output parameters,
  /// they will have a default value.
  /// </summary>
  private void RunScript(bool T, string P)
  {
    if(T)
    {
      var file_name = "";
      if (P != "")
      {
        file_name = P;
        var bitmap = RhinoDoc.ActiveDoc.Views.ActiveView.CaptureToBitmap(false, false, false);
        //Clipboard.SetImage(bitmap);
        bitmap.Save(file_name);
      }
    }


  }

  // <Custom additional code> 

  // </Custom additional code> 
}
# ---------- end c_script ----------
full_saved_image_path = Panel(txt_12)

# ==== cluster QuadDoubleSplit
data = ClusterInput()
# 2 curve at once selection
number = ClusterInput()
data_2 = Data(data)
number_2 = Number(number)
deconstruct_brep = DeconstructBrep(Brep=data_2)  # -> simplify(Faces), Edges, flatten(Vertices)
join_curves = JoinCurves(Curves=deconstruct_brep.Edges, Preserve=False)  # -> simplify(Curves)
reduce = Reduce(Polyline=join_curves, Tolerance=number_2)  # -> Polyline, Reduction
explode = Explode(Curve=reduce.Polyline, Recursive=True)  # -> simplify(Segments), Vertices
length = Length(Curve=explode.Segments)
sort_list = SortList(Keys=length, ValuesValuesA=explode.Segments)  # -> Keys, ValuesValuesA
list_item = ListItem(List=sort_list.ValuesValuesA, Index="-1", Wrap=True)
item_index = ItemIndex(List=explode.Segments, Item=list_item)
addition = Addition(A=item_index, B=2)
list_item_2 = ListItem(List=explode.Segments, Index=addition, Wrap=True)
evaluate_length = EvaluateLength(Curve=list_item, Length=Slider(0.333, range=0..1), Normalized=True)  # -> Point, Tangent, Parameter
evaluate_length_2 = EvaluateLength(Curve=list_item_2, Length=Slider(0.667, range=0..1), Normalized=True)  # -> Point, Tangent, Parameter
construct_domain = ConstructDomain(DomainStart=Slider(0.1, range=0..0.1), DomainEnd=Slider(0.9, range=0..1))
line = Line(StartPoint=evaluate_length.Point, EndPoint=evaluate_length_2.Point)
project = Project(Curve=line, Brep=deconstruct_brep.Faces, Direction=Vector(0, 0, 1))
random = Random(Range=construct_domain, Number=1, Seed=2)
item_index_2 = ItemIndex(List=explode.Segments, Item=list_item)
addition_2 = Addition(A=item_index_2, B=1)
evaluate_curve = EvaluateCurve(Curve=reparameterize(project), Parameter=random)  # -> Point, Tangent, Angle
list_item_3 = ListItem(List=explode.Segments, Index=addition_2, Wrap=True)
subtraction = Subtraction(A=1, B=random)
evaluate_curve_2 = EvaluateCurve(Curve=reparameterize(list_item_3), Parameter=subtraction)  # -> Point, Tangent, Angle
line_2 = Line(StartPoint=evaluate_curve.Point, EndPoint=evaluate_curve_2.Point)
surface_split = SurfaceSplit(Surface=deconstruct_brep.Faces, Curves=flatten([project, line_2]))  # -> simplify(flatten(Fragments))
fragments = ClusterOutput(surface_split)

# ==== cluster Cluster
data = ClusterInput()
data_2 = Data(data)
joint_points = ClusterInput()  # joint points
relay = ClusterInput()
brep_edges = BrepEdges(Brep=data_2)  # -> flatten(Naked), Interior, NonManifold
relay_2 = ClusterInput()
relay_3 = ClusterInput()
num = Number(relay)
num_2 = Number(relay_2)
llinter = LineLineIntersectionKaramba3D(Line=brep_edges.Naked, LimitDistance_m=0.005)  # -> IntersectionPoints, flatten(LineSubSegements)
removeduplicatelines = RemoveDuplicateLines(Lines=llinter.LineSubSegements, Tolerance=0.01)
data_3 = Data(removeduplicatelines)
# This is to find the top chord
# to apply line load to
data_4 = Data(data_3)
end_points = EndPoints(Curve=data_4)  # -> Start, End
point = Point(end_points.Start)
point_2 = Point(end_points.End)
deconstruct = Deconstruct(Point=point_2)  # -> XComponent, YComponent, ZComponent
deconstruct_2 = Deconstruct(Point=point)  # -> XComponent, YComponent, ZComponent
length = Length(Curve=removeduplicatelines)
num_3 = Number(num)
larger_than = LargerThan(FirstNumber=deconstruct_2.YComponent, SecondNumber=Slider(3.229, range=0..10))  # -> LargerThan, OrEqualTo
equality_within_tolerance = EqualityWithinTolerance(FirstNumber=deconstruct_2.YComponent, SecondNumber=deconstruct.YComponent, Tolerance=Slider(0.01, range=0..0.01))  # -> Equality, Inequality
mass_addition = MassAddition(Input=length)  # -> Result, PartialResults
pi = Pi(Factor=1)
gate_and = GateAnd(A=equality_within_tolerance.Equality, B=larger_than.LargerThan)
division = Division(A=num_3, B=mass_addition.Result)
dispatch = Dispatch(List=removeduplicatelines, DispatchPattern=gate_and)  # -> ListA, ListB
division_2 = Division(A=division, B=pi)
square_root = SquareRoot(Value=division_2)
line = Line(dispatch.ListA)
list_length = ListLength(List=line)
entwine = Entwine(Branch00=dispatch.ListA, Branch01=dispatch.ListB, FlattenInputs=True)  # -> flatten(Result)
list_length_2 = ListLength(List=entwine)
series = Series(Start=0, Step=1, Count=list_length_2)
concatenate = Concatenate(FragmentA="BEAM", FragmentB=series)
split_list = SplitList(List=concatenate, Index=list_length)  # -> ListA, ListB
multiplication = Multiplication(A=square_root, B=200)
division_3 = Division(A=multiplication, B="2")
num_4 = Number(multiplication)
num_5 = Number(division_3)
crosec = CrossSectionKaramba3D(FamilyNameOfCrossSection="DefaultCroSec", Diameter_cm=num_4, WallThickness_cm=num_5, mode="Circular Hollow")
curve = Curve(entwine)
num_6 = Number(num_2)
linetobeam = LineToBeamKaramba3D(
    Line=curve,
    Identifier=concatenate,
    CrossSection=crosec,
    New=True,
    Remove=True,
    LimitDistance_m=num_6,
    Bending=True,
    SetBucklingLength=True,
    ToPolylineMaxAngle=0.03,
    ToPolylineTolerance=0.01,
    ToPolylineMaxEdgeLength=0.25)  # -> Element, Points, Info
removeduplicatepts = RemoveDuplicatePts(Points=joint_points, Tolerance=num_2)
unit_y = UnitY(Factor=Slider(2, range=0..1000))
data_5 = Data(split_list.ListA)
pt = Point(removeduplicatepts)
point_3 = Point(linetobeam.Points)
supp = SupportKaramba3D(PosInd=pt, menu=[buttons(on, on, off, on, on, on)])
supp_2 = SupportKaramba3D(PosInd=point_3, menu=[buttons(off, off, on, off, off, off)])
loads = LoadsKaramba3D(Vector=Vector(0, 0, -1), LCase="LC0", mode="Gravity")
beam_loads = BeamLoadsKaramba3D(BeamIdentifier=data_5, LoadCase="LC0", ForceVector=unit_y, TPosition=0.5, mode="Concentrated", menu=[buttons(on, off)])
load_karamba3d = LoadKaramba3D(flatten(beam_loads))
limit_distance_m = LimitDistanceM(num_2)
assemble = AssembleModelKaramba3D(
    Elem=flatten(linetobeam.Element),
    Support=flatten([supp, supp_2]),
    Load=flatten([load_karamba3d, loads]),
    LimitDistance_m=flatten(limit_distance_m))  # -> Model, Info, Mass_kg, CentreOfGravity, LoadCaseNames
number = Number(assemble.Mass_kg)
analyse = AnalyseKaramba3D(Model=assemble.Model)  # -> AnalysedModel, MaximumDisplacement_cm, ResultingForce_kN, ChangeOfElasticEnergy_kNm
model_karamba3d = ModelKaramba3D(analyse.AnalysedModel)
number_2 = Number(analyse.MaximumDisplacement_cm)
number_3 = Number(analyse.ChangeOfElasticEnergy_kNm)
# Create Cross Sections
number_slider = Slider(0.5, range=0..10)
number_4 = Number(Slider(30, range=0..100))
integer = Integer(Slider(30, range=0..100))
number_5 = Number(number_slider)
construct_domain = ConstructDomain(DomainStart=number_5, DomainEnd=number_4)
range = Range(Domain=construct_domain, Steps=integer)
number_6 = Number(range)
model_karamba3d_2 = ModelKaramba3D(model_karamba3d)
concatenate_2 = Concatenate(FragmentA="circle_solid_", FragmentB=number_6)
integer_2 = Integer(relay_3)
stream_gate = StreamGate(Stream=model_karamba3d_2, Gate=integer_2)  # -> Target0, Target1
number_7 = Number(number_6)
model_karamba3d_3 = ModelKaramba3D(stream_gate.Target0)
model_karamba3d_4 = ModelKaramba3D(stream_gate.Target1)
# OPTIMISE
# Cross Section Optimisation
crosec_2 = CrossSectionKaramba3D(
    FamilyNameOfCrossSection="DefaultCroSec",
    NameOfCrossSection=concatenate_2,
    Diameter_cm=number_7,
    WallThickness_cm=expr("x/2", number_7),
    mode="Circular Hollow")
number_8 = Number(Slider(1, range=0..1))
number_9 = Number(number_8)
model_karamba3d_5 = ModelKaramba3D(model_karamba3d_4)
cross_sections = CrossSections(crosec_2)
opticrosec = OptimizeCrossSectionKaramba3D(
    Model=model_karamba3d_5,
    CrossSections=cross_sections,
    MaximumUtilization=number_9,
    MaximumDisplacement_cm=-1,
    MaximumVirtualWork_kNcm=0.01,
    NumberOfUtilizationIterations=5,
    NumberOfDisplacementIterations=5,
    NumberOfDisplacementIncrementsPerIteration=2,
    DisplacementTolerance=0.01,
    NumberOfSamplePoints=3,
    ElasticDesign=True,
    GammaM0=1,
    GammaM1=1.1,
    SwayFrame=True)  # -> OptimizedModel, Info, Mass_kg, MaximumDisplacement_cm, ElasticEnergyChange_kNm, MaximumUtilizationViewInsufficientCrossSections, MaximumDisplacementViewLimitCrossSections
model_karamba3d_6 = ModelKaramba3D(opticrosec.OptimizedModel)
number_10 = Number(opticrosec.Mass_kg)
number_11 = Number(number)
number_12 = Number(number_10)
_0 = Stream0(model_karamba3d_3)
_0_2 = Stream0(model_karamba3d_6)
integer_3 = Integer(relay_3)
stream_filter = StreamFilter(Gate=integer_3, Stream0=_0, Stream1=_0_2)
_0_3 = Stream0(number_11)
_0_4 = Stream0(number_12)
integer_4 = Integer(relay_3)
stream_filter_2 = StreamFilter(Gate=integer_4, Stream0=_0_3, Stream1=_0_4)
_0_5 = Stream0(stream_filter)
curve_2 = ClusterOutput(curve)
pts = ClusterOutput(linetobeam.Points)
model_karamba3d_7 = ModelKaramba3D(_0_5)
energy_kn_m = ClusterOutput(number_3)
displacement_cm = ClusterOutput(number_2)
s_0 = ClusterOutput(stream_filter_2)
model_karamba3d_8 = ClusterOutput(model_karamba3d_7)

# ==== cluster GenericRule2
brep = ClusterInput()
deconstruct_brep = DeconstructBrep(Brep=brep)  # -> Faces, Edges, flatten(Vertices)
join_curves = JoinCurves(Curves=deconstruct_brep.Edges, Preserve=False)
explode = Explode(Curve=join_curves, Recursive=True)  # -> Segments, Vertices
number_slider = Slider(0.333, range=0..1)
length = Length(Curve=explode.Segments)
sort_list = SortList(Keys=length, ValuesValuesA=explode.Segments)  # -> Keys, ValuesValuesA
list_item = ListItem(List=sort_list.ValuesValuesA, Index="-1", Wrap=True)
item_index = ItemIndex(List=explode.Segments, Item=list_item)
addition = Addition(A=item_index, B=2)
list_item_2 = ListItem(List=explode.Segments, Index=addition, Wrap=True)
evaluate_length = EvaluateLength(Curve=list_item, Length=number_slider, Normalized=True)  # -> Point, Tangent, Parameter
evaluate_length_2 = EvaluateLength(Curve=list_item_2, Length=number_slider, Normalized=True)  # -> Point, Tangent, Parameter
line = Line(StartPoint=evaluate_length.Point, EndPoint=evaluate_length_2.Point)
project = Project(Curve=line, Brep=deconstruct_brep.Faces, Direction=Vector(0, 0, 1))
surface_split = SurfaceSplit(Surface=deconstruct_brep.Faces, Curves=project)  # -> simplify(flatten(Fragments))
fragments = ClusterOutput(surface_split)

# ==== cluster Cluster_2
data = ClusterInput()
data_2 = Data(data)
deconstruct_brep = DeconstructBrep(Brep=data_2)  # -> Faces, Edges, flatten(Vertices)
join_curves = JoinCurves(Curves=deconstruct_brep.Edges, Preserve=False)  # -> simplify(Curves)
explode = Explode(Curve=join_curves, Recursive=True)  # -> Segments, Vertices
length = Length(Curve=explode.Segments)
sort_list = SortList(Keys=length, ValuesValuesA=explode.Segments)  # -> Keys, ValuesValuesA
list_item = ListItem(List=sort_list.ValuesValuesA, Index="0", Wrap=True)
item_index = ItemIndex(List=explode.Segments, Item=list_item)
list_item_2 = ListItem(List=sort_list.ValuesValuesA, Index="-1", Wrap=True)
item_index_2 = ItemIndex(List=explode.Segments, Item=list_item_2)
addition = Addition(A=item_index_2, B=2)
addition_2 = Addition(A=item_index, B=2)
list_item_3 = ListItem(List=explode.Segments, Index=addition, Wrap=True)
list_item_4 = ListItem(List=explode.Segments, Index=addition_2, Wrap=True)
evaluate_length = EvaluateLength(Curve=list_item_3, Length="0.5", Normalized=True)  # -> Point, Tangent, Parameter
evaluate_length_2 = EvaluateLength(Curve=list_item, Length="0.5", Normalized=True)  # -> Point, Tangent, Parameter
evaluate_length_3 = EvaluateLength(Curve=list_item_2, Length="0.5", Normalized=True)  # -> Point, Tangent, Parameter
evaluate_length_4 = EvaluateLength(Curve=list_item_4, Length="0.5", Normalized=True)  # -> Point, Tangent, Parameter
line = Line(StartPoint=evaluate_length_3.Point, EndPoint=evaluate_length.Point)
line_2 = Line(StartPoint=evaluate_length_2.Point, EndPoint=evaluate_length_4.Point)
project = Project(Curve=line, Brep=deconstruct_brep.Faces, Direction=Vector(0, 0, 1))
surface_split = SurfaceSplit(Surface=deconstruct_brep.Faces, Curves=flatten([line_2, project]))  # -> flatten(Fragments)
fragments = ClusterOutput(surface_split)

# ==== cluster Cluster_3
data = ClusterInput()
data_2 = Data(data)
deconstruct_brep = DeconstructBrep(Brep=data_2)  # -> Faces, Edges, flatten(Vertices)
join_curves = JoinCurves(Curves=deconstruct_brep.Edges, Preserve=False)  # -> simplify(Curves)
explode = Explode(Curve=join_curves, Recursive=True)  # -> Segments, Vertices
length = Length(Curve=explode.Segments)
sort_list = SortList(Keys=length, ValuesValuesA=explode.Segments)  # -> Keys, ValuesValuesA
addition = Addition(A="0", B=2)
subtraction = Subtraction(A=addition, B=1)
list_item = ListItem(List=explode.Vertices, Index="0", Wrap=True)
list_item_2 = ListItem(List=explode.Vertices, Index=subtraction, Wrap=True)
list_item_3 = ListItem(List=explode.Vertices, Index=addition, Wrap=True)
line = Line(StartPoint=list_item, EndPoint=list_item_3)
curve_middle = CurveMiddle(Curve=line)
line_2 = Line(StartPoint=curve_middle, EndPoint=list_item_2)
project = Project(Curve=line, Brep=deconstruct_brep.Faces, Direction=Vector(0, 0, 1))
surface_split = SurfaceSplit(Surface=deconstruct_brep.Faces, Curves=flatten([line_2, project]))  # -> flatten(Fragments)
fragments = ClusterOutput(surface_split)

# ==== cluster Cluster_4
data = ClusterInput()
data_2 = Data(data)
deconstruct_brep = DeconstructBrep(Brep=data_2)  # -> Faces, Edges, flatten(Vertices)
join_curves = JoinCurves(Curves=deconstruct_brep.Edges, Preserve=False)  # -> simplify(Curves)
explode = Explode(Curve=join_curves, Recursive=True)  # -> Segments, Vertices
length = Length(Curve=explode.Segments)
sort_list = SortList(Keys=length, ValuesValuesA=explode.Segments)  # -> Keys, ValuesValuesA
list_item = ListItem(List=sort_list.ValuesValuesA, Index="-1", Wrap=True)
list_item_2 = ListItem(List=sort_list.ValuesValuesA, Index="-2", Wrap=True)
curve_middle = CurveMiddle(Curve=list_item)
curve_middle_2 = CurveMiddle(Curve=list_item_2)
line = Line(StartPoint=curve_middle, EndPoint=curve_middle_2)
project = Project(Curve=line, Brep=deconstruct_brep.Faces, Direction=Vector(0, 0, 1))
surface_split = SurfaceSplit(Surface=deconstruct_brep.Faces, Curves=flatten([project, line]))  # -> flatten(Fragments)
fragments = ClusterOutput(surface_split)

# ==== cluster Cluster_5
srf = ClusterInput()
srf_2 = Surface(srf)
region_union = RegionUnion(Curves=srf_2)
surface = Surface(region_union)
boundary_surfaces = BoundarySurfaces(Edges=surface)
deconstruct_brep = DeconstructBrep(Brep=srf_2)  # -> Faces, Edges, simplify(Vertices)
deconstruct_brep_2 = DeconstructBrep(Brep=boundary_surfaces)  # -> Faces, Edges, simplify(Vertices)
merge = Merge(Data1=deconstruct_brep.Edges, Data2=deconstruct_brep_2.Faces)
curve = Curve(merge)
lineelem = CreateLinearElementKaramba3D(
    Line=curve,
    LimitDistance_m=0.005,
    BucklingLengthY_m=-1,
    BucklingLengthZ_m=-1,
    BucklingLengthLT_m=-1,
    Bending=True,
    ToPolylineMaxAngle=0.25,
    ToPolylineTolerance=0.1,
    ToPolylineMaxEdgeLength=0.25,
    New=True,
    Remove=True,
    mode="LineToBeam")  # -> flatten(Element), flatten(Points), Info

# ---- group: Select the top chord
curve_2 = Curve(lineelem.Element)
length = Length(Curve=curve_2)
sort_list = SortList(Keys=length, ValuesValuesA=curve_2)  # -> Keys, reverse(ValuesValuesA)
curve_3 = Curve(sort_list.ValuesValuesA)
bounds = Bounds(Numbers=sort_list.ValuesValuesA)
deconstruct_domain = DeconstructDomain(Domain=bounds)  # -> Start, End
list_item = ListItem(List=sort_list.ValuesValuesA, Index=0, Wrap=True)
equality = Equality(FirstNumber=sort_list.ValuesValuesA, SecondNumber=deconstruct_domain.End)  # -> Equality, Inequality
cull_pattern = CullPattern(List=sort_list.ValuesValuesA, CullPattern=equality.Inequality)
length_2 = Length(Curve=cull_pattern)
sort_list_2 = SortList(Keys=length_2, ValuesValuesA=cull_pattern)  # -> Keys, reverse(ValuesValuesA)
bounds_2 = Bounds(Numbers=sort_list_2.ValuesValuesA)
deconstruct_domain_2 = DeconstructDomain(Domain=bounds_2)  # -> Start, End
equality_2 = Equality(FirstNumber=sort_list_2.ValuesValuesA, SecondNumber=deconstruct_domain_2.End)  # -> Equality, Inequality
cull_pattern_2 = CullPattern(List=sort_list_2.ValuesValuesA, CullPattern=equality_2.Equality)
curve_middle = CurveMiddle(Curve=cull_pattern_2)
deconstruct = Deconstruct(Point=curve_middle)  # -> XComponent, YComponent, ZComponent
sort_list_3 = SortList(Keys=deconstruct.YComponent, ValuesValuesA=deconstruct.YComponent)  # -> Keys, reverse(ValuesValuesA)
bounds_3 = Bounds(Numbers=sort_list_3.ValuesValuesA)
deconstruct_domain_3 = DeconstructDomain(Domain=bounds_3)  # -> Start, End
equality_3 = Equality(FirstNumber=sort_list_3.ValuesValuesA, SecondNumber=deconstruct_domain_3.End)  # -> Equality, Inequality
cull_pattern_3 = CullPattern(List=sort_list_3.ValuesValuesA, CullPattern=equality_3.Equality)
list_item_2 = ListItem(List=cull_pattern_2, Index=cull_pattern_3, Wrap=True)
element_karamba3d = ElementKaramba3D(list_item_2)

# ----
point = Point(lineelem.Points)

# ---- group: Select Vertices based on physical positions
deconstruct_2 = Deconstruct(Point=point)  # -> XComponent, YComponent, ZComponent
sort_list_4 = SortList(Keys=deconstruct_2.YComponent, ValuesValuesA=point)  # -> Keys, reverse(ValuesValuesA)
deconstruct_3 = Deconstruct(Point=sort_list_4.ValuesValuesA)  # -> XComponent, YComponent, ZComponent
bounds_4 = Bounds(Numbers=deconstruct_3.YComponent)
deconstruct_domain_4 = DeconstructDomain(Domain=bounds_4)  # -> Start, End
equality_4 = Equality(FirstNumber=deconstruct_3.YComponent, SecondNumber=deconstruct_domain_4.End)  # -> Equality, Inequality
cull_pattern_4 = CullPattern(List=sort_list_4.ValuesValuesA, CullPattern=equality_4.Equality)  # -> simplify(flatten(List))
deconstruct_4 = Deconstruct(Point=cull_pattern_4)  # -> XComponent, YComponent, ZComponent
sort_list_5 = SortList(Keys=deconstruct_4.XComponent, ValuesValuesA=cull_pattern_4)  # -> Keys, reverse(ValuesValuesA)
sort_list_6 = SortList(Keys=deconstruct_2.XComponent, ValuesValuesA=point)  # -> Keys, reverse(ValuesValuesA)
deconstruct_5 = Deconstruct(Point=sort_list_6.ValuesValuesA)  # -> XComponent, YComponent, ZComponent
bounds_5 = Bounds(Numbers=deconstruct_5.XComponent)
deconstruct_domain_5 = DeconstructDomain(Domain=bounds_5)  # -> Start, End
equality_5 = Equality(FirstNumber=deconstruct_5.XComponent, SecondNumber=deconstruct_domain_5.End)  # -> Equality, Inequality
item_index = ItemIndex(List=deconstruct_5.XComponent, Item=equality_5.Equality)
cull_pattern_5 = CullPattern(List=sort_list_6.ValuesValuesA, CullPattern=equality_5.Equality)  # -> simplify(flatten(List))
deconstruct_6 = Deconstruct(Point=cull_pattern_5)  # -> XComponent, YComponent, ZComponent
sort_list_7 = SortList(Keys=deconstruct_6.YComponent, ValuesValuesA=cull_pattern_5)  # -> Keys, ValuesValuesA
list_item_3 = ListItem(List=sort_list_7.ValuesValuesA, Index="0", Wrap=True)
point_2 = Point(list_item_3)
sort_list_8 = SortList(Keys=deconstruct_6.YComponent, ValuesValuesA=cull_pattern_5)  # -> Keys, reverse(ValuesValuesA)
list_item_4 = ListItem(List=sort_list_8.ValuesValuesA, Index="0", Wrap=True)
point_3 = Point(list_item_4)

sort_list_9 = SortList(Keys=deconstruct_2.XComponent, ValuesValuesA=point)  # -> Keys, ValuesValuesA
deconstruct_7 = Deconstruct(Point=sort_list_9.ValuesValuesA)  # -> XComponent, YComponent, ZComponent
bounds_6 = Bounds(Numbers=deconstruct_7.XComponent)
deconstruct_domain_6 = DeconstructDomain(Domain=bounds_6)  # -> Start, End
equality_6 = Equality(FirstNumber=deconstruct_7.XComponent, SecondNumber=deconstruct_domain_6.Start)  # -> Equality, Inequality
cull_pattern_6 = CullPattern(List=sort_list_9.ValuesValuesA, CullPattern=equality_6.Equality)  # -> simplify(flatten(List))
deconstruct_8 = Deconstruct(Point=cull_pattern_6)  # -> XComponent, YComponent, ZComponent
sort_list_10 = SortList(Keys=deconstruct_8.YComponent, ValuesValuesA=cull_pattern_6)  # -> Keys, reverse(ValuesValuesA)
list_item_5 = ListItem(List=sort_list_5.ValuesValuesA, Index="-1", Wrap=True)
list_item_6 = ListItem(List=sort_list_10.ValuesValuesA, Index="-1", Wrap=True)
point_4 = Point(list_item_5)
point_5 = Point(list_item_6)

# ----
supp = SupportKaramba3D(
    PosInd=[point_2, point_3],
    Ct_kN_m=Vector(0, 0, 0),
    Cr_kNm_rad=Vector(0, 0, 0),
    menu=[buttons(on, on, on, off, off, off)])
supp_2 = SupportKaramba3D(PosInd=[point_4, point_5], Ct_kN_m=Vector(0, 0, 0), Cr_kNm_rad=Vector(0, 0, 0), menu=[buttons(on, on, off, on, on, on)])

# ---- group: Force Vector
curve_4 = Curve(list_item_2)
rotate = Rotate(Geometry=curve_4, Angle="90°", Plane=PlaneXY(0, 0, 0))  # -> Geometry, Transform
vector = Vector(rotate.Geometry)
negative = Negative(Value=vector)

# ---- group: Karamba Analysis
beam_loads = BeamLoadsKaramba3D(
    BeamIdentifier=element_karamba3d,
    LoadCase="LC0",
    ForceVector=negative,
    TStart=0,
    TEnd=1,
    mode="Block",
    menu=[buttons(on, off, off)])  # -> flatten(Load)
assemble = AssembleModelKaramba3D(Elem=lineelem.Element, Support=[supp_2, supp], Load=beam_loads, LimitDistance_m=0.005)  # -> Model, Info, Mass_kg, CentreOfGravity, LoadCaseNames
analyse = AnalyseKaramba3D(Model=assemble.Model)  # -> AnalysedModel, MaximumDisplacement_cm, simplify(flatten(ResultingForce_kN)), ChangeOfElasticEnergy_kNm
b_forces = BeamForcesKaramba3D(AnalysedModel=analyse.AnalysedModel, Ts=[0, 1])  # -> Model, NormalForce_kN, ShearForceVz_kN, ShearForceVy_kN, TorsionalMomentMt_kNm, BendingMomentMy_kNm, BendingMomentMz_kNm, LoadCaseIndex
modelview = ModelViewKaramba3D(Model=assemble.Model)  # -> Model, DeformedMesh, DeformedAxes, DeformedModel, MaximumDeformation

# ----
absolute = Absolute(Value=analyse.ResultingForce_kN)
number = Number(absolute)
cross_reference = CrossReference(ListListA=srf_2, ListListB=number, CrossMode=1)  # -> ListListA, ListListB
area = Area(Geometry=cross_reference.ListListA)  # -> Area, Centroid
division = Division(A=cross_reference.ListListB, B=area.Area)
result = ClusterOutput(division)
