# Grasshopper definition PatternMorph.gh (Grasshopper 1.0.8)
# plug-ins: Karamba3D, Human

# GLOBAL PARAMETERS
number_slider = Slider(1, range=0..10)

# ---- group: Turn on this to start recording; rewrites over file
boolean_toggle = BooleanToggle(True)

# ----
reset = Button()
# Global Tolerance
num = Number("1e-3")
# Total Volume
num_2 = Number(number_slider)
txt = Text("C:/test_data/data_stream_test.csv")
bool = Boolean(boolean_toggle)

# ----
# ITERATION CONTROL
# animate slider
# total number should equal to number of experiments x number of iterations
# iterate here -->
number_slider_2 = Slider(0, range=0..30)

# ----
# Number of Iterations per Experiment
# EXPERIMENT PARAMETERS
number_slider_3 = Slider(24, range=0..100)
# Design Rule
number_slider_4 = Slider(5, range=0..10)
# Cross Section Option
# play here -->
# and then iterate above...
number_slider_5 = Slider(2, range=0..10)
# Selection: Strategy
number_slider_6 = Slider(4, range=0..10)
# selection percentage
number_slider_7 = Slider(0.2, range=0..1)
# Starting Design
number_slider_8 = Slider(6, range=0..10)
# 0) Automation Geneneration
# Selection: Attribute
number_slider_9 = Slider(4, range=0..10)
# 1) Manual Experimentation
# Selection: Attribute
# Selection: Strategy
number_slider_10 = Slider(1, range=0..10)
# selection percentage
number_slider_11 = Slider(0.2, range=0..1)
# Design Rule
# Starting Design
# Cross Section Option
number_slider_12 = Slider(0, range=0..10)
C = Count(number_slider_3)
series = Series(Start=0, Step=1, Count=number_slider_9)
series_2 = Series(Start="1", Step=1, Count=number_slider_6)
series_3 = Series(Start=0, Step=1, Count=number_slider_4)
series_4 = Series(Start=0, Step=1, Count=number_slider_8)
series_5 = Series(Start=0, Step=1, Count=number_slider_5)
merge = Merge(
    Data1=number_slider_10,
    Data2=Slider(1, range=0..10),
    Data3=number_slider_11,
    Data4=number_slider_12,
    Data5=Slider(2, range=0..10),
    Data6=Slider(0, range=0..1))
panel = Panel(series_5)
panel_2 = Panel(series)
panel_3 = Panel(series_2)
panel_4 = Panel(series_3)
panel_5 = Panel(series_4)
data = Data(merge)
cross_reference = CrossReference(ListListA=panel_2, ListListB=panel_3, ListA=number_slider_7, ListB=panel_4, ListC=panel_5, ListD=panel, CrossMode=1)  # -> ListListA, ListListB, ListA, ListB, ListC, ListD
py3 = Python3Script(x=data)  # -> out, list_of_params; inputs x: list
# ---------- py3: Python ----------
list_of_params = [x]
# ---------- end py3 ----------

# ----
# right click on input
# -chose 'list access'
# -set 'type hint' to 'int'
ghpython_script = GhPythonScript(
    a=cross_reference.ListListA,
    b=cross_reference.ListListB,
    c=cross_reference.ListA,
    d=cross_reference.ListB,
    e=cross_reference.ListC,
    f=cross_reference.ListD)  # -> out, list_of_params; inputs a: list, b: list, c: list, d: list, e: list, f: list
# ---------- ghpython_script: Python ----------
__author__ = "User"
__version__ = "2024.05.02"

import rhinoscriptsyntax as rs

list_of_params = list(zip(a,b,c,d,e,f))  # include all options here

list_of_params = [list(_x) for _x in list_of_params]
# ---------- end ghpython_script ----------

# ----
# 0 or 1
boolean_toggle_2 = BooleanToggle(True)
panel_6 = Panel(ghpython_script.list_of_params)
data_2 = Data(ghpython_script.list_of_params)
data_3 = Data(py3.list_of_params)

# ---- group: Automated OR Manual
stream_filter = StreamFilter(Gate=boolean_toggle_2, Stream0=data_2, Stream1=data_3)

# ----
data_4 = Data(stream_filter)
# ITERATION SETUP
data_5 = Data(C)
list_length = ListLength(List=data_4)
integer = Integer(list_length)
curve = Curve([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])
curve_2 = Curve([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])
curve_3 = Curve([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])
C_2 = Count(integer)
C_3 = Count(data_5)
srf = Surface(curve_2)
srf_2 = Surface(curve)
srf_3 = Surface(curve_3)
number = Number(Slider(2.44, range=0..4))
number_2 = Number(Slider(3.23, range=0..4))
series_6 = Series(Start=0, Step=1, Count=C_3)
series_7 = Series(Start=0, Step=1, Count=C_2)
number_3 = Number(number_2)
number_4 = Number(number)
cross_reference_2 = CrossReference(ListListA=series_6, ListListB=series_7, CrossMode=1)  # -> ListListA, ListListB
integer_2 = Integer(number_slider_2)
integer_3 = Integer(cross_reference_2.ListListA)
integer_4 = Integer(cross_reference_2.ListListB)
# Current Experiment
list_length_2 = ListLength(List=integer_4)
point = Point([Point(0, 3.23, 0), Point(0, 0, 0), Point(19.52, 3.23, 0), Point(19.52, 0, 0)])
# Supports
# hand drawn dots to represent joints
point_2 = Point([Point(0, 0, 0), Point(2.44, 0, 0)])
# DESIGN INITIALISATION
# for experiments
# Layout
rectangle = Rectangle(Plane=PlaneXY(0, 0, 0), XSize=number_4, YSize=number_3, Radius=0)  # -> Rectangle, Length
point_3 = Point([Point(0, 0, 0), Point(0, 3.23, 0)])
list_item = ListItem(List=integer_4, Index=integer_2, Wrap=True)
list_item_2 = ListItem(List=integer_3, Index=integer_2, Wrap=True)
num_3 = Number(number)
entwine = Entwine(Branch00=point_2, Branch01=point, Branch02=point_3, Branch03=point, Branch04=point, Branch05=point_2, FlattenInputs=True)  # -> simplify(Result)
integer_5 = Integer(list_length_2)
data_6 = Data(list_item)
# Current Experiment Parameters
list_item_3 = ListItem(List=data_4, Index=data_6, Wrap=True)
ghpython_script_2 = GhPythonScript(x=list_item_3)  # -> out, params
# ---------- ghpython_script_2: Python ----------
__author__ = "user"
__version__ = "2024.03.09"

import rhinoscriptsyntax as rs

params = x
# ---------- end ghpython_script_2 ----------
data_7 = Data(list_item_2)
curve_4 = Curve(rectangle.Rectangle)
data_8 = Data(ghpython_script_2.params)
list_item_4 = ListItem(List=data_8, Index=0, Wrap=True)  # -> Item, Item1, Item2, Item3, Item4, Item5
total_iterations = Panel(integer_5)
series_8 = Series(Start=0, Step=num_3, Count=Slider(8, range=0..10))
iteration = Panel(data_7)
panel_7 = Panel(integer_4)
number_of_experiments = Panel(integer)
id_experiment = Panel(data_6)
# Starting Design
integer_6 = Integer(list_item_4.Item4)
path = Path(integer_6)
# Cross Section
integer_7 = Integer(list_item_4.Item5)
# Design Operation
integer_8 = Integer(list_item_4.Item3)
# Selection: Attribute
integer_9 = Integer(list_item_4.Item)
# Selection: Percentage
num_4 = Number(list_item_4.Item2)
# Selection: Strategy
integer_10 = Integer(list_item_4.Item1)
curve_5 = Curve(curve_4)
tree_branch = TreeBranch(Tree=entwine, Path=path, MaintainPaths=True)
unit_x = UnitX(Factor=series_8)
currrent_experiment_parameters = Panel(data_8)
panel_8 = Panel(integer_3)
point_4 = Point(tree_branch)
move = Move(Geometry=graft(curve_5), Motion=unit_x)  # -> flatten(Geometry), Transform
srf_4 = Surface(move.Geometry)
integer_11 = Integer(integer_6)
srf_5 = Surface(curve_4)
srf_6 = Surface(srf_4)
filter = StreamFilter(Gate=integer_11, Stream0=srf_5, Stream1=srf_6, Stream2=srf_6, Stream3=srf, Stream4=srf_2, Stream5=srf_3)
curve_6 = Curve(filter)
curve_7 = Curve(curve_6)
number_slider_13 = Slider(0, range=0..1)
data_9 = Data(data_7)
srf_7 = Surface(curve_7)
data_10 = Data(data_9)
data_11 = Data(data_5)
py3_2 = Python3Script(data_0=srf_7, n_iter=data_11, iter=data_10, reset=Button())  # -> out, iter, data; inputs data_0: list, n_iter: Int32, iter: Int32
# ---------- py3_2: Python ----------
__author__ = "tamk"
__version__ = "2024.03.21"

import rhinoscriptsyntax as rs
from scriptcontext import sticky
from copy import deepcopy

if reset or 'logger' not in sticky:
    sticky['logger'] = {}

if iter_ == 0:
    data = sticky['logger'][0] = data_0
else:
    data = sticky['logger'][iter_]
# ---------- end py3_2 ----------
data_12 = Data(py3_2.data)
data_13 = Data(py3_2.iter)
# RULE-BASED DESIGN SYSTEM COMPONENTS
# SELECTION ATTRIBUTE
integer_12 = Integer(integer_9)
data_14 = Data(data_12)
stream_gate = StreamGate(Stream=data_14, Gate=integer_12)  # -> Target0, Target1, Target2
data_15 = Data(data_14)
data_16 = Data(stream_gate.Target0)
data_17 = Data(point_4)
data_18 = Data(stream_gate.Target1)
number_5 = Number(num_2)
# Karamba3D Analysis
# different criteria/attribute to choose
# in this case: the value of Force_sum / Area
num_5 = Number(num)
integer_13 = Integer(integer_7)
cluster = Cluster(data=data_18, relay=number_5, joint_points=data_17, relay_3=integer_13, relay_2=num_5)  # -> model_karamba3d_8, s_0, displacement, utilization, surface_force_sum, moment, force_sum_area, curve_4, points
# Face Areas
srf_8 = Surface(data_16)
area = Area(Geometry=srf_8)  # -> Area, Centroid
data_19 = Data(area.Area)
data_20 = Data(cluster.moment)
integer_14 = Integer(integer_12)
data_21 = Data(data_19)
stream_filter_2 = StreamFilter(Gate=integer_14, Stream0=data_21, Stream1=data_20)
data_22 = Data(stream_filter_2)
entwine_2 = Entwine(Branch00=data_22, Branch01=data_15, FlattenInputs=True)
data_23 = Data(entwine_2)
# SELECTION METHOD
integer_15 = Integer(integer_10)
data_24 = Data(data_23)
integer_16 = Integer(integer_15)
stream_gate_2 = StreamGate(Stream=data_24, Gate=integer_16)  # -> Target0, Target1, Target2, Target3

# ----
# Select Top Ranked Faces
data_25 = Data(stream_gate_2.Target1)
explode_tree = ExplodeTree(Data=data_25)  # -> Branch0, Branch1
data_26 = Data(explode_tree.Branch1)
data_27 = Data(explode_tree.Branch0)
num_6 = Number(num_4)
list_length_3 = ListLength(List=data_26)
multiplication = Multiplication(A=list_length_3, B=num_6)
sort_list = SortList(Keys=data_27, ValuesValuesA=data_26)  # -> Keys, reverse(ValuesValuesA)
round = Round(Number=multiplication)  # -> Nearest, Floor, Ceiling
integer_17 = Integer(round.Ceiling)
data_28 = Data(sort_list.ValuesValuesA)
ghpython_script_3 = GhPythonScript(list=data_28, k=integer_17)  # -> out, list_1, list_2; inputs list: list
# ---------- ghpython_script_3: Python ----------
__author__ = "user"
__version__ = "2024.03.09"

import rhinoscriptsyntax as rs

n = len(list)

list_1=list[k:]
list_2=list[:k]
# ---------- end ghpython_script_3 ----------
data_29 = Data(ghpython_script_3.list_1)
data_30 = Data(ghpython_script_3.list_2)
entwine_3 = Entwine(Branch00=data_29, Branch01=data_30, FlattenInputs=True)  # -> simplify(Result)

# ----
# Select All Faces
data_31 = Data(stream_gate_2.Target0)
explode_tree_2 = ExplodeTree(Data=data_31)  # -> Branch0, Branch1
data_32 = Data(explode_tree_2.Branch1)
data_33 = Data(data_32)
entwine_4 = Entwine(Branch01=data_33, FlattenInputs=True)  # -> simplify(Result)
integer_18 = Integer(integer_15)
integer_19 = Integer(integer_8)
# Ice Ray Lattice
number_6 = Number(num)
integer_20 = Integer(integer_19)
data_34 = Data(data_13)

# ---- group: record this with colibri / experiment e
data_35 = Data(data_6)

# ---- group: record this with colibri / experiment e iteration k
iteration_2 = Data(data_13)

# ----
panel_9 = Panel(", out:")
panel_10 = Panel(", in:")
construct_point = ConstructPoint(XCoordinate=0, YCoordinate=Slider(-2, range=-10..10), ZCoordinate=0)
concatenate = Concatenate(FragmentH="exp: ", FragmentA=data_35, FragmentI=", iter:", FragmentC=iteration_2)
text_tag_3d = TextTag3D(Location=construct_point, Text=concatenate, Size=Slider(0.5, range=0..1), Justification=7)
integer_21 = Integer(integer_7)
num_7 = Number(num)
num_8 = Number(num_2)
data_36 = Data(point_4)
number_7 = Number()
number_8 = Number(number_7)
strain_energy = Panel(number_8)
# SAVE DATA
integer_22 = Integer(data_6)
integer_23 = Integer(data_7)
number_9 = Number(integer_9)
number_10 = Number(integer_10)
number_11 = Number(integer_8)
number_12 = Number(num_4)
number_13 = Number(integer_7)
number_14 = Number(integer_6)
number_15 = Number(strain_energy)
panel_11 = Panel("""ep
iter
selection_att
selection_str
Select_percent
Design_rule
Starting_case
Crossec_opt""")
panel_12 = Panel("""mass
max_disp
strain_ener
max_util""")
merge_2 = Merge(
    Data1=integer_22,
    Data2=integer_23,
    Data3=number_9,
    Data4=number_10,
    Data5=number_12,
    Data6=number_11,
    Data7=number_14,
    Data8=number_13)  # -> flatten(Result)
merge_3 = Merge(Data1=panel_11, Data2=panel_12)
panel_13 = Panel(merge_3)
bool_2 = Boolean(bool)
data_37 = Data(reset)
txt_2 = Text(txt)
panel_14 = Panel(txt_2)
panel_15 = Panel("""1
2
3
4
5
6
7
8
9
10
11""")
python_3_script = Python3Script()  # -> out, path
# ---------- python_3_script: Python ----------
import os

_filepath = ghenv.Component.OnPingDocument().FilePath
path = os.path.dirname(_filepath)
# ---------- end python_3_script ----------
# Path
folder_path = Panel(python_3_script.path)
num_9 = Number()
num_10 = Number()
num_11 = Number()
txt_3 = Text("save_folder")
txt_4 = Text(folder_path)
txt_5 = Text("data_table.csv")
txt_6 = Text("screenshot")
path_2 = Python3Script(path=txt_4, to_append=txt_3)  # -> out, path
# ---------- path_2: Python ----------
import os
if to_append:
    path_ = os.path.join(path, to_append)
# ---------- end path_2 ----------
data_38 = Data(num_11)
data_39 = Data()
# Create header row of csv spreadsheet,
# containing names of the columns
merge_4 = Merge(Data1=panel_15, Data2="steel comsumption", Data3="max_disp", Data4="strain energy", Data5="image_path")
data_40 = Data(num_10)
data_41 = Data(num_9)
data_42 = Data()
data_43 = Data()
bool_3 = Boolean()
txt_7 = Text(path_2.path)
# CSV File Streamer
txt_8 = Text(txt_7)
# Screenshot Saver
txt_9 = Text(txt_7)
path_3 = Python3Script(path=txt_8, to_append=txt_5)  # -> out, path; same code as path_2
path_4 = Python3Script(path=txt_9, to_append=txt_6)  # -> out, path; same code as path_2
txt_10 = Text(path_3.path)
txt_11 = Text(path_4.path)
bool_4 = Boolean(bool_3)
txt_12 = Text(folder_path)
item = ListItem(List=data_42, Index=0, Wrap=True)
data_44 = Data(Toggle(True))

# ---- group: make folder if it does not exists
path_5 = Python3Script(path=txt_7)  # -> out
# ---------- path_5: Python ----------
import os
if not os.path.exists(path):
    os.makedirs(path)
# ---------- end path_5 ----------

# ----
c_name_iterator = CSharpScript(port=item, T=bool_4, R=data_43, P=txt_11)  # -> out, A; inputs T: Boolean, R: Boolean
# ---------- c_name_iterator: C# ----------
    if(T)
    {
      n++;
    }
    if(R)
    {
      n = 0;
    }
    A = P + "_" + n + ".jpg";
# ---------- c_name_iterator: C# additional code ----------
  public int n;
# ---------- end c_name_iterator ----------
panel_16 = Panel(txt_10)
txt_13 = Text(c_name_iterator.A)
data_45 = Data(txt_13)
# Merge data
merge_5 = Merge(Data1=flatten(data_40), Data2=flatten(data_39), Data3=flatten(data_41), Data4=flatten(data_38), Data5=flatten(data_45))
data_46 = Data(flatten(merge_5))
panel_17 = Panel(data_46)
txt_14 = Text(txt_10)
txt_15 = Text(merge_4)
data_47 = Data(data_46)
data_48 = Data()
bool_5 = Boolean(data_44)
c_vp_to_img = CSharpScript(T=bool_4, P=txt_13)  # inputs T: Boolean, P: String
# ---------- c_vp_to_img: C# ----------
    if(T)
    {
      var file_name = "";
      if (P != "")
      {
        file_name = P;
        var bitmap = RhinoDoc.ActiveDoc.Views.ActiveView.CaptureToBitmap(false, false, false);
        //Clipboard.SetImage(bitmap);
        bitmap.Save(file_name);
      }
    }
# ---------- end c_vp_to_img ----------
c_script = CSharpScript(T=bool_4, P=txt_13)  # inputs T: Boolean, P: String
# ---------- c_script: C# ----------
using System;
using System.Collections;
using System.Collections.Generic;

using Rhino;
using Rhino.Geometry;

using Grasshopper;
using Grasshopper.Kernel;
using Grasshopper.Kernel.Data;
using Grasshopper.Kernel.Types;

/// <summary>
/// This class will be instantiated on demand by the Script component.
/// </summary>
public class Script_Instance : GH_ScriptInstance
{
  /// <summary>Print a String to the [Out] Parameter of the Script component.</summary>
  /// <param name="text">String to print.</param>
  private void Print(string text) { /* Implementation hidden. */ }
  /// <summary>Print a formatted String to the [Out] Parameter of the Script component.</summary>
  /// <param name="format">String format.</param>
  /// <param name="args">Formatting parameters.</param>
  private void Print(string format, params object[] args) { /* Implementation hidden. */ }
  /// <summary>Print useful information about an object instance to the [Out] Parameter of the Script component. </summary>
  /// <param name="obj">Object instance to parse.</param>
  private void Reflect(object obj) { /* Implementation hidden. */ }
  /// <summary>Print the signatures of all the overloads of a specific method to the [Out] Parameter of the Script component. </summary>
  /// <param name="obj">Object instance to parse.</param>
  private void Reflect(object obj, string method_name) { /* Implementation hidden. */ }

  /// <summary>Gets the current Rhino document.</summary>
  private readonly RhinoDoc RhinoDocument;
  /// <summary>Gets the Grasshopper document that owns this script.</summary>
  private readonly GH_Document GrasshopperDocument;
  /// <summary>Gets the Grasshopper script component that owns this script.</summary>
  private readonly IGH_Component Component;
  /// <summary>
  /// Gets the current iteration count. The first call to RunScript() is associated with Iteration==0.
  /// Any subsequent call within the same solution will increment the Iteration count.
  /// </summary>
  private readonly int Iteration;

  /// <summary>
  /// This procedure contains the user code. Input parameters are provided as regular arguments,
  /// Output parameters as ref arguments. You don't have to assign output parameters,
  /// they will have a default value.
  /// </summary>
  private void RunScript(bool T, string P)
  {
    if(T)
    {
      var file_name = "";
      if (P != "")
      {
        file_name = P;
        var bitmap = RhinoDoc.ActiveDoc.Views.ActiveView.CaptureToBitmap(false, false, false);
        //Clipboard.SetImage(bitmap);
        bitmap.Save(file_name);
      }
    }


  }

  // <Custom additional code> 

  // </Custom additional code> 
}
# ---------- end c_script ----------
ghpython_script_4 = GhPythonScript(filepath=txt_14, head=txt_15, data=data_47, write=bool_5, reset=data_48)  # -> out, a; inputs head: list, data: list
# ---------- ghpython_script_4: Python ----------
__author__ = "tamk"
__version__ = "2024.04.04"

import rhinoscriptsyntax as rs
from scriptcontext import sticky
import os
import sys


if reset:
    _ = sticky.pop('filestream', {})
    
fs = sticky.setdefault('filestream', None)

if not fs and filepath and write:
    fs = sticky['filestream'] = open(filepath, 'w')
    if head:
        fs.write(','.join(str(_h) for _h in head) + '\n')
    
if fs and write:
    fs.write(','.join(str(_x) for _x in data) + '\n')
    fs.flush()

if fs and not write:
    fs.close()
    fs = sticky['filestream'] = None
# ---------- end ghpython_script_4 ----------
full_saved_image_path = Panel(txt_13)

# ----
# Select the area(s) with the largest value of chosen criteria, which is the most dangerous for the structure
# in this case: the value of Force_sum / Area
# check the largest value
# select the area(s) that share thelargest value
data_49 = Data(stream_gate_2.Target2)
explode_tree_3 = ExplodeTree(Data=data_49)  # -> Branch0, Branch1
data_50 = Data(explode_tree_3.Branch1)
data_51 = Data(explode_tree_3.Branch0)

sort_list_2 = SortList(Keys=data_51, ValuesValuesA=data_50)  # -> Keys, reverse(ValuesValuesA)
list_item_5 = ListItem(List=sort_list_2.ValuesValuesA, Index="0", Wrap=True)

item_index = ItemIndex(List=explode_tree_3.Branch1, Item=list_item_5)
list_item_6 = ListItem(List=data_51, Index=item_index, Wrap=True)
delete_consecutive = DeleteConsecutive(Set=list_item_6, Wrap=False)  # -> Set, Count
member_index = MemberIndex(Set=data_51, Member=delete_consecutive.Set)  # -> Index, Count
list_length_4 = ListLength(List=member_index.Index)

data_52 = Data(sort_list_2.ValuesValuesA)
ghpython_script_5 = GhPythonScript(list=data_52, k=list_length_4)  # -> out, list_1, list_2; inputs list: list
# ---------- ghpython_script_5: Python ----------
__author__ = "user"
__version__ = "2024.03.09"

import rhinoscriptsyntax as rs



list_1=list[k:]
list_2=list[:k]
# ---------- end ghpython_script_5 ----------
data_53 = Data(ghpython_script_5.list_1)
data_54 = Data(ghpython_script_5.list_2)
entwine_5 = Entwine(Branch00=data_53, Branch01=data_54, FlattenInputs=True)  # -> simplify(Result)

# ----
# Select the area(s) with the samllest value of chosen criteria
# check the smallest value
# select the area(s) that share thelargest value
data_55 = Data(stream_gate_2.Target3)
explode_tree_4 = ExplodeTree(Data=data_55)  # -> Branch0, Branch1
data_56 = Data(explode_tree_4.Branch1)
data_57 = Data(explode_tree_4.Branch0)

sort_list_3 = SortList(Keys=data_57, ValuesValuesA=data_56)  # -> Keys, ValuesValuesA
list_item_7 = ListItem(List=sort_list_3.ValuesValuesA, Index="0", Wrap=True)

item_index_2 = ItemIndex(List=explode_tree_4.Branch1, Item=list_item_7)
list_item_8 = ListItem(List=data_57, Index=item_index_2, Wrap=True)
delete_consecutive_2 = DeleteConsecutive(Set=list_item_8, Wrap=False)  # -> Set, Count
member_index_2 = MemberIndex(Set=data_57, Member=delete_consecutive_2.Set)  # -> Index, Count
list_length_5 = ListLength(List=member_index_2.Index)

data_58 = Data(sort_list_3.ValuesValuesA)
ghpython_script_6 = GhPythonScript(list=data_58, k=list_length_5)  # -> out, list_1, list_2; inputs list: list; same code as ghpython_script_5
data_59 = Data(ghpython_script_6.list_1)
data_60 = Data(ghpython_script_6.list_2)
entwine_6 = Entwine(Branch00=data_59, Branch01=data_60, FlattenInputs=True)  # -> simplify(Result)

stream_filter_3 = StreamFilter(Gate=integer_18, Stream0=entwine_4, Stream1=entwine_3, Stream2=entwine_5, Stream3=entwine_6)
explode_tree_5 = ExplodeTree(Data=stream_filter_3)  # -> Branch0, Branch1
data_61 = Data(explode_tree_5.Branch1)
data_62 = Data(data_61)
crv = Curve(data_62)
previewlw = CustomPreviewLineweights(Geometry=crv, Shader=ColourSwatch(SwatchColor=RGB(204, 0, 0)), Thickness=Slider(20, range=0..100), Absolute=False)
# DESIGN OPERATION
stream_gate_3 = StreamGate(Stream=data_62, Gate=integer_19)  # -> Target0, Target1, Target2, Target3, Target4
data_63 = Data(stream_gate_3.Target1)
data_64 = Data(stream_gate_3.Target0)
data_65 = Data(data_63)
data_66 = Data(stream_gate_3.Target2)
data_67 = Data(stream_gate_3.Target3)
data_68 = Data(stream_gate_3.Target4)
data_69 = Data(explode_tree_5.Branch0)

# ---- group: Rule #1
quad_double_split = QuadDoubleSplit(data=data_64, number=number_6)

# ---- group: Rule #2
generic_rule2 = GenericRule2(brep=data_65)

# ---- group: Rule #3
cluster_2 = Cluster_2(data=data_66)

# ---- group: Rule #5
cluster_3 = Cluster_3(data=data_68)

# ---- group: Rule #4
cluster_4 = Cluster_4(data=data_67)

# ----
srf_9 = Surface(quad_double_split)
surface = Surface(generic_rule2)
srf_10 = Surface(cluster_4)
srf_11 = Surface(cluster_2)
srf_12 = Surface(cluster_3)
srf_13 = Surface(surface)
srf_14 = Surface(srf_9)
srf_15 = Surface(srf_11)
srf_16 = Surface(srf_10)
srf_17 = Surface(srf_12)
stream_filter_4 = StreamFilter(Gate=integer_19, Stream0=srf_14, Stream1=srf_13, Stream2=srf_15, Stream3=srf_16, Stream4=srf_17)
surface_2 = Surface(data_69)
surface_3 = Surface(stream_filter_4)
merge_6 = Merge(Data1=flatten(surface_2), Data2=flatten(surface_3))
data_70 = Data(merge_6)
py3_3 = Python3Script(data_1=data_70, iter=data_34, log_hist=Toggle(True))  # -> out, data_1, hist; inputs data_1: list of GeometryBase, iter: Int32
# ---------- py3_3: Python ----------
"""Grasshopper Script"""
a = "Hello Python 3 in Grasshopper!"


import rhinoscriptsyntax as rs

from scriptcontext import sticky

_hist = sticky.get('logger', {})

_hist[iter_ + 1] = data_1
if not log_hist and iter_ in _hist:
    _hist.pop(iter_)

hist = [_hist]

print(data_1)
# ---------- end py3_3 ----------
crv_2 = Curve(merge_6)
crv_3 = Curve(surface_3)
previewlw_2 = CustomPreviewLineweights(Geometry=crv_3, Shader=ColourSwatch(SwatchColor=RGB(143, 73, 105)), Thickness=Slider(13, range=0..100), Absolute=False)
previewlw_3 = CustomPreviewLineweights(Geometry=crv_2, Shader=ColourSwatch(SwatchColor=RGB(204, 204, 204)), Thickness=Slider(2, range=0..10), Absolute=False)

# ---- group: record this with colibri / output data for experiment e iteration k
data_71 = Data(py3_3.data_1)

# ----
# ANALYSIS
srf_18 = Surface(data_71)
cluster_5 = Cluster(data=srf_18, relay=num_8, joint_points=data_36, relay_3=integer_21, relay_2=num_7)  # -> model_karamba3d_8, s_0, displacement, utilization, surface_force_sum, moment, force_sum_area, curve_4, points
model_karamba3d = ModelKaramba3D(cluster_5.model_karamba3d_8)
num_12 = Number(cluster_5.s_0)
num_13 = Number(cluster_5.displacement)
number_16 = Number(num_13)
num_14 = Number(num_12)
max_disp = Panel(number_16)
mass = Panel(num_14)
model_karamba3d_2 = ModelKaramba3D(model_karamba3d)
model_karamba3d_3 = ModelKaramba3D(model_karamba3d_2)
model_karamba3d_4 = ModelKaramba3D(model_karamba3d_2)
# EXTRACT RESULTS
disassemble = DisassembleModelKaramba3D(Model=model_karamba3d_3)  # -> Model, Point, Beam, Shell, Support, Load, Line, Mesh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
utilization = UtilizationOfElementsKaramba3D(
    AnalysedModel=model_karamba3d_4,
    NumberOfSamplePoints=3,
    ElasticDesign=True,
    GammaM0=1,
    GammaM1=1.1,
    SwayFrame=True,
    WithDetails=False,
    mode="Beams")  # -> Model, Utilization, SigMax_kN_cm², SigMin_kN_cm², TauMax_kN_cm², UtilN, UtilVy, UtilVz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
number_17 = Number(mass)
number_18 = Number(max_disp)
element_karamba3d = ElementKaramba3D(disassemble.Beam)
num_15 = Number(utilization.Utilization)
disassemble_2 = DisassembleElementKaramba3D(Element=element_karamba3d)  # -> Element, ElementIdentifier, AxisOfElement, CrossSection, Joint, Material, LocalCoordinateSystem, ElementIsActive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
num_16 = Number(flatten(num_15))
cross_section_karamba3d = CrossSectionKaramba3D(disassemble_2.CrossSection)
sort = SortList(Keys=num_16)  # -> Keys, ValuesA
disassemble_3 = DisassembleCrossSectionKaramba3D(CroSec=cross_section_karamba3d)  # -> CrossSection, FamilyNameOfCrossSection, TypeNameOfCrossSection, ElemIdentifiers, Colour, Material, LocalEccentricity_cm, simplify(Heights_cm)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
num_17 = Number(flatten(sort.Keys))
num_18 = Number(flatten(num_17))
sort_2 = SortList(Keys=num_18)  # -> reverse(Keys), ValuesA
item_2 = ListItem(List=sort_2.Keys, Index=0, Wrap=True)
number_19 = Number(item_2)
number_20 = Number(number_19)
max_utilisation = Panel(number_20)
number_21 = Number(max_utilisation)
merge_7 = Merge(Data1=number_17, Data2=number_18, Data3=number_15, Data4=number_21)  # -> flatten(Result)
merge_8 = Merge(Data1=merge_2, Data2=merge_7)
model_karamba3d_5 = ModelKaramba3D(model_karamba3d_2)
modelview = ModelViewKaramba3D(Model=model_karamba3d_5)  # -> Model, DeformedMesh, DeformedAxes, DeformedModel, MaximumDeformation
ghpython_script_7 = GhPythonScript(filepath=txt_2, head=panel_13, data=merge_8, write=bool_2, reset=data_37)  # -> out, a; inputs head: list, data: list; same code as ghpython_script_4
beamview = BeamViewKaramba3D(Model=modelview.Model)  # -> Model, MeshesOfRenderedBeams, DeformedBeamAxes, LegendColours, LegendTags
legend = Legend(Colour=beamview.LegendColours, Tags=beamview.LegendTags, LegendType=101)

# ==== cluster QuadDoubleSplit
data = ClusterInput()
# 2 curve at once selection
number = ClusterInput()
data_2 = Data(data)
number_2 = Number(number)
deconstruct_brep = DeconstructBrep(Brep=data_2)  # -> simplify(Faces), Edges, flatten(Vertices)
join_curves = JoinCurves(Curves=deconstruct_brep.Edges, Preserve=False)  # -> simplify(Curves)
reduce = Reduce(Polyline=join_curves, Tolerance=number_2)  # -> Polyline, Reduction
explode = Explode(Curve=reduce.Polyline, Recursive=True)  # -> simplify(Segments), Vertices
length = Length(Curve=explode.Segments)
sort_list = SortList(Keys=length, ValuesValuesA=explode.Segments)  # -> Keys, ValuesValuesA
list_item = ListItem(List=sort_list.ValuesValuesA, Index="-1", Wrap=True)
item_index = ItemIndex(List=explode.Segments, Item=list_item)
addition = Addition(A=item_index, B=2)
list_item_2 = ListItem(List=explode.Segments, Index=addition, Wrap=True)
evaluate_length = EvaluateLength(Curve=list_item, Length=Slider(0.333, range=0..1), Normalized=True)  # -> Point, Tangent, Parameter
evaluate_length_2 = EvaluateLength(Curve=list_item_2, Length=Slider(0.667, range=0..1), Normalized=True)  # -> Point, Tangent, Parameter
construct_domain = ConstructDomain(DomainStart=Slider(0.1, range=0..0.1), DomainEnd=Slider(0.9, range=0..1))
line = Line(StartPoint=evaluate_length.Point, EndPoint=evaluate_length_2.Point)
project = Project(Curve=line, Brep=deconstruct_brep.Faces, Direction=Vector(0, 0, 1))
random = Random(Range=construct_domain, Number=1, Seed=2)
item_index_2 = ItemIndex(List=explode.Segments, Item=list_item)
addition_2 = Addition(A=item_index_2, B=1)
evaluate_curve = EvaluateCurve(Curve=reparameterize(project), Parameter=random)  # -> Point, Tangent, Angle
list_item_3 = ListItem(List=explode.Segments, Index=addition_2, Wrap=True)
subtraction = Subtraction(A=1, B=random)
evaluate_curve_2 = EvaluateCurve(Curve=reparameterize(list_item_3), Parameter=subtraction)  # -> Point, Tangent, Angle
line_2 = Line(StartPoint=evaluate_curve.Point, EndPoint=evaluate_curve_2.Point)
surface_split = SurfaceSplit(Surface=deconstruct_brep.Faces, Curves=flatten([project, line_2]))  # -> simplify(flatten(Fragments))
fragments = ClusterOutput(surface_split)

# ==== cluster Cluster
data = ClusterInput()
data_2 = Data(data)
joint_points = ClusterInput()  # joint points
relay = ClusterInput()
brep_edges = BrepEdges(Brep=data_2)  # -> flatten(Naked), Interior, NonManifold
relay_2 = ClusterInput()
surface = Surface(data_2)
surface_2 = Surface(data)
relay_3 = ClusterInput()
boundary_surfaces = BoundarySurfaces(Edges=surface)
num = Number(relay)
num_2 = Number(relay_2)
line_line_intersection_karamba3d = LLInter(Line=brep_edges.Naked, LimitDistance_m=0.005)  # -> IntersectionPoints, flatten(LineSubSegements)
area = Area(Geometry=surface)  # -> simplify(graft(Area)), Centroid
removeduplicatelines = RemoveDuplicateLines(Lines=line_line_intersection_karamba3d.LineSubSegements, Tolerance=0.01)
data_3 = Data(removeduplicatelines)
data_4 = Data(data_3)
end_points = EndPoints(Curve=data_4)  # -> Start, End
point = Point(end_points.Start)
cull_duplicates = CullDuplicates(Points=point, Tolerance=0.1, CullMode=3)  # -> Points, Indices, Valence
point_2 = Point(cull_duplicates.Points)
deconstruct = Deconstruct(Point=point_2)  # -> XComponent, YComponent, ZComponent
data_5 = Data(data_3)
sort_list = SortList(Keys=deconstruct.YComponent, ValuesValuesA=point_2)  # -> Keys, reverse(ValuesValuesA)
deconstruct_2 = Deconstruct(Point=sort_list.ValuesValuesA)  # -> XComponent, YComponent, ZComponent
delete_consecutive = DeleteConsecutive(Set=deconstruct_2.YComponent, Wrap=False)  # -> Set, Count
member_index = MemberIndex(Set=deconstruct_2.YComponent, Member=delete_consecutive.Set)  # -> Index, Count
end_points_2 = EndPoints(Curve=data_5)  # -> Start, End
point_3 = Point(end_points_2.End)
point_4 = Point(end_points_2.Start)
list_item = ListItem(List=sort_list.ValuesValuesA, Index=member_index.Index, Wrap=True)
point_5 = Point(list_item)
deconstruct_3 = Deconstruct(Point=point_5)  # -> XComponent, YComponent, ZComponent
sort_list_2 = SortList(Keys=deconstruct_3.XComponent, ValuesValuesA=point_5)  # -> Keys, reverse(simplify(flatten(ValuesValuesA)))
# This is to find the top chord
# to apply line load to
number_slider = Slider(3.229, range=0..10)
deconstruct_4 = Deconstruct(Point=point_3)  # -> XComponent, YComponent, ZComponent
deconstruct_5 = Deconstruct(Point=point_4)  # -> XComponent, YComponent, ZComponent
panel = Panel(area.Area)
point_6 = Point(sort_list_2.ValuesValuesA)
panel_2 = Panel(sort_list.ValuesValuesA)
list_item_2 = ListItem(List=point_6, Index="0", Wrap=True)
num_3 = Number(num)
larger_than = LargerThan(FirstNumber=deconstruct_5.YComponent, SecondNumber=number_slider)  # -> LargerThan, OrEqualTo
length = Length(Curve=removeduplicatelines)
equality_within_tolerance = EqualityWithinTolerance(FirstNumber=deconstruct_5.YComponent, SecondNumber=deconstruct_4.YComponent, Tolerance=Slider(0.01, range=0..0.01))  # -> Equality, Inequality
point_7 = Point(list_item_2)
mass_addition = MassAddition(Input=length)  # -> Result, PartialResults
pi = Pi(Factor=1)
gate_and = GateAnd(A=equality_within_tolerance.Equality, B=larger_than.LargerThan)
division = Division(A=num_3, B=mass_addition.Result)
dispatch = Dispatch(List=removeduplicatelines, DispatchPattern=gate_and)  # -> ListA, ListB
division_2 = Division(A=division, B=pi)
square_root = SquareRoot(Value=division_2)
num_4 = Number(num_2)
line = Line(dispatch.ListA)
list_length = ListLength(List=line)
addition = Addition(A="2", B=num_4)
entwine = Entwine(Branch00=dispatch.ListA, Branch01=dispatch.ListB, FlattenInputs=True)  # -> flatten(Result)
list_length_2 = ListLength(List=entwine)
series = Series(Start=0, Step=1, Count=list_length_2)
concatenate = Concatenate(FragmentA="BEAM", FragmentB=series)
split_list = SplitList(List=concatenate, Index=list_length)  # -> ListA, ListB
multiplication = Multiplication(A=square_root, B=200)
division_3 = Division(A=multiplication, B=addition)
num_5 = Number(multiplication)
curve = Curve(entwine)
num_6 = Number(division_3)
cross_section_karamba3d = CroSec(FamilyNameOfCrossSection="DefaultCroSec", Diameter_cm=num_5, WallThickness_cm=num_6, mode="Circular Hollow")
line_to_beam_karamba3d = LineToBeam(
    Line=curve,
    Identifier=concatenate,
    CrossSection=cross_section_karamba3d,
    New=True,
    Remove=True,
    LimitDistance_m=0.005,
    Bending=True,
    SetBucklingLength=True,
    ToPolylineMaxAngle=0.03,
    ToPolylineTolerance=0.01,
    ToPolylineMaxEdgeLength=0.25)  # -> Element, Points, Info
removeduplicatepts = RemoveDuplicatePts(Points=joint_points, Tolerance=num_2)
data_6 = Data(split_list.ListA)
unit_y = UnitY(Factor=Slider(2, range=0..1000))
pt = Point(removeduplicatepts)
point_8 = Point(line_to_beam_karamba3d.Points)
support_karamba3d = Supp(PosInd=pt, menu=[buttons(on, on, off, on, on, on)])
support_karamba3d_2 = Supp(PosInd=point_8, menu=[buttons(off, off, on, off, off, off)])
beam_loads_karamba3d = BeamLoads(BeamIdentifier=data_6, LoadCase="LC0", ForceVector=unit_y, TStart=0, TEnd=1, mode="Block", menu=[buttons(on, off, off)])
loads_karamba3d = Loads(Vector=Vector(0, 0, -1), LCase="LC0", mode="Gravity")
load_karamba3d = LoadKaramba3D(flatten(beam_loads_karamba3d))
limit_distance_m = LimitDistanceM(num_2)
assemble_model_karamba3d = Assemble(
    Elem=flatten(line_to_beam_karamba3d.Element),
    Support=flatten([support_karamba3d, support_karamba3d_2]),
    Load=flatten([load_karamba3d, loads_karamba3d]),
    LimitDistance_m=flatten(limit_distance_m))  # -> Model, Info, Mass_kg, CentreOfGravity, LoadCaseNames
number = Number(assemble_model_karamba3d.Mass_kg)
analyse_karamba3d = Analyse(Model=assemble_model_karamba3d.Model)  # -> AnalysedModel, MaximumDisplacement_cm, ResultingForce_kN, ChangeOfElasticEnergy_kNm
beam_forces_karamba3d = BForces(AnalysedModel=analyse_karamba3d.AnalysedModel, BeamsIdentifiers=line_to_beam_karamba3d.Element, Ts=[0, 1])  # -> Model, NormalForce_kN, ShearForceVz_kN, ShearForceVy_kN, simplify(TorsionalMomentMt_kNm), simplify(BendingMomentMy_kNm), BendingMomentMz_kNm, LoadCaseIndex
model_view_karamba3d = ModelView(Model=analyse_karamba3d.AnalysedModel)  # -> Model, DeformedMesh, DeformedAxes, DeformedModel, MaximumDeformation
# Create Cross Sections
number_slider_2 = Slider(0.5, range=0..10)
average = Average(Input=beam_forces_karamba3d.TorsionalMomentMt_kNm)  # -> flatten(ArithmeticMean)
average_2 = Average(Input=beam_forces_karamba3d.BendingMomentMy_kNm)  # -> flatten(ArithmeticMean)
beam_displacements_karamba3d = BeamDisp(AnalysedModel=analyse_karamba3d.AnalysedModel, Ts=[0, 1])  # -> Model, Translations_m, Rotations_rad, LoadCaseIndex
disassemble_model_karamba3d = Disassemble(Model=beam_forces_karamba3d.Model)  # -> Model, Point, Beam, Shell, Support, Load, Line, Mesh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
split_list_2 = SplitList(List=beam_forces_karamba3d.NormalForce_kN, Index="1")  # -> flatten(ListA), ListB
model_karamba3d = ModelKaramba3D(analyse_karamba3d.AnalysedModel)
number_2 = Number(analyse_karamba3d.MaximumDisplacement_cm)
number_3 = Number(Slider(30, range=0..100))
integer = Integer(Slider(30, range=0..100))
number_4 = Number(number_slider_2)
number_5 = Number(analyse_karamba3d.ChangeOfElasticEnergy_kNm)
construct_domain = ConstructDomain(DomainStart=number_4, DomainEnd=number_3)
# area boundary curves
curve_2 = Curve(graft(boundary_surfaces))
curve_3 = Curve(disassemble_model_karamba3d.Beam)
absolute = Absolute(Value=beam_displacements_karamba3d.Translations_m)
mass_addition_2 = MassAddition(Input=absolute)  # -> Result, PartialResults
curve_middle = CurveMiddle(Curve=curve_3)
range = Range(Domain=construct_domain, Steps=integer)
point_in_curve = PointInCurve(Point=curve_middle, Curve=curve_2)  # -> Relationship, Point
number_6 = Number(range)
deconstruct_6 = Deconstruct(Point=mass_addition_2.Result)  # -> XComponent, YComponent, ZComponent
integer_2 = Integer(relay_3)
model_karamba3d_2 = ModelKaramba3D(model_karamba3d)
concatenate_2 = Concatenate(FragmentA="circle_solid_", FragmentB=number_6)
utilization_of_elements_karamba3d = Utilization(
    AnalysedModel=analyse_karamba3d.AnalysedModel,
    NumberOfSamplePoints=3,
    ElasticDesign=True,
    GammaM0=1,
    GammaM1=1.1,
    SwayFrame=True,
    WithDetails=False,
    mode="Beams")  # -> Model, flatten(Utilization), SigMax_kN_cm², SigMin_kN_cm², TauMax_kN_cm², UtilN, UtilVy, UtilVz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
addition_2 = Addition(A=average, B=average_2)
stream_gate = StreamGate(Stream=model_karamba3d_2, Gate=integer_2)  # -> Target0, Target1
number_7 = Number(number_6)
expression = Expression(x=point_in_curve.Relationship, Expression="x=1")  # -> simplify(Result)
list_length_3 = ListLength(List=expression)  # -> graft(Length)
series_2 = Series(Start=0, Step=1, Count=list_length_3)  # -> simplify(Series)
addition_3 = Addition(A=deconstruct_6.XComponent, B=deconstruct_6.YComponent, C=deconstruct_6.ZComponent)  # -> simplify(flatten(Result))
# OPTIMISE
# Cross Section Optimisation
cross_section_karamba3d_2 = CroSec(
    FamilyNameOfCrossSection="DefaultCroSec",
    NameOfCrossSection=concatenate_2,
    Diameter_cm=number_7,
    WallThickness_cm=expr("x/2", number_7),
    mode="Circular Hollow")
model_karamba3d_3 = ModelKaramba3D(stream_gate.Target0)
model_karamba3d_4 = ModelKaramba3D(stream_gate.Target1)
cull_pattern = CullPattern(List=series_2, CullPattern=expression)
list_item_3 = ListItem(List=split_list_2.ListA, Index=cull_pattern, Wrap=True)
absolute_2 = Absolute(Value=list_item_3)
list_item_4 = ListItem(List=addition_2, Index=cull_pattern, Wrap=True)
number_8 = Number(Slider(1, range=0..1))
number_9 = Number(number_8)
mass_addition_3 = MassAddition(Input=list_item_4)  # -> Result, PartialResults
mass_addition_4 = MassAddition(Input=absolute_2)  # -> Result, PartialResults
list_item_5 = ListItem(List=addition_3, Index=cull_pattern, Wrap=True)
mass_addition_5 = MassAddition(Input=list_item_5)  # -> Result, PartialResults
panel_3 = Panel(mass_addition_3.Result)
list_item_6 = ListItem(List=utilization_of_elements_karamba3d.Utilization, Index=cull_pattern, Wrap=True)
model_karamba3d_5 = ModelKaramba3D(model_karamba3d_4)
cross_sections = CrossSections(cross_section_karamba3d_2)
optimize_cross_section_karamba3d = OptiCroSec(
    Model=model_karamba3d_5,
    CrossSections=cross_sections,
    MaximumUtilization=number_9,
    MaximumDisplacement_cm=-1,
    MaximumVirtualWork_kNcm=0.01,
    NumberOfUtilizationIterations=5,
    NumberOfDisplacementIterations=5,
    NumberOfDisplacementIncrementsPerIteration=2,
    DisplacementTolerance=0.01,
    NumberOfSamplePoints=3,
    ElasticDesign=True,
    GammaM0=1,
    GammaM1=1.1,
    SwayFrame=True)  # -> OptimizedModel, Info, Mass_kg, MaximumDisplacement_cm, ElasticEnergyChange_kNm, MaximumUtilizationViewInsufficientCrossSections, MaximumDisplacementViewLimitCrossSections
mass_addition_6 = MassAddition(Input=list_item_6)  # -> Result, PartialResults
model_karamba3d_6 = ModelKaramba3D(optimize_cross_section_karamba3d.OptimizedModel)
division_4 = Division(A=mass_addition_4.Result, B=area.Area)
number_10 = Number(optimize_cross_section_karamba3d.Mass_kg)
negative = Negative(Value=mass_addition_6.Result)
number_11 = Number(number)
number_12 = Number(number_10)
_0 = Stream0(model_karamba3d_3)
_0_2 = Stream0(model_karamba3d_6)
integer_3 = Integer(relay_3)
stream_filter = StreamFilter(Gate=integer_3, Stream0=_0, Stream1=_0_2)
_0_3 = Stream0(number_11)
_0_4 = Stream0(number_12)
integer_4 = Integer(relay_3)
stream_filter_2 = StreamFilter(Gate=integer_4, Stream0=_0_3, Stream1=_0_4)
_0_5 = Stream0(stream_filter)
force_sum_area = ClusterOutput(division_4)
surface_force_sum = ClusterOutput(mass_addition_4.Result)
moment = ClusterOutput(mass_addition_3.Result)
utilization = ClusterOutput(negative)
curve_4 = ClusterOutput(curve)
points = ClusterOutput(line_to_beam_karamba3d.Points)
model_karamba3d_7 = ModelKaramba3D(_0_5)
displacement = ClusterOutput(mass_addition_5.Result)
s_0 = ClusterOutput(stream_filter_2)
model_karamba3d_8 = ClusterOutput(model_karamba3d_7)

# ==== cluster GenericRule2
brep = ClusterInput()
deconstruct_brep = DeconstructBrep(Brep=brep)  # -> Faces, Edges, flatten(Vertices)
join_curves = JoinCurves(Curves=deconstruct_brep.Edges, Preserve=False)
explode = Explode(Curve=join_curves, Recursive=True)  # -> Segments, Vertices
number_slider = Slider(0.333, range=0..1)
length = Length(Curve=explode.Segments)
sort_list = SortList(Keys=length, ValuesValuesA=explode.Segments)  # -> Keys, ValuesValuesA
list_item = ListItem(List=sort_list.ValuesValuesA, Index="-1", Wrap=True)
item_index = ItemIndex(List=explode.Segments, Item=list_item)
addition = Addition(A=item_index, B=2)
list_item_2 = ListItem(List=explode.Segments, Index=addition, Wrap=True)
evaluate_length = EvaluateLength(Curve=list_item, Length=number_slider, Normalized=True)  # -> Point, Tangent, Parameter
evaluate_length_2 = EvaluateLength(Curve=list_item_2, Length=number_slider, Normalized=True)  # -> Point, Tangent, Parameter
line = Line(StartPoint=evaluate_length.Point, EndPoint=evaluate_length_2.Point)
project = Project(Curve=line, Brep=deconstruct_brep.Faces, Direction=Vector(0, 0, 1))
surface_split = SurfaceSplit(Surface=deconstruct_brep.Faces, Curves=project)  # -> simplify(flatten(Fragments))
fragments = ClusterOutput(surface_split)

# ==== cluster Cluster_2
data = ClusterInput()
data_2 = Data(data)
deconstruct_brep = DeconstructBrep(Brep=data_2)  # -> Faces, Edges, flatten(Vertices)
join_curves = JoinCurves(Curves=deconstruct_brep.Edges, Preserve=False)  # -> simplify(Curves)
explode = Explode(Curve=join_curves, Recursive=True)  # -> Segments, Vertices
length = Length(Curve=explode.Segments)
sort_list = SortList(Keys=length, ValuesValuesA=explode.Segments)  # -> Keys, ValuesValuesA
list_item = ListItem(List=sort_list.ValuesValuesA, Index="0", Wrap=True)
item_index = ItemIndex(List=explode.Segments, Item=list_item)
list_item_2 = ListItem(List=sort_list.ValuesValuesA, Index="-1", Wrap=True)
item_index_2 = ItemIndex(List=explode.Segments, Item=list_item_2)
addition = Addition(A=item_index_2, B=2)
addition_2 = Addition(A=item_index, B=2)
list_item_3 = ListItem(List=explode.Segments, Index=addition, Wrap=True)
list_item_4 = ListItem(List=explode.Segments, Index=addition_2, Wrap=True)
evaluate_length = EvaluateLength(Curve=list_item_3, Length="0.5", Normalized=True)  # -> Point, Tangent, Parameter
evaluate_length_2 = EvaluateLength(Curve=list_item, Length="0.5", Normalized=True)  # -> Point, Tangent, Parameter
evaluate_length_3 = EvaluateLength(Curve=list_item_2, Length="0.5", Normalized=True)  # -> Point, Tangent, Parameter
evaluate_length_4 = EvaluateLength(Curve=list_item_4, Length="0.5", Normalized=True)  # -> Point, Tangent, Parameter
line = Line(StartPoint=evaluate_length_3.Point, EndPoint=evaluate_length.Point)
line_2 = Line(StartPoint=evaluate_length_2.Point, EndPoint=evaluate_length_4.Point)
project = Project(Curve=line, Brep=deconstruct_brep.Faces, Direction=Vector(0, 0, 1))
surface_split = SurfaceSplit(Surface=deconstruct_brep.Faces, Curves=flatten([line_2, project]))  # -> flatten(Fragments)
fragments = ClusterOutput(surface_split)

# ==== cluster Cluster_3
data = ClusterInput()
data_2 = Data(data)
deconstruct_brep = DeconstructBrep(Brep=data_2)  # -> Faces, Edges, flatten(Vertices)
join_curves = JoinCurves(Curves=deconstruct_brep.Edges, Preserve=False)  # -> simplify(Curves)
explode = Explode(Curve=join_curves, Recursive=True)  # -> Segments, Vertices
length = Length(Curve=explode.Segments)
sort_list = SortList(Keys=length, ValuesValuesA=explode.Segments)  # -> Keys, ValuesValuesA
addition = Addition(A="0", B=2)
subtraction = Subtraction(A=addition, B=1)
list_item = ListItem(List=explode.Vertices, Index="0", Wrap=True)
list_item_2 = ListItem(List=explode.Vertices, Index=subtraction, Wrap=True)
list_item_3 = ListItem(List=explode.Vertices, Index=addition, Wrap=True)
line = Line(StartPoint=list_item, EndPoint=list_item_3)
curve_middle = CurveMiddle(Curve=line)
line_2 = Line(StartPoint=curve_middle, EndPoint=list_item_2)
project = Project(Curve=line, Brep=deconstruct_brep.Faces, Direction=Vector(0, 0, 1))
surface_split = SurfaceSplit(Surface=deconstruct_brep.Faces, Curves=flatten([line_2, project]))  # -> flatten(Fragments)
fragments = ClusterOutput(surface_split)

# ==== cluster Cluster_4
data = ClusterInput()
data_2 = Data(data)
deconstruct_brep = DeconstructBrep(Brep=data_2)  # -> Faces, Edges, flatten(Vertices)
join_curves = JoinCurves(Curves=deconstruct_brep.Edges, Preserve=False)  # -> simplify(Curves)
explode = Explode(Curve=join_curves, Recursive=True)  # -> Segments, Vertices
length = Length(Curve=explode.Segments)
sort_list = SortList(Keys=length, ValuesValuesA=explode.Segments)  # -> Keys, ValuesValuesA
list_item = ListItem(List=sort_list.ValuesValuesA, Index="-1", Wrap=True)
list_item_2 = ListItem(List=sort_list.ValuesValuesA, Index="-2", Wrap=True)
curve_middle = CurveMiddle(Curve=list_item)
curve_middle_2 = CurveMiddle(Curve=list_item_2)
line = Line(StartPoint=curve_middle, EndPoint=curve_middle_2)
project = Project(Curve=line, Brep=deconstruct_brep.Faces, Direction=Vector(0, 0, 1))
surface_split = SurfaceSplit(Surface=deconstruct_brep.Faces, Curves=flatten([project, line]))  # -> flatten(Fragments)
fragments = ClusterOutput(surface_split)
