# Grasshopper definition PatternMorph.gh (Grasshopper 1.0.8)
# plug-ins: Karamba3D, Human, Weaverbird

# Automated
# animate slider
number_slider = Slider(896, range=0..10000)
# Inputs
# Toggle between manual and automated
# sampling
# true = automated, false = manual
sampling_mode = BooleanToggle(False)

# ----
# Manual
d2 = Slider(0.529, range=0..1)
# Play with Me
num_y = Slider(10, range=2..14)
d1 = Slider(0.404, range=0..1)

# ----
# Start Screenshot Recorder
# Start Data Recorder
toggle = BooleanToggle(True)
reset = Button()
random = Random(Range=Domain(0, 1), Number=Slider(11, range=0..20), Seed=number_slider)
data = Data(toggle)
data_2 = Data(sampling_mode)
data_3 = Data(reset)
panel = Panel(random)
item = ListItem(List=panel, Index=0, Wrap=True)  # -> Item, Item1, Item2, Item3, Item4, Item5, Item6, Item7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
G = Gate(data_2)
num = Number(num_y)
G_2 = Gate(data_2)
num_2 = Number(item.Item2)
G_3 = Gate(data_2)
num_3 = Number(item.Item1)
num_4 = Number(d2)
num_5 = Number(d1)
G_4 = Gate(data_2)
G_5 = Gate(data_2)
num_6 = Number(item.Item4)
G_6 = Gate(data_2)
num_7 = Number(Slider(1.3, range=0..10))
num_8 = Number(item.Item5)
num_9 = Number(Slider(0.287, range=0..1))
G_7 = Gate(data_2)
num_10 = Number(item.Item6)
num_11 = Number(Slider(0.483, range=0..1))
num_12 = Number(Slider(0.608, range=0..1))
G_8 = Gate(data_2)
num_13 = Number(item.Item8)
G_9 = Gate(data_2)
num_14 = Number(Slider(0.708, range=0..1))
num_15 = Number(item.Item7)
num_16 = Number(Slider(0.399, range=0..1))
G_10 = Gate(data_2)
num_17 = Number(item.Item9)
num_18 = Number(Slider(0.532, range=0..1))
multiplication = Multiplication(A=item.Item10, B="11")
G_11 = Gate(data_2)
num_19 = Number(Slider(4, range=0..10))
filter = StreamFilter(Gate=G_2, Stream0=num_4, Stream1=num_2)
filter_2 = StreamFilter(Gate=G_3, Stream0=num_5, Stream1=num_3)
multiplication_2 = Multiplication(A=item.Item3, B="10")
num_20 = Number(multiplication_2)
filter_3 = StreamFilter(Gate=G_4, Stream0=num_7, Stream1=num_20)
filter_4 = StreamFilter(Gate=G_5, Stream0=num_9, Stream1=num_6)
filter_5 = StreamFilter(Gate=G_6, Stream0=num_11, Stream1=num_8)
filter_6 = StreamFilter(Gate=G_7, Stream0=num_12, Stream1=num_10)
multiplication_3 = Multiplication(A=item.Item, B="13")
filter_7 = StreamFilter(Gate=G_8, Stream0=num_14, Stream1=num_13)
filter_8 = StreamFilter(Gate=G_9, Stream0=num_16, Stream1=num_15)
round = Round(Number=multiplication)  # -> Nearest, Floor, Ceiling
num_21 = Number(round.Floor)
filter_9 = StreamFilter(Gate=G_11, Stream0=num_19, Stream1=num_21)
filter_10 = StreamFilter(Gate=G_10, Stream0=num_18, Stream1=num_17)
round_2 = Round(Number=multiplication_3)  # -> Nearest, Floor, Ceiling
addition = Addition(A=round_2.Floor, B="2")
num_22 = Number(addition)
filter_11 = StreamFilter(Gate=G, Stream0=num, Stream1=num_22)
integer = Integer(filter_11)
merge = Merge(
    Data1=filter_11,
    Data2=filter_2,
    Data3=filter,
    Data4=filter_3,
    Data5=filter_4,
    Data6=filter_5,
    Data7=filter_6,
    Data8=filter_8,
    Data9=filter_7,
    Data10=filter_10,
    Data11=filter_9)
panel_2 = Panel(integer)
num_23 = Number(merge)
crv = Curve(<curve referenced from the Rhino model>)
number_slider_2 = Slider(0.006, range=0..0.01)
Z = UnitZ(Factor=Slider(0.3, range=0..1))
rev = Reverse(Vector=Z)
loads = LoadsKaramba3D(Vector=Vector(0, 0, -1), LCase="LC0", mode="Gravity")
panel_3 = Panel("""1
2
3
4
5
6
7
8
9
10
11""")
python_3_script = Python3Script()  # -> out, path
# ---------- python_3_script: Python ----------
import os

_filepath = ghenv.Component.OnPingDocument().FilePath
path = os.path.dirname(_filepath)
# ---------- end python_3_script ----------
# Path
folder_path = Panel(python_3_script.path)
num_24 = Number(num_23)
txt = Text("save_folder")
txt_2 = Text(folder_path)
txt_3 = Text("data_table.csv")
txt_4 = Text("screenshot")
path = Python3Script(path=txt_2, to_append=txt)  # -> out, path
# ---------- path: Python ----------
import os
if to_append:
    path_ = os.path.join(path, to_append)
# ---------- end path ----------
# Create header row of csv spreadsheet,
# containing names of the columns
merge_2 = Merge(Data1=panel_3, Data2="steel comsumption", Data3="max_disp", Data4="strain energy", Data5="image_path")
data_4 = Data(num_24)
data_5 = Data(data_3)
bool = Boolean(data)
txt_5 = Text(path.path)
# CSV File Streamer
txt_6 = Text(txt_5)
# Screenshot Saver
txt_7 = Text(txt_5)
path_2 = Python3Script(path=txt_6, to_append=txt_3)  # -> out, path; same code as path
path_3 = Python3Script(path=txt_7, to_append=txt_4)  # -> out, path; same code as path
txt_8 = Text(path_2.path)
txt_9 = Text(path_3.path)
bool_2 = Boolean(bool)
txt_10 = Text(folder_path)
data_6 = Data(Toggle(True))

# ---- group: make folder if it does not exists
path_4 = Python3Script(path=txt_5)  # -> out
# ---------- path_4: Python ----------
import os
if not os.path.exists(path):
    os.makedirs(path)
# ---------- end path_4 ----------

# ----
panel_4 = Panel(txt_8)
txt_11 = Text(txt_8)
txt_12 = Text(merge_2)
data_7 = Data(data_3)
bool_3 = Boolean(data_6)

# ---- group: PatternGenerator
crv_2 = Curve(<curve referenced from the Rhino model>)
data_8 = Data(filter_9)
scale = Scale(Geometry=crv_2, Center=Point(0, 0, 0), Factor=Slider(1, range=0..1))  # -> Geometry, Transform
srf = Surface(reparameterize(scale.Geometry))
data_9 = Data(data_8)
sdivide = DivideSurface(Surface=srf, UCount=data_9, VCount=data_9)  # -> Points, Normals, simplify(Parameters)
data_10 = Data(filter_3)
evalsrf = EvaluateSurface(Surface=srf, Point=sdivide.Parameters)  # -> Point, Normal, Frame
Z_2 = UnitZ(Factor=data_10)
pt = Point(evalsrf.Point)
data_11 = Data(Z_2)
data_12 = Data(filter_2)
data_13 = Data(filter)
# PatternGenerator
pattern_type_toggle = BooleanToggle(False)
num_y_2 = Integer(panel_2)
boolean = Boolean(pattern_type_toggle)
num_y_3 = Integer(num_y_2)

data_14 = Data(data_9)
pt_2 = Point(flatten(pt))
data_15 = Data(data_11)
panel_5 = Panel("""0
2
6
8""")
panel_6 = Panel("""1
3
5
7""")
data_16 = Data(filter_4)
data_17 = Data(filter_5)
data_18 = Data(filter_6)
item_2 = ListItem(List=pt_2, Index=panel_5, Wrap=True)
item_3 = ListItem(List=pt_2, Index=panel_6, Wrap=True)
item_4 = ListItem(List=pt_2, Index="4", Wrap=True)
pt_3 = Point(item_4)
pt_4 = Point(item_2)
pt_5 = Point(item_3)
multiplication_4 = Multiplication(A=data_15, B=data_16)
multiplication_5 = Multiplication(A=data_15, B=data_17)
multiplication_6 = Multiplication(A=data_15, B=data_18)
data_19 = Data(multiplication_4)
data_20 = Data(multiplication_5)
data_21 = Data(multiplication_6)
move = Move(Geometry=pt_4, Motion=data_19)  # -> Geometry, Transform
move_2 = Move(Geometry=pt_5, Motion=data_20)  # -> Geometry, Transform
move_3 = Move(Geometry=pt_3, Motion=data_21)  # -> Geometry, Transform
merge_3 = Merge(Data1=panel_5, Data2=panel_6, Data3="4")
merge_4 = Merge(Data1=move.Geometry, Data2=move_2.Geometry, Data3=move_3.Geometry)
data_22 = Data(merge_3)
pt_6 = Point(pt_2)
pt_7 = Point(merge_4)
pt_8 = Point(pt_7)
replace = ReplaceItems(List=pt_6, Item=pt_8, Indices=data_22, Wrap=False)
pt_9 = Point(replace)
pt_10 = Point(pt_9)
srfgrid = SurfaceFromPoints(Points=pt_10, UCount=expr("x+1", data_14), Interpolate=False)
srf_2 = Surface(srfgrid)

pt_11 = Point(flatten(pt))
data_23 = Data(data_9)
panel_7 = Panel("""0
2
6
8""")
panel_8 = Panel("""1
3
5
7""")
data_24 = Data(data_11)
data_25 = Data(filter_10)
data_26 = Data(filter_8)
item_5 = ListItem(List=pt_11, Index=panel_7, Wrap=True)
item_6 = ListItem(List=pt_11, Index=panel_8, Wrap=True)
data_27 = Data(filter_7)
item_7 = ListItem(List=pt_11, Index="4", Wrap=True)
pt_12 = Point(item_7)
pt_13 = Point(item_5)
pt_14 = Point(item_6)
multiplication_7 = Multiplication(A=data_24, B=data_26)
multiplication_8 = Multiplication(A=data_24, B=data_27)
multiplication_9 = Multiplication(A=data_24, B=data_25)
data_28 = Data(multiplication_7)
data_29 = Data(multiplication_8)
data_30 = Data(multiplication_9)
move_4 = Move(Geometry=pt_13, Motion=data_28)  # -> Geometry, Transform
move_5 = Move(Geometry=pt_14, Motion=data_29)  # -> Geometry, Transform
merge_5 = Merge(Data1=panel_7, Data2=panel_8, Data3="4")
move_6 = Move(Geometry=pt_12, Motion=data_30)  # -> Geometry, Transform
merge_6 = Merge(Data1=move_4.Geometry, Data2=move_5.Geometry, Data3=move_6.Geometry)
data_31 = Data(merge_5)
pt_15 = Point(pt_11)
pt_16 = Point(merge_6)
pt_17 = Point(pt_16)
replace_2 = ReplaceItems(List=pt_15, Item=pt_17, Indices=data_31, Wrap=False)
pt_18 = Point(replace_2)
pt_19 = Point(pt_18)
srfgrid_2 = SurfaceFromPoints(Points=pt_19, UCount=expr("x+1", data_23), Interpolate=False)
srf_3 = Surface(srfgrid_2)

division = Division(A="3.5184", B=num_y_3)
division_2 = Division(A="2.1155", B=num_y_3)
division_3 = Division(A="1.9238", B=num_y_3)
division_4 = Division(A="1.2086", B=num_y_3)
panel_9 = Panel("0")
construct_domain = ConstructDomain(DomainStart=panel_9, DomainEnd=division_3)
construct_domain_2 = ConstructDomain(DomainStart=panel_9, DomainEnd=division_4)
construct_domain_3 = ConstructDomain(DomainStart=panel_9, DomainEnd=division)
construct_domain_4 = ConstructDomain(DomainStart=panel_9, DomainEnd=division_2)
remap_numbers = RemapNumbers(Value=data_12, Source=Domain(0, 1), Target=construct_domain_3)  # -> Mapped, Clipped
remap_numbers_2 = RemapNumbers(Value=data_13, Source=Domain(0, 1), Target=construct_domain_4)  # -> Mapped, Clipped
remap_numbers_3 = RemapNumbers(Value=data_12, Source=Domain(0, 1), Target=construct_domain)  # -> Mapped, Clipped
remap_numbers_4 = RemapNumbers(Value=data_13, Source=Domain(0, 1), Target=construct_domain_2)  # -> Mapped, Clipped
d1_square = Panel(remap_numbers.Mapped)
d2_square = Panel(remap_numbers_2.Mapped)
d1_rectangle = Panel(remap_numbers_3.Mapped)
d2_rectangle = Panel(remap_numbers_4.Mapped)
d2_2 = Number([d2_square, d2_rectangle])
d1_2 = Number([d1_square, d1_rectangle])

num_x_3_num_y = Panel("3")
num_x = Panel(num_y_2)
expression = Expression(x=boolean, y=boolean, Expression="if(x = true, 1, 0)")
multiplication_10 = Multiplication(A=num_x_3_num_y, B=num_y_2)

list_item = ListItem(List=d1_2, Index=expression, Wrap=True)
list_item_2 = ListItem(List=d2_2, Index=expression, Wrap=True)
d1_3 = Number(list_item)
d2_3 = Number(list_item_2)

num_x_2 = Integer([num_x, multiplication_10])
srf_4 = Surface(srf_3)
srf_5 = Surface(srf_2)
srf_6 = Surface(srf_5)
srf_7 = Surface(srf_4)
construct_domain_5 = ConstructDomain(DomainStart=panel_9, DomainEnd=division_2)
construct_domain_6 = ConstructDomain(DomainStart=panel_9, DomainEnd=division)

list_item_3 = ListItem(List=num_x_2, Index=expression, Wrap=True)
integer_2 = Integer(list_item_3)

const_area = Panel("100")
multiplication_11 = Multiplication(A=integer_2, B=num_y_3)
division_5 = Division(A=const_area, B=multiplication_11)
square_root = SquareRoot(Value=division_5)

sqgrid = Square(Plane=PlaneXY(0, 0, 0), Size=square_root, ExtentX=list_item_3, ExtentY=num_y_3)  # -> Cells, Points
divide = DivideCurve(Curve=sqgrid.Cells, Count=12, Kinks=False)  # -> Points, Tangents, Parameters
item_8 = ListItem(List=divide.Points, Index=[1, 2, 4, 5, 7, 8, 10, 11], Wrap=False)
item_9 = ListItem(List=divide.Points, Index=[4, 7, 10, 1], Wrap=False)
item_10 = ListItem(List=divide.Points, Index=[2, 5, 8, 11], Wrap=False)
pline = PolyLine(Vertices=item_8, Closed=True)  # -> simplify(Polyline)
ln = Line(StartPoint=item_10, EndPoint=item_9)
join = JoinCurves(Curves=flatten(ln), Preserve=False)  # -> flatten(Curves)
explode = Explode(Curve=pline, Recursive=True)  # -> Segments, Vertices
cls = Closed(Curve=join)  # -> Closed, Periodic
crv_3 = Curve(pline)
cull = CullPattern(List=join, CullPattern=cls.Closed)
explode_2 = Explode(Curve=cull, Recursive=True)  # -> Segments, Vertices
eval = EvaluateCurve(Curve=reparameterize(explode.Segments), Parameter=0.5)  # -> simplify(Point), Tangent, Angle

crv_4 = Curve(simplify(graft(cull)))
crv_5 = Curve(simplify(crv_3))
crv_6 = Curve(simplify(graft(pline)))
explode_3 = Explode(Curve=crv_6, Recursive=True)  # -> simplify(Segments), simplify(Vertices)
curvepoint = PointOnCurve(explode_3.Segments, parameter=0.5)
weave = Weave(Pattern=[0, 1], Stream0=explode_3.Vertices, Stream1=curvepoint, NullGaps=False)
pline_2 = PolyLine(Vertices=weave, Closed=False)
crv_7 = Curve(pline_2)
crv_8 = Curve(crv_5)

crv_9 = Curve(flatten(crv_7))
explode_4 = Explode(Curve=crv_9, Recursive=True)  # -> Segments, Vertices
pt_20 = Point(flatten(explode_4.Vertices))
crv_10 = Curve(flatten(explode_4.Segments))

pt_21 = Point(flatten(pt_20))
crv_11 = Curve(flatten(crv_10))
hull = ConvexHull(Points=pt_21, Plane=PlaneXY(0, 0, 0))  # -> Hull, HullZ, Indices
crv_12 = Curve(reparameterize(hull.Hull))

crv_13 = Curve(crv_12)
crv_cp = CurveClosestPoint(Point=pt_21, Curve=crv_13)  # -> Point, Parameter, Distance
data_32 = Data(crv_cp.Distance)
pt_22 = Point(crv_cp.Point)
data_33 = Data(crv_cp.Parameter)
smaller = SmallerThan(FirstNumber=data_32, SecondNumber="0.001")  # -> SmallerThan, OrEqualTo
dispatch = Dispatch(List=pt_22, DispatchPattern=smaller.SmallerThan)  # -> ListA, ListB
dispatch_2 = Dispatch(List=data_33, DispatchPattern=smaller.SmallerThan)  # -> ListA, ListB
pt_23 = Point(dispatch.ListA)
data_34 = Data(dispatch_2.ListA)

crv_14 = Curve(crv_10)
curvepoint_2 = PointOnCurve(crv_14, parameter=0.5)
crv_cp_2 = CurveClosestPoint(Point=curvepoint_2, Curve=crv_12)  # -> Point, Parameter, Distance

data_35 = Data(crv_14)
data_36 = Data(crv_cp_2.Distance)
smaller_2 = SmallerThan(FirstNumber=data_36, SecondNumber="0.001")  # -> SmallerThan, OrEqualTo
dispatch_3 = Dispatch(List=data_35, DispatchPattern=smaller_2.SmallerThan)  # -> ListA, ListB
data_37 = Data(dispatch_3.ListB)

crv_15 = Curve(crv_12)
shatter = Shatter(Curve=crv_15, Parameters=data_34)
crv_16 = Curve(shatter)

crv_17 = Curve(crv_5)
area = Area(Geometry=crv_17)  # -> Area, Centroid
data_38 = Data("100")
Z_3 = UnitZ(Factor=data_38)
pt_24 = Point(area.Centroid)
move_7 = Move(Geometry=pt_24, Motion=Z_3)  # -> Geometry, Transform
pt_25 = Point(move_7.Geometry)
geo = Geometry(srf_7)
project = ProjectPoint(Point=pt_25, Direction=Vector(0, 0, -1), Geometry=geo)  # -> Point, Index
pt_26 = Point(project.Point)
pdecon = Deconstruct(Point=pt_26)  # -> XComponent, YComponent, ZComponent
data_39 = Data(pdecon.ZComponent)

data_40 = Data(data_39)
min = Minimum(A=data_40, B="1")
data_41 = Data(min)

data_42 = Data(data_41)

crv_18 = Curve(crv_4)
area_2 = Area(Geometry=crv_18)  # -> Area, Centroid
data_43 = Data("100")
Z_4 = UnitZ(Factor=data_43)
pt_27 = Point(area_2.Centroid)
move_8 = Move(Geometry=pt_27, Motion=Z_4)  # -> Geometry, Transform
pt_28 = Point(move_8.Geometry)
geo_2 = Geometry(srf_6)
project_2 = ProjectPoint(Point=pt_28, Direction=Vector(0, 0, -1), Geometry=geo_2)  # -> Point, Index
pt_29 = Point(project_2.Point)
pdecon_2 = Deconstruct(Point=pt_29)  # -> XComponent, YComponent, ZComponent
data_44 = Data(pdecon_2.ZComponent)

data_45 = Data(data_44)
min_2 = Minimum(A=data_45, B="1")
data_46 = Data(min_2)

data_47 = Data(data_46)

crv_19 = Curve(crv_4)
crv_20 = Curve(crv_8)
crv_21 = Curve(crv_19)
eval_2 = EvaluateCurve(Curve=reparameterize(explode_2.Segments), Parameter=0.5)  # -> simplify(Point), Tangent, Angle

remap_numbers_5 = RemapNumbers(Value=data_47, Source=Domain(0, 1), Target=construct_domain_5)  # -> Mapped, Clipped
remap_numbers_6 = RemapNumbers(Value=data_42, Source=Domain(0, 1), Target=construct_domain_6)  # -> Mapped, Clipped
data_48 = Data(remap_numbers_5.Mapped)
data_49 = Data(remap_numbers_6.Mapped)
crv_22 = Curve(crv_16)
pt_30 = Point(pt_23)
crv_23 = Curve(crv_16)
crv_24 = Curve(crv_23)

data_50 = Data(data_49)
data_51 = Data(data_48)
offset = Offset(Curve=crv_20, Distance=expr("-x", data_50), Plane=PlaneXY(0, 0, 0), Corners=1)
offset_2 = Offset(Curve=simplify(crv_21), Distance=simplify(data_51), Plane=PlaneXY(0, 0, 0), Corners=1)  # -> simplify(Curve)
explode_5 = Explode(Curve=offset, Recursive=True)  # -> Segments, simplify(Vertices)
explode_6 = Explode(Curve=offset_2, Recursive=True)  # -> Segments, simplify(Vertices)
weave_2 = Weave(Pattern=[0, 1], Stream0=explode_5.Vertices, Stream1=eval.Point, NullGaps=False)
weave_3 = Weave(Pattern=[0, 1], Stream0=explode_6.Vertices, Stream1=eval_2.Point, NullGaps=False)
rdpoints = RemoveDuplicatePointsKaramba3D(Point=explode_6.Vertices, LimitDistance=0.005)  # -> OutPoint, Info, Indexes
rdpoints_2 = RemoveDuplicatePointsKaramba3D(Point=weave_3, LimitDistance=0.005)  # -> OutPoint, Info, Indexes
rdpoints_3 = RemoveDuplicatePointsKaramba3D(Point=explode_5.Vertices, LimitDistance=0.005)  # -> OutPoint, Info, Indexes
rdpoints_4 = RemoveDuplicatePointsKaramba3D(Point=weave_2, LimitDistance=0.005)  # -> OutPoint, Info, Indexes
pline_3 = PolyLine(Vertices=rdpoints_2.OutPoint, Closed=True)
pline_4 = PolyLine(Vertices=rdpoints_4.OutPoint, Closed=True)
polyline = PolyLine(Vertices=rdpoints.OutPoint, Closed=True)
polyline_2 = PolyLine(Vertices=rdpoints_3.OutPoint, Closed=True)
simplify = SimplifyCurve(Curve=polyline)  # -> Curve, Simplified
simplify_2 = SimplifyCurve(Curve=pline_3)  # -> Curve, Simplified
simplify_3 = SimplifyCurve(Curve=pline_4)  # -> Curve, Simplified
simplify_4 = SimplifyCurve(Curve=polyline_2)  # -> Curve, Simplified
crv_25 = Curve([simplify_4.Curve, simplify_3.Curve, simplify_2.Curve, simplify.Curve])
explode_7 = Explode(Curve=crv_25, Recursive=True)  # -> Segments, Vertices

crv_26 = Curve(flatten(explode_7.Segments))

crv_27 = Curve(data_37)
crv_28 = Curve(crv_26)
merge_7 = Merge(Data1=crv_22, Data2=crv_27, Data3=crv_28)  # -> flatten(Result)
rdlines = RemoveDuplicateLinesKaramba3D(Line=merge_7, LimitDistance=0.005)  # -> OutLine, Info, Indexes
crv_29 = Curve(rdlines.OutLine)

crv_30 = Curve(data_37)
crv_31 = Curve(crv_26)
merge_8 = Merge(Data2=crv_30, Data3=crv_31)  # -> flatten(Result)
rdlines_2 = RemoveDuplicateLinesKaramba3D(Line=merge_8, LimitDistance=0.005)  # -> OutLine, Info, Indexes
crv_32 = Curve(rdlines_2.OutLine)

# ----
crv_33 = Curve(crv_24)
crv_34 = Curve(crv_32)
join_2 = JoinCurves(Curves=crv_33, Preserve=False)
simplify_5 = SimplifyCurve(Curve=join_2)  # -> Curve, Simplified
crv_35 = Curve(crv_34)
explode_8 = Explode(Curve=simplify_5.Curve, Recursive=True)  # -> Segments, Vertices
crv_36 = Curve(flatten(simplify_5.Curve))
crv_37 = Curve(flatten(explode_8.Segments))
pt_31 = Point(flatten(explode_8.Vertices))
end = EndPoints(Curve=crv_35)  # -> flatten(Start), flatten(End)
cset = CreateSet(List=flatten([end.Start, end.End]))  # -> Set, Map
pt_32 = Point(cset.Set)
pt_33 = Point(pt_32)
crv_38 = Curve(crv_35)
crv_39 = Curve(crv_36)
crv_40 = Curve(flatten([crv_38, crv_39, crv]))
crv_41 = Curve(crv_38)
pt_34 = Point(pt_33)
crv_42 = Curve(crv_39)
previewlw = CustomPreviewLineweights(Geometry=crv_40, Shader=ColourSwatch(SwatchColor=RGB(0, 0, 0)), Thickness=Slider(4, range=0..10), Absolute=False)

# ---- group: structural analysis
# STRUCTURAL ANALYSIS
explode_9 = Explode(Curve=crv_42, Recursive=True)  # -> flatten(Segments), Vertices
explode_10 = Explode(Curve=crv, Recursive=True)  # -> flatten(Segments), Vertices
llinter = LineLineIntersectionKaramba3D(IntersectingLines=flatten(crv_41), LinesToIntersect=graft(explode_9.Segments), LimitDistance_m=0.005)  # -> InterSecPoints, LineSubSegments
llinter_2 = LineLineIntersectionKaramba3D(IntersectingLines=flatten(crv_41), LinesToIntersect=graft(explode_10.Segments), LimitDistance_m=0.005)  # -> InterSecPoints, LineSubSegments
crv_43 = Curve(flatten(llinter.LineSubSegments))
line = Line(flatten(llinter.LineSubSegments))
null = NullItem(Item=crv_43)  # -> NullFlags, InvalidFlags, Description
end_2 = EndPoints(Curve=crv_43)  # -> Start, End
crv_44 = Curve(flatten(llinter_2.LineSubSegments))
line_2 = Line(flatten(llinter_2.LineSubSegments))
dispatch_4 = Dispatch(List=crv_43, DispatchPattern=null.InvalidFlags)  # -> ListA, ListB
null_2 = NullItem(Item=crv_44)  # -> NullFlags, InvalidFlags, Description
end_3 = EndPoints(Curve=crv_44)  # -> Start, End
dispatch_5 = Dispatch(List=crv_44, DispatchPattern=null_2.InvalidFlags)  # -> ListA, ListB
crv_45 = Curve([dispatch_5.ListB, dispatch_4.ListB])
dupln = RemoveDuplicateLines(Lines=crv_45, Tolerance=0.01)
merge_9 = Merge(Data1=crv_41, Data2=dupln)  # -> flatten(Result)
crv_46 = Curve(merge_9)
material_consumption = Panel("5600")
end_4 = EndPoints(Curve=line_2)  # -> Start, End
len = Length(Curve=crv_46)
division_6 = Division(A=material_consumption, B="7350")
ma = MassAddition(Input=len)  # -> Result, PartialResults
division_7 = Division(A=division_6, B=ma.Result)
panel_10 = Panel("100")

# ----
pt_35 = Point([end_4.End, end_4.Start])
wbweave = WeaverbirdsMeshFromLinesWeaveBack(Lines=crv_46, MaximumValence=Slider(10, range=0..10))
duppt = RemoveDuplicatePts(Points=pt_35, Tolerance=0.01)
expression_2 = Expression(x=division_7, y=number_slider_2, Expression="(x+4*y²)/4/y")
supp = SupportKaramba3D(PosInd=duppt, menu=[buttons(on, on, on, off, off, off)])
loads_2 = LoadsKaramba3D(Vector=rev, Mesh=wbweave, LCase="LC0", mode="MeshLoad -Const.", menu=[buttons(on, off, off), buttons(on, on)])
multiplication_12 = Multiplication(A=number_slider_2, B=panel_10)
load = LoadKaramba3D([loads, loads_2])

# ---- group: structural analysis (continued)
multiplication_13 = Multiplication(A=expression_2, B=panel_10)
num_25 = Number(multiplication_13)
support = Support(supp)
crosec = CrossSectionKaramba3D(
    FamilyNameOfCrossSection="DefaultCroSec",
    Height_cm=num_25,
    UpperFlangeWidth_cm=num_25,
    LowerFlangeWidth_cm=num_25,
    UpperFlangeThickness_cm=multiplication_12,
    LowerFlangeThickness_cm=multiplication_12,
    SidewallsThickness_cm=multiplication_12,
    FilletRadius_cm=0.6,
    mode="Box")
lineelem = CreateLinearElementKaramba3D(
    Line=crv_46,
    CrossSection=crosec,
    LimitDistance_m=0.005,
    BucklingLengthY_m=-1,
    BucklingLengthZ_m=-1,
    BucklingLengthLT_m=-1,
    Bending=True,
    ToPolylineMaxAngle=0.03,
    ToPolylineTolerance=0.01,
    ToPolylineMaxEdgeLength=0.25,
    New=True,
    Remove=True,
    mode="LineToBeam")  # -> Element, Points, Info
elem = Elem(lineelem.Element)
support_2 = Support(flatten(support))
elem_2 = Elem(flatten(elem))
load_2 = LoadKaramba3D(flatten(load))
assemble = AssembleModelKaramba3D(Elem=elem_2, Support=support_2, Load=load_2, LimitDistance_m=0.005)  # -> Model, Info, Mass_kg, CentreOfGravity, LoadCaseNames
model = Model(assemble.Model)
analyse = AnalyseKaramba3D(Model=model)  # -> AnalysedModel, MaximumDisplacement_cm, ResultingForce_kN, ChangeOfElasticEnergy_kNm
model_2 = Model(analyse.AnalysedModel)
num_26 = Number(analyse.MaximumDisplacement_cm)
modelview = ModelViewKaramba3D(Model=analyse.AnalysedModel)  # -> Model, DeformedMesh, DeformedAxes, DeformedModel, MaximumDeformation
b_forces = BeamForcesKaramba3D(AnalysedModel=model_2, Ts=[0, 1])  # -> Model, NormalForce_kN, ShearForceVz_kN, ShearForceVy_kN, TorsionalMomentMt_kNm, flatten(BendingMomentMy_kNm), flatten(BendingMomentMz_kNm), LoadCaseIndex
beamview = BeamViewKaramba3D(Model=modelview.Model)  # -> Model, MeshesOfRenderedBeams, DeformedBeamAxes, LegendColours, LegendTags
legend = Legend(Colour=beamview.LegendColours, Tags=beamview.LegendTags, LegendType=1)
panel_11 = Panel(b_forces.BendingMomentMz_kNm)
model_3 = ModelKaramba3D(beamview.Model)

# ----
num_27 = Number(analyse.ChangeOfElasticEnergy_kNm)
num_28 = Number(num_26)
num_29 = Number(analyse.ChangeOfElasticEnergy_kNm)
data_52 = Data(num_29)
data_53 = Data(material_consumption)
data_54 = Data(num_28)
data_55 = Data(flatten(model_3))
item_11 = ListItem(List=data_55, Index=0, Wrap=True)
c_name_iterator = CSharpScript(port=item_11, T=bool_2, R=data_5, P=txt_9)  # -> out, A; inputs T: Boolean, R: Boolean
# ---------- c_name_iterator: C# ----------
    if(T)
    {
      n++;
    }
    if(R)
    {
      n = 0;
    }
    A = P + "_" + n + ".jpg";
# ---------- c_name_iterator: C# additional code ----------
  public int n;
# ---------- end c_name_iterator ----------
txt_13 = Text(c_name_iterator.A)
data_56 = Data(txt_13)
# Merge data
merge_10 = Merge(Data1=flatten(data_4), Data2=flatten(data_53), Data3=flatten(data_54), Data4=flatten(data_52), Data5=flatten(data_56))
data_57 = Data(flatten(merge_10))
panel_12 = Panel(data_57)
data_58 = Data(data_57)
c_vp_to_img = CSharpScript(T=bool_2, P=txt_13)  # inputs T: Boolean, P: String
# ---------- c_vp_to_img: C# ----------
    if(T)
    {
      var file_name = "";
      if (P != "")
      {
        file_name = P;
        var bitmap = RhinoDoc.ActiveDoc.Views.ActiveView.CaptureToBitmap(false, false, false);
        //Clipboard.SetImage(bitmap);
        bitmap.Save(file_name);
      }
    }
# ---------- end c_vp_to_img ----------
c_script = CSharpScript(T=bool_2, P=txt_13)  # inputs T: Boolean, P: String
# ---------- c_script: C# ----------
using System;
using System.Collections;
using System.Collections.Generic;

using Rhino;
using Rhino.Geometry;

using Grasshopper;
using Grasshopper.Kernel;
using Grasshopper.Kernel.Data;
using Grasshopper.Kernel.Types;

/// <summary>
/// This class will be instantiated on demand by the Script component.
/// </summary>
public class Script_Instance : GH_ScriptInstance
{
  /// <summary>Print a String to the [Out] Parameter of the Script component.</summary>
  /// <param name="text">String to print.</param>
  private void Print(string text) { /* Implementation hidden. */ }
  /// <summary>Print a formatted String to the [Out] Parameter of the Script component.</summary>
  /// <param name="format">String format.</param>
  /// <param name="args">Formatting parameters.</param>
  private void Print(string format, params object[] args) { /* Implementation hidden. */ }
  /// <summary>Print useful information about an object instance to the [Out] Parameter of the Script component. </summary>
  /// <param name="obj">Object instance to parse.</param>
  private void Reflect(object obj) { /* Implementation hidden. */ }
  /// <summary>Print the signatures of all the overloads of a specific method to the [Out] Parameter of the Script component. </summary>
  /// <param name="obj">Object instance to parse.</param>
  private void Reflect(object obj, string method_name) { /* Implementation hidden. */ }

  /// <summary>Gets the current Rhino document.</summary>
  private readonly RhinoDoc RhinoDocument;
  /// <summary>Gets the Grasshopper document that owns this script.</summary>
  private readonly GH_Document GrasshopperDocument;
  /// <summary>Gets the Grasshopper script component that owns this script.</summary>
  private readonly IGH_Component Component;
  /// <summary>
  /// Gets the current iteration count. The first call to RunScript() is associated with Iteration==0.
  /// Any subsequent call within the same solution will increment the Iteration count.
  /// </summary>
  private readonly int Iteration;

  /// <summary>
  /// This procedure contains the user code. Input parameters are provided as regular arguments,
  /// Output parameters as ref arguments. You don't have to assign output parameters,
  /// they will have a default value.
  /// </summary>
  private void RunScript(bool T, string P)
  {
    if(T)
    {
      var file_name = "";
      if (P != "")
      {
        file_name = P;
        var bitmap = RhinoDoc.ActiveDoc.Views.ActiveView.CaptureToBitmap(false, false, false);
        //Clipboard.SetImage(bitmap);
        bitmap.Save(file_name);
      }
    }


  }

  // <Custom additional code> 

  // </Custom additional code> 
}
# ---------- end c_script ----------
ghpython_script = GhPythonScript(filepath=txt_11, head=txt_12, data=data_58, write=bool_3, reset=data_7)  # -> out, a; inputs head: list, data: list
# ---------- ghpython_script: Python ----------
__author__ = "tamk"
__version__ = "2024.04.04"

import rhinoscriptsyntax as rs
from scriptcontext import sticky
import os
import sys


if reset:
    _ = sticky.pop('filestream', {})
    
fs = sticky.setdefault('filestream', None)

if not fs and filepath and write:
    fs = sticky['filestream'] = open(filepath, 'w')
    if head:
        fs.write(','.join(str(_h) for _h in head) + '\n')
    
if fs and write:
    fs.write(','.join(str(_x) for _x in data) + '\n')
    fs.flush()

if fs and not write:
    fs.close()
    fs = sticky['filestream'] = None
# ---------- end ghpython_script ----------
full_saved_image_path = Panel(txt_13)
