# Grasshopper definition PatternMorph.gh (Grasshopper 1.0.8)
# plug-ins: Karamba3D, Human, Weaverbird

# ----
# Automated
# animate slider
number_slider = Slider(14, range=0..10000)

# ----
# Toggle between manual and automated
# sampling
# true = automated, false = manual
sampling_mode = BooleanToggle(False)

# ----
# Design variables
d2 = Slider(0.529, range=0..1)
d1 = Slider(0.404, range=0..1)
# manual
num_y = Slider(6, range=2..14)

# ----
# Start Screenshot Recorder
toggle = BooleanToggle(True)
# Start Data Recorder
toggle_2 = BooleanToggle(True)
# Reset Recording
# Inputs
reset = Button()
random = Random(Range=Domain(0, 1), Number=Slider(10, range=0..10), Seed=number_slider)
data = Data(sampling_mode)
data_2 = Data(toggle)
data_3 = Data(toggle_2)
data_4 = Data(reset)
panel = Panel(random)
# OPTION 1 OR 2
# INPUT VARIABLES
toggle_3 = BooleanToggle(True)
# Start Screenshot Recorder
toggle_4 = BooleanToggle(True)
# Start Data Recorder
toggle_5 = BooleanToggle(True)
# SET INITIAL VALUES
# Truss Span
# y_0 (Initial)
number_slider_2 = Slider(4, range=0..10)
# dy_4
number_slider_3 = Slider(0, range=-1..1)
# OPTION 2.
# dy_4
number_slider_4 = Slider(0.35, range=-2..2)
# dx_0
# dy_0
number_slider_5 = Slider(0.2, range=-1..1)
# dx_0
number_slider_6 = Slider(0, range=-1..1)
# dy_0
number_slider_7 = Slider(0, range=-2..2)
# OPTION 1. PARAMETER AUTO-GENERATION & ANIMATION
int = Integer(Slider(4, range=0..10))
data_5 = Data(toggle_3)
data_6 = Data(toggle_4)
data_7 = Data(toggle_5)
item = ListItem(List=panel, Index=0, Wrap=True)  # -> Item, Item1, Item2, Item3, Item4, Item5, Item6, Item7, Item8, Item9

# ----
# make sure slider max value set to number of data points N_data - 1
# ANIMATE THIS!
number_slider_8 = Slider(0, range=0..124)
# MANUAL EXPLORATION
int_2 = Integer(number_slider_8)

num = Number("-2")
num_2 = Number("2")
int_3 = Integer(int)
num_3 = Number("-1")
num_4 = Number("-2")
num_5 = Number("3")
int_4 = Integer(int)
num_6 = Number("1")
int_5 = Integer(int)
G = Gate(data)
dom = ConstructDomain(DomainStart=num, DomainEnd=num_2)
dom_2 = ConstructDomain(DomainStart=num_4, DomainEnd=num_5)
dom_3 = ConstructDomain(DomainStart=num_3, DomainEnd=num_6)
num_7 = Number(num_y)
G_2 = Gate(data)
num_8 = Number(item.Item2)
G_3 = Gate(data)
num_9 = Number(item.Item1)
num_10 = Number(d2)
num_11 = Number(number_slider_7)
num_12 = Number(d1)
G_4 = Gate(data)
num_13 = Number(number_slider_3)
G_5 = Gate(data)
num_14 = Number(Slider(1.3, range=0..10))
num_15 = Number(item.Item4)
G_6 = Gate(data)
num_16 = Number(item.Item5)
num_17 = Number(Slider(0.287, range=0..1))
G_7 = Gate(data)
num_18 = Number(number_slider_6)
num_19 = Number(Slider(0.425, range=0..1))
num_20 = Number(item.Item6)
num_21 = Number(Slider(0.608, range=0..1))
G_8 = Gate(data)
num_22 = Number(Slider(1, range=-2..2))
num_23 = Number(item.Item8)
num_24 = Number(number_slider_2)
G_9 = Gate(data)
num_25 = Number(Slider(0.708, range=0..1))
num_26 = Number(item.Item7)
num_27 = Number(Slider(0.399, range=0..1))
G_10 = Gate(data)
num_28 = Number(item.Item9)
num_29 = Number(Slider(0.532, range=0..1))
range = Range(Domain=dom_2, Steps=int_4)
filter = StreamFilter(Gate=G_2, Stream0=num_10, Stream1=num_8)
filter_2 = StreamFilter(Gate=G_3, Stream0=num_12, Stream1=num_9)
multiplication = Multiplication(A=item.Item3, B="10")
num_30 = Number(multiplication)
range_2 = Range(Domain=dom, Steps=int_3)
filter_3 = StreamFilter(Gate=G_4, Stream0=num_14, Stream1=num_30)
range_3 = Range(Domain=dom_3, Steps=int_5)
filter_4 = StreamFilter(Gate=G_5, Stream0=num_17, Stream1=num_15)
filter_5 = StreamFilter(Gate=G_6, Stream0=num_19, Stream1=num_16)
filter_6 = StreamFilter(Gate=G_7, Stream0=num_21, Stream1=num_20)
multiplication_2 = Multiplication(A=item.Item, B="13")
# Reset Recording
reset_2 = Button()
filter_7 = StreamFilter(Gate=G_8, Stream0=num_25, Stream1=num_23)
filter_8 = StreamFilter(Gate=G_9, Stream0=num_27, Stream1=num_26)
filter_9 = StreamFilter(Gate=G_10, Stream0=num_29, Stream1=num_28)
num_31 = Number(number_slider_5)
num_32 = Number(Slider(1.38, range=-2..3))
# OPTIMISATION-DRIVEN EXPLORATION
num_33 = Number(number_slider_4)
neg = Negative(Value=num_22)
round = Round(Number=multiplication_2)  # -> Nearest, Floor, Ceiling
dy_0 = Panel(range)
data_8 = Data(reset_2)
dx_0 = Panel(range_3)
dy_4 = Panel(range_2)
addition = Addition(A=round.Floor, B="2")
num_34 = Number(addition)
filter_10 = StreamFilter(Gate=G, Stream0=num_7, Stream1=num_34)
integer = Integer(filter_10)
crossref = CrossReference(ListA=dy_4, ListB=dx_0, ListC=dy_0, CrossMode=1)  # -> ListA, ListB, ListC
int_6 = Integer(int_2)
panel_2 = Panel(integer)
galapagos = Galapagos()
int_7 = Integer(int_6)
L = List(crossref.ListB)
int_8 = Integer(int_6)
L_2 = List(crossref.ListC)
int_9 = Integer(int_6)
L_3 = List(crossref.ListA)
lng = ListLength(List=L_3)
num_35 = Number(num_31)
G_11 = Gate(data_5)
num_36 = Number(lng)
n_data = Panel(num_36)
item_2 = ListItem(List=L, Index=int_7, Wrap=True)
item_3 = ListItem(List=L_2, Index=int_8, Wrap=True)
item_4 = ListItem(List=L_3, Index=int_9, Wrap=True)
merge = Merge(
    Data1=filter_10,
    Data2=filter_2,
    Data3=filter,
    Data4=filter_3,
    Data5=filter_4,
    Data6=filter_5,
    Data7=filter_6,
    Data8=filter_8,
    Data9=filter_7,
    Data10=filter_9)
num_37 = Number(item_3)
num_38 = Number(item_2)
num_39 = Number(item_4)
num_40 = Number(num_31)
num_41 = Number(num_18)
G_12 = Gate(data_5)
G_13 = Gate(data_5)
num_42 = Number(num_11)
num_43 = Number(num_32)
num_44 = Number(num_33)
num_45 = Number(num_13)
# ROUTE DATA BY OPTION
G_14 = Gate(data_5)
dx_0_2 = Panel(num_38)
dy_1 = Panel(num_37)
dy_4_2 = Panel(num_39)
num_46 = Number(merge)
crv = Curve(<curve referenced from the Rhino model>)
data_9 = Data(Slider(2, range=0..10))
scale = Scale(Geometry=crv, Center=Point(0, 0, 0), Factor=Slider(1, range=0..1))  # -> Geometry, Transform
num_47 = Number(flatten(dy_1))
num_48 = Number(num_47)
filter_11 = StreamFilter(Gate=G_12, Stream0=num_43, Stream1=num_48)
num_49 = Number(filter_11)
num_50 = Number(flatten(dx_0_2))
num_51 = Number(num_50)
filter_12 = StreamFilter(Gate=G_11, Stream0=num_35, Stream1=num_51)
num_52 = Number(num_50)
filter_13 = StreamFilter(Gate=G_13, Stream0=num_40, Stream1=num_52)
num_53 = Number(filter_13)
num_54 = Number(flatten(dy_4_2))
num_55 = Number(num_54)
filter_14 = StreamFilter(Gate=G_14, Stream0=num_44, Stream1=num_55)
num_56 = Number(filter_14)
addition_2 = Addition(A=num_53, B=num_41)
addition_3 = Addition(A=num_49, B=num_42)
addition_4 = Addition(A=num_56, B=num_45)
srf = Surface(reparameterize(scale.Geometry))
data_10 = Data(data_9)
_0 = Stream0(addition_2)
_0_2 = Stream0(addition_4)
_0_3 = Stream0(addition_3)
_0_4 = Stream0(neg)
sdivide = DivideSurface(Surface=srf, UCount=data_10, VCount=data_10)  # -> Points, Normals, simplify(Parameters)
data_11 = Data(filter_3)
evalsrf = EvaluateSurface(Surface=srf, Point=sdivide.Parameters)  # -> Point, Normal, Frame
Z = UnitZ(Factor=data_11)
pt = Point(evalsrf.Point)
data_12 = Data(Z)
data_13 = Data(filter_2)

# ----
# Grid shape
# true = rectangular, false = square
pattern_type_toggle = BooleanToggle(False)

data_14 = Data(filter)
num_y_2 = Integer(panel_2)
num_57 = Number(num_49)  # disabled
num_58 = Number(num_53)  # disabled
num_59 = Number(num_56)  # disabled
num_60 = Number(_0)  # disabled
num_61 = Number(_0_3)  # disabled
num_62 = Number(_0_2)  # disabled
num_63 = Number(num_24)  # disabled
num_64 = Number(_0_4)  # disabled
merge_2 = Merge(Data1=num_59, Data2=num_58, Data3=num_57)  # disabled
num_65 = Number(merge_2)  # disabled
num_66 = Number(num_63)  # disabled
num_67 = Number(num_63)  # disabled

pt_2 = Point(flatten(pt))
data_15 = Data(data_10)
data_16 = Data(data_12)
panel_3 = Panel("""0
2
6
8""")
panel_4 = Panel("""1
3
5
7""")
data_17 = Data(filter_4)
data_18 = Data(filter_5)
data_19 = Data(filter_6)
item_5 = ListItem(List=pt_2, Index=panel_3, Wrap=True)
item_6 = ListItem(List=pt_2, Index=panel_4, Wrap=True)
item_7 = ListItem(List=pt_2, Index="4", Wrap=True)
pt_3 = Point(item_7)
pt_4 = Point(item_5)
pt_5 = Point(item_6)
multiplication_3 = Multiplication(A=data_16, B=data_17)
multiplication_4 = Multiplication(A=data_16, B=data_18)
multiplication_5 = Multiplication(A=data_16, B=data_19)
data_20 = Data(multiplication_3)
data_21 = Data(multiplication_4)
data_22 = Data(multiplication_5)
move = Move(Geometry=pt_4, Motion=data_20)  # -> Geometry, Transform
move_2 = Move(Geometry=pt_5, Motion=data_21)  # -> Geometry, Transform
move_3 = Move(Geometry=pt_3, Motion=data_22)  # -> Geometry, Transform
merge_3 = Merge(Data1=panel_3, Data2=panel_4, Data3="4")
merge_4 = Merge(Data1=move.Geometry, Data2=move_2.Geometry, Data3=move_3.Geometry)
data_23 = Data(merge_3)
pt_6 = Point(pt_2)
pt_7 = Point(merge_4)
pt_8 = Point(pt_7)
replace = ReplaceItems(List=pt_6, Item=pt_8, Indices=data_23, Wrap=False)
pt_9 = Point(replace)
pt_10 = Point(pt_9)
srfgrid = SurfaceFromPoints(Points=pt_10, UCount=expr("x+1", data_15), Interpolate=False)
srf_2 = Surface(srfgrid)

pt_11 = Point(flatten(pt))
data_24 = Data(data_10)
panel_5 = Panel("""0
2
6
8""")
panel_6 = Panel("""1
3
5
7""")
data_25 = Data(data_12)
data_26 = Data(filter_9)
data_27 = Data(filter_8)
item_8 = ListItem(List=pt_11, Index=panel_5, Wrap=True)
item_9 = ListItem(List=pt_11, Index=panel_6, Wrap=True)
data_28 = Data(filter_7)
item_10 = ListItem(List=pt_11, Index="4", Wrap=True)
pt_12 = Point(item_10)
pt_13 = Point(item_8)
pt_14 = Point(item_9)
multiplication_6 = Multiplication(A=data_25, B=data_27)
multiplication_7 = Multiplication(A=data_25, B=data_28)
multiplication_8 = Multiplication(A=data_25, B=data_26)
data_29 = Data(multiplication_6)
data_30 = Data(multiplication_7)
data_31 = Data(multiplication_8)
move_4 = Move(Geometry=pt_13, Motion=data_29)  # -> Geometry, Transform
move_5 = Move(Geometry=pt_14, Motion=data_30)  # -> Geometry, Transform
merge_5 = Merge(Data1=panel_5, Data2=panel_6, Data3="4")
move_6 = Move(Geometry=pt_12, Motion=data_31)  # -> Geometry, Transform
merge_6 = Merge(Data1=move_4.Geometry, Data2=move_5.Geometry, Data3=move_6.Geometry)
data_32 = Data(merge_5)
pt_15 = Point(pt_11)
pt_16 = Point(merge_6)
pt_17 = Point(pt_16)
replace_2 = ReplaceItems(List=pt_15, Item=pt_17, Indices=data_32, Wrap=False)
pt_18 = Point(replace_2)
pt_19 = Point(pt_18)
srfgrid_2 = SurfaceFromPoints(Points=pt_19, UCount=expr("x+1", data_24), Interpolate=False)
srf_3 = Surface(srfgrid_2)

panel_7 = Panel("2")  # disabled
panel_8 = Panel("4")  # disabled
division = Division(A=num_66, B=panel_7)  # disabled
division_2 = Division(A=num_67, B=panel_8)  # disabled
boolean = Boolean(pattern_type_toggle)
num_68 = Number(division)  # disabled
num_69 = Number(division_2)  # disabled
num_y_3 = Integer(num_y_2)
num_70 = Number(num_60)  # disabled
num_71 = Number(num_69)  # disabled
num_72 = Number(num_63)  # disabled
subtraction = Subtraction(A=num_72, B=num_71)  # disabled
num_73 = Number(subtraction)  # disabled
num_74 = Number(num_61)  # disabled
num_75 = Number(num_61)  # disabled
num_76 = Number(num_64)  # disabled
num_77 = Number(num_64)  # disabled
num_78 = Number(num_60)  # disabled
# PIPELINE
# BUILD TRUSS
num_79 = Number(num_69)  # disabled
addition_5 = Addition(A=num_76, B=num_74)  # disabled
addition_6 = Addition(A=num_77, B=num_75)  # disabled
subtraction_2 = Subtraction(A=num_73, B=num_70)  # disabled
addition_7 = Addition(A=num_79, B=num_78)  # disabled
num_80 = Number(num_62)  # disabled
num_81 = Number(num_68)  # disabled
num_82 = Number(addition_5)  # disabled
num_83 = Number(addition_6)  # disabled
num_84 = Number(addition_7)  # disabled
panel_9 = Panel("0")  # disabled
panel_10 = Panel("0")  # disabled
panel_11 = Panel("0")  # disabled
panel_12 = Panel(num_80)  # disabled
num_85 = Number(num_63)  # disabled
pt_20 = ConstructPoint(XCoordinate=panel_9, YCoordinate=panel_9, ZCoordinate=panel_9)  # disabled
pt_21 = ConstructPoint(XCoordinate=num_85, YCoordinate=panel_9, ZCoordinate=panel_9)  # disabled
pt_22 = ConstructPoint(XCoordinate=num_81, YCoordinate=panel_12, ZCoordinate=panel_9)  # disabled
pt_23 = ConstructPoint(XCoordinate=subtraction_2, YCoordinate=num_83, ZCoordinate=panel_11)  # disabled
pt_24 = ConstructPoint(XCoordinate=num_84, YCoordinate=num_82, ZCoordinate=panel_10)  # disabled
pt_25 = Point(pt_20)  # disabled
pt_26 = Point(pt_21)  # disabled
pt_27 = Point(pt_22)  # disabled
pt_28 = Point(pt_24)  # disabled
pt_29 = Point(pt_23)  # disabled
pt_30 = Point(pt_25)  # disabled
pt_31 = Point(pt_26)  # disabled
pt_32 = Point(pt_28)  # disabled
pt_33 = Point(pt_27)  # disabled
pt_34 = Point(pt_29)  # disabled
srf_4 = Surface(srf_3)
srf_5 = Surface(srf_2)
merge_7 = Merge(Data1=pt_32, Data2=pt_34, Data3=pt_30, Data4=pt_31, Data5=pt_33)  # disabled
ln = Line(StartPoint=pt_30, EndPoint=pt_32)  # disabled
pt_35 = Point(merge_7)  # disabled
number_slider_9 = Slider(0.5, range=0..10)  # disabled
crv_2 = Curve(ln)  # disabled
ln_2 = Line(StartPoint=pt_30, EndPoint=pt_33)  # disabled
points = PointList(Points=pt_35, Size=number_slider_9)  # disabled
ln_3 = Line(StartPoint=pt_32, EndPoint=pt_33)  # disabled
crv_3 = Curve(ln_2)  # disabled
ln_4 = Line(StartPoint=pt_32, EndPoint=pt_34)  # disabled
crv_4 = Curve(ln_3)  # disabled
ln_5 = Line(StartPoint=pt_34, EndPoint=pt_33)  # disabled
ln_6 = Line(StartPoint=pt_33, EndPoint=pt_31)  # disabled
crv_5 = Curve(ln_5)  # disabled
ln_7 = Line(StartPoint=pt_31, EndPoint=pt_34)  # disabled
crv_6 = Curve(ln_4)  # disabled
crv_7 = Curve(ln_6)  # disabled
crv_8 = Curve(ln_7)  # disabled
srf_6 = Surface(srf_5)
srf_7 = Surface(srf_4)
number_slider_10 = Slider(100, range=0..100)  # disabled
merge_8 = Merge(Data1=pt_30, Data2=pt_31, Data3=pt_32, Data4=pt_34, Data5=pt_33)  # disabled
merge_9 = Merge(Data1=crv_2, Data2=crv_8, Data3=crv_6, Data4=crv_3, Data5=crv_7, Data6=crv_4, Data7=crv_5)  # disabled
merge_10 = Merge(Data1=pt_30, Data2=pt_31)  # disabled
num_86 = Number(number_slider_10)  # disabled
pt_36 = Point(merge_8)  # disabled
pt_37 = Point(merge_10)  # disabled
crv_9 = Curve(merge_9)  # disabled
neg_2 = Negative(Value=num_86)  # disabled
Y = UnitY(Factor=neg_2)  # disabled
force = ForceVector(Y)  # disabled
pt_38 = Point(pt_33)  # disabled
pt_39 = Point(pt_37)  # disabled
pt_40 = Point(pt_36)  # disabled
crv_10 = Curve(crv_9)  # disabled
loads = LoadsKaramba3D(ForceVector=force, Local=False, PosInd=pt_38, LCase="LC0", mode="Point")  # disabled
lineelem = CreateLinearElementKaramba3D(
    Line=crv_10,
    LimitDistance_m=0.005,
    BucklingLengthY_m=-1,
    BucklingLengthZ_m=-1,
    BucklingLengthLT_m=-1,
    Bending=True,
    ToPolylineMaxAngle=0.03,
    ToPolylineTolerance=0.01,
    ToPolylineMaxEdgeLength=0.25,
    New=True,
    Remove=True,
    mode="LineToBeam")  # -> Element, Points, Info; disabled
supp = SupportKaramba3D(PosInd=pt_40, menu=[buttons(off, off, on, off, off, off)])  # disabled
supp_2 = SupportKaramba3D(PosInd=pt_39, menu=[buttons(on, on, off, off, off, off)])  # disabled
elem = Elem(lineelem.Element)  # disabled
load = LoadKaramba3D(loads)  # disabled
support = Support(supp)  # disabled
support_2 = Support(supp_2)  # disabled
merge_11 = Merge(Data1=support_2, Data2=support)  # disabled
support_3 = Support(merge_11)  # disabled
elem_2 = Elem(elem)  # disabled
load_2 = LoadKaramba3D(load)  # disabled
support_4 = Support(support_3)  # disabled
# EVALUATION
# STRUCTURAL ANALYSIS
assemble = AssembleModelKaramba3D(Elem=elem_2, Support=support_4, Load=load_2, LimitDistance_m=0.005)  # -> Model, Info, Mass_kg, CentreOfGravity, LoadCaseNames; disabled
model = Model(assemble.Model)  # disabled
analyse = AnalyseKaramba3D(Model=model)  # -> AnalysedModel, MaximumDisplacement_cm, ResultingForce_kN, ChangeOfElasticEnergy_kNm; disabled
model_2 = Model(analyse.AnalysedModel)  # disabled
b_forces = BeamForcesKaramba3D(AnalysedModel=model_2, Ts=[0, 1])  # -> Model, NormalForce_kN, ShearForceVz_kN, ShearForceVy_kN, TorsionalMomentMt_kNm, flatten(BendingMomentMy_kNm), flatten(BendingMomentMz_kNm), LoadCaseIndex; disabled
num_87 = Number(analyse.MaximumDisplacement_cm)  # disabled
panel_13 = Panel(b_forces.BendingMomentMz_kNm)  # disabled
model_3 = Model(model_2)  # disabled
num_88 = Number(num_87)  # disabled
modelview = ModelViewKaramba3D(Model=model_3)  # -> Model, DeformedMesh, DeformedAxes, DeformedModel, MaximumDeformation; disabled
objectives = Panel(num_88)  # disabled
beamview = BeamViewKaramba3D(Model=modelview.Model)  # -> Model, MeshesOfRenderedBeams, DeformedBeamAxes, LegendColours, LegendTags; disabled
model_4 = ModelKaramba3D(beamview.Model)  # disabled
image_file_name_prefix = Panel("test_save")
csv_file_name = Panel("data_log.csv")
# SAVE DATA
# Path
folder_path = Panel("C:/GHAutoScreenshotTest")
bool = Boolean(data_6)
data_33 = Data(flatten(model_4))
num_89 = Number(num_65)
num_90 = Number(num_88)
data_34 = Data(num_89)
data_35 = Data(num_90)
item_11 = ListItem(List=data_33, Index=0, Wrap=True)
panel_14 = Panel("""y_4
x_0
y_0""")
# Screenshot Saver
data_36 = Data(data_8)
# Create header row of csv spreadsheet,
# containing names of the columns
panel_15 = Panel("image_path")
bool_2 = Boolean(bool)
merge_12 = Merge(Data1=panel_14, Data2="max_disp", Data3=panel_15)
txt = Text(csv_file_name)
txt_2 = Text(image_file_name_prefix)
txt_3 = Text(folder_path)
txt_4 = Text(txt_3)
txt_5 = Text(txt_3)
concat = Concatenate(FragmentA=txt_4, FragmentB="/", FragmentC=txt)
concat_2 = Concatenate(FragmentA=txt_5, FragmentB="/", FragmentC=txt_2)
txt_6 = Text(concat)
txt_7 = Text(concat_2)
txt_8 = Text(txt_7)
c_name_iterator = CSharpScript(port=item_11, T=bool_2, R=data_36, P=txt_8)  # -> out, A; inputs T: Boolean, R: Boolean
# ---------- c_name_iterator: C# ----------
    if(T)
    {
      n++;
    }
    if(R)
    {
      n = 0;
    }
    A = P + "_" + n + ".jpg";
# ---------- c_name_iterator: C# additional code ----------
  public int n;
# ---------- end c_name_iterator ----------
txt_9 = Text(c_name_iterator.A)
# Merge data
# CSV File Streamer
data_37 = Data(txt_9)
merge_13 = Merge(Data1=flatten(data_34), Data2=flatten(data_35), Data3=flatten(data_37))
data_38 = Data(flatten(merge_13))
c_vp_to_img = CSharpScript(T=bool_2, P=txt_9)  # inputs T: Boolean, P: String
# ---------- c_vp_to_img: C# ----------
    if(T)
    {
      var file_name = "";
      if (P != "")
      {
        file_name = P;
        var bitmap = RhinoDoc.ActiveDoc.Views.ActiveView.CaptureToBitmap(false, false, false);
        //Clipboard.SetImage(bitmap);
        bitmap.Save(file_name);
      }
    }
# ---------- end c_vp_to_img ----------
panel_16 = Panel(data_38)
full_saved_image_path = Panel(txt_9)
panel_17 = Panel(txt_6)
txt_10 = Text(txt_6)
bool_3 = Boolean(data_7)
data_39 = Data(data_8)
txt_11 = Text(merge_12)
data_40 = Data(data_38)
ghpython_script = GhPythonScript(filepath=txt_10, head=txt_11, data=data_40, write=bool_3, reset=data_39)  # -> out, a; inputs head: list, data: list
# ---------- ghpython_script: Python ----------
__author__ = "tamk"
__version__ = "2024.04.04"

import rhinoscriptsyntax as rs
from scriptcontext import sticky
import os
import sys


if reset:
    _ = sticky.pop('filestream', {})
    
fs = sticky.setdefault('filestream', None)

if not fs and filepath and write:
    fs = sticky['filestream'] = open(filepath, 'w')
    if head:
        fs.write(','.join(str(_h) for _h in head) + '\n')
    
if fs and write:
    fs.write(','.join(str(_x) for _x in data) + '\n')
    fs.flush()

if fs and not write:
    fs.close()
    fs = sticky['filestream'] = None
# ---------- end ghpython_script ----------
crv_11 = Curve(<curve referenced from the Rhino model>)
number_slider_11 = Slider(0.006, range=0..0.01)
Z_2 = UnitZ(Factor=Slider(0.3, range=0..1))
rev = Reverse(Vector=Z_2)
loads_2 = LoadsKaramba3D(Vector=Vector(0, 0, -1), LCase="LC0", mode="Gravity")
panel_18 = Panel("""1
2
3
4
5
6
7
8
9
10""")
num_91 = Number(num_46)
image_file_name_prefix_2 = Panel("test_save")
csv_file_name_2 = Panel("data_log.csv")
bool_4 = Boolean(data_2)
# Path
folder_path_2 = Panel("D:\Dropbox\HKU_202425S1_ARCH7378\Scripts\B_Helpers\New folder")
# Create header row of csv spreadsheet,
# containing names of the columns
panel_19 = Panel("image_path")
data_41 = Data(data_4)
data_42 = Data(num_91)
bool_5 = Boolean(bool_4)
merge_14 = Merge(Data1=panel_18, Data2="max_disp", Data3=panel_19)
txt_12 = Text(folder_path_2)
txt_13 = Text(txt_12)
txt_14 = Text(image_file_name_prefix_2)
txt_15 = Text(txt_12)
txt_16 = Text(csv_file_name_2)
concat_3 = Concatenate(FragmentA=txt_15, FragmentB="/", FragmentC=txt_16)
concat_4 = Concatenate(FragmentA=txt_13, FragmentB="/", FragmentC=txt_14)
txt_17 = Text(concat_3)
txt_18 = Text(txt_17)
txt_19 = Text(merge_14)
bool_6 = Boolean(data_3)
data_43 = Data(data_4)
txt_20 = Text(concat_4)
# Screenshot Saver
txt_21 = Text(txt_20)
panel_20 = Panel(txt_17)

# ----
# File reader
panel_21 = Panel(csv_file_name_2)
python_3_script = Python3Script(filename=panel_21)  # -> out, filepath
# ---------- python_3_script: Python ----------
import os

_filepath = ghenv.Component.OnPingDocument().FilePath
path = os.path.dirname(_filepath)

filepath = os.path.join(path, filename)
# ---------- end python_3_script ----------
panel_22 = Panel(python_3_script.filepath)
file_path = FilePath(panel_22)
read_file = ReadFile(File=file_path, PerLineParse=True)
cull_index = CullIndex(List=read_file, Indices="0", Wrap=True)
text_split = TextSplit(Text=cull_index, Separators=",")  # -> simplify(Result)
number = Number(text_split)
panel_23 = Panel(number)

# ----
# Offset parameter domain mapping
# offset value selection
# final value
# Square: d1 mapping
# Square: d2 mapping
# 3-bay rectangle: d1 mapping
# 3-bay rectangle: d2 mapping
panel_24 = Panel("3.5184")
division_3 = Division(A=panel_24, B=num_y_3)
division_4 = Division(A="2.1155", B=num_y_3)
division_5 = Division(A="1.9238", B=num_y_3)
division_6 = Division(A="1.2086", B=num_y_3)
construct_domain = ConstructDomain(DomainStart="0", DomainEnd=division_5)
construct_domain_2 = ConstructDomain(DomainStart="0", DomainEnd=division_6)
construct_domain_3 = ConstructDomain(DomainStart="0", DomainEnd=division_3)
construct_domain_4 = ConstructDomain(DomainStart="0", DomainEnd=division_4)
remap_numbers = RemapNumbers(Value=data_13, Source=Domain(0, 1), Target=construct_domain_3)  # -> Mapped, Clipped
remap_numbers_2 = RemapNumbers(Value=data_14, Source=Domain(0, 1), Target=construct_domain_4)  # -> Mapped, Clipped
remap_numbers_3 = RemapNumbers(Value=data_13, Source=Domain(0, 1), Target=construct_domain)  # -> Mapped, Clipped
remap_numbers_4 = RemapNumbers(Value=data_14, Source=Domain(0, 1), Target=construct_domain_2)  # -> Mapped, Clipped
d1_square = Panel(remap_numbers.Mapped)
d2_square = Panel(remap_numbers_2.Mapped)
d1_rectangle = Panel(remap_numbers_3.Mapped)
d2_rectangle = Panel(remap_numbers_4.Mapped)
d2_2 = Number([d2_square, d2_rectangle])
d1_2 = Number([d1_square, d1_rectangle])

construct_domain_5 = ConstructDomain(DomainStart="0", DomainEnd=division_4)
construct_domain_6 = ConstructDomain(DomainStart="0", DomainEnd=division_3)

# ----
# Grid shape selection
# Square configuration (false)
# 3-bay rectangular configuration (true)
num_x_3_num_y = Panel("3")
num_x = Panel(num_y_2)
expression = Expression(x=boolean, y=boolean, Expression="if(x = true, 1, 0)")
multiplication_9 = Multiplication(A=num_x_3_num_y, B=num_y_2)

num_x_2 = Integer([num_x, multiplication_9])

list_item = ListItem(List=num_x_2, Index=expression, Wrap=True)
integer_2 = Integer(list_item)

list_item_2 = ListItem(List=d1_2, Index=expression, Wrap=True)
list_item_3 = ListItem(List=d2_2, Index=expression, Wrap=True)
d1_3 = Number(list_item_2)
d2_3 = Number(list_item_3)

# ----
# Area normalisation
const_area = Panel("100")
multiplication_10 = Multiplication(A=integer_2, B=num_y_3)
division_7 = Division(A=const_area, B=multiplication_10)
square_root = SquareRoot(Value=division_7)

sqgrid = Square(Plane=PlaneXY(0, 0, 0), Size=square_root, ExtentX=list_item, ExtentY=num_y_3)  # -> Cells, Points
divide = DivideCurve(Curve=sqgrid.Cells, Count=12, Kinks=False)  # -> Points, Tangents, Parameters
item_12 = ListItem(List=divide.Points, Index=[1, 2, 4, 5, 7, 8, 10, 11], Wrap=False)
item_13 = ListItem(List=divide.Points, Index=[4, 7, 10, 1], Wrap=False)
item_14 = ListItem(List=divide.Points, Index=[2, 5, 8, 11], Wrap=False)
pline = PolyLine(Vertices=item_12, Closed=True)  # -> simplify(Polyline)
ln_8 = Line(StartPoint=item_14, EndPoint=item_13)
join = JoinCurves(Curves=flatten(ln_8), Preserve=False)  # -> flatten(Curves)
explode = Explode(Curve=pline, Recursive=True)  # -> Segments, Vertices
cls = Closed(Curve=join)  # -> Closed, Periodic
crv_12 = Curve(pline)
cull = CullPattern(List=join, CullPattern=cls.Closed)
explode_2 = Explode(Curve=cull, Recursive=True)  # -> Segments, Vertices
eval = EvaluateCurve(Curve=reparameterize(explode.Segments), Parameter=0.5)  # -> simplify(Point), Tangent, Angle

crv_13 = Curve(simplify(graft(cull)))
crv_14 = Curve(simplify(crv_12))
crv_15 = Curve(simplify(graft(pline)))
explode_3 = Explode(Curve=crv_15, Recursive=True)  # -> simplify(Segments), simplify(Vertices)
curvepoint = PointOnCurve(explode_3.Segments, parameter=0.5)
weave = Weave(Pattern=[0, 1], Stream0=explode_3.Vertices, Stream1=curvepoint, NullGaps=False)
pline_2 = PolyLine(Vertices=weave, Closed=False)
crv_16 = Curve(pline_2)

crv_17 = Curve(flatten(crv_16))
explode_4 = Explode(Curve=crv_17, Recursive=True)  # -> Segments, Vertices
pt_41 = Point(flatten(explode_4.Vertices))
crv_18 = Curve(flatten(explode_4.Segments))

crv_19 = Curve(crv_14)

pt_42 = Point(flatten(pt_41))
crv_20 = Curve(flatten(crv_18))
hull = ConvexHull(Points=pt_42, Plane=PlaneXY(0, 0, 0))  # -> Hull, HullZ, Indices
crv_21 = Curve(reparameterize(hull.Hull))

crv_22 = Curve(crv_21)
crv_cp = CurveClosestPoint(Point=pt_42, Curve=crv_22)  # -> Point, Parameter, Distance
data_44 = Data(crv_cp.Distance)
pt_43 = Point(crv_cp.Point)
data_45 = Data(crv_cp.Parameter)
smaller = SmallerThan(FirstNumber=data_44, SecondNumber="0.001")  # -> SmallerThan, OrEqualTo
dispatch = Dispatch(List=pt_43, DispatchPattern=smaller.SmallerThan)  # -> ListA, ListB
dispatch_2 = Dispatch(List=data_45, DispatchPattern=smaller.SmallerThan)  # -> ListA, ListB
pt_44 = Point(dispatch.ListA)
data_46 = Data(dispatch_2.ListA)

crv_23 = Curve(crv_18)
curvepoint_2 = PointOnCurve(crv_23, parameter=0.5)
crv_cp_2 = CurveClosestPoint(Point=curvepoint_2, Curve=crv_21)  # -> Point, Parameter, Distance

data_47 = Data(crv_23)
data_48 = Data(crv_cp_2.Distance)
smaller_2 = SmallerThan(FirstNumber=data_48, SecondNumber="0.001")  # -> SmallerThan, OrEqualTo
dispatch_3 = Dispatch(List=data_47, DispatchPattern=smaller_2.SmallerThan)  # -> ListA, ListB
data_49 = Data(dispatch_3.ListB)

crv_24 = Curve(crv_21)
shatter = Shatter(Curve=crv_24, Parameters=data_46)
crv_25 = Curve(shatter)

crv_26 = Curve(crv_25)
pt_45 = Point(pt_44)
crv_27 = Curve(crv_25)
crv_28 = Curve(crv_27)
crv_29 = Curve(crv_28)
join_2 = JoinCurves(Curves=crv_29, Preserve=False)
simplify = SimplifyCurve(Curve=join_2)  # -> Curve, Simplified
explode_5 = Explode(Curve=simplify.Curve, Recursive=True)  # -> Segments, Vertices
crv_30 = Curve(flatten(simplify.Curve))
crv_31 = Curve(flatten(explode_5.Segments))
pt_46 = Point(flatten(explode_5.Vertices))
crv_32 = Curve(crv_30)
crv_33 = Curve(crv_32)

crv_34 = Curve(crv_14)
area = Area(Geometry=crv_34)  # -> Area, Centroid
data_50 = Data("100")
Z_3 = UnitZ(Factor=data_50)
pt_47 = Point(area.Centroid)
move_7 = Move(Geometry=pt_47, Motion=Z_3)  # -> Geometry, Transform
pt_48 = Point(move_7.Geometry)
geo = Geometry(srf_7)
project = ProjectPoint(Point=pt_48, Direction=Vector(0, 0, -1), Geometry=geo)  # -> Point, Index
pt_49 = Point(project.Point)
pdecon = Deconstruct(Point=pt_49)  # -> XComponent, YComponent, ZComponent
data_51 = Data(pdecon.ZComponent)

data_52 = Data(data_51)
min = Minimum(A=data_52, B="1")
data_53 = Data(min)

data_54 = Data(data_53)

remap_numbers_5 = RemapNumbers(Value=data_54, Source=Domain(0, 1), Target=construct_domain_6)  # -> Mapped, Clipped
data_55 = Data(remap_numbers_5.Mapped)

crv_35 = Curve(crv_13)
area_2 = Area(Geometry=crv_35)  # -> Area, Centroid
data_56 = Data("100")
Z_4 = UnitZ(Factor=data_56)
pt_50 = Point(area_2.Centroid)
move_8 = Move(Geometry=pt_50, Motion=Z_4)  # -> Geometry, Transform
pt_51 = Point(move_8.Geometry)
geo_2 = Geometry(srf_6)
project_2 = ProjectPoint(Point=pt_51, Direction=Vector(0, 0, -1), Geometry=geo_2)  # -> Point, Index
pt_52 = Point(project_2.Point)
pdecon_2 = Deconstruct(Point=pt_52)  # -> XComponent, YComponent, ZComponent
data_57 = Data(pdecon_2.ZComponent)

data_58 = Data(data_57)
min_2 = Minimum(A=data_58, B="1")
data_59 = Data(min_2)

data_60 = Data(data_59)

remap_numbers_6 = RemapNumbers(Value=data_60, Source=Domain(0, 1), Target=construct_domain_5)  # -> Mapped, Clipped
data_61 = Data(remap_numbers_6.Mapped)

crv_36 = Curve(crv_13)
crv_37 = Curve(crv_19)
data_62 = Data(data_55)
data_63 = Data(data_61)
crv_38 = Curve(crv_36)
offset = Offset(Curve=crv_37, Distance=expr("-x", data_62), Plane=PlaneXY(0, 0, 0), Corners=1)
offset_2 = Offset(Curve=simplify(crv_38), Distance=simplify(data_63), Plane=PlaneXY(0, 0, 0), Corners=1)  # -> simplify(Curve)
eval_2 = EvaluateCurve(Curve=reparameterize(explode_2.Segments), Parameter=0.5)  # -> simplify(Point), Tangent, Angle
explode_6 = Explode(Curve=offset, Recursive=True)  # -> Segments, simplify(Vertices)
explode_7 = Explode(Curve=offset_2, Recursive=True)  # -> Segments, simplify(Vertices)
weave_2 = Weave(Pattern=[0, 1], Stream0=explode_6.Vertices, Stream1=eval.Point, NullGaps=False)
weave_3 = Weave(Pattern=[0, 1], Stream0=explode_7.Vertices, Stream1=eval_2.Point, NullGaps=False)
rdpoints = RemoveDuplicatePointsKaramba3D(Point=explode_7.Vertices, LimitDistance=0.005)  # -> OutPoint, Info, Indexes
rdpoints_2 = RemoveDuplicatePointsKaramba3D(Point=weave_3, LimitDistance=0.005)  # -> OutPoint, Info, Indexes
rdpoints_3 = RemoveDuplicatePointsKaramba3D(Point=explode_6.Vertices, LimitDistance=0.005)  # -> OutPoint, Info, Indexes
rdpoints_4 = RemoveDuplicatePointsKaramba3D(Point=weave_2, LimitDistance=0.005)  # -> OutPoint, Info, Indexes
pline_3 = PolyLine(Vertices=rdpoints_2.OutPoint, Closed=True)
pline_4 = PolyLine(Vertices=rdpoints_4.OutPoint, Closed=True)
polyline = PolyLine(Vertices=rdpoints.OutPoint, Closed=True)
polyline_2 = PolyLine(Vertices=rdpoints_3.OutPoint, Closed=True)
simplify_2 = SimplifyCurve(Curve=polyline)  # -> Curve, Simplified
simplify_3 = SimplifyCurve(Curve=pline_3)  # -> Curve, Simplified
simplify_4 = SimplifyCurve(Curve=pline_4)  # -> Curve, Simplified
simplify_5 = SimplifyCurve(Curve=polyline_2)  # -> Curve, Simplified
crv_39 = Curve([simplify_5.Curve, simplify_4.Curve, simplify_3.Curve, simplify_2.Curve])
explode_8 = Explode(Curve=crv_39, Recursive=True)  # -> Segments, Vertices

crv_40 = Curve(flatten(explode_8.Segments))

crv_41 = Curve(data_49)
crv_42 = Curve(crv_40)
merge_15 = Merge(Data1=crv_26, Data2=crv_41, Data3=crv_42)  # -> flatten(Result)
rdlines = RemoveDuplicateLinesKaramba3D(Line=merge_15, LimitDistance=0.005)  # -> OutLine, Info, Indexes
crv_43 = Curve(rdlines.OutLine)

crv_44 = Curve(data_49)
crv_45 = Curve(crv_40)
merge_16 = Merge(Data2=crv_44, Data3=crv_45)  # -> flatten(Result)
rdlines_2 = RemoveDuplicateLinesKaramba3D(Line=merge_16, LimitDistance=0.005)  # -> OutLine, Info, Indexes
crv_46 = Curve(rdlines_2.OutLine)

crv_47 = Curve(crv_46)
crv_48 = Curve(crv_47)
end = EndPoints(Curve=crv_48)  # -> flatten(Start), flatten(End)
cset = CreateSet(List=flatten([end.Start, end.End]))  # -> Set, Map
pt_53 = Point(cset.Set)
pt_54 = Point(pt_53)
crv_49 = Curve(crv_48)
crv_50 = Curve(flatten([crv_49, crv_32, crv_11]))
crv_51 = Curve(crv_49)
pt_55 = Point(pt_54)
previewlw = CustomPreviewLineweights(Geometry=crv_50, Shader=ColourSwatch(SwatchColor=RGB(0, 0, 0)), Thickness=Slider(4, range=0..10), Absolute=False)

# ---- group: structural analysis
# STRUCTURAL ANALYSIS
explode_9 = Explode(Curve=crv_33, Recursive=True)  # -> flatten(Segments), Vertices
explode_10 = Explode(Curve=crv_11, Recursive=True)  # -> flatten(Segments), Vertices
llinter = LineLineIntersectionKaramba3D(IntersectingLines=flatten(crv_51), LinesToIntersect=graft(explode_9.Segments), LimitDistance_m=0.005)  # -> InterSecPoints, LineSubSegments
llinter_2 = LineLineIntersectionKaramba3D(IntersectingLines=flatten(crv_51), LinesToIntersect=graft(explode_10.Segments), LimitDistance_m=0.005)  # -> InterSecPoints, LineSubSegments
crv_52 = Curve(flatten(llinter.LineSubSegments))
line = Line(flatten(llinter.LineSubSegments))
null = NullItem(Item=crv_52)  # -> NullFlags, InvalidFlags, Description
end_2 = EndPoints(Curve=crv_52)  # -> Start, End
crv_53 = Curve(flatten(llinter_2.LineSubSegments))
line_2 = Line(flatten(llinter_2.LineSubSegments))
dispatch_4 = Dispatch(List=crv_52, DispatchPattern=null.InvalidFlags)  # -> ListA, ListB
null_2 = NullItem(Item=crv_53)  # -> NullFlags, InvalidFlags, Description
end_3 = EndPoints(Curve=crv_53)  # -> Start, End
dispatch_5 = Dispatch(List=crv_53, DispatchPattern=null_2.InvalidFlags)  # -> ListA, ListB
crv_54 = Curve([dispatch_5.ListB, dispatch_4.ListB])
dupln = RemoveDuplicateLines(Lines=crv_54, Tolerance=0.01)
merge_17 = Merge(Data1=crv_51, Data2=dupln)  # -> flatten(Result)
crv_55 = Curve(merge_17)
material_consumption = Panel("5600")
end_4 = EndPoints(Curve=line_2)  # -> Start, End
len = Length(Curve=crv_55)
division_8 = Division(A=material_consumption, B="7350")
ma = MassAddition(Input=len)  # -> Result, PartialResults
division_9 = Division(A=division_8, B=ma.Result)
panel_25 = Panel("100")

# ----
pt_56 = Point([end_4.End, end_4.Start])
wbweave = WeaverbirdsMeshFromLinesWeaveBack(Lines=crv_55, MaximumValence=Slider(10, range=0..10))
duppt = RemoveDuplicatePts(Points=pt_56, Tolerance=0.01)
expression_2 = Expression(x=division_9, y=number_slider_11, Expression="(x+4*y²)/4/y")
supp_3 = SupportKaramba3D(PosInd=duppt, menu=[buttons(on, on, on, off, off, off)])
loads_3 = LoadsKaramba3D(Vector=rev, Mesh=wbweave, LCase="LC0", mode="MeshLoad -Const.", menu=[buttons(off, on, off), buttons(off, on)])
multiplication_11 = Multiplication(A=number_slider_11, B=panel_25)
load_3 = LoadKaramba3D([loads_3, loads_2])

# ---- group: structural analysis (continued)
multiplication_12 = Multiplication(A=expression_2, B=panel_25)
num_92 = Number(multiplication_12)
support_5 = Support(supp_3)
crosec = CrossSectionKaramba3D(
    FamilyNameOfCrossSection="DefaultCroSec",
    Height_cm=num_92,
    UpperFlangeWidth_cm=num_92,
    LowerFlangeWidth_cm=num_92,
    UpperFlangeThickness_cm=multiplication_11,
    LowerFlangeThickness_cm=multiplication_11,
    SidewallsThickness_cm=multiplication_11,
    FilletRadius_cm=0.6,
    mode="Box")
lineelem_2 = CreateLinearElementKaramba3D(
    Line=crv_55,
    CrossSection=crosec,
    LimitDistance_m=0.005,
    BucklingLengthY_m=-1,
    BucklingLengthZ_m=-1,
    BucklingLengthLT_m=-1,
    Bending=True,
    ToPolylineMaxAngle=0.03,
    ToPolylineTolerance=0.01,
    ToPolylineMaxEdgeLength=0.25,
    New=True,
    Remove=True,
    mode="LineToBeam")  # -> Element, Points, Info
elem_3 = Elem(lineelem_2.Element)
support_6 = Support(flatten(support_5))
elem_4 = Elem(flatten(elem_3))
load_4 = LoadKaramba3D(flatten(load_3))
assemble_2 = AssembleModelKaramba3D(Elem=elem_4, Support=support_6, Load=load_4, LimitDistance_m=0.005)  # -> Model, Info, Mass_kg, CentreOfGravity, LoadCaseNames
model_5 = Model(assemble_2.Model)
analyse_2 = AnalyseKaramba3D(Model=model_5)  # -> AnalysedModel, MaximumDisplacement_cm, ResultingForce_kN, ChangeOfElasticEnergy_kNm
model_6 = Model(analyse_2.AnalysedModel)
num_93 = Number(analyse_2.MaximumDisplacement_cm)
modelview_2 = ModelViewKaramba3D(Model=analyse_2.AnalysedModel)  # -> Model, DeformedMesh, DeformedAxes, DeformedModel, MaximumDeformation
b_forces_2 = BeamForcesKaramba3D(AnalysedModel=model_6, Ts=[0, 1])  # -> Model, NormalForce_kN, ShearForceVz_kN, ShearForceVy_kN, TorsionalMomentMt_kNm, flatten(BendingMomentMy_kNm), flatten(BendingMomentMz_kNm), LoadCaseIndex
beamview_2 = BeamViewKaramba3D(Model=modelview_2.Model)  # -> Model, MeshesOfRenderedBeams, DeformedBeamAxes, LegendColours, LegendTags
legend = Legend(Colour=beamview_2.LegendColours, Tags=beamview_2.LegendTags, LegendType=1)
panel_26 = Panel(b_forces_2.BendingMomentMz_kNm)
model_7 = ModelKaramba3D(beamview_2.Model)

# ----
data_64 = Data(flatten(model_7))
num_94 = Number(num_93)
data_65 = Data(num_94)
item_15 = ListItem(List=data_64, Index=0, Wrap=True)
c_name_iterator_2 = CSharpScript(port=item_15, T=bool_5, R=data_41, P=txt_21)  # -> out, A; inputs T: Boolean, R: Boolean; same code as c_name_iterator
txt_22 = Text(c_name_iterator_2.A)
# Merge data
# CSV File Streamer
data_66 = Data(txt_22)
merge_18 = Merge(Data1=flatten(data_42), Data2=flatten(data_65), Data3=flatten(data_66))
data_67 = Data(flatten(merge_18))
c_vp_to_img_2 = CSharpScript(T=bool_5, P=txt_22)  # inputs T: Boolean, P: String; same code as c_vp_to_img
full_saved_image_path_2 = Panel(txt_22)
panel_27 = Panel(data_67)
data_68 = Data(data_67)
ghpython_script_2 = GhPythonScript(filepath=txt_18, head=txt_19, data=data_68, write=bool_6, reset=data_43)  # -> out, a; inputs head: list, data: list; same code as ghpython_script
